# Grasshopper definition physics_test11_blocks.gh (Grasshopper 1.0.8)
# plug-ins: Heteroptera, Pufferfish, Anemone, Kangaroo2 Components

# ---- group: 4.3 · О3
point = Point(<point referenced from the Rhino model>)
о3_n_рядов = Slider(2, range=0..30)
о3_значение = Slider(6.418, range=0.1..7)
geo = Geometry(flatten([Point(4.5, 0, 0.2), Point(5.4, 0, 0.42), Point(6.3, 0, 0.665), Point(7.2, 0, 0.9314285714), Point(8.1, 0, 1.216607143), Point(9, 0, 1.518452381), Point(9.9, 0, 1.835297619), Point(10.8, 0, 2.165779221), Point(11.7, 0, 2.508760823), Point(12.6, 0, 2.863280886), Point(13.5, 0, 3.228515235), Point(14.4, 0, 3.603749584), Point(15.3, 0, 3.988358933), Point(16.2, 0, 4.381791811), Point(17.1, 0, 4.783558023), Point(18, 0, 5.193218971), Point(18.9, 0, 5.61037992), Point(19.8, 0, 6.034683726), Point(20.7, 0, 6.465805713), Point(19.85, 0, 10.18206873), Point(20.7, 0, 10.77449988), Point(21.55, 0, 11.37309046), Point(22.4, 0, 11.97759751), Point(23.25, 0, 12.58779652), Point(24.1, 0, 13.2034794), Point(24.95, 0, 13.82445274)]))
point_2 = Point(<point referenced from the Rhino model>)
point_3 = Point(point)
cull_index = CullIndex(List=geo, Indices=8, Wrap=True)
cluster = Cluster_6(point_3=point_3, relay=point_2, relay_2=о3_значение, point=cull_index, count=о3_n_рядов)  # -> segments, geometry_3
list_item = ListItem(List=flatten(cluster.segments), Index=0, Wrap=True)
loft = Loft(
    Curves=cluster.geometry_3,
    Options={Adjust=False, Closed=False, LoftEnds=0, LoftSimp=0, LoftType=3, Rebuild=10, Refit=0.01})

# ---- group: 4.2 · О2
о2_n_рядов = Slider(8, range=0..30)
о2_значение = Slider(10.09, range=0.1..47)
geo_2 = Geometry(flatten([Point(4.5, 0, 0.2), Point(5.4, 0, 0.42), Point(6.3, 0, 0.665), Point(7.2, 0, 0.9314285714), Point(8.1, 0, 1.216607143), Point(9, 0, 1.518452381), Point(9.9, 0, 1.835297619), Point(10.8, 0, 2.165779221), Point(11.7, 0, 2.508760823), Point(12.6, 0, 2.863280886), Point(13.5, 0, 3.228515235), Point(14.4, 0, 3.603749584), Point(15.3, 0, 3.988358933), Point(16.2, 0, 4.381791811), Point(17.1, 0, 4.783558023), Point(18, 0, 5.193218971), Point(18.9, 0, 5.61037992), Point(19.8, 0, 6.034683726), Point(20.7, 0, 6.465805713), Point(19.85, 0, 10.18206873), Point(20.7, 0, 10.77449988), Point(21.55, 0, 11.37309046), Point(22.4, 0, 11.97759751), Point(23.25, 0, 12.58779652), Point(24.1, 0, 13.2034794), Point(24.95, 0, 13.82445274)]))
point_4 = Point(<point referenced from the Rhino model>)
point_5 = Point(point)
cull_index_2 = CullIndex(List=geo_2, Indices=8, Wrap=True)
cluster_2 = Cluster_6(point_3=point_5, relay=point_4, relay_2=о2_значение, point=cull_index_2, count=о2_n_рядов)  # -> segments, geometry_3
list_item_2 = ListItem(List=flatten(cluster_2.segments), Index=0, Wrap=True)
loft_2 = Loft(
    Curves=cluster_2.geometry_3,
    Options={Adjust=False, Closed=False, LoftEnds=0, LoftSimp=0, LoftType=3, Rebuild=10, Refit=0.01})

# ---- group: 4.4 · О4
о4_n_рядов = Slider(19, range=0..30)
о4_значение = Slider(6.27, range=0.1..17)
geo_3 = Geometry(flatten([Point(4.5, 0, 0.2), Point(5.4, 0, 0.42), Point(6.3, 0, 0.665), Point(7.2, 0, 0.9314285714), Point(8.1, 0, 1.216607143), Point(9, 0, 1.518452381), Point(9.9, 0, 1.835297619), Point(10.8, 0, 2.165779221), Point(11.7, 0, 2.508760823), Point(12.6, 0, 2.863280886), Point(13.5, 0, 3.228515235), Point(14.4, 0, 3.603749584), Point(15.3, 0, 3.988358933), Point(16.2, 0, 4.381791811), Point(17.1, 0, 4.783558023), Point(18, 0, 5.193218971), Point(18.9, 0, 5.61037992), Point(19.8, 0, 6.034683726), Point(20.7, 0, 6.465805713), Point(19.85, 0, 10.18206873), Point(20.7, 0, 10.77449988), Point(21.55, 0, 11.37309046), Point(22.4, 0, 11.97759751), Point(23.25, 0, 12.58779652), Point(24.1, 0, 13.2034794), Point(24.95, 0, 13.82445274)]))
point_6 = Point(point)
point_7 = Point(<point referenced from the Rhino model>)
cull_index_3 = CullIndex(List=geo_3, Indices=-1, Wrap=True)
cluster_3 = Cluster_6(point_3=point_6, relay=point_7, relay_2=о4_значение, point=cull_index_3, count=о4_n_рядов)  # -> segments, geometry_3
list_item_3 = ListItem(List=flatten(cluster_3.segments), Index=0, Wrap=True)
loft_3 = Loft(
    Curves=cluster_3.geometry_3,
    Options={Adjust=False, Closed=False, LoftEnds=0, LoftSimp=0, LoftType=3, Rebuild=10, Refit=0.01})

# ---- group: 4.5 · О5
о5_n_рядов = Slider(19, range=0..30)
о5_значение = Slider(6.805, range=0.1..19)
geo_4 = Geometry(flatten([Point(4.5, 0, 0.2), Point(5.4, 0, 0.42), Point(6.3, 0, 0.665), Point(7.2, 0, 0.9314285714), Point(8.1, 0, 1.216607143), Point(9, 0, 1.518452381), Point(9.9, 0, 1.835297619), Point(10.8, 0, 2.165779221), Point(11.7, 0, 2.508760823), Point(12.6, 0, 2.863280886), Point(13.5, 0, 3.228515235), Point(14.4, 0, 3.603749584), Point(15.3, 0, 3.988358933), Point(16.2, 0, 4.381791811), Point(17.1, 0, 4.783558023), Point(18, 0, 5.193218971), Point(18.9, 0, 5.61037992), Point(19.8, 0, 6.034683726), Point(20.7, 0, 6.465805713), Point(19.85, 0, 10.18206873), Point(20.7, 0, 10.77449988), Point(21.55, 0, 11.37309046), Point(22.4, 0, 11.97759751), Point(23.25, 0, 12.58779652), Point(24.1, 0, 13.2034794), Point(24.95, 0, 13.82445274)]))
point_8 = Point(point)
point_9 = Point(<point referenced from the Rhino model>)
cull_index_4 = CullIndex(List=geo_4, Indices=-1, Wrap=True)
cluster_4 = Cluster_6(point_3=point_8, relay=point_9, relay_2=о5_значение, point=cull_index_4, count=о5_n_рядов)  # -> segments, geometry_3
list_item_4 = ListItem(List=flatten(cluster_4.segments), Index=0, Wrap=True)
loft_4 = Loft(
    Curves=cluster_4.geometry_3,
    Options={Adjust=False, Closed=False, LoftEnds=0, LoftSimp=0, LoftType=3, Rebuild=10, Refit=0.01})

# ---- group: 4.6 · О6 · нижняя грань балкона
о6_n_рядов = Slider(19, range=0..30)
о6_старт = Slider(21, range=0..30)
о6_значение = Slider(7.26, range=0.1..19)
geo_5 = Geometry(flatten([Point(4.5, 0, 0.2), Point(5.4, 0, 0.42), Point(6.3, 0, 0.665), Point(7.2, 0, 0.9314285714), Point(8.1, 0, 1.216607143), Point(9, 0, 1.518452381), Point(9.9, 0, 1.835297619), Point(10.8, 0, 2.165779221), Point(11.7, 0, 2.508760823), Point(12.6, 0, 2.863280886), Point(13.5, 0, 3.228515235), Point(14.4, 0, 3.603749584), Point(15.3, 0, 3.988358933), Point(16.2, 0, 4.381791811), Point(17.1, 0, 4.783558023), Point(18, 0, 5.193218971), Point(18.9, 0, 5.61037992), Point(19.8, 0, 6.034683726), Point(20.7, 0, 6.465805713), Point(19.85, 0, 10.18206873), Point(20.7, 0, 10.77449988), Point(21.55, 0, 11.37309046), Point(22.4, 0, 11.97759751), Point(23.25, 0, 12.58779652), Point(24.1, 0, 13.2034794), Point(24.95, 0, 13.82445274)]))
point_10 = Point(<point referenced from the Rhino model>)
point_11 = Point(point)
cluster_5 = Cluster_8(point_3=point_11, relay=point_10, relay_2=о6_значение, point=geo_5, start=о6_n_рядов, count=о6_старт)  # -> segments, geometry_3
loft_5 = Loft(
    Curves=cluster_5.geometry_3,
    Options={Adjust=False, Closed=False, LoftEnds=0, LoftSimp=0, LoftType=3, Rebuild=10, Refit=0.01})
list_item_5 = ListItem(List=flatten(cluster_5.segments), Index=0, Wrap=True)

# ---- group: 4.x · вариант отражателя (не идёт в вывод)
вар_n_рядов = Slider(0, range=0..30)
вар_значение = Slider(5.78, range=0.1..17)
geo_6 = Geometry(flatten([Point(4.5, 0, 0.2), Point(5.4, 0, 0.42), Point(6.3, 0, 0.665), Point(7.2, 0, 0.9314285714), Point(8.1, 0, 1.216607143), Point(9, 0, 1.518452381), Point(9.9, 0, 1.835297619), Point(10.8, 0, 2.165779221), Point(11.7, 0, 2.508760823), Point(12.6, 0, 2.863280886), Point(13.5, 0, 3.228515235), Point(14.4, 0, 3.603749584), Point(15.3, 0, 3.988358933), Point(16.2, 0, 4.381791811), Point(17.1, 0, 4.783558023), Point(18, 0, 5.193218971), Point(18.9, 0, 5.61037992), Point(19.8, 0, 6.034683726), Point(20.7, 0, 6.465805713), Point(19.85, 0, 10.18206873), Point(20.7, 0, 10.77449988), Point(21.55, 0, 11.37309046), Point(22.4, 0, 11.97759751), Point(23.25, 0, 12.58779652), Point(24.1, 0, 13.2034794), Point(24.95, 0, 13.82445274)]))
point_12 = Point(point)
point_13 = Point(<point referenced from the Rhino model>)
cull_index_5 = CullIndex(List=geo_6, Indices=-1, Wrap=True)
cluster_6 = Cluster_6(point_3=point_12, relay=point_13, relay_2=вар_значение, point=cull_index_5, count=вар_n_рядов)  # -> segments, geometry_3; disabled
list_item_6 = ListItem(List=flatten(cluster_6.segments), Index=0, Wrap=True)
loft_6 = Loft(
    Curves=cluster_6.geometry_3,
    Options={Adjust=False, Closed=False, LoftEnds=0, LoftSimp=0, LoftType=3, Rebuild=10, Refit=0.01})

вар_значение_2 = Slider(0, range=0..30)
вар_n_рядов_2 = Slider(5.127, range=0.1..7)
geo_7 = Geometry(flatten([Point(4.5, 0, 0.2), Point(5.4, 0, 0.42), Point(6.3, 0, 0.665), Point(7.2, 0, 0.9314285714), Point(8.1, 0, 1.216607143), Point(9, 0, 1.518452381), Point(9.9, 0, 1.835297619), Point(10.8, 0, 2.165779221), Point(11.7, 0, 2.508760823), Point(12.6, 0, 2.863280886), Point(13.5, 0, 3.228515235), Point(14.4, 0, 3.603749584), Point(15.3, 0, 3.988358933), Point(16.2, 0, 4.381791811), Point(17.1, 0, 4.783558023), Point(18, 0, 5.193218971), Point(18.9, 0, 5.61037992), Point(19.8, 0, 6.034683726), Point(20.7, 0, 6.465805713), Point(19.85, 0, 10.18206873), Point(20.7, 0, 10.77449988), Point(21.55, 0, 11.37309046), Point(22.4, 0, 11.97759751), Point(23.25, 0, 12.58779652), Point(24.1, 0, 13.2034794), Point(24.95, 0, 13.82445274)]))
point_14 = Point(point)
point_15 = Point(<point referenced from the Rhino model>)
cluster_7 = Cluster_7(point_3=point_14, relay=point_15, relay_2=вар_n_рядов_2, point=geo_7, count=вар_значение_2)  # -> segments, geometry_3; disabled
list_item_7 = ListItem(List=flatten(cluster_7.segments), Index=0, Wrap=True)
loft_7 = Loft(
    Curves=cluster_7.geometry_3,
    Options={Adjust=False, Closed=False, LoftEnds=0, LoftSimp=0, LoftType=3, Rebuild=10, Refit=0.01})

# ---- group: 4.1 · О1 · потолок над сценой
о1_значение = Slider(20.102, range=0.1..57)
geo_8 = Geometry(flatten([Point(4.5, 0, 0.2), Point(5.4, 0, 0.42), Point(6.3, 0, 0.665), Point(7.2, 0, 0.9314285714), Point(8.1, 0, 1.216607143), Point(9, 0, 1.518452381), Point(9.9, 0, 1.835297619), Point(10.8, 0, 2.165779221), Point(11.7, 0, 2.508760823), Point(12.6, 0, 2.863280886), Point(13.5, 0, 3.228515235), Point(14.4, 0, 3.603749584), Point(15.3, 0, 3.988358933), Point(16.2, 0, 4.381791811), Point(17.1, 0, 4.783558023), Point(18, 0, 5.193218971), Point(18.9, 0, 5.61037992), Point(19.8, 0, 6.034683726), Point(20.7, 0, 6.465805713), Point(19.85, 0, 10.18206873), Point(20.7, 0, 10.77449988), Point(21.55, 0, 11.37309046), Point(22.4, 0, 11.97759751), Point(23.25, 0, 12.58779652), Point(24.1, 0, 13.2034794), Point(24.95, 0, 13.82445274)]))
point_16 = Point(point)
point_17 = Point(<point referenced from the Rhino model>)
cull_index_6 = CullIndex(List=geo_8, Indices=8, Wrap=True)
cluster_8 = Cluster_7(point_3=point_16, relay=point_17, relay_2=о1_значение, point=cull_index_6, count=вар_значение_2)  # -> segments, geometry_3
list_item_8 = ListItem(List=flatten(cluster_8.segments), Index=0, Wrap=True)
loft_8 = Loft(
    Curves=cluster_8.geometry_3,
    Options={Adjust=False, Closed=False, LoftEnds=0, LoftSimp=0, LoftType=3, Rebuild=10, Refit=0.01})

# ---- group: 1 · ИСТОЧНИК: точка звука и опорные линии
construct_point = ConstructPoint(XCoordinate=0, YCoordinate=0, ZCoordinate=0)
unit_x = UnitX(Factor=1)
line_sdl = LineSDL(Start=construct_point, Direction=unit_x, Length="1.5")
unit_z = UnitZ(Factor=1)
reverse = Reverse(Vector=unit_z)
end_points = EndPoints(Curve=line_sdl)  # -> Start, End
unit_x_2 = UnitX(Factor=1)
line_sdl_2 = LineSDL(Start=end_points.End, Direction=reverse, Length="1")
end_points_2 = EndPoints(Curve=line_sdl_2)  # -> Start, End
line_sdl_3 = LineSDL(Start=end_points_2.End, Direction=unit_x_2, Length="3")

# ---- group: 6 · ЗАЛ: профиль рядов, план мест, линии видимости
number_slider = Slider(-19, range=-40..10)
z_coordinate = ZCoordinate(-40)
z_coordinate_2 = ZCoordinate(-43)
z_coordinate_3 = ZCoordinate(-41.2)
subtraction = Subtraction(A=z_coordinate, B=number_slider)
subtraction_2 = Subtraction(A=z_coordinate_2, B=number_slider)
subtraction_3 = Subtraction(A=z_coordinate_3, B=number_slider)
construct_point_2 = ConstructPoint(XCoordinate=0, YCoordinate=0, ZCoordinate=subtraction_2)
construct_point_3 = ConstructPoint(XCoordinate=0, YCoordinate=0, ZCoordinate=subtraction_3)
construct_point_4 = ConstructPoint(XCoordinate=0, YCoordinate=0, ZCoordinate=subtraction)
unit_z_2 = UnitZ(Factor=1)
unit_z_3 = UnitZ(Factor=1)
unit_z_4 = UnitZ(Factor=1)
point_18 = Point(construct_point_2)
point_19 = Point(construct_point_3)
point_20 = Point(construct_point_4)
geometry = Geometry([<curve referenced from the Rhino model> x7])
geometry_2 = Geometry([<curve referenced from the Rhino model> x17])
geometry_3 = Geometry(<curve referenced from the Rhino model>)
line_sdl_4 = LineSDL(Start=point_18, Direction=unit_z_3, Length="18")
line_sdl_5 = LineSDL(Start=point_19, Direction=unit_z_4, Length="14.4")
line_sdl_6 = LineSDL(Start=point_20, Direction=unit_z_2, Length="12")
center = Center(Geometric=line_sdl_6)  # -> Center, Dimension
degrees = Degrees(11)
explode = Explode(Curve=[geometry_2, geometry_3], Recursive=True)  # -> Segments, Vertices
unit_x_3 = UnitX(Factor=1)
explode_2 = Explode(Curve=geometry, Recursive=True)  # -> Segments, Vertices
xz_plane = XZPlane(Origin=Point(0, 0, 0))
end_points_3 = EndPoints(Curve=line_sdl_4)  # -> Start, End
degrees_2 = Degrees(degrees)
end_points_4 = EndPoints(Curve=line_sdl_5)  # -> Start, End
removeduplicatepts = RemoveDuplicatePts(Points=flatten(explode.Vertices), Tolerance=0.01)
removeduplicatepts_2 = RemoveDuplicatePts(Points=flatten(explode_2.Vertices), Tolerance=0.01)
line_sdl_7 = LineSDL(Start=center.Center, Direction=unit_x_3, Length=100)
end_points_5 = EndPoints(Curve=line_sdl_6)  # -> Start, End
negative = Negative(Value=degrees)
negative_2 = Negative(Value=degrees_2)
negative_3 = Negative(Value="0.6")
unit_y = UnitY(Factor=1)
radians = Radians(Degrees=negative)
unit_y_2 = UnitY(Factor=1)
unit_x_4 = UnitX(Factor=1)
unit_y_3 = UnitY(Factor=1)
radians_2 = Radians(Degrees=degrees)
radians_3 = Radians(Degrees=negative_2)
unit_x_5 = UnitX(Factor=1)
unit_y_4 = UnitY(Factor=1)
unit_x_6 = UnitX(Factor=1)
radians_4 = Radians(Degrees=degrees_2)
unit_x_7 = UnitX(Factor=1)
unit_y_5 = UnitY(Factor=1)
radians_5 = Radians(Degrees=-15)
unit_y_6 = UnitY(Factor=1)
unit_x_8 = UnitX(Factor=1)
radians_6 = Radians(Degrees=15)
unit_x_9 = UnitX(Factor=1)
offset_curve = OffsetCurve(Curve=line_sdl_7, Plane=xz_plane, Distance="0.6", BothSides=negative_3, Kinks=0, CapType=1)
rotate = Rotate(Vector=unit_x_5, Axis=unit_y_2, Angle=radians_2)
rotate_2 = Rotate(Vector=unit_x_4, Axis=unit_y, Angle=radians)
rotate_3 = Rotate(Vector=unit_x_7, Axis=unit_y_4, Angle=radians_4)
rotate_4 = Rotate(Vector=unit_x_6, Axis=unit_y_3, Angle=radians_3)
rotate_5 = Rotate(Vector=unit_x_8, Axis=unit_y_5, Angle=radians_5)
rotate_6 = Rotate(Vector=unit_x_9, Axis=unit_y_6, Angle=radians_6)
line_sdl_8 = LineSDL(Start=end_points_3.End, Direction=rotate_2, Length="40")
line_sdl_9 = LineSDL(Start=end_points_3.Start, Direction=rotate, Length="40")
line_sdl_10 = LineSDL(Start=end_points_5.End, Direction=rotate_5, Length="40")
line_sdl_11 = LineSDL(Start=end_points_5.Start, Direction=rotate_6, Length="40")
line_sdl_12 = LineSDL(Start=end_points_4.Start, Direction=rotate_3, Length="40")
line_sdl_13 = LineSDL(Start=end_points_4.End, Direction=rotate_4, Length="40")
unit_y_7 = UnitY(Factor=1)
end_points_6 = EndPoints(Curve=line_sdl_11)  # -> Start, End
end_points_7 = EndPoints(Curve=line_sdl_10)  # -> Start, End
geometry_4 = Geometry(<curve referenced from the Rhino model>)
line_line = LineLine(Line1=line_sdl_11, Line2=line_sdl_10)  # -> ParamA, ParamB, PointA, PointB
line_line_2 = LineLine(Line1=line_sdl_12, Line2=line_sdl_13)  # -> ParamA, ParamB, PointA, PointB
vector_2pt = Vector2Pt(PointA=line_line_2.PointA, PointB=removeduplicatepts, Unitize=False)  # -> Vector, Length
vector_2pt_2 = Vector2Pt(PointA=line_line_2.PointA, PointB=removeduplicatepts_2, Unitize=False)  # -> Vector, Length
deconstruct_vector = DeconstructVector(Vector=vector_2pt.Vector)  # -> XComponent, YComponent, ZComponent
deconstruct_vector_2 = DeconstructVector(Vector=vector_2pt_2.Vector)  # -> XComponent, YComponent, ZComponent
min_max = MinMax(Number=deconstruct_vector_2.XComponent)  # -> Minimum, Maximum
smaller_than = SmallerThan(FirstNumber=deconstruct_vector.XComponent, SecondNumber=min_max.Minimum)  # -> SmallerThan, OrEqualTo
cull_pattern = CullPattern(List=deconstruct_vector.XComponent, CullPattern=smaller_than.SmallerThan)
explode_3 = Explode(Curve=geometry_4, Recursive=True)  # -> Segments, Vertices
relay = Relay([cull_pattern, deconstruct_vector_2.XComponent])
polyline = PolyLine(Vertices=[end_points_6.Start, line_line.PointA, end_points_7.Start], Closed=False)
ruled_surface = RuledSurface(CurveA=line_sdl_11, CurveB=line_sdl_10)
ruled_surface_2 = RuledSurface(CurveA=line_sdl_12, CurveB=line_sdl_13)
sort_list = SortList(Keys=relay)  # -> Keys, ValuesValuesA
removeduplicatepts_3 = RemoveDuplicatePts(Points=flatten(explode_3.Vertices), Tolerance=0.01)
delete_consecutive = DeleteConsecutive(Set=sort_list.Keys, Wrap=False)  # -> Set, Count
circle_cnr = CircleCNR(Center=line_line_2.PointA, Normal=unit_y_7, Radius=delete_consecutive.Set)
min_max_2 = MinMax(Number=delete_consecutive.Set)  # -> Minimum, Maximum
region_intersection = RegionIntersection(CurvesA=ruled_surface, CurvesB=ruled_surface_2)
vector_2pt_3 = Vector2Pt(PointA=line_line_2.PointA, PointB=removeduplicatepts_3, Unitize=False)  # -> Vector, Length
subtraction_4 = Subtraction(A=min_max_2.Minimum, B=3)
region_difference = RegionDifference(CurvesA=region_intersection, CurvesB=offset_curve)
deconstruct_vector_3 = DeconstructVector(Vector=vector_2pt_3.Vector)  # -> XComponent, YComponent, ZComponent
surface_curve = SurfaceCurve(Surface=graft(region_intersection), Curve=circle_cnr)  # -> Curves, Points, UVPoints, Normals, Parameters, Tangents
circle_cnr_2 = CircleCNR(Center=line_line_2.PointA, Normal=unit_y_7, Radius=min_max_2.Maximum)
boundary_surfaces = BoundarySurfaces(Edges=region_difference)
surface_curve_2 = SurfaceCurve(Surface=graft(boundary_surfaces), Curve=circle_cnr)  # -> Curves, Points, UVPoints, Normals, Parameters, Tangents
point_21 = Point(line_line_2.PointA)
panel = Panel("""19
20
46
47""")
min_max_3 = MinMax(Number=deconstruct_vector_3.XComponent)  # -> Minimum, Maximum
loft_9 = Loft(Curves=circle_cnr_2, Options={Adjust=False, Closed=False, LoftEnds=0, LoftSimp=0, LoftType=0, Rebuild=10, Refit=0.01})
boundary_surfaces_2 = BoundarySurfaces(Edges=circle_cnr_2)
circle_cnr_3 = CircleCNR(Center=line_line_2.PointA, Normal=unit_y_7, Radius=min_max.Minimum)
list_item_9 = ListItem(List=flatten(surface_curve_2.Curves), Index=panel, Wrap=True)
panel_2 = Panel("""0
9
25
26
27
36
52
53
17
44""")
panel_3 = Panel("""0
27""")
circle_cnr_4 = CircleCNR(Center=line_line_2.PointA, Normal=unit_y_7, Radius=min_max_3.Maximum)
cull_index_7 = CullIndex(List=flatten(surface_curve_2.Curves), Indices=panel_2, Wrap=True)
region_intersection_2 = RegionIntersection(CurvesA=region_difference, CurvesB=boundary_surfaces_2)
list_item_10 = ListItem(List=flatten(surface_curve.Curves), Index=panel_3, Wrap=True)
merge = Merge(Data1=flatten(cull_index_7), Data2=flatten(list_item_9))
divide_distance = DivideDistance(Curve=merge, Distance=0.5)  # -> Points, Tangents, Parameters
list_length = ListLength(List=divide_distance.Points)  # -> simplify(Length)
boundary_surfaces_3 = BoundarySurfaces(Edges=region_intersection_2)
surface_split = SurfaceSplit(Surface=boundary_surfaces_3, Curves=circle_cnr_3)
surface_split_2 = SurfaceSplit(Surface=boundary_surfaces_3, Curves=circle_cnr_4)
subtraction_5 = Subtraction(A=list_length, B=1)
list_item_11 = ListItem(List=surface_split, Index=0, Wrap=True)
list_item_12 = ListItem(List=surface_split_2, Index=1, Wrap=True)
divide_curve = DivideCurve(Curve=simplify(graft(merge)), Count=subtraction_5, Kinks=False)  # -> Points, Tangents, Parameters
create_material = CreateMaterial(
    Diffuse=ColourSwatch(SwatchColor=RGB(0, 0, 0)),
    Specular=RGB(255, 255, 255),
    Emission=RGB(0, 0, 0),
    Transparency=0.6,
    Shine=0)
vector_2pt_4 = Vector2Pt(PointA=divide_curve.Points, PointB=line_line_2.PointA, Unitize=False)  # -> Vector, Length
panel_4 = Panel(vector_2pt_4.Length)
length = Length("0.4")
custom_preview = CustomPreview(Geometry=graft(list_item_10), Material=graft(create_material))
line_sdl_14 = LineSDL(Start=divide_curve.Points, Direction=vector_2pt_4.Vector, Length=length)
list_length_2 = ListLength(List=flatten(merge))
subtraction_6 = Subtraction(A=panel_4, B=length)
sort_list_2 = SortList(Keys=flatten(subtraction_6))  # -> Keys, ValuesValuesA
list_length_3 = ListLength(List=flatten(line_sdl_14))
multiplication = Multiplication(A=list_length_2, B=2)
delete_consecutive_2 = DeleteConsecutive(Set=flatten(sort_list_2.Keys), Wrap=False)  # -> Set, Count
subtraction_7 = Subtraction(A=list_length_3, B=multiplication)
circle_cnr_5 = CircleCNR(Center=line_line_2.PointA, Normal=unit_y_7, Radius=delete_consecutive_2.Set)
panel_5 = Panel(subtraction_7)
surface_curve_3 = SurfaceCurve(Surface=graft(boundary_surfaces), Curve=flatten(circle_cnr_5))  # -> Curves, Points, UVPoints, Normals, Parameters, Tangents
custom_preview_2 = CustomPreview(Geometry=[surface_curve_3.Curves, line_sdl_14, merge], Material=ColourSwatch(SwatchColor=RGB(0, 0, 0)))

# ---- group: 5 · ВИЗУАЛИЗАЦИЯ: веера, цвета, превью
relay_2 = Relay([loft_5, loft_4, loft_3, loft, loft_6, loft_2, loft_7, loft_8])
offset_curve_2 = OffsetCurve(
    Curve=[list_item, list_item_6, list_item_3, list_item_2, list_item_7, list_item_8, list_item_4, list_item_5],
    Plane=PlaneXZ(0, 0, 0),
    Distance=0.01,
    BothSides=-0.1,
    Kinks=0,
    CapType=1)
list_length_4 = ListLength(List=relay_2)
deconstruct_brep = DeconstructBrep(Brep=relay_2)  # -> Faces, Edges, Vertices
subtraction_8 = Subtraction(A=list_length_4, B=1)
boundary_surfaces_4 = BoundarySurfaces(Edges=offset_curve_2)
range = Range(Domain=Domain(0, 1), Steps=subtraction_8)
brep_join = BrepJoin(Breps=deconstruct_brep.Faces)  # -> Breps, Closed
gradient = Gradient(
    LowerLimit=0,
    UpperLimit=1,
    Parameter=range,
    stops=[0: RGB(243, 57, 0), 0.0451: RGB(236, 27, 60), 0.11: RGB(210, 0, 118), 0.217: RGB(103, 0, 120), 0.398: RGB(39, 72, 161), 0.499: RGB(1, 192, 229), 0.585: RGB(18, 178, 90), 0.656: RGB(79, 186, 8), 0.76: RGB(220, 237, 32), 0.855: RGB(247, 159, 20), 1: RGB(243, 57, 0)])
entwine = Entwine(
    Branch00=cluster_5.geometry_3,
    Branch01=cluster_4.geometry_3,
    Branch02=cluster_3.geometry_3,
    Branch03=cluster.geometry_3,
    Branch04=cluster_2.geometry_3,
    Branch05=cluster_8.geometry_3,
    FlattenInputs=True)
custom_preview_3 = CustomPreview(Geometry=boundary_surfaces_4, Material=ColourSwatch(SwatchColor=RGB(0, 0, 0)))
create_material_2 = CreateMaterial(Diffuse=gradient, Specular=RGB(255, 255, 255), Emission=RGB(0, 0, 0), Transparency=0.6, Shine=0)
custom_preview_4 = CustomPreview(Geometry=graft(relay_2), Material=graft(create_material_2))
custom_preview_5 = CustomPreview(Geometry=entwine, Material=graft(create_material_2))

# ---- group: ТЕСТ: ранний вариант отражателя
point_22 = Point([<point referenced from the Rhino model> x27])
point_23 = Point(<point referenced from the Rhino model>)
point_24 = Point(<point referenced from the Rhino model>)
cluster_9 = Cluster_2(relay_3=point_24, relay=point_22, relay_2=point_23, relay_4=Slider(4.598, range=0.1..7))  # -> relay_6, relay_5, relay_7
polyline_2 = PolyLine(Vertices=cluster_9.relay_7, Closed=False)

# ---- group: НЕ ПОДКЛЮЧЕНО
angle = Angle()  # -> Angle, Reflex
geo_9 = Geometry(flatten([Point(4.5, 0, 0.2), Point(5.4, 0, 0.42), Point(6.3, 0, 0.665), Point(7.2, 0, 0.9314285714), Point(8.1, 0, 1.216607143), Point(9, 0, 1.518452381), Point(9.9, 0, 1.835297619), Point(10.8, 0, 2.165779221), Point(11.7, 0, 2.508760823), Point(12.6, 0, 2.863280886), Point(13.5, 0, 3.228515235), Point(14.4, 0, 3.603749584), Point(15.3, 0, 3.988358933), Point(16.2, 0, 4.381791811), Point(17.1, 0, 4.783558023), Point(18, 0, 5.193218971), Point(18.9, 0, 5.61037992), Point(19.8, 0, 6.034683726), Point(20.7, 0, 6.465805713), Point(19.85, 0, 10.18206873), Point(20.7, 0, 10.77449988), Point(21.55, 0, 11.37309046), Point(22.4, 0, 11.97759751), Point(23.25, 0, 12.58779652), Point(24.1, 0, 13.2034794), Point(24.95, 0, 13.82445274)]))
geometry_5 = Geometry([<curve referenced from the Rhino model> x48])
geometry_6 = Geometry([<curve referenced from the Rhino model> x17])
geometry_7 = Geometry(<curve referenced from the Rhino model>)
list_item_13 = ListItem(Index=0, Wrap=True)
number_slider_2 = Slider(45, range=0..100)
panel_6 = Panel("0")
point_25 = Point(Point(14.3, 0, 1.856438674))
point_26 = Point(Point(14.3, 0, 1.856438674))

# ---- group: 2 · ЛУЧИ К РЯДАМ ПАРТЕРА (Anemone)
button = Button()
panel_8 = Panel("""8
8""")
end_points_8 = EndPoints(Curve=line_sdl_3)  # -> Start, End
list_length_5 = ListLength(List=panel_8)
subtraction_9 = Subtraction(A=list_length_5, B=1)
point_27 = Point(end_points_8.End)
factor = Factor(1.2)
loop_start = LoopStart(Repeat=subtraction_9, Trigger=button, Data=point_27)  # -> port, Counter, Data
list_item_14 = ListItem(List=panel_8, Index=loop_start.Counter, Wrap=True)
point_28 = Point(<point referenced from the Rhino model>)
pdecon = Deconstruct(Point=point_28)  # -> XComponent, YComponent, ZComponent
loop_start_2 = LoopStart(Repeat=list_item_14, Trigger=button, Data=loop_start.Data)  # -> port, Counter, Data
list_item_15 = ListItem(List=loop_start_2.Data, Index=-1, Wrap=True)
cluster_10 = Cluster_3(point=point_28, relay=list_item_15, factor=factor, factor_2="0.9")
loop_end = LoopEnd(port=loop_start_2.port, Exit=False, Data=cluster_10, TimeOutVal=0, pausedState=False, state="Last & Record")  # -> flatten(Data)
list_item_16 = ListItem(List=loop_end, Index=-1, Wrap=True)
loop_end_2 = LoopEnd(port=loop_start.port, Exit=False, Data=loop_end, TimeOutVal=0, pausedState=False, state="Last & Record")  # -> flatten(Data)
merge_2 = Merge(Data1=flatten(point_27), Data2=loop_end_2)
unit_z_5 = UnitZ(Factor=1.2)
sort_points = SortPoints(Points=merge_2)  # -> Points, Indices
move = Move(Geometry=sort_points.Points, Motion=unit_z_5)  # -> Geometry, Transform
cull_index_8 = CullIndex(List=sort_points.Points, Indices=-1, Wrap=True)
shift_list = ShiftList(List=sort_points.Points, Shift=1, Wrap=False)
line = Line(StartPoint=cull_index_8, EndPoint=shift_list)
line_2 = Line(StartPoint=point_28, EndPoint=move.Geometry)
sphere = Sphere(Base=move.Geometry, Radius=0.1)
cluster_11 = Cluster(line=line)
geo_10 = Geometry(merge_2)
number_slider_3 = Slider(8, range=0..100)
line_3 = Line(StartPoint=point, EndPoint=move.Geometry)
colour_swatch = ColourSwatch(SwatchColor=RGB(0, 0, 0))

# ---- group: 3 · ЛУЧИ К РЯДАМ БАЛКОНА (Anemone)
button_2 = Button()
end_points_9 = EndPoints(Curve=line_sdl_3)  # -> Start, End
point_29 = Point(<point referenced from the Rhino model>)
list_length_6 = ListLength(List="4")
point_30 = Point(point_29)
subtraction_10 = Subtraction(A=list_length_6, B=1)
factor_2 = Factor(1.2)
loop_start_3 = LoopStart(Repeat=subtraction_10, Trigger=button_2, Data=point_30)  # -> port, Counter, Data
list_item_17 = ListItem(List="4", Index=loop_start_3.Counter, Wrap=True)
point_31 = Point(<point referenced from the Rhino model>)
pdecon_2 = Deconstruct(Point=point_31)  # -> XComponent, YComponent, ZComponent
loop_start_4 = LoopStart(Repeat=list_item_17, Trigger=button_2, Data=loop_start_3.Data)  # -> port, Counter, Data
list_item_18 = ListItem(List=loop_start_4.Data, Index=-1, Wrap=True)
cluster_12 = Cluster_3(point=point_31, relay=list_item_18, factor=factor_2, factor_2="0.85")
loop_end_3 = LoopEnd(port=loop_start_4.port, Exit=False, Data=cluster_12, TimeOutVal=0, pausedState=False, state="Last & Record")  # -> flatten(Data)
list_item_19 = ListItem(List=loop_end_3, Index=-1, Wrap=True)
loop_end_4 = LoopEnd(port=loop_start_3.port, Exit=False, Data=loop_end_3, TimeOutVal=0, pausedState=False, state="Last & Record")  # -> flatten(Data)
merge_3 = Merge(Data1=flatten(point_30), Data2=loop_end_4)
unit_z_6 = UnitZ(Factor=1.2)
sort_points_2 = SortPoints(Points=merge_3)  # -> Points, Indices
move_2 = Move(Geometry=sort_points_2.Points, Motion=unit_z_6)  # -> Geometry, Transform
cull_index_9 = CullIndex(List=sort_points_2.Points, Indices=-1, Wrap=True)
shift_list_2 = ShiftList(List=sort_points_2.Points, Shift=1, Wrap=False)
line_4 = Line(StartPoint=cull_index_9, EndPoint=shift_list_2)
sphere_2 = Sphere(Base=move_2.Geometry, Radius=0.1)
line_5 = Line(StartPoint=point_31, EndPoint=move_2.Geometry)
cluster_13 = Cluster(line=line_4)
geo_11 = Geometry(merge_3)
geo_12 = Geometry(flatten([move_2.Geometry, move.Geometry]))
deconstruct = Deconstruct(Point=geo_12)  # -> XComponent, YComponent, ZComponent
geo_13 = Geometry(flatten([cluster_13, cluster_11]))
sort_list_3 = SortList(Keys=deconstruct.ZComponent, ValuesValuesA=geo_12)  # -> Keys, ValuesValuesA

# ---- group: 2 · ЛУЧИ К РЯДАМ ПАРТЕРА (Anemone) (continued)
line_6 = Line(StartPoint=point, EndPoint=move_2.Geometry)
geo_14 = Geometry(flatten([sphere_2, sphere]))
relay_3 = Relay([line_2, line_5])
cull_index_10 = CullIndex(List=relay_3, Indices=number_slider_3, Wrap=True)
cull_index_11 = CullIndex(List=[line_3, line_6], Indices=number_slider_3, Wrap=True)
cull_index_12 = CullIndex(List=geo_14, Indices=Slider(14, range=0..100), Wrap=True)
custom_preview_6 = CustomPreview(Geometry=cull_index_11, Material=colour_swatch)
custom_preview_7 = CustomPreview(Geometry=cull_index_10, Material=ColourSwatch(SwatchColor=RGB(255, 255, 255)))
custom_preview_8 = CustomPreview(Geometry=cull_index_12, Material=colour_swatch)

# ==== cluster Cluster
line = ClusterInput()
line_2 = Line(line)
end_points = EndPoints(Curve=line_2)  # -> Start, End
vector_2pt = Vector2Pt(PointA=end_points.Start, PointB=end_points.End, Unitize=False)  # -> Vector, Length
deconstruct_vector = DeconstructVector(Vector=vector_2pt.Vector)  # -> XComponent, YComponent, ZComponent
vector_xyz = VectorXYZ(XComponent=deconstruct_vector.XComponent, YComponent=0, ZComponent=0)  # -> Vector, Length
vector_xyz_2 = VectorXYZ(XComponent=0, YComponent=0, ZComponent=deconstruct_vector.ZComponent)  # -> Vector, Length
move = Move(Geometry=end_points.Start, Motion=vector_xyz_2.Vector)  # -> Geometry, Transform
entwine = Entwine(Branch00=end_points.Start, Branch01=move.Geometry, Branch02=end_points.End, FlattenInputs=True)
flip_matrix = FlipMatrix(Data=entwine)
polyline = PolyLine(Vertices=flip_matrix, Closed=False)
polyline_2 = ClusterOutput(polyline)

# ==== cluster Cluster_2
relay = ClusterInput()
relay_2 = ClusterInput()
relay_3 = ClusterInput()
relay_4 = ClusterInput()
xz_plane = XZPlane(Origin=Point(0, 0, 0))
sphere = Sphere(Base=relay_2, Radius=relay_4)
line = Line(StartPoint=relay, EndPoint=relay_2)
line_2 = Line(StartPoint=relay_3, EndPoint=relay_2)
length = Length(Curve=line)
length_2 = Length(Curve=line_2)
brep_plane = BrepPlane(Brep=sphere, Plane=xz_plane)  # -> Curves, Points
brep_line = BrepLine(Brep=sphere, Line=line, LimitToFirst=False)  # -> Curves, Points
brep_line_2 = BrepLine(Brep=sphere, Line=line_2, LimitToFirst=False)  # -> Curves, Points
subtraction = Subtraction(A=length, B=relay_4)
subtraction_2 = Subtraction(A=length_2, B=relay_4)
list_item = ListItem(List=brep_line.Points, Index=0, Wrap=True)
list_item_2 = ListItem(List=brep_line_2.Points, Index=0, Wrap=True)
addition = Addition(A=subtraction, B=subtraction_2)
curve_closest_point = CurveClosestPoint(Point=list_item, Curve=brep_plane.Curves)  # -> Point, simplify(Parameter), Distance
curve_closest_point_2 = CurveClosestPoint(Point=list_item_2, Curve=brep_plane.Curves)  # -> Point, Parameter, Distance
list_length = ListLength(List=flatten(curve_closest_point.Parameter))
repeat_data = RepeatData(Data=curve_closest_point_2.Parameter, Length=list_length)  # -> simplify(graft(Data))
division = Division(A=subtraction, B=addition)
division_2 = Division(A=subtraction_2, B=addition)
shatter = Shatter(Curve=brep_plane.Curves, Parameters=[curve_closest_point.Parameter, repeat_data])
graph_mapper = GraphMapper(division_2, x0=0, x1=1, y0=0, y1=1, container_name="Sigmoid-Logits", e=0.4413514137, t0=-100, t1=100)
graph_mapper_2 = GraphMapper(division_2, x0=0, x1=1, y0=0, y1=1, container_name="Bezier", cpx=[0, 0, 1, 1], cpy=[0, 0.3534784913, 0.7215582728, 1])
list_item_3 = ListItem(List=shatter, Index=0, Wrap=True)
evaluate_curve = EvaluateCurve(Curve=reparameterize(simplify(list_item_3)), Parameter=simplify(graft(graph_mapper_2)))  # -> Point, Tangent, Angle
repeat_data_2 = RepeatData(Data=relay_3, Length=list_length)  # -> simplify(graft(Data))
line_3 = Line(StartPoint=relay_2, EndPoint=evaluate_curve.Point)
entwine = Entwine(Branch00=relay, Branch01=evaluate_curve.Point, Branch02=repeat_data_2, FlattenInputs=True)
flip_matrix = FlipMatrix(Data=entwine)
angle_dimension_points = AngleDimensionPoints(Center=evaluate_curve.Point, PointA=relay_3, PointB=relay_2)  # -> AngleDimension, Center, PointA, PointB, DimensionLocation
angle_dimension_points_2 = AngleDimensionPoints(Center=evaluate_curve.Point, PointA=relay_2, PointB=relay)  # -> AngleDimension, Center, PointA, PointB, DimensionLocation
relay_5 = ClusterOutput(evaluate_curve.Point)
relay_6 = ClusterOutput(brep_plane.Curves)
relay_7 = ClusterOutput(flip_matrix)

# ==== cluster Cluster_3
relay = ClusterInput()
factor = ClusterInput()
point = ClusterInput()
unit_z = UnitZ(Factor=factor)
factor_2 = ClusterInput()
point_2 = Point(point)
move = Move(Geometry=relay, Motion=unit_z)  # -> Geometry, Transform
unit_x = UnitX(Factor=factor_2)
unit_z_2 = UnitZ(Factor=0.15)
line = Line(StartPoint=point_2, EndPoint=move.Geometry)
move_2 = Move(Geometry=relay, Motion=unit_x)  # -> Geometry, Transform
move_3 = Move(Geometry=move.Geometry, Motion=unit_z_2)  # -> Geometry, Transform
unit_z_3 = UnitZ(Factor=0.15)
vector_2pt = Vector2Pt(PointA=point_2, PointB=move_3.Geometry, Unitize=False)  # -> Vector, Length
line_sdl = LineSDL(Start=point_2, Direction=vector_2pt.Vector, Length="2000")
line_sdl_2 = LineSDL(Start=move_2.Geometry, Direction=unit_z_3, Length="2000")
curve_curve = CurveCurve(CurveA=line_sdl, CurveB=line_sdl_2)  # -> Points, ParamsA, ParamsB
reverse = Reverse(Vector=unit_z)
move_4 = Move(Geometry=curve_curve.Points, Motion=reverse)  # -> Geometry, Transform
geometry = ClusterOutput(move_4.Geometry)

# ==== cluster Cluster_6
point = ClusterInput()
count = ClusterInput()
point_2 = Point(point)
point_3 = ClusterInput()
series = Series(Start=0, Step=1, Count=count)
point_4 = Point(point_3)
cull_index = CullIndex(List=point_2, Indices=series, Wrap=True)
point_5 = Point(cull_index)
relay = ClusterInput()
relay_2 = ClusterInput()
cluster = Cluster_2(relay_3=point_4, relay=point_5, relay_2=relay, relay_4=relay_2)  # -> relay_6, relay_5, relay_7
geometry = Geometry(cluster.relay_7)
cluster_2 = Cluster_4(vertices=cluster.relay_7, first_number="17", start_point=point_5, end_point=point_4)  # -> relay, larger_than_2
cluster_3 = Cluster_5(relay=cluster.relay_6, list=cluster.relay_5, cull_pattern=cluster_2.larger_than_2)
geometry_2 = Geometry(cluster_2.relay)
geometry_3 = ClusterOutput(geometry_2)
segments = ClusterOutput(cluster_3)

# ==== cluster Cluster_7
point = ClusterInput()
count = ClusterInput()
point_2 = Point(point)
point_3 = ClusterInput()
series = Series(Start=0, Step=1, Count=count)
point_4 = Point(point_3)
negative = Negative(Value=series)
cull_index = CullIndex(List=point_2, Indices=negative, Wrap=True)
point_5 = Point(cull_index)
relay = ClusterInput()
relay_2 = ClusterInput()
cluster = Cluster_2(relay_3=point_4, relay=point_5, relay_2=relay, relay_4=relay_2)  # -> relay_6, relay_5, relay_7
geometry = Geometry(cluster.relay_7)
cluster_2 = Cluster_4(vertices=cluster.relay_7, first_number="17", start_point=point_5, end_point=point_4)  # -> relay, larger_than_2
cluster_3 = Cluster_5(relay=cluster.relay_6, list=cluster.relay_5, cull_pattern=cluster_2.larger_than_2)
geometry_2 = Geometry(cluster_2.relay)
geometry_3 = ClusterOutput(geometry_2)
segments = ClusterOutput(cluster_3)

# ==== cluster Cluster_8
point = ClusterInput()
start = ClusterInput()
count = ClusterInput()
point_2 = Point(point)
point_3 = ClusterInput()
series = Series(Start=start, Step=1, Count=count)
point_4 = Point(point_3)
cull_index = CullIndex(List=point_2, Indices=series, Wrap=True)
point_5 = Point(cull_index)
relay = ClusterInput()
relay_2 = ClusterInput()
cluster = Cluster_2(relay_3=point_4, relay=point_5, relay_2=relay, relay_4=relay_2)  # -> relay_6, relay_5, relay_7
geometry = Geometry(cluster.relay_7)
cluster_2 = Cluster_4(vertices=cluster.relay_7, first_number="17", start_point=point_5, end_point=point_4)  # -> relay, larger_than_2
cluster_3 = Cluster_5(relay=cluster.relay_6, list=cluster.relay_5, cull_pattern=cluster_2.larger_than_2)
geometry_2 = Geometry(cluster_2.relay)
geometry_3 = ClusterOutput(geometry_2)
segments = ClusterOutput(cluster_3)

# ==== cluster Cluster_4
vertices = ClusterInput()
start_point = ClusterInput()
end_point = ClusterInput()
polyline = PolyLine(Vertices=vertices, Closed=False)  # -> flatten(Polyline)
line = Line(StartPoint=start_point, EndPoint=end_point)
length = Length(Curve=polyline)
length_2 = Length(Curve=line)
subtraction = Subtraction(A=length, B=length_2)
absolute = Absolute(Value=subtraction)
first_number = ClusterInput()
larger_than = LargerThan(FirstNumber=first_number, SecondNumber=absolute)  # -> LargerThan, OrEqualTo
cull_pattern = CullPattern(List=polyline, CullPattern=larger_than.LargerThan)
larger_than_2 = ClusterOutput(larger_than.LargerThan)
relay = ClusterOutput(cull_pattern)

# ==== cluster Cluster_5
list = ClusterInput()
cull_pattern = ClusterInput()
cull_pattern_2 = CullPattern(List=flatten(list), CullPattern=cull_pattern)
relay = ClusterInput()
list_item = ListItem(List=flatten(cull_pattern_2), Index=0, Wrap=True)
list_item_2 = ListItem(List=flatten(cull_pattern_2), Index=-1, Wrap=True)
curve_closest_point = CurveClosestPoint(Point=[list_item, list_item_2], Curve=relay)  # -> Point, simplify(Parameter), Distance
shatter = Shatter(Curve=relay, Parameters=curve_closest_point.Parameter)
segments = ClusterOutput(shatter)
