# Grasshopper definition physics74_blocks.gh (Grasshopper 1.0.8)
# plug-ins: Heteroptera, Pufferfish, Anemone, Human, BubalusGH2.0, LunchBox, Cordyceps, eleFront, Sasquatch

# ---- group: 1.1 ВАРИАНТ: номер XYZ (панель) → Y = город, Z = строка таблиц
panel = Panel("128")
text_fragment = TextFragment(Text=panel, Start=1, Count=1)
text_fragment_2 = TextFragment(Text=panel, Start=2, Count=1)
panel_2 = Panel(text_fragment)
panel_3 = Panel(text_fragment_2)

# ---- group: 1.2 ДАННЫЕ: данные.csv → солнце и разворот по городу (Y), схема/H1–H3/окно по варианту (Z)
panel_4 = Panel("C:\Users\adel\Downloads\Telegram Desktop\физика\физика\данные.csv")
данные = Script(path=panel_4, Y=text_fragment, Z=text_fragment_2)  # -> out, az, alt, t_rise, t_set, rot, s1, s2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; inputs path: String, Y: String, Z: String
# ---------- данные: Python ----------
#! python 3
import csv
from Grasshopper import DataTree
from Grasshopper.Kernel.Data import GH_Path

HOURS = ["5-19", "6-18", "7-17", "8-16", "9-15", "10-14", "11-13", "12"]

def tree(values, *path):
    t = DataTree[object]()
    p = GH_Path(*path)
    t.EnsurePath(p)
    for v in values:
        t.Add(v, p)
    return t

with open(path, encoding="utf-8-sig", newline="") as f:
    rows = list(csv.DictReader(f))

def find(kind, code):
    for r in rows:
        if r["тип"].strip() == kind and r["код"].strip() == str(code).strip():
            return r
    raise ValueError("нет строки: тип=%s код=%s" % (kind, code))

c = find("город", Y)
v = find("вариант", Z)

def series(prefix):
    cells = [c[prefix + "восход"]] + [c[prefix + h] for h in HOURS]
    return [float(x) for x in cells if x.strip() != ""]

az = tree(series("аз_"), 0, 0)
alt = tree(series("выс_"), 0, 0)
t_rise = tree([c["восход"]], 0)
t_set = tree([c["закат"]], 0)
rot = tree([c["разворот"]], 1)
s1 = tree([v["схема_1"]], 0)
s2 = tree([v["схема_2"]], 1)
s3 = tree([v["схема_3"]], 2)
s4 = tree([v["схема_4"]], 3)
H = tree([v["H1"], v["H2"], v["H3"]], 0)
w1 = tree([v["окно_1"]], 4)
w2 = tree([v["окно_2"]], 5)
# ---------- end данные ----------

# ---- group: 1.4 ПАКЕТНЫЙ ПЕРЕБОР ВАРИАНТОВ (Anemone) — НЕ ПОДКЛЮЧЁН к варианту
loop_start = LoopStart(Repeat=98, Trigger=Button(), Data="100")  # -> port, Counter, Data
loop_start_2 = LoopStart(Repeat=6, Trigger=Button(), Data="-1")  # -> port, Counter, Data
addition = Addition(A=loop_start.Data, B=1)
addition_2 = Addition(A=loop_start_2.Data, B=1)
panel_5 = Panel("""194
197
102
118
143
175
103
128""")
loop_end = LoopEnd(port=loop_start.port, Exit=False, Data=addition, TimeOutVal=0, pausedState=False, state="Constant output")
loop_end_2 = LoopEnd(port=loop_start_2.port, Exit=False, Data=addition_2, TimeOutVal=0, pausedState=False, state="Constant output")
list_item = ListItem(List=panel_5, Index=loop_end_2, Wrap=False)
panel_6 = Panel(loop_end)
panel_7 = Panel(list_item)

# ---- group: НЕ ИСП — ничего не подключено
cordyceps = Cordyceps(HttpPort=26929, DebugLevel=0)  # -> About, Status, LastCommand

# ---- group: Ф15 [лист 0,-1500] — круговая карта с заливкой
ввод_text_fragment = Data(text_fragment)
ввод_text_fragment_2 = Data(text_fragment_2)
series = Series(Start=10, Step=10, Count=9)
construct_point = ConstructPoint(XCoordinate=0, YCoordinate=-100, ZCoordinate=0)
construct_point_2 = ConstructPoint(XCoordinate=0, YCoordinate=-10, ZCoordinate=0)
construct_domain = ConstructDomain(DomainStart=0, DomainEnd=6.283185307)
colour_swatch = ColourSwatch(SwatchColor=RGB(0, 0, 0))
construct_point_3 = ConstructPoint(XCoordinate=0, YCoordinate=-90, ZCoordinate=0)
colour_swatch_2 = ColourSwatch(SwatchColor=RGB(0, 0, 0))
hatch_table = HatchTable(Update=True)
panel_8 = Panel("10")
construct_point_4 = ConstructPoint(XCoordinate=1000, YCoordinate=0, ZCoordinate=0)
panel_9 = Panel("45")
panel_10 = Panel("?.dwg")
boolean_toggle = BooleanToggle(False)
vector_xyz = VectorXYZ(XComponent=0, YComponent=-1500, ZComponent=0)  # -> Vector, Length
vector_xyz_2 = VectorXYZ(XComponent=0, YComponent=-1750, ZComponent=0)  # -> Vector, Length
vector_xyz_3 = VectorXYZ(XComponent=300, YComponent=-1750, ZComponent=0)  # -> Vector, Length
series_2 = Series(Start=0, Step=10, Count=36)
ввод_panel_128 = Data(panel)
panel_11 = Panel("""Тень в 12
Тень в 11/13
Тень в 10/14
Тень в 9/15
Тень в 8/16
Тень в 7/17
Тень в 6/18
Тень в 5/19
Тень в 4/20""")
circle = Circle(Plane=PlaneXY(0, 0, 0), Radius=series)
line = Line(StartPoint=construct_point_2, EndPoint=construct_point)
range = Range(Domain=construct_domain, Steps=36)
line_2 = Line(StartPoint=construct_point_2, EndPoint=construct_point_3)
list_item_2 = ListItem(List=hatch_table, Index=Slider(1, range=0..21), Wrap=True)
define_color = DefineColor(Color=ColourSwatch(SwatchColor=RGB(214, 113, 245)), Source="object")
move = Move(Motion=vector_xyz.Vector)  # -> Geometry, Transform
construct_point_5 = ConstructPoint(XCoordinate=0, YCoordinate=Slider(-9, range=-9..4), ZCoordinate=0)
reverse_list = ReverseList(List=series_2)
reference_by_layer = ReferenceByLayer(LayerName=ввод_panel_128, lightweight=False)
relay = Relay([ввод_text_fragment, ввод_text_fragment_2])
colour_swatch_3 = ColourSwatch(SwatchColor=RGB(255, 255, 255))
colour_swatch_4 = ColourSwatch(SwatchColor=RGB(255, 107, 107))
list_item_3 = ListItem(List=circle, Index=-1, Wrap=True)
length = Length(Curve=circle)
cull_index = CullIndex(List=range, Indices=-1, Wrap=True)
shift_list = ShiftList(List=reverse_list, Shift=Slider(17, range=0..19), Wrap=True)
text_join = TextJoin(Text=["1", relay])
panel_12 = Panel("°")
guid = Guid(reference_by_layer)
elefront_attributes = EleFrontAttributes(
    Layer=text_join,
    ColourSource="Object",
    ObjectColour=colour_swatch_3,
    PrintColour=colour_swatch_3,
    PrintColourSource="Object")  # -> Attributes, Keys, Values, Name, Layer, ColourSource, DisplayColour, MaterialSource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
elefront_attributes_2 = EleFrontAttributes(
    Layer=text_join,
    ColourSource="Object",
    ObjectColour=colour_swatch_4,
    PrintColour=colour_swatch_4,
    PrintColourSource="Object")  # -> Attributes, Keys, Values, Name, Layer, ColourSource, DisplayColour, MaterialSource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
rotate = Rotate(Geometry=line, Angle=cull_index, Plane=PlaneXY(0, 0, 0))  # -> Geometry, Transform
insert_items = InsertItems(List=graft(shift_list), Item=panel_12, Indices=1, Wrap=True)
elefront_attributes_3 = EleFrontAttributes(Layer=text_join, ColourSource="Object", ObjectColour=define_color, PrintColour=define_color, PrintColourSource="Object")  # -> Attributes, Keys, Values, Name, Layer, ColourSource, DisplayColour, MaterialSource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
rotate_2 = Rotate(Geometry=line_2, Angle=cull_index, Plane=PlaneXY(0, 0, 0))  # -> Geometry, Transform
scale = Scale(Geometry=list_item_3, Center=Point(0, 0, 0), Factor=1.3)  # -> Geometry, Transform
larger_than = LargerThan(FirstNumber=length, SecondNumber=0)  # -> LargerThan, OrEqualTo
elefront_attributes_4 = EleFrontAttributes(Layer=text_join)  # -> Attributes, Keys, Values, Name, Layer, ColourSource, DisplayColour, MaterialSource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
delete_guid = DeleteGuid(Guids=guid)
export_generic = ExportGeneric(
    FolderPath="C:\Users\adel\Downloads\Telegram Desktop\физика\физика\vars",
    FileName=graft(ввод_panel_128),
    FileExtension=".dwg",
    RhinoObjects=guid,
    AxisSystem=PlaneXY(0, 0, 0),
    Export=False,
    Overwrite=True,
    networkMode=True,
    ValueTable_Overwrite=False,
    ValueTable_networkMode=True)
end_points = EndPoints(Curve=rotate.Geometry)  # -> Start, End
text_join_2 = TextJoin(Text=insert_items)  # -> flatten(Result)
cull_pattern = CullPattern(List=circle, CullPattern=larger_than.LargerThan)
panel_13 = Panel("""Ю
В
С
З""")
panel_14 = Panel("""0
9
18
27""")
replace_items = ReplaceItems(List=text_join_2, Item=panel_13, Indices=panel_14, Wrap=False)
cluster = Cluster(relay=replace_items, relay_2=end_points.End)
geometry = Geometry(cluster)
move_2 = Move(Geometry=geometry, Motion=vector_xyz.Vector)  # -> Geometry, Transform

# ---- group: Ф1 [лист 0,-200] — план-сетка: солнечные лучи по часам
construct_point_6 = ConstructPoint(XCoordinate=0, YCoordinate=5, ZCoordinate=0)
colour_swatch_5 = ColourSwatch(SwatchColor=RGB(0, 0, 0))
number_slider = Slider(100.946, range=80..120.001)
cluster_2 = Cluster(relay="0", relay_2=construct_point_6)
negative = Negative(Value=number_slider)
vector_xyz_4 = VectorXYZ(XComponent=0, YComponent=-200, ZComponent=0)  # -> Vector, Length

# ---- group: Ф4 [лист 0,-350] — тень стержня: азимут Ао
construct_point_7 = ConstructPoint(XCoordinate=-20, YCoordinate=0, ZCoordinate=0)
construct_point_8 = ConstructPoint(XCoordinate=0, YCoordinate=20, ZCoordinate=0)
construct_point_9 = ConstructPoint(XCoordinate=5, YCoordinate=5, ZCoordinate=0)
construct_point_10 = ConstructPoint(XCoordinate=-5, YCoordinate=-5, ZCoordinate=0)
construct_point_11 = ConstructPoint(XCoordinate=0, YCoordinate=0, ZCoordinate=0)
vector_2pt = Vector2Pt(PointA=construct_point_11, PointB=construct_point_7, Unitize=False)  # -> Vector, Length
line_3 = Line(StartPoint=construct_point_9, EndPoint=construct_point_10)
vector_2pt_2 = Vector2Pt(PointA=construct_point_11, PointB=construct_point_8, Unitize=False)  # -> Vector, Length
rotate_3 = Rotate(Geometry=line_3, Angle=1.570796327, Plane=PlaneXY(0, 0, 0))  # -> Geometry, Transform
merge = Merge(Data1=rotate_3.Geometry, Data2=line_3)
move_3 = Move(Geometry=merge, Motion=vector_2pt.Vector)  # -> Geometry, Transform
move_4 = Move(Geometry=merge, Motion=vector_2pt_2.Vector)  # -> Geometry, Transform

# ---- group: Ф7 [лист 0,-800] — схема застройки на сетке
panel_15 = Panel("""1
2
3""")
panel_16 = Panel("""-pi/2
0
-pi/2""")
ввод_entwine = Data(данные.H)
panel_17 = Panel(ввод_entwine)
division = Division(A=panel_17, B=10)
x_minus_one = XMinusOne(NumberX=division)
vector_xyz_5 = VectorXYZ(XComponent=0, YComponent=-800, ZComponent=0)  # -> Vector, Length

# ---- group: Ф14 [лист 0,-1250] — застройка с лучами (2)
panel_18 = Panel("3")
ввод_explode_tree = Data(данные.w1)
ввод_explode_tree_2 = Data(данные.w2)
vector_xyz_6 = VectorXYZ(XComponent=0, YComponent=-1250, ZComponent=0)  # -> Vector, Length
panel_19 = Panel(ввод_explode_tree_2)
panel_20 = Panel(ввод_explode_tree)
similarity = Similarity(FirstNumber=panel_20, SecondNumber=1.5, Threshold=0.1)  # -> Similarity, AbsoluteDifference
similarity_2 = Similarity(FirstNumber=panel_20, SecondNumber=1.8, Threshold=0.1)  # -> Similarity, AbsoluteDifference
text = Text([similarity.Similarity, similarity_2.Similarity])
panel_21 = Panel("""2.5
3""")
cull_pattern_2 = CullPattern(List=panel_21, CullPattern=text)
cluster_3 = Cluster_11(panel=cull_pattern_2, relay=panel_20, relay_2=panel_19)  # -> nearest, nearest_2, geometry_2, nearest_3, nearest_4
construct_point_12 = ConstructPoint(XCoordinate=0, YCoordinate=300, ZCoordinate=0)
geometry_2 = Geometry(cluster_3.geometry_2)
panel_22 = Panel(cluster_3.nearest_2)
cluster_4 = Cluster_12(B=panel_22, offset="20")  # -> geometry_4, geometry_2, angular_dimension, geometry_3
move_5 = Move(Geometry=geometry_2, Motion=construct_point_12)  # -> Geometry, Transform
geometry_3 = Geometry(cluster_4.geometry_2)
geometry_4 = Geometry(cluster_4.angular_dimension)
geometry_5 = Geometry(cluster_4.geometry_3)
geometry_6 = Geometry(cluster_4.geometry_4)
construct_point_13 = ConstructPoint(XCoordinate=0, YCoordinate=0, ZCoordinate=0)
geometry_7 = Geometry([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])

# ---- group: Ф15 [лист 0,-1500] — круговая карта с заливкой (continued)
ф14_cluster_nearest = Data(cluster_3.nearest_3)
ф14_cluster_nearest_2 = Data(cluster_3.nearest_4)
ф14_panel = Data(panel_22)
panel_23 = Panel(ф14_cluster_nearest)
panel_24 = Panel(ф14_cluster_nearest_2)

# ---- group: Ф14 [лист 0,-1250] — застройка с лучами (2) (continued)
ф15_panel = Data(panel_24)
cluster_5 = Cluster_12(B=ф15_panel, offset="12")  # -> geometry_4, geometry_2, angular_dimension, geometry_3
geometry_8 = Geometry(cluster_5.geometry_2)
geometry_9 = Geometry(cluster_5.angular_dimension)
geometry_10 = Geometry(cluster_5.geometry_3)
geometry_11 = Geometry(cluster_5.geometry_4)
merge_2 = Merge(Data1=geometry_4, Data2=geometry_5, Data3=geometry_9, Data4=geometry_10)
merge_3 = Merge(Data1=geometry_3, Data2=geometry_6, Data3=geometry_8, Data4=geometry_11)
scale_2 = Scale(Geometry=merge_3, Center=Point(0, 0, 0), Factor=10)  # -> Geometry, Transform

# ---- group: Ф13 [лист 0,-1000] — застройка с лучами (1)
ф14_merge = Data(merge_2)
vector_xyz_7 = VectorXYZ(XComponent=0, YComponent=-1000, ZComponent=0)  # -> Vector, Length

# ---- group: Ф16 [лист 0,-1950] — ГИЗ, задача 10 (граница В = Б − норма из «ВЫВОДЫ»)
ф14_cluster_nearest_3 = Data(cluster_3.nearest)
construct_domain_2 = ConstructDomain(DomainStart=0, DomainEnd=300)
construct_domain_3 = ConstructDomain(DomainStart=-300, DomainEnd=300)
ввод_explode_tree_3 = Data(данные.s1)
rectangle = Rectangle(Plane=PlaneXY(0, 0, 0), XSize=construct_domain_2, YSize=construct_domain_3, Radius=0)  # -> Rectangle, Length
panel_25 = Panel(ф14_cluster_nearest_3)
panel_26 = Panel(ввод_explode_tree_3)
vector_xyz_8 = VectorXYZ(XComponent=0, YComponent=0, ZComponent=0)  # -> Vector, Length
subtraction = Subtraction(A=180, B=panel_25)
addition_3 = Addition(A=panel_26, B=90)
unit_y = UnitY(Factor=60)
unit_z = UnitZ(Factor=1)
division_2 = Division(A=subtraction, B=2)
radians = Radians(Degrees=addition_3)
rotate_4 = Rotate(Vector=unit_y, Axis=unit_z, Angle=radians)
rotate_5 = Rotate(Geometry=rectangle.Rectangle, Angle=radians, Plane=PlaneXY(0, 0, 0))  # -> Geometry, Transform
radians_2 = Radians(Degrees=division_2)
vector_xyz_9 = VectorXYZ(XComponent=0, YComponent=-1950, ZComponent=0)  # -> Vector, Length
unit_x = UnitX(Factor=-20)

# ---- group: Ф15 [лист 0,-1500] — круговая карта с заливкой (continued)
ф16_panel = Data(panel_25)

# ---- group: Ф5 [лист 300,-350] — тень стержня: азимут Ао и длина L
construct_point_14 = ConstructPoint(XCoordinate=-4, YCoordinate=3, ZCoordinate=0)
boolean_toggle_2 = BooleanToggle(False)
ввод_explode_tree_4 = Data(данные.s1)
ввод_explode_tree_5 = Data(данные.s2)
ввод_explode_tree_6 = Data(данные.s4)
ф4_move_geometry = Data(move_3.Geometry)
ф4_move_geometry_2 = Data(move_4.Geometry)
ввод_panel_128_2 = Data(panel)
angle = Angle(1.570796327)
angle_2 = Angle(1.570796327)
number_slider_2 = Slider(60, range=0..151)
panel_27 = Panel("l = . м")
panel_28 = Panel("-400")
ф4_construct_point = Data(construct_point_7)
ф4_construct_point_2 = Data(construct_point_8)
construct_point_15 = ConstructPoint(XCoordinate=0, YCoordinate=0, ZCoordinate=0)
subtraction_2 = Subtraction(A=0, B=angle)
subtraction_3 = Subtraction(A=number_slider_2, B=ввод_explode_tree_6)
replace_text = ReplaceText(Text="L = . м", Find=".", Replace=ввод_explode_tree_5, RecursiveReplace=False)  # -> graft(Result)
vector_xyz_10 = VectorXYZ(XComponent=300, YComponent=panel_28, ZComponent=0)  # -> Vector, Length
replace_text_2 = ReplaceText(Text="Aо = .°", Find=".", Replace=ввод_explode_tree_4, RecursiveReplace=False)  # -> graft(Result)
division_3 = Division(A=ввод_explode_tree_4, B=180)
subtraction_4 = Subtraction(A=0, B=ввод_explode_tree_5)
reference_by_layer_2 = ReferenceByLayer(LayerName=ввод_panel_128_2, lightweight=False)
maximum = Maximum(A=subtraction_3, B=ввод_explode_tree_6)
multiplication = Multiplication(A=division_3, B=3.141592654)
construct_point_16 = ConstructPoint(XCoordinate=0, YCoordinate=subtraction_4, ZCoordinate=0)
guid_2 = Guid(reference_by_layer_2)
line_4 = Line(StartPoint=construct_point_15, EndPoint=construct_point_16)
delete_guid_2 = DeleteGuid(Guids=guid_2)
export_generic_2 = ExportGeneric(
    FolderPath="C:\Users\adel\Downloads\Telegram Desktop\физика\физика\vars\Новая папка",
    FileName=graft(ввод_panel_128_2),
    FileExtension=".dwg",
    RhinoObjects=guid_2,
    AxisSystem=PlaneXY(0, 0, 0),
    Export=False,
    Overwrite=True,
    networkMode=True,
    ValueTable_Overwrite=False,
    ValueTable_networkMode=True)
rotate_6 = Rotate(Geometry=line_4, Angle=multiplication, Plane=PlaneXY(0, 0, 0))  # -> Geometry, Transform
panel_29 = Panel("""З
С
В
Ю""")
end_points_2 = EndPoints(Curve=rotate_6.Geometry)  # -> Start, End
define_linear_dimension = DefineLinearDimension(Point1=construct_point_15, Point2=end_points_2.End, Offset=5, OverwriteText=replace_text, internalize=False)
vector_2pt_3 = Vector2Pt(PointA=end_points_2.Start, PointB=end_points_2.End, Unitize=False)  # -> Vector, Length
xy_plane = XYPlane(Origin=end_points_2.End)
define_angular_dimension = DefineAngularDimension(
    Origin=construct_point_15,
    Point1=construct_point_16,
    Point2=end_points_2.End,
    Offset=25,
    OverwriteText=replace_text_2,
    internalize=False)
number_slider_3 = Slider(12, range=0..41)
amplitude = Amplitude(Vector=vector_2pt_3.Vector, Amplitude=number_slider_3)
amplitude_2 = Amplitude(Vector=vector_2pt_3.Vector, Amplitude=number_slider_2)
line_sdl = LineSDL(Start=end_points_2.End, Direction=vector_2pt_3.Vector, Length=maximum)
line_sdl_2 = LineSDL(Start=end_points_2.End, Direction=vector_2pt_3.Vector, Length=amplitude_2)

# ---- group: Ф4 [лист 0,-350] — тень стержня: азимут Ао (continued)
ф5_construct_point = Data(construct_point_14)
ф5_panel_400 = Data(panel_28)
ф5_define_linear_dimension = Data(define_linear_dimension)
ф5_define_angular_dimension = Data(define_angular_dimension)
ф5_rotate_geometry = Data(rotate_6.Geometry)
vector_xyz_11 = VectorXYZ(XComponent=0, YComponent=ф5_panel_400, ZComponent=0)  # -> Vector, Length

# ---- group: Ф16 [лист 0,-1950] — ГИЗ, задача 10 (граница В = Б − норма из «ВЫВОДЫ») (continued)
ф5_amplitude = Data(amplitude)
reverse = Reverse(Vector=ф5_amplitude)

# ---- group: Ф2 [лист 300,-200] — план-сетка: тень стержня
ф5_subtraction = Data(subtraction_2)
panel_30 = Panel("5")
construct_point_17 = ConstructPoint(XCoordinate=0, YCoordinate=7, ZCoordinate=0)
ввод_cull_pattern = Data(данные.az)
ввод_cull_pattern_2 = Data(данные.alt)
ф5_line_sdl = Data(line_sdl)
ф5_xy_plane = Data(xy_plane)
ф5_line_sdl_2 = Data(line_sdl_2)
ф5_xy_plane_2 = Data(xy_plane)
ввод_explode_tree_7 = Data(данные.s3)
indices = Indices([0, -1])
panel_31 = Panel("РТ")
number_slider_4 = Slider(5, range=0..20)
number_slider_5 = Slider(-2, range=-4..4)
ф5_angle = Data(angle_2)
cluster_6 = Cluster(relay=panel_31, relay_2=construct_point_17)
division_4 = Division(A=ввод_cull_pattern, B=180)
subtraction_5 = Subtraction(A=90, B=ввод_cull_pattern_2)
list_length = ListLength(List=ввод_cull_pattern_2)
rotate_7 = Rotate(Geometry=ф5_line_sdl, Angle=ф5_subtraction, Plane=ф5_xy_plane)  # -> Geometry, Transform
null_placeholder = NullPlaceholder()
rotate_8 = Rotate(Geometry=ф5_line_sdl_2, Angle=ф5_angle, Plane=ф5_xy_plane_2)  # -> Geometry, Transform
vector_xyz_12 = VectorXYZ(XComponent=300, YComponent=-200, ZComponent=0)  # -> Vector, Length
division_5 = Division(A=ввод_explode_tree_7, B=10)
multiplication_2 = Multiplication(A=division_4, B=3.141592654)
negative_2 = Negative(Value=subtraction_5)
series_3 = Series(Start=12, Step=-1, Count=list_length)
end_points_3 = EndPoints(Curve=rotate_7.Geometry)  # -> Start, End
x_minus_one_2 = XMinusOne(NumberX=division_5)
addition_4 = Addition(A=division_5, B=1)
negative_3 = Negative(Value=multiplication_2)
construct_point_18 = ConstructPoint(XCoordinate=0, YCoordinate=negative_2, ZCoordinate=0)
vector_2pt_4 = Vector2Pt(PointA=end_points_3.Start, PointB=end_points_3.End, Unitize=True)  # -> Vector, Length
series_4 = Series(Start=10, Step=10, Count=addition_4)
ввод_explode_tree_8 = Data(данные.s4)
rotate_9 = Rotate(Geometry=construct_point_18, Angle=multiplication_2, Plane=PlaneXY(0, 0, 0))  # -> Geometry, Transform
rotate_10 = Rotate(Geometry=construct_point_18, Angle=negative_3, Plane=PlaneXY(0, 0, 0))  # -> Geometry, Transform
amplitude_3 = Amplitude(Vector=vector_2pt_4.Vector, Amplitude=ввод_explode_tree_8)
replace_text_3 = ReplaceText(Text="H = . м", Find=".", Replace=series_4, RecursiveReplace=False)  # -> graft(Result)
reverse_list_2 = ReverseList(List=rotate_10.Geometry)
move_6 = Move(Geometry=rotate_8.Geometry, Motion=amplitude_3)  # -> Geometry, Transform
ф5_amplitude_2 = Data(amplitude)
removeduplicatepts = RemoveDuplicatePts(Points=[rotate_9.Geometry, reverse_list_2], Tolerance=0.01)
end_points_4 = EndPoints(Curve=move_6.Geometry)  # -> Start, End
extrude = Extrude(Base=move_6.Geometry, Direction=ф5_amplitude_2)
ф5_rotate_geometry_2 = Data(rotate_6.Geometry)
geometry_12 = Geometry(removeduplicatepts)
define_linear_dimension_2 = DefineLinearDimension(Point1=end_points_4.Start, Point2=end_points_4.End, Offset=13, internalize=False)
brep_edges = BrepEdges(Brep=extrude)  # -> Naked, Interior, NonManifold
construct_point_19 = ConstructPoint(XCoordinate=0, YCoordinate=0, ZCoordinate=0)
ф5_define_linear_dimension_2 = Data(define_linear_dimension)
ф5_define_angular_dimension_2 = Data(define_angular_dimension)
colour_swatch_6 = ColourSwatch(SwatchColor=RGB(0, 0, 0))
vector_2pt_5 = Vector2Pt(PointA=construct_point_19, PointB=geometry_12, Unitize=False)  # -> Vector, Length
subtraction_6 = Subtraction(A=90, B=vector_2pt_5.Length)
line_sdl_3 = LineSDL(Start=construct_point_19, Direction=vector_2pt_5.Vector, Length=500)
radians_3 = Radians(Degrees=subtraction_6)
maximum_2 = Maximum(A=radians_3, B=0.01)
cotangent = CoTangent(Value=maximum_2)
list_length_2 = ListLength(List=cotangent)
line_sdl_4 = LineSDL(Start=construct_point_19, Direction=vector_2pt_5.Vector, Length=cotangent)
end_points_5 = EndPoints(Curve=line_sdl_4)  # -> Start, End
cull_index_2 = CullIndex(List=end_points_5.End, Indices=[0, -1], Wrap=True)
scale_3 = Scale(Geometry=cull_index_2, Center=Point(0, 0, 0), Factor=simplify(graft(series_4)))  # -> Geometry, Transform
polyline = PolyLine(Vertices=scale_3.Geometry, Closed=False)
geometry_13 = Geometry(scale_3.Geometry)
geometry_14 = Geometry(flatten(polyline))
list_length_3 = ListLength(List=geometry_13)
list_item_4 = ListItem(List=flatten(polyline), Index=x_minus_one_2, Wrap=True)
list_item_5 = ListItem(List=geometry_14, Index=-1, Wrap=True)
division_6 = Division(A=list_length_3, B=2)
extrude_point = ExtrudePoint(Base=list_item_4, Point=construct_point_19)
deconstruct_box = DeconstructBox(Box=list_item_5)  # -> Plane, X, Y, Z
round = Round(Number=division_6)  # -> Nearest, Floor, Ceiling
region_intersection = RegionIntersection(CurvesA=extrude, CurvesB=extrude_point)
deconstruct_domain = DeconstructDomain(Domain=deconstruct_box.Y)  # -> Start, End
boundary_surfaces = BoundarySurfaces(Edges=region_intersection)
construct_point_20 = ConstructPoint(XCoordinate=0, YCoordinate=0, ZCoordinate=1)
extrude_2 = Extrude(Base=boundary_surfaces, Direction=construct_point_20)
extrude_point_2 = ExtrudePoint(Base=boundary_surfaces, Point=construct_point_19)
geometry_15 = Geometry(extrude_2)
project = Project(Geometry=extrude_point_2, Plane=PlaneXY(0, 0, 0))  # -> Geometry, Transform
brep_edges_2 = BrepEdges(Brep=geometry_15)  # -> Naked, Interior, NonManifold
brep_edges_3 = BrepEdges(Brep=project.Geometry)  # -> Naked, Interior, NonManifold
project_2 = Project(Geometry=brep_edges_2.Interior, Plane=PlaneXY(0, 0, 0))  # -> Geometry, Transform
removeduplicatelines = RemoveDuplicateLines(Lines=[brep_edges_3.Interior, brep_edges_3.Naked], Tolerance=0.01)
len = Length(Curve=project_2.Geometry)
boundary_surfaces_2 = BoundarySurfaces(Edges=removeduplicatelines)
larger = LargerThan(FirstNumber=len, SecondNumber="0.001")  # -> LargerThan, OrEqualTo
region_difference = RegionDifference(CurvesA=boundary_surfaces_2, CurvesB=boundary_surfaces)
cull = CullPattern(List=project_2.Geometry, CullPattern=larger.LargerThan)
boundary_surfaces_3 = BoundarySurfaces(Edges=region_difference)
removeduplicatelines_2 = RemoveDuplicateLines(Lines=cull, Tolerance=0.01)
move_7 = Move(Geometry=boundary_surfaces_3, Motion=vector_xyz_12.Vector)  # -> Geometry, Transform
join_curves = JoinCurves(Curves=removeduplicatelines_2, Preserve=False)

# ---- group: Ф13 [лист 0,-1000] — застройка с лучами (1) (continued)
ф2_cluster_text = Data(cluster_6)
ф2_construct_point = Data(construct_point_19)

# ---- group: Ф1 [лист 0,-200] — план-сетка: солнечные лучи по часам (continued)
ф2_deconstruct_box_x = Data(deconstruct_box.X)
ф2_deconstruct_domain_start = Data(deconstruct_domain.Start)
ф2_deconstruct_domain_end = Data(deconstruct_domain.End)
ф2_list_item = Data(list_item_5)
deconstruct_domain_2 = DeconstructDomain(Domain=ф2_deconstruct_box_x)  # -> Start, End
minimum = Minimum(A=ф2_deconstruct_domain_start, B=ф2_deconstruct_domain_end)
maximum_3 = Maximum(A=ф2_deconstruct_domain_start, B=ф2_deconstruct_domain_end)
deconstruct_box_2 = DeconstructBox(Box=ф2_list_item)  # -> Plane, X, Y, Z
division_7 = Division(A=deconstruct_domain_2.Start, B=2)
division_8 = Division(A=deconstruct_domain_2.End, B=2)
maximum_4 = Maximum(A=maximum_3, B=10)
deconstruct_domain_3 = DeconstructDomain(Domain=deconstruct_box_2.X)  # -> Start, End
deconstruct_domain_4 = DeconstructDomain(Domain=deconstruct_box_2.Y)  # -> Start, End
maximum_5 = Maximum(A=division_7, B=negative)
minimum_2 = Minimum(A=division_8, B=number_slider)
construct_domain_4 = ConstructDomain(DomainStart=maximum_4, DomainEnd=minimum)
division_9 = Division(A=deconstruct_domain_3.Start, B=2)
division_10 = Division(A=deconstruct_domain_3.End, B=2)
addition_5 = Addition(A=maximum_4, B="10")
maximum_6 = Maximum(A=deconstruct_domain_4.Start, B=deconstruct_domain_4.End)
construct_domain_5 = ConstructDomain(DomainStart=maximum_5, DomainEnd=minimum_2)
maximum_7 = Maximum(A=division_9, B=negative)
addition_6 = Addition(A=minimum_2, B="10")
addition_7 = Addition(A=maximum_5, B="-10")
minimum_3 = Minimum(A=number_slider, B=division_10)
maximum_8 = Maximum(A=maximum_6, B=10)
rectangle_2 = Rectangle(Plane=PlaneXY(0, 0, 0), XSize=construct_domain_5, YSize=construct_domain_4, Radius=0)  # -> Rectangle, Length
construct_domain_6 = ConstructDomain(DomainStart=maximum_7, DomainEnd=minimum_3)
construct_domain_7 = ConstructDomain(DomainStart=addition_7, DomainEnd=addition_6)
boundary_surfaces_4 = BoundarySurfaces(Edges=rectangle_2.Rectangle)
ф2_polyline = Data(polyline)
surface_curve = SurfaceCurve(Surface=boundary_surfaces_4, Curve=ф2_polyline)  # -> Curves, Points, UVPoints, Normals, Parameters, Tangents
explode = Explode(Curve=flatten(surface_curve.Curves), Recursive=True)  # -> Segments, flatten(Vertices)
deconstruct = Deconstruct(Point=explode.Vertices)  # -> XComponent, YComponent, ZComponent
min_max = MinMax(Number=deconstruct.YComponent)  # -> Minimum, Maximum
construct_domain_8 = ConstructDomain(DomainStart=maximum_8, DomainEnd=min_max.Minimum)
addition_8 = Addition(A=min_max.Minimum, B="-10")
rectangle_3 = Rectangle(Plane=PlaneXY(0, 0, 0), XSize=construct_domain_6, YSize=construct_domain_8, Radius=0)  # -> Rectangle, Length
construct_domain_9 = ConstructDomain(DomainStart=addition_5, DomainEnd=addition_8)
boundary_surfaces_5 = BoundarySurfaces(Edges=rectangle_3.Rectangle)
rectangle_4 = Rectangle(Plane=PlaneXY(0, 0, 0), XSize=construct_domain_7, YSize=construct_domain_9, Radius=0)  # -> Rectangle, Length
ф2_line_sdl = Data(line_sdl_3)
surface_curve_2 = SurfaceCurve(Surface=boundary_surfaces_5, Curve=ф2_line_sdl)  # -> Curves, Points, UVPoints, Normals, Parameters, Tangents
boundary_surfaces_6 = BoundarySurfaces(Edges=rectangle_4.Rectangle)
surface_curve_3 = SurfaceCurve(Surface=boundary_surfaces_6, Curve=ф2_line_sdl)  # -> Curves, Points, UVPoints, Normals, Parameters, Tangents
end_points_6 = EndPoints(Curve=surface_curve_3.Curves)  # -> Start, End
circle_cnr = CircleCNR(Center=end_points_6.End, Normal=Vector(0, 0, 1), Radius=5)
xy_plane_2 = XYPlane(Origin=end_points_6.End)

# ---- group: Ф7 [лист 0,-800] — схема застройки на сетке (continued)
ф1_circle_cnr = Data(circle_cnr)
ф2_scale_geometry = Data(scale_3.Geometry)
ф2_list_length = Data(list_length)
geometry_16 = Geometry(flatten(ф1_circle_cnr))
series_5 = Series(Start=12, Step=1, Count=ф2_list_length)
polyline_2 = PolyLine(Vertices=ф2_scale_geometry, Closed=False)
ф2_cluster_text_2 = Data(cluster_6)
center = Center(Geometric=geometry_16)  # -> Center, Dimension
ф2_construct_point_2 = Data(construct_point_19)
list_item_6 = ListItem(List=flatten(polyline_2), Index=x_minus_one, Wrap=True)
extrude_point_3 = ExtrudePoint(Base=list_item_6, Point=ф2_construct_point_2)

# ---- group: Ф13 [лист 0,-1000] — застройка с лучами (1) (continued)
ф7_extrude_point = Data(extrude_point_3)

# ---- group: Ф4 [лист 0,-350] — тень стержня: азимут Ао (continued)
ф2_panel_рт = Data(panel_31)
ф2_extrude = Data(extrude)
ф2_brep_edges_naked = Data(brep_edges.Naked)
ф2_define_linear_dimension = Data(define_linear_dimension_2)
cluster_7 = Cluster(relay=ф2_panel_рт, relay_2=ф5_construct_point)
deconstruct_box_3 = DeconstructBox(Box=ф2_extrude)  # -> Plane, X, Y, Z
deconstruct_domain_5 = DeconstructDomain(Domain=deconstruct_box_3.X)  # -> Start, End
deconstruct_domain_6 = DeconstructDomain(Domain=deconstruct_box_3.Y)  # -> Start, End
move_8 = Move(Geometry=ф2_extrude, Motion=vector_xyz_11.Vector)  # -> Geometry, Transform
maximum_9 = Maximum(A=deconstruct_domain_5.Start, B=deconstruct_domain_5.End)
minimum_4 = Minimum(A=deconstruct_domain_6.Start, B=deconstruct_domain_6.End)
construct_point_21 = ConstructPoint(XCoordinate=maximum_9, YCoordinate=0, ZCoordinate=0)
construct_point_22 = ConstructPoint(XCoordinate=0, YCoordinate=minimum_4, ZCoordinate=0)
line_5 = Line(StartPoint=construct_point_7, EndPoint=construct_point_21)
line_6 = Line(StartPoint=construct_point_8, EndPoint=construct_point_22)
vector_2pt_6 = Vector2Pt(PointA=construct_point_11, PointB=construct_point_21, Unitize=False)  # -> Vector, Length
vector_2pt_7 = Vector2Pt(PointA=construct_point_11, PointB=construct_point_22, Unitize=False)  # -> Vector, Length
deconstruct_box_4 = DeconstructBox(Box=line_5)  # -> Plane, X, Y, Z
deconstruct_box_5 = DeconstructBox(Box=line_6)  # -> Plane, X, Y, Z
move_9 = Move(Geometry=merge, Motion=vector_2pt_6.Vector)  # -> Geometry, Transform
move_10 = Move(Geometry=merge, Motion=vector_2pt_7.Vector)  # -> Geometry, Transform
rectangle_5 = Rectangle(Plane=PlaneXY(0, 0, 0), XSize=deconstruct_box_4.X, YSize=deconstruct_box_5.Y, Radius=0)  # -> Rectangle, Length

# ---- group: Ф15 [лист 0,-1500] — круговая карта с заливкой (continued)
ф2_scale_geometry_2 = Data(scale_3.Geometry)
ф2_construct_point_3 = Data(construct_point_19)
ф2_removeduplicatepts = Data(removeduplicatepts)
ф2_list_length_2 = Data(list_length)
ф2_list_length_3 = Data(list_length_2)
split_list = SplitList(List=panel_11, Index=ф2_list_length_2)  # -> ListA, ListB
line_7 = Line(StartPoint=ф2_construct_point_3, EndPoint=simplify(ф2_scale_geometry_2))
circle_cnr_2 = CircleCNR(Center=ф2_removeduplicatepts, Normal=Vector(0, 0, 1), Radius=1)
division_11 = Division(A=ф2_list_length_3, B=2)
ф2_cotangent = Data(cotangent)
reverse_list_3 = ReverseList(List=split_list.ListA)
length_2 = Length(Curve=line_7)
round_2 = Round(Number=division_11)  # -> Nearest, Floor, Ceiling
insert_items_2 = InsertItems(List=reverse_list_3, Item="Высота стержня", Indices=0, Wrap=True)
split_list_2 = SplitList(List=ф2_cotangent, Index=round_2.Ceiling)  # -> simplify(ListA), ListB
panel_32 = Panel(length_2)
boundary_surfaces_7 = BoundarySurfaces(Edges=flatten([circle_cnr_2, scale.Geometry]))
cull_index_3 = CullIndex(List=split_list_2.ListA, Indices=0, Wrap=True)
ф2_series = Data(series_4)
multiplication_3 = Multiplication(A=graft(cull_index_3), B=ф2_series)
area = Area(Geometry=boundary_surfaces_7)  # -> Area, Centroid
flip_matrix = FlipMatrix(Data=multiplication_3)
min_max_2 = MinMax(Number=area.Area)  # -> Minimum, Maximum
insert_items_3 = InsertItems(List=flip_matrix, Item=graft(ф2_series), Indices=0, Wrap=True)
member_index = MemberIndex(Set=area.Area, Member=min_max_2.Maximum)  # -> Index, Count
insert_items_4 = InsertItems(List=insert_items_3, Item=graft("-"), Indices=1, Wrap=True)
list_item_7 = ListItem(List=boundary_surfaces_7, Index=member_index.Index, Wrap=True)
flip_matrix_2 = FlipMatrix(Data=insert_items_4)
surface_curve_4 = SurfaceCurve(Surface=list_item_7, Curve=rotate_2.Geometry)  # -> Curves, Points, UVPoints, Normals, Parameters, Tangents
panel_33 = Panel(flip_matrix_2)

# ---- group: Ф16 [лист 0,-1950] — ГИЗ, задача 10 (граница В = Б − норма из «ВЫВОДЫ») (continued)
ф1_construct_domain = Data(construct_domain_6)
ф1_construct_domain_2 = Data(construct_domain_8)
ф1_circle_cnr_2 = Data(circle_cnr)
ф7_center_center = Data(center.Center)
ф2_round_floor = Data(round.Floor)
ф2_number_slider = Data(number_slider_5)
ф2_number_slider_2 = Data(number_slider_4)
ф2_polyline_2 = Data(polyline)
ф2_rotate_geometry = Data(rotate_8.Geometry)
ф2_amplitude = Data(amplitude_3)
ф2_construct_point_4 = Data(construct_point_19)
subtraction_7 = Subtraction(A=ф2_round_floor, B=ф2_number_slider)
list_item_8 = ListItem(List=flatten(ф2_polyline_2), Index="-1", Wrap=True)
vector_xyz_13 = VectorXYZ(XComponent=0, YComponent=ф2_number_slider_2, ZComponent=0)  # -> Vector, Length
rectangle_6 = Rectangle(Plane=PlaneXY(0, 0, 0), XSize=ф1_construct_domain, YSize=ф1_construct_domain_2, Radius=0)  # -> Rectangle, Length
geometry_17 = Geometry(flatten(ф1_circle_cnr_2))
move_11 = Move(Geometry=ф2_rotate_geometry, Motion=ф2_amplitude)  # -> Geometry, Transform
ф2_replace_text = Data(replace_text_3)
ф2_line_sdl_2 = Data(line_sdl_3)
extrude_point_4 = ExtrudePoint(Base=list_item_8, Point=ф2_construct_point_4)
boundary_surfaces_8 = BoundarySurfaces(Edges=rectangle_6.Rectangle)
end_points_7 = EndPoints(Curve=move_11.Geometry)  # -> Start, End
surface_curve_5 = SurfaceCurve(Surface=boundary_surfaces_8, Curve=ф2_line_sdl_2)  # -> Curves, Points, UVPoints, Normals, Parameters, Tangents
vector_2pt_8 = Vector2Pt(PointA=end_points_7.End, PointB=vector_xyz_8.Vector, Unitize=False)  # -> Vector, Length
surface_curve_6 = SurfaceCurve(Surface=boundary_surfaces_8, Curve=ф2_polyline_2)  # -> Curves, Points, UVPoints, Normals, Parameters, Tangents
move_12 = Move(Geometry=move_11.Geometry, Motion=vector_2pt_8.Vector)  # -> Geometry, Transform
rotate_11 = Rotate(Geometry=move_12.Geometry, Angle=radians_2, Plane=PlaneXY(0, 0, 0))  # -> Geometry, Transform
region_difference_2 = RegionDifference(CurvesA=boundary_surfaces_8, CurvesB=rotate_5.Geometry)
end_points_8 = EndPoints(Curve=move_12.Geometry)  # -> Start, End
extrude_3 = Extrude(Base=move_12.Geometry, Direction=reverse)
scale_4 = Scale(Geometry=rotate_11.Geometry, Center=Point(0, 0, 0), Factor=10)  # -> Geometry, Transform
end_points_9 = EndPoints(Curve=rotate_11.Geometry)  # -> Start, End
move_13 = Move(Geometry=extrude_3, Motion=vector_xyz_9.Vector)  # -> Geometry, Transform
boundary_surfaces_9 = BoundarySurfaces(Edges=flatten(region_difference_2))
vector_2pt_9 = Vector2Pt(PointA=end_points_8.End, PointB=end_points_8.Start, Unitize=False)  # -> Vector, Length
surface_curve_7 = SurfaceCurve(Surface=boundary_surfaces_9, Curve=surface_curve_5.Curves)  # -> Curves, Points, UVPoints, Normals, Parameters, Tangents
define_angular_dimension_2 = DefineAngularDimension(Origin=end_points_8.End, Point1=end_points_8.Start, Point2=end_points_9.Start, Offset=40, internalize=False)
surface_curve_8 = SurfaceCurve(Surface=boundary_surfaces_9, Curve=surface_curve_6.Curves)  # -> Curves, Points, UVPoints, Normals, Parameters, Tangents
geometry_18 = Geometry(flatten(surface_curve_7.Curves))
geometry_19 = Geometry(define_angular_dimension_2)
geometry_20 = Geometry([surface_curve_7.Curves, surface_curve_8.Curves, region_difference_2])
move_14 = Move(Geometry=geometry_20, Motion=rotate_4)  # -> Geometry, Transform
list_item_9 = ListItem(List=geometry_18, Index=-3, Wrap=True)

# ---- group: 1.3 ВЫВОДЫ: продолжительность инсоляции по задачам 4–10, СанПиН, ГИЗ → текст на лист и vars\выводы_XYZ.txt
выводы = Script(path=panel_4, Y=text_fragment, Z=text_fragment_2, v=panel, ray=list_item_9)  # -> out, out_2, T, P, ang, text; inputs path: String, Y: String, Z: String, v: String, ray: Curve
# ---------- выводы: Python ----------
#! python 3
import math, csv

HOURS = [("5-19", 7), ("6-18", 6), ("7-17", 5), ("8-16", 4), ("9-15", 3), ("10-14", 2), ("11-13", 1), ("12", 0)]
WALL, LOG_D, LOG_W, TOP = 0.51, 1.2, 3.3, 0.4


def hm(t):
    m = int(round(t * 60))
    return "%d:%02d" % (m // 60, m % 60)


def dur(h):
    m = int(round(h * 60))
    return "%d ч %02d мин" % (m // 60, m % 60) if m >= 60 else "%d мин" % m


def parse_t(s):
    h, m = s.split(":")
    return int(h) + int(m) / 60.0


def sun_table(c):
    pts = []
    for key, n in HOURS:
        a, h = c.get("аз_" + key, ""), c.get("выс_" + key, "")
        if a == "" or h == "":
            continue
        a, h = float(a), float(h)
        if n == 0:
            pts.append((12.0, 0.0, h))
        else:
            pts.append((12.0 - n, a, h)); pts.append((12.0 + n, -a, h))
    tr, ts, ar = parse_t(c["восход"]), parse_t(c["закат"]), float(c["аз_восход"])
    pts += [(tr, ar, 0.0), (ts, -ar, 0.0)]
    pts.sort()
    return pts, tr, ts


def _cr(p0, p1, p2, p3, t0, t1, t2, t3, t):
    m1 = (p2 - p0) / (t2 - t0)
    m2 = (p3 - p1) / (t3 - t1)
    h = t2 - t1; s = (t - t1) / h
    h00 = 2 * s**3 - 3 * s**2 + 1; h10 = s**3 - 2 * s**2 + s
    h01 = -2 * s**3 + 3 * s**2; h11 = s**3 - s**2
    return h00 * p1 + h10 * h * m1 + h01 * p2 + h11 * h * m2


def sun_at(pts, t):
    if t <= pts[0][0] or t >= pts[-1][0]:
        return None
    n = len(pts)
    for i in range(n - 1):
        if pts[i][0] <= t <= pts[i + 1][0]:
            i0, i3 = max(i - 1, 0), min(i + 2, n - 1)
            T = [pts[j][0] for j in (i0, i, i + 1, i3)]
            if T[0] == T[1]: T[0] = T[1] - (T[2] - T[1])
            if T[3] == T[2]: T[3] = T[2] + (T[2] - T[1])
            def comp(k):
                P = [pts[j][k] for j in (i0, i, i + 1, i3)]
                if i0 == i: P[0] = 2 * P[1] - P[2]
                if i3 == i + 1: P[3] = 2 * P[2] - P[1]
                return _cr(P[0], P[1], P[2], P[3], T[0], T[1], T[2], T[3], t)
            return comp(1), max(comp(2), 0.0)


def time_of_az(pts, az):
    lo, hi = pts[0][0] + 1e-6, pts[-1][0] - 1e-6
    f = lambda t: sun_at(pts, t)[0] - az
    if f(lo) * f(hi) > 0:
        return None
    for _ in range(60):
        m = (lo + hi) / 2
        if f(lo) * f(m) <= 0: hi = m
        else: lo = m
    return (lo + hi) / 2


def sdir(az):
    r = math.radians(az)
    return math.sin(r), -math.cos(r)


def rot(p, deg):
    r = math.radians(deg); c, s = math.cos(r), math.sin(r)
    return (p[0] * c - p[1] * s, p[0] * s + p[1] * c)


def ray_poly(o, d, poly):
    tin, tout = -1e9, 1e9
    n = len(poly)
    cx = sum(p[0] for p in poly) / n; cy = sum(p[1] for p in poly) / n
    for i in range(n):
        a, b = poly[i], poly[(i + 1) % n]
        ex, ey = b[0] - a[0], b[1] - a[1]
        nx, ny = ey, -ex
        if (cx - a[0]) * nx + (cy - a[1]) * ny > 0:
            nx, ny = -nx, -ny
        den = d[0] * nx + d[1] * ny
        num = (a[0] - o[0]) * nx + (a[1] - o[1]) * ny
        if abs(den) < 1e-12:
            if num < 0:
                return None
            continue
        t = num / den
        if den < 0:
            tin = max(tin, t)
        else:
            tout = min(tout, t)
    if tin > tout or tout < 0:
        return None
    return max(tin, 0.0)


def shaded(o, az, alt, blds):
    d = sdir(az)
    ta = math.tan(math.radians(alt))
    for poly, H in blds:
        t = ray_poly(o, d, poly)
        if t is not None and t * ta < H:
            return True
    return False


def periods(pred, t0, t1, step=1 / 60.0):
    out, cur = [], None
    n = int(round((t1 - t0) / step))
    for i in range(n + 1):
        t = t0 + i * step
        ok = pred(t)
        if ok and cur is None:
            cur = t
        if not ok and cur is not None:
            out.append((cur, t)); cur = None
    if cur is not None:
        out.append((cur, t1))
    return [(a, b) for a, b in out if b - a > 1e-9]


def r5(t):
    return round(t * 12) / 12.0


def fmt_periods(ps):
    return ", ".join("%s–%s" % (hm(r5(a)), hm(r5(b))) for a, b in ps) if ps else "нет"


def norm_for(lat):
    if lat > 58: return 2.5, 1.5, "северная зона (севернее 58° с.ш.)"
    if lat >= 48: return 2.0, 1.0, "центральная зона (58–48° с.ш.)"
    return 1.5, 1.0, "южная зона (южнее 48° с.ш.)"


def verdict(ps, D):
    tot = sum(b - a for a, b in ps)
    mx = max([b - a for a, b in ps], default=0.0)
    if mx >= D - 1e-6:
        return tot, True, "непрерывно %s ≥ %s — соответствует СанПиН" % (dur(mx), dur(D))
    if len(ps) > 1 and mx >= 1.0 - 1e-6 and tot >= D + 0.5 - 1e-6:
        return tot, True, "прерывисто %s (≥ %s, период ≥ 1 ч) — соответствует СанПиН" % (dur(tot), dur(D + 0.5))
    return tot, False, "не соответствует СанПиН (нужно непрерывно ≥ %s или прерывисто ≥ %s)" % (dur(D), dur(D + 0.5))


def solve(city, var, lat):
    pts, tr, ts = sun_table(city)
    D, excl, zone = norm_for(lat)
    t0, t1 = tr + excl, ts - excl
    A0, L, H, l = (float(var["схема_%d" % k]) for k in range(1, 5))
    H1, H2, H3 = float(var["H1"]), float(var["H2"]), float(var["H3"])
    h_ok, b_ok = float(var["окно_1"]), float(var["окно_2"])
    rotd = float(city["разворот"])
    R = {"город": city["название"], "широта": lat, "норма": D, "зона": zone, "учёт": (t0, t1)}

    n = sdir(A0); u = (-math.cos(math.radians(A0)), -math.sin(math.radians(A0)))
    def P(s, q): return (s * u[0] + q * n[0], s * u[1] + q * n[1])
    b1 = [P(l - 60, L), P(l, L), P(l, L + 12), P(l - 60, L + 12)]
    sun = lambda t: sun_at(pts, t)
    def lit(o, blds, extra=None):
        def f(t):
            s = sun(t)
            if s is None or s[1] <= 0: return False
            if extra and not extra(s): return False
            return not shaded(o, s[0], s[1], blds)
        return f
    ps = periods(lit((0, 0), [(b1, H)]), t0, t1)
    sh = periods(lambda t: sun(t) is not None and shaded((0, 0), sun(t)[0], sun(t)[1], [(b1, H)]), t0, t1)
    R["з4"] = dict(shade=sh, lit=ps, total=sum(b - a for a, b in ps))

    RT = (60.0, 69.0)
    raw = [([(0, 28), (12, 28), (12, 102), (0, 102)], H1),
           ([(12, 0), (108, 0), (108, 12), (12, 12)], H2),
           ([(108, 28), (120, 28), (120, 102), (108, 102)], H3)]
    def place(p, origin): return rot((p[0] - origin[0], p[1] - origin[1]), rotd)
    blds = [([place(p, RT) for p in poly], h) for poly, h in raw]
    ps = periods(lit((0, 0), blds), t0, t1)
    R["з6"] = dict(lit=ps, total=sum(b - a for a, b in ps))

    n_az = 90.0 + rotd
    dw = math.degrees(math.atan((WALL / 2) / b_ok))
    vw = math.degrees(math.atan(h_ok / (WALL / 2)))
    dl = math.degrees(math.atan((LOG_D + WALL / 2) / (LOG_W / 2 + b_ok / 2)))
    vl = math.degrees(math.atan((h_ok + TOP) / (LOG_D + WALL / 2)))
    R["углы"] = dict(окно_г=180 - 2 * dw, окно_в=vw, лоджия_г=180 - 2 * dl, лоджия_в=vl)
    for key, pt in (("РТ1", (12, 92)), ("РТ2", (12, 40))):
        o = place(pt, RT)
        others = [blds[1], blds[2]]
        for kind, dd, vv in (("окно", dw, vw), ("лоджия", dl, vl)):
            win = lambda s, dd=dd, vv=vv: abs(((s[0] - n_az + 180) % 360) - 180) < 90 - dd and s[1] < vv
            p8 = periods(lit(o, others, win), t0, t1)
            tot, okk, txt = verdict(p8, D)
            R["з8_%s_%s" % (key, kind)] = dict(lit=p8, total=tot, ok=okk, txt=txt)

    ag = dw
    az_B = A0 - 90 + ag
    tB = time_of_az(pts, az_B)
    tV = tB - D if tB is not None else None
    azV = sun_at(pts, tV)[0] if tV is not None and sun_at(pts, tV) else None
    R["з10"] = dict(a_giz=ag, tB=tB, tV=tV, azB=az_B, azV=azV)
    return R


def lines(R, v):
    out = []
    z4 = R["з4"]; z6 = R["з6"]; z10 = R["з10"]
    out.append("ВЫВОДЫ · вариант %s · %s, %.1f° с.ш., %s; норма непрерывной инсоляции %s" % (v, R["город"], R["широта"], R["зона"], dur(R["норма"])))
    out.append("Учётное время: %s–%s (без первого часа после восхода и последнего перед закатом)" % (hm(R["учёт"][0]), hm(R["учёт"][1])))
    out.append("Задачи 4–5 · точка вблизи затеняющего здания: РТ затеняется %s; инсолируется %s, всего %s." % (fmt_periods(z4["shade"]), fmt_periods(z4["lit"]), dur(z4["total"])))
    out.append("Задачи 6–7 · РТ на детской площадке: инсолируется %s, всего %s (для площадок норма — 3 ч на 50 %% площади)." % (fmt_periods(z6["lit"]), dur(z6["total"])))
    a = R["углы"]
    out.append("Задачи 8–9 · инсоляционные углы: окно %.0f° / %.0f°, окно с лоджией %.0f° / %.0f° (гориз. / верт.)." % (a["окно_г"], a["окно_в"], a["лоджия_г"], a["лоджия_в"]))
    for k in ("РТ1", "РТ2"):
        for kind, name in (("окно", "окно без лоджии"), ("лоджия", "окно с лоджией")):
            r = R["з8_%s_%s" % (k, kind)]
            out.append("  %s, %s: %s — %s." % (k, name, fmt_periods(r["lit"]), r["txt"]))
    if z10["tB"] is not None:
        out.append("Задача 10 · ГИЗ: a_гиз = %.0f°; конец инсоляции Б = %s (A₀ = %.1f°), начало В = Б − %s = %s (A₀ = %.1f°)." % (
            z10["a_giz"], hm(r5(z10["tB"])), z10["azB"], dur(R["норма"]), hm(r5(z10["tV"])), z10["azV"] if z10["azV"] is not None else float("nan")))
    return out


import os
import System
import Rhino
import Rhino.Geometry as rg

with open(path, encoding="utf-8-sig", newline="") as f:
    rows = list(csv.DictReader(f))
def find(kind, code):
    for r in rows:
        if r["тип"].strip() == kind and r["код"].strip() == str(code).strip():
            return r
    raise ValueError("нет строки: тип=%s код=%s" % (kind, code))
C = find("город", Y); V = find("вариант", Z)
lat = float(C["широта"])
R = solve(C, V, lat)
vv = str(v).strip()
L = lines(R, vv)
full = "\n".join(L)

try:
    d = os.path.join(os.path.dirname(path), "vars")
    if not os.path.isdir(d): os.makedirs(d)
    with open(os.path.join(d, "выводы_%s.txt" % vv), "w", encoding="utf-8") as f:
        f.write(full + "\n")
except Exception as e:
    print("файл не записан:", e)

z = R["з10"]
ang = None
if ray is not None and z["azV"] is not None:
    p0, p1 = ray.PointAtStart, ray.PointAtEnd
    if p0.DistanceTo(rg.Point3d(0, 0, 0)) > p1.DistanceTo(rg.Point3d(0, 0, 0)):
        p0, p1 = p1, p0
    az_ray = math.degrees(math.atan2(p1.X - p0.X, -(p1.Y - p0.Y)))
    ang = math.radians(z["azV"] - az_ray)

# стиль текста для блока выводов: текущий стиль документа, текст крупнее в 4 раза
doc = Rhino.RhinoDoc.ActiveDoc
cur = doc.DimStyles.Current
BIG = "Выводы"
if doc.DimStyles.FindName(BIG) is None:
    nd = cur.Duplicate(BIG, System.Guid.Empty, System.Guid.Empty)
    nd.TextHeight = cur.TextHeight * 4
    doc.DimStyles.Add(nd, False)

A0 = float(V["схема_1"])
U = (0.0, -1950.0)
B = (U[0] - 60 * math.cos(math.radians(A0)), U[1] - 60 * math.sin(math.radians(A0)))
T, P, text = [full], [rg.Plane(rg.Point3d(460.0, -1720.0, 0), rg.Vector3d.ZAxis)], [BIG]
for name, tt, dx, dy in (("Б", z["tB"], -11.0, 1.5), ("В", z["tV"], -2.0, -6.0)):
    if tt is None: continue
    s = sun_at(sun_table(C)[0], tt)
    x, y = sdir(s[0])
    dd = min(80.0 / math.tan(math.radians(max(s[1], 1))), 77.8 / max(-y, 0.2))
    T.append("%s %s" % (name, hm(r5(tt))))
    P.append(rg.Plane(rg.Point3d(B[0] + x * dd + dx, B[1] + y * dd + dy, 0), rg.Vector3d.ZAxis))
    text.append(cur.Name)
out = L
# ---------- end выводы ----------

# ---- group: Ф14 [лист 0,-1250] — застройка с лучами (2) (continued)
ф2_cluster_text_3 = Data(cluster_6)
ф7_extrude_point_2 = Data(extrude_point_3)
ф2_construct_point_5 = Data(construct_point_19)
ф1_rectangle_rectangle = Data(rectangle_4.Rectangle)
offset_curve = OffsetCurve(Curve=ф1_rectangle_rectangle, Distance=-2, Corners=1)

# ---- group: Ф16 [лист 0,-1950] — ГИЗ, задача 10 (граница В = Б − норма из «ВЫВОДЫ») (continued)
rotate_12 = Rotate(Geometry=list_item_9, Angle=выводы.ang, Plane=PlaneXY(0, 0, 0))  # -> Geometry, Transform
scale_5 = Scale(Geometry=rotate_12.Geometry, Center=Point(0, 0, 0), Factor=10)  # -> Geometry, Transform
join_curves_2 = JoinCurves(Curves=flatten([scale_4.Geometry, scale_5.Geometry]), Preserve=False)
explode_2 = Explode(Curve=join_curves_2, Recursive=True)  # -> Segments, Vertices
surface_curve_9 = SurfaceCurve(Surface=boundary_surfaces_9, Curve=join_curves_2)  # -> Curves, Points, UVPoints, Normals, Parameters, Tangents
polyline_3 = PolyLine(Vertices=explode_2.Vertices, Closed=True)
move_15 = Move(Geometry=[surface_curve_9.Curves, geometry_19], Motion=vector_xyz_9.Vector)  # -> Geometry, Transform
boundary_surfaces_10 = BoundarySurfaces(Edges=polyline_3)
region_intersection_2 = RegionIntersection(CurvesA=extrude_point_4, CurvesB=boundary_surfaces_10)
boundary_surfaces_11 = BoundarySurfaces(Edges=region_intersection_2)
extrude_4 = Extrude(Base=boundary_surfaces_11, Direction=vector_2pt_9.Vector)
move_16 = Move(Geometry=extrude_4, Motion=vector_xyz_9.Vector)  # -> Geometry, Transform

# ---- group: Ф1 [лист 0,-200] — план-сетка: солнечные лучи по часам (continued)
ф15_insert_items = Data(insert_items_2)
textobject = TextObject(Plane=xy_plane_2, Text=graft(ф15_insert_items), Size=5, Height=5, Font="Arial", UseTasks=True)

# ---- group: Ф2 [лист 300,-200] — план-сетка: тень стержня (continued)
ф1_circle_cnr_3 = Data(circle_cnr)
ф15_length = Data(length_2)
ф1_surface_curve_curves = Data(surface_curve.Curves)
ф1_surface_curve_curves_2 = Data(surface_curve_2.Curves)
ф1_rectangle_rectangle_2 = Data(rectangle_3.Rectangle)
cull_index_4 = CullIndex(List=ф15_length, Indices=indices, Wrap=True)
insert_items_5 = InsertItems(List=cull_index_4, Item=null_placeholder, Indices=indices, Wrap=True)
ф7_series = Data(series_5)
list_length_4 = ListLength(List=insert_items_5)
merge_4 = Merge(Data1=series_3, Data2=ф7_series)
sort_list = SortList(Keys=merge_4)  # -> Keys, ValuesValuesA
ф16_subtraction = Data(subtraction_7)
list_item_10 = ListItem(List=geometry_13, Index=ф16_subtraction, Wrap=True)
ф1_boundary_surfaces = Data(boundary_surfaces_4)
surface_curve_10 = SurfaceCurve(Surface=ф1_boundary_surfaces, Curve=list_item_4)  # -> Curves, Points, UVPoints, Normals, Parameters, Tangents
offset_curve_2 = OffsetCurve(Curve=surface_curve_10.Curves, Plane=PlaneXY(0, 0, 0), Distance=0.5, BothSides=-0.5, Kinks=0, CapType=1)
relay_2 = Relay([offset_curve_2, join_curves])
move_17 = Move(Geometry=relay_2, Motion=vector_xyz_12.Vector)  # -> Geometry, Transform

# ---- group: Ф15 [лист 0,-1500] — круговая карта с заливкой (continued)
ф2_list_length_4 = Data(list_length_4)
division_12 = Division(A=ф2_list_length_4, B=2)
ф2_insert_items = Data(insert_items_5)
round_3 = Round(Number=division_12)  # -> Nearest, Floor, Ceiling
split_list_3 = SplitList(List=ф2_insert_items, Index=round_3.Ceiling)  # -> simplify(ListA), ListB
cull_index_5 = CullIndex(List=split_list_3.ListA, Indices=0, Wrap=True)
insert_items_6 = InsertItems(List=cull_index_5, Item=graft(ф2_series), Indices=0, Wrap=True)
panel_34 = Panel(insert_items_6)

# ---- group: Ф16 [лист 0,-1950] — ГИЗ, задача 10 (граница В = Б − норма из «ВЫВОДЫ») (continued)
ф2_list_item_2 = Data(list_item_10)
move_18 = Move(Geometry=ф2_list_item_2, Motion=vector_xyz_13.Vector)  # -> Geometry, Transform
cluster_8 = Cluster(relay=ф2_replace_text, relay_2=move_18.Geometry)
geometry_21 = Geometry(flatten(cluster_8))
mirror = Mirror(Geometry=geometry_21, Plane=PlaneYZ(0, 0, 0))  # -> Geometry, Transform
center_2 = Center(Geometric=mirror.Geometry)  # -> Center, Dimension
yz_plane = YZPlane(Origin=center_2.Center)
mirror_2 = Mirror(Geometry=mirror.Geometry, Plane=yz_plane)  # -> Geometry, Transform
move_19 = Move(Geometry=mirror_2.Geometry, Motion=unit_x)  # -> Geometry, Transform
move_20 = Move(Geometry=move_19.Geometry, Motion=rotate_4)  # -> Geometry, Transform

# ---- group: Ф1 [лист 0,-200] — план-сетка: солнечные лучи по часам (continued)
ф16_cluster_text = Data(cluster_8)

# ---- group: Ф5 [лист 300,-350] — тень стержня: азимут Ао и длина L (continued)
ф15_insert_items_2 = Data(insert_items_2)
ф15_panel_2 = Data(panel_33)
ф4_move_geometry_3 = Data(move_9.Geometry)
ф4_move_geometry_4 = Data(move_10.Geometry)
ф2_extrude_2 = Data(extrude)
ф4_construct_point_3 = Data(construct_point_21)
ф4_construct_point_4 = Data(construct_point_22)
ф2_construct_point_6 = Data(construct_point_19)
ф4_rectangle_rectangle = Data(rectangle_5.Rectangle)
create_csv = CreateCSV(DataGridHeaders=ф15_insert_items_2, ValueTree=ф15_panel_2, Delimiter=",")
merge_5 = Merge(Data1=ф4_move_geometry, Data2=ф4_move_geometry_2, Data3=ф4_move_geometry_3, Data4=ф4_move_geometry_4)
merge_6 = Merge(Data1=ф4_construct_point, Data2=ф4_construct_point_2, Data3=ф4_construct_point_3, Data4=ф4_construct_point_4)  # -> flatten(Result)
extrude_point_5 = ExtrudePoint(Base=ф2_extrude_2, Point=ф2_construct_point_6)
ф4_line = Data(line_5)
ф4_line_2 = Data(line_6)
vector_2pt_10 = Vector2Pt(PointA=construct_point_15, PointB=merge_6, Unitize=True)  # -> Vector, Length
surface_curve_11 = SurfaceCurve(Surface=ф4_rectangle_rectangle, Curve=merge_5)  # -> Curves, Points, UVPoints, Normals, Parameters, Tangents
move_21 = Move(Geometry=ф2_extrude_2, Motion=vector_xyz_10.Vector)  # -> Geometry, Transform
deconstruct_brep = DeconstructBrep(Brep=extrude_point_5)  # -> Faces, Edges, Vertices
panel_35 = Panel(create_csv)
merge_7 = Merge(Data1=surface_curve_11.Curves, Data2=ф4_line, Data3=ф4_line_2)
amplitude_4 = Amplitude(Vector=vector_2pt_10.Vector, Amplitude=5)
region_union = RegionUnion(Curves=deconstruct_brep.Faces)
brep_edges_4 = BrepEdges(Brep=region_union)  # -> Naked, Interior, NonManifold
move_22 = Move(Geometry=merge_6, Motion=amplitude_4)  # -> Geometry, Transform
ф2_end_points_start = Data(end_points_4.Start)
ф2_end_points_end = Data(end_points_4.End)
end_points_10 = EndPoints(Curve=brep_edges_4.Naked)  # -> Start, End
cluster_9 = Cluster(relay=panel_29, relay_2=move_22.Geometry)
distance = Distance(PointA=end_points_10.Start, PointB=construct_point_15)
distance_2 = Distance(PointA=end_points_10.End, PointB=construct_point_15)
define_linear_dimension_3 = DefineLinearDimension(Point1=end_points_2.End, Point2=ф2_end_points_end, Offset=5, internalize=False)
define_linear_dimension_4 = DefineLinearDimension(Point1=ф2_end_points_start, Point2=end_points_2.End, Offset=5, internalize=False)
multiplication_4 = Multiplication(A=distance, B=distance_2)
round_4 = Round(Number=multiplication_4)  # -> Nearest, Floor, Ceiling
line_sdl_5 = LineSDL(Start=ф2_end_points_end, Direction=amplitude, Length=number_slider_3)
equality = Equality(FirstNumber=round_4.Nearest, SecondNumber=0)  # -> Equality, Inequality
end_points_11 = EndPoints(Curve=line_sdl_5)  # -> Start, End
cull_pattern_3 = CullPattern(List=brep_edges_4.Naked, CullPattern=equality.Equality)
end_points_12 = EndPoints(Curve=cull_pattern_3)  # -> Start, End
merge_8 = Merge(Data1=end_points_12.Start, Data2=end_points_12.End)
deconstruct_2 = Deconstruct(Point=merge_8)  # -> XComponent, YComponent, ZComponent
sort_list_2 = SortList(Keys=deconstruct_2.YComponent, ValuesValuesA=merge_8)  # -> Keys, ValuesValuesA
deconstruct_3 = Deconstruct(Point=sort_list_2.ValuesValuesA)  # -> XComponent, YComponent, ZComponent
round_5 = Round(Number=deconstruct_3.XComponent)  # -> Nearest, Floor, Ceiling
equality_2 = Equality(FirstNumber=round_5.Nearest, SecondNumber=0)  # -> Equality, Inequality
cull_pattern_4 = CullPattern(List=sort_list_2.ValuesValuesA, CullPattern=equality_2.Inequality)
explode_tree = ExplodeTree(Data=graft(cull_pattern_4))  # -> flatten(_10000), flatten(_10001)
define_angular_dimension_3 = DefineAngularDimension(Origin=construct_point_15, Point1=explode_tree._10000, Point2=end_points_2.End, Offset="50", internalize=False)
define_angular_dimension_4 = DefineAngularDimension(Origin=construct_point_15, Point1=explode_tree._10001, Point2=end_points_2.End, Offset="50", internalize=False)
cluster_10 = Cluster_2(point_b=explode_tree._10000, point_b_2=end_points_2.End)
cluster_11 = Cluster_2(point_b=explode_tree._10001, point_b_2=end_points_2.End)
ф2_define_linear_dimension_2 = Data(define_linear_dimension_2)
ф4_cluster_text = Data(cluster_7)
ф2_brep_edges_naked_2 = Data(brep_edges.Naked)
cull_pattern_5 = CullPattern(List=define_angular_dimension_3, CullPattern=cluster_10)
cull_pattern_6 = CullPattern(List=define_angular_dimension_4, CullPattern=cluster_11)

# ---- group: Ф4 [лист 0,-350] — тень стержня: азимут Ао (continued)
ф5_merge = Data(merge_7)
ф5_define_linear_dimension_3 = Data(define_linear_dimension_3)
ф5_define_linear_dimension_4 = Data(define_linear_dimension_4)
ф5_cluster_text = Data(cluster_9)

# ---- group: Ф2 [лист 300,-200] — план-сетка: тень стержня (continued)
ф5_end_points_start = Data(end_points_11.Start)
ф5_end_points_end = Data(end_points_11.End)
ф16_cluster_text_2 = Data(cluster_8)
define_linear_dimension_5 = DefineLinearDimension(Point1=ф5_end_points_start, Point2=ф5_end_points_end, Offset=13, internalize=False)
ф5_define_linear_dimension_5 = Data(define_linear_dimension_3)
ф5_define_linear_dimension_6 = Data(define_linear_dimension_4)
relay_3 = Relay([define_linear_dimension_5, define_linear_dimension_2, ф5_define_linear_dimension_5, ф5_define_linear_dimension_6, ф5_define_linear_dimension_2, ф5_define_angular_dimension_2, ф5_rotate_geometry_2, brep_edges.Naked, cluster_6])
custom_preview = CustomPreview(
    Geometry=[define_linear_dimension_5, define_linear_dimension_2, ф5_define_linear_dimension_5, ф5_define_linear_dimension_6, ф5_define_linear_dimension_2, ф5_define_angular_dimension_2, ф5_rotate_geometry_2],
    Material=colour_swatch_6)
move_23 = Move(Geometry=relay_3, Motion=vector_xyz_12.Vector)  # -> Geometry, Transform

# ---- group: Ф4 [лист 0,-350] — тень стержня: азимут Ао (continued)
ф2_define_linear_dimension_3 = Data(define_linear_dimension_5)
relay_4 = Relay([ф2_define_linear_dimension_3, ф2_define_linear_dimension, ф5_define_linear_dimension_3, ф5_define_linear_dimension_4, ф5_define_linear_dimension, ф5_define_angular_dimension, ф5_rotate_geometry, ф5_cluster_text, ф5_merge, cluster_7, ф2_brep_edges_naked])
move_24 = Move(Geometry=relay_4, Motion=vector_xyz_11.Vector)  # -> Geometry, Transform

# ---- group: Ф5 [лист 300,-350] — тень стержня: азимут Ао и длина L (continued)
ф2_define_linear_dimension_4 = Data(define_linear_dimension_5)
relay_5 = Relay([ф2_define_linear_dimension_4, ф2_define_linear_dimension_2, define_linear_dimension_3, define_linear_dimension_4, define_linear_dimension, define_angular_dimension, rotate_6.Geometry, cluster_9, merge_7, ф4_cluster_text, ф2_brep_edges_naked_2, cull_pattern_5, cull_pattern_6, cull_pattern_3])
move_25 = Move(Geometry=relay_5, Motion=vector_xyz_10.Vector)  # -> Geometry, Transform

# ---- group: Ф8 [лист 300,-800] — узел/разрез здания с углами
cluster_12 = Cluster_3()  # -> rectangle_4, radians_2, result, start, point
panel_36 = Panel("""{-1, 0, 0}
{0, -1, 0}
{1, 0, 0}""")
construct_point_23 = ConstructPoint(XCoordinate=0, YCoordinate=0, ZCoordinate=0)
panel_37 = Panel("{0, 1, 0}")
panel_38 = Panel("{0, 0, 0}")
geometry_22 = Geometry([Point(-53.84072505, -35.33690196, 0), Point(-41.29387573, -63.06513528, 0), Point(54.02418344, -35.64165441, 0)])
construct_point_24 = ConstructPoint(XCoordinate=0, YCoordinate=1, ZCoordinate=0)
geometry_23 = Geometry(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)
ввод_explode_tree_9 = Data(данные.rot)
panel_39 = Panel("""1
2
3""")
panel_40 = Panel("""1
2
3""")
ф2_construct_point_7 = Data(construct_point_19)
curve_closest_point = CurveClosestPoint(Point=construct_point_23, Curve=cluster_12.result)  # -> Point, Parameter, Distance
explode_tree_2 = ExplodeTree(Data=graft(panel_36))  # -> Branch0, Branch1, Branch2
geometry_24 = Geometry(construct_point_24)
extrude_point_6 = ExtrudePoint(Base=cluster_12.result, Point=ф2_construct_point_7)
replace_text_4 = ReplaceText(Text="L.=,м", Find=".", Replace=panel_39, RecursiveReplace=False)
subtraction_8 = Subtraction(A="95", B=5)
explode_3 = Explode(Curve=geometry_23, Recursive=True)  # -> Segments, Vertices
replace_text_5 = ReplaceText(Text="H.=,м", Find=".", Replace=panel_40, RecursiveReplace=False)
radians_4 = Radians(Degrees=ввод_explode_tree_9)
ф7_panel_40_50_30 = Data(panel_17)
geometry_25 = Geometry(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)
line_8 = Line(StartPoint=construct_point_23, EndPoint=curve_closest_point.Point)
project_3 = Project(Geometry=extrude_point_6, Plane=PlaneXY(0, 0, 0))  # -> Geometry, Transform
replace_text_6 = ReplaceText(Text=replace_text_5, Find=",", Replace=ф7_panel_40_50_30, RecursiveReplace=False)
negative_4 = Negative(Value=radians_4)
panel_41 = Panel("""pi/2
0
pi/2""")
length_3 = Length(Curve=line_8)
deconstruct_brep_2 = DeconstructBrep(Brep=project_3.Geometry)  # -> Faces, Edges, Vertices
rotate_13 = Rotate(Geometry=geometry_25, Angle=negative_4, Plane=PlaneXY(0, 0, 0))  # -> Geometry, Transform
rotate_14 = Rotate(Geometry=geometry_24, Angle=negative_4, Plane=PlaneXY(0, 0, 0))  # -> Geometry, Transform
cluster_13 = Cluster(relay=replace_text_6, relay_2=explode_3.Vertices)
sort_list_3 = SortList(Keys=length_3, ValuesValuesA=curve_closest_point.Point)  # -> Keys, ValuesValuesA
region_union_2 = RegionUnion(Curves=deconstruct_brep_2.Faces)
replace_text_7 = ReplaceText(Text=replace_text_4, Find=",", Replace=length_3, RecursiveReplace=False)
rotate_3d = Rotate3D(Geometry=cluster_13, Angle=panel_41, Center=explode_3.Vertices, Axis=Vector(0, 0, 1))  # -> Geometry, Transform
list_item_11 = ListItem(List=sort_list_3.ValuesValuesA, Index=[0, 1], Wrap=True)
deconstruct_brep_3 = DeconstructBrep(Brep=region_union_2)  # -> Faces, Edges, Vertices
define_linear_dimension_6 = DefineLinearDimension(Point1=construct_point_23, Point2=curve_closest_point.Point, Offset=0, OverwriteText=replace_text_7, internalize=False)
ф5_construct_point_2 = Data(construct_point_15)
end_points_13 = EndPoints(Curve=deconstruct_brep_3.Edges)  # -> Start, End
define_angular_dimension_5 = DefineAngularDimension(Origin=ф5_construct_point_2, Point1=rotate_14.Geometry, Point2=list_item_11, Offset=7, internalize=False)
distance_3 = Distance(PointA=end_points_13.Start, PointB=construct_point_23)
distance_4 = Distance(PointA=end_points_13.End, PointB=construct_point_23)
multiplication_5 = Multiplication(A=distance_3, B=distance_4)
round_6 = Round(Number=multiplication_5)  # -> Nearest, Floor, Ceiling
equality_3 = Equality(FirstNumber=round_6.Nearest, SecondNumber=0)  # -> Equality, Inequality
cull_pattern_7 = CullPattern(List=deconstruct_brep_3.Edges, CullPattern=equality_3.Equality)
cluster_14 = Cluster_4(curve=cull_pattern_7)
explode_tree_3 = ExplodeTree(Data=cluster_14)  # -> Branch0, Branch1, Branch2, Branch3, Branch4, Branch5
geometry_26 = Geometry(flatten(cluster_14))
define_angular_dimension_6 = DefineAngularDimension(
    Origin=ф5_construct_point_2,
    Point1=explode_tree_2.Branch0,
    Point2=explode_tree_3.Branch0,
    Offset="43",
    internalize=False)
define_angular_dimension_7 = DefineAngularDimension(
    Origin=ф5_construct_point_2,
    Point1=explode_tree_3.Branch1,
    Point2=explode_tree_2.Branch0,
    Offset="43",
    internalize=False)
define_angular_dimension_8 = DefineAngularDimension(
    Origin=ф5_construct_point_2,
    Point1=explode_tree_2.Branch1,
    Point2=explode_tree_3.Branch2,
    Offset="43",
    internalize=False)
define_angular_dimension_9 = DefineAngularDimension(
    Origin=ф5_construct_point_2,
    Point1=explode_tree_3.Branch3,
    Point2=explode_tree_2.Branch1,
    Offset="43",
    internalize=False)
define_angular_dimension_10 = DefineAngularDimension(
    Origin=ф5_construct_point_2,
    Point1=explode_tree_3.Branch4,
    Point2=explode_tree_2.Branch2,
    Offset="43",
    internalize=False)
define_angular_dimension_11 = DefineAngularDimension(
    Origin=ф5_construct_point_2,
    Point1=explode_tree_3.Branch5,
    Point2=explode_tree_2.Branch2,
    Offset="43",
    internalize=False)
vector_2pt_11 = Vector2Pt(PointA=construct_point_23, PointB=geometry_26, Unitize=True)  # -> Vector, Length
merge_9 = Merge(Data1=define_angular_dimension_6, Data2=define_angular_dimension_7)
merge_10 = Merge(Data1=define_angular_dimension_8, Data2=define_angular_dimension_9)
line_sdl_6 = LineSDL(Start=construct_point_23, Direction=vector_2pt_11.Vector, Length=subtraction_8)
line_sdl_7 = LineSDL(Start=construct_point_23, Direction=vector_2pt_11.Vector, Length="95")
merge_11 = Merge(Data1=define_angular_dimension_10, Data2=define_angular_dimension_11)
entwine = Entwine(Branch00=merge_9, Branch01=merge_10, Branch02=merge_11, FlattenInputs=True)
end_points_14 = EndPoints(Curve=line_sdl_7)  # -> Start, End
circle_cnr_3 = CircleCNR(Center=end_points_14.End, Normal=Vector(0, 0, 1), Radius=5)
center_3 = Center(Geometric=circle_cnr_3)  # -> Center, Dimension
geometry_27 = Geometry([line_sdl_6, circle_cnr_3])
sort_points_polar = SortPointsPolar(Points=center_3.Center, ReferncePlane=PlaneXY(0, 0, 0))  # -> SortedPoints, SortedValues
shift_list_2 = ShiftList(List=sort_points_polar.SortedPoints, Shift=Slider(5, range=0..6), Wrap=True)
panel_42 = Panel("""1
2
3
4
5
6""")
_21 = Cluster(relay=panel_42, relay_2=shift_list_2)
vector_xyz_14 = VectorXYZ(XComponent=300, YComponent=-800, ZComponent=0)  # -> Vector, Length

# ---- group: Ф13 [лист 0,-1000] — застройка с лучами (1) (continued)
ф8_cluster_start = Data(cluster_12.start)
ф8_radians = Data(radians_4)
ф8_cluster_result = Data(cluster_12.result)
rotate_15 = Rotate(Geometry=ф14_merge, Angle=ф8_radians, Plane=PlaneXY(0, 0, 0))  # -> Geometry, Transform

# ---- group: Ф7 [лист 0,-800] — схема застройки на сетке (continued)
ф8_cluster_result_2 = Data(cluster_12.result)
ф8_radians_2 = Data(radians_4)
ф8_cluster_rectangle = Data(cluster_12.rectangle_4)
ф8_geometry = Data(geometry_22)
ф8_cluster_text = Data(cluster_13)
ф8_explode_vertices = Data(explode_3.Vertices)
cluster_15 = Cluster(relay=panel_15, relay_2=ф8_geometry)
rotate_16 = Rotate(Geometry=ф8_cluster_result_2, Angle=ф8_radians_2, Plane=PlaneXY(0, 0, 0))  # -> Geometry, Transform
rotate_3d_2 = Rotate3D(Geometry=ф8_cluster_text, Angle=panel_16, Center=ф8_explode_vertices, Axis=Vector(0, 0, 1))  # -> Geometry, Transform
rotate_17 = Rotate(Geometry=ф8_cluster_rectangle, Angle=ф8_radians_2, Plane=PlaneXY(0, 0, 0))  # -> Geometry, Transform
rotate_18 = Rotate(Geometry=cluster_15, Angle=ф8_radians_2, Plane=PlaneXY(0, 0, 0))  # -> Geometry, Transform
rotate_19 = Rotate(Geometry=simplify(rotate_3d_2.Geometry), Angle=simplify(graft(ф8_radians_2)), Plane=PlaneXY(0, 0, 0))  # -> Geometry, Transform
region_intersection_3 = RegionIntersection(CurvesA=graft(rotate_16.Geometry), CurvesB=graft(extrude_point_3))
project_4 = Project(Geometry=region_intersection_3, Plane=PlaneXY(0, 0, 0))  # -> flatten(Geometry), Transform
extrude_point_7 = ExtrudePoint(Base=region_intersection_3, Point=ф2_construct_point_2)
geometry_28 = Geometry(project_4.Geometry)
boundary_surfaces_12 = BoundarySurfaces(Edges=project_4.Geometry)
brep_edges_5 = BrepEdges(Brep=extrude_point_7)  # -> Naked, Interior, NonManifold
boundary_surfaces_13 = BoundarySurfaces(Edges=geometry_28)
project_5 = Project(Geometry=[brep_edges_5.Naked, brep_edges_5.Interior], Plane=PlaneXY(0, 0, 0))  # -> Geometry, Transform
geometry_29 = Geometry(boundary_surfaces_13)
removeduplicatelines_3 = RemoveDuplicateLines(Lines=project_5.Geometry, Tolerance=0.01)  # -> flatten(UniqueLines)
move_26 = Move(Geometry=geometry_29, Motion=vector_xyz_5.Vector)  # -> Geometry, Transform
boundary_surfaces_14 = BoundarySurfaces(Edges=removeduplicatelines_3)
region_union_3 = RegionUnion(Curves=boundary_surfaces_14)
project_6 = Project(Geometry=region_union_3, Plane=PlaneXY(0, 0, 0))  # -> flatten(Geometry), Transform
boundary_surfaces_15 = BoundarySurfaces(Edges=project_6.Geometry)
region_difference_3 = RegionDifference(CurvesA=boundary_surfaces_15, CurvesB=boundary_surfaces_12)
boundary_surfaces_16 = BoundarySurfaces(Edges=region_difference_3)
geometry_30 = Geometry(boundary_surfaces_16)
move_27 = Move(Geometry=geometry_30, Motion=vector_xyz_5.Vector)  # -> Geometry, Transform

# ---- group: Ф8 [лист 300,-800] — узел/разрез здания с углами (continued)
ф7_cluster_text = Data(cluster_15)
geometry_31 = Geometry([cluster_12.rectangle_4, cluster_12.result, ф7_cluster_text, construct_point_23, rotate_13.Geometry, entwine, define_linear_dimension_6, define_angular_dimension_5, line_sdl_6, geometry_27, _21, rotate_3d.Geometry])
move_28 = Move(Geometry=geometry_31, Motion=vector_xyz_14.Vector)  # -> Geometry, Transform

# ---- group: Ф13 [лист 0,-1000] — застройка с лучами (1) (continued)
ф7_rotate_geometry = Data(rotate_19.Geometry)
ф7_rotate_geometry_2 = Data(rotate_18.Geometry)
ф7_rotate_geometry_3 = Data(rotate_16.Geometry)
ф7_rotate_geometry_4 = Data(rotate_17.Geometry)

# ---- group: Ф14 [лист 0,-1250] — застройка с лучами (2) (continued)
ф7_rotate_geometry_5 = Data(rotate_19.Geometry)
ф7_rotate_geometry_6 = Data(rotate_18.Geometry)
ф7_rotate_geometry_7 = Data(rotate_16.Geometry)
ф7_rotate_geometry_8 = Data(rotate_17.Geometry)
ф8_cluster_end = Data(cluster_12.point)
ф8_radians_3 = Data(radians_4)
ф8_cluster_result_3 = Data(cluster_12.result)
rotate_20 = Rotate(Geometry=scale_2.Geometry, Angle=ф8_radians_3, Plane=PlaneXY(0, 0, 0))  # -> Geometry, Transform
surface_curve_12 = SurfaceCurve(Surface=offset_curve, Curve=rotate_20.Geometry)  # -> Curves, Points, UVPoints, Normals, Parameters, Tangents
curve_curve = CurveCurve(CurveA=ф1_rectangle_rectangle, CurveB=rotate_20.Geometry)  # -> Points, ParamsA, ParamsB
vector_2pt_12 = Vector2Pt(PointA=construct_point_13, PointB=curve_curve.Points, Unitize=False)  # -> Vector, Length
move_29 = Move(Geometry=geometry_7, Motion=vector_2pt_12.Vector)  # -> Geometry, Transform

# ---- group: Ф13 [лист 0,-1000] — застройка с лучами (1) (continued)
ф14_move_geometry = Data(move_29.Geometry)
ф14_surface_curve_curves = Data(surface_curve_12.Curves)
boundary_surfaces_17 = BoundarySurfaces(Edges=ф14_move_geometry)
relay_6 = Relay([rotate_15.Geometry, ф14_surface_curve_curves, ф14_move_geometry])

# ---- group: Ф14 [лист 0,-1250] — застройка с лучами (2) (continued)
ф13_relay = Data(relay_6)

# ---- group: Ф9 [лист 600,-800] — инсоляционный график (полукруг) №1
ф8_panel_1_0_0_0 = Data(panel_36)
ф15_vector_xyz_vector = Data(vector_xyz_2.Vector)
ф15_vector_xyz_vector_2 = Data(vector_xyz_3.Vector)
ф7_panel_40_50_30_2 = Data(panel_17)
vector_angle = VectorAngle(Vector1=ф8_panel_1_0_0_0, Vector2="{0, -1, 0}", Radians=True)
geometry_32 = Geometry(ф15_vector_xyz_vector)
geometry_33 = Geometry(ф15_vector_xyz_vector_2)
panel_43 = Panel("""48
57
48""")
panel_44 = Panel(ф7_panel_40_50_30_2)
vector_xyz_15 = VectorXYZ(XComponent=600, YComponent=-800, ZComponent=0)  # -> Vector, Length
ф8_region_union = Data(region_union_2)
negative_5 = Negative(Value=vector_angle)
division_13 = Division(A=panel_44, B=panel_43)
rotate_21 = Rotate(Geometry=simplify(ф8_region_union), Angle=simplify(graft(negative_5)), Plane=PlaneXY(0, 0, 0))  # -> Geometry, Transform
arctangent = ArcTangent(Value=division_13)
scale_6 = Scale(Geometry=rotate_21.Geometry, Center=Point(0, 0, 0), Factor=5)  # -> Geometry, Transform
degrees = Degrees(Radians=arctangent)
boundary_surfaces_18 = BoundarySurfaces(Edges=scale_6.Geometry)
subtraction_9 = Subtraction(A=90, B=degrees)
boundary_surfaces_19 = BoundarySurfaces(Edges=boundary_surfaces_18)
division_14 = Division(A=subtraction_9, B=90)

# ---- group: Ф7 [лист 0,-800] — схема застройки на сетке (continued)
ф9_vector_angle = Data(vector_angle)
panel_45 = Panel(ф9_vector_angle)

# ---- group: Ф6 [лист 600,-350] — круговая солнечная карта с сектором
series_6 = Series(Start=10, Step=10, Count=17)
ф1_end_points_end = Data(end_points_6.End)
ф15_insert_items_3 = Data(insert_items_2)
ф15_list_item = Data(list_item_7)
series_7 = Series(Start=0, Step=10, Count=19)
ф15_circle_cnr = Data(circle_cnr_2)
reverse_list_4 = ReverseList(List=series_6)
vector_xyz_16 = VectorXYZ(XComponent=0, YComponent=Slider(5, range=0..20), ZComponent=0)  # -> Vector, Length
text_tag_camera = TextTagCamera(Location=ф1_end_points_end, Text=graft(ф15_insert_items_3), Size=5, Colour=RGB(0, 0, 0), Scale=False)
vector_xyz_17 = VectorXYZ(XComponent=600, YComponent=-350, ZComponent=0)  # -> Vector, Length
merge_12 = Merge(Data1=series_7, Data2=reverse_list_4)
move_30 = Move(Geometry=ф15_circle_cnr, Motion=vector_xyz_16.Vector)  # -> Geometry, Transform
ф15_panel_3 = Data(panel_12)
text_2 = Text(graft(merge_12))
insert_items_7 = InsertItems(List=text_2, Item=ф15_panel_3, Indices=1, Wrap=True)
ф15_panel_ю_в_с_з = Data(panel_13)
ф15_panel_0_9_18_27 = Data(panel_14)
text_join_3 = TextJoin(Text=insert_items_7)  # -> flatten(Result)
ф15_end_points_end = Data(end_points.End)
replace_items_2 = ReplaceItems(List=text_join_3, Item=ф15_panel_ю_в_с_з, Indices=ф15_panel_0_9_18_27, Wrap=False)
ф15_surface_curve_curves = Data(surface_curve_4.Curves)
cluster_16 = Cluster(relay=replace_items_2, relay_2=ф15_end_points_end)

# ---- group: Ф3 [лист 600,-200] — полукруглый угломер высот солнца
construct_point_25 = ConstructPoint(XCoordinate=0, YCoordinate=0, ZCoordinate=0)
construct_point_26 = ConstructPoint(XCoordinate=10, YCoordinate=0, ZCoordinate=0)
geometry_34 = Geometry(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)
construct_point_27 = ConstructPoint(XCoordinate=-90, YCoordinate=0, ZCoordinate=0)
construct_point_28 = ConstructPoint(XCoordinate=90, YCoordinate=0, ZCoordinate=0)
construct_point_29 = ConstructPoint(XCoordinate=0, YCoordinate=-7, ZCoordinate=0)
construct_point_30 = ConstructPoint(XCoordinate=0, YCoordinate=90, ZCoordinate=0)
vector_xyz_18 = VectorXYZ(XComponent=600, YComponent=-200, ZComponent=0)  # -> Vector, Length
ф15_list_item_2 = Data(list_item_3)
ф5_end_points_end_2 = Data(end_points_2.End)
ф5_explode_tree = Data(explode_tree._10000)
ф5_explode_tree_2 = Data(explode_tree._10001)
ввод_explode_tree_10 = Data(данные.s1)
ф15_surface_curve_curves_2 = Data(surface_curve_4.Curves)
ф15_end_points_end_2 = Data(end_points.End)
ф15_circle = Data(circle)
ф15_series = Data(series)
ввод_explode_tree_11 = Data(данные.s3)
ввод_explode_tree_12 = Data(данные.s2)
panel_46 = Panel("Aо = .°")
panel_47 = Panel("0")
vector_2pt_13 = Vector2Pt(PointA=construct_point_25, PointB=construct_point_26, Unitize=False)  # -> Vector, Length
line_9 = Line(StartPoint=construct_point_25, EndPoint=construct_point_30)
line_10 = Line(StartPoint=construct_point_27, EndPoint=construct_point_28)
cluster_17 = Cluster(relay="0", relay_2=construct_point_29)
range_2 = Range(Domain=Domain(0, 1), Steps=18)
vector_xyz_19 = VectorXYZ(XComponent=90, YComponent=0, ZComponent=0)  # -> Vector, Length
vector_xyz_20 = VectorXYZ(XComponent=-90, YComponent=0, ZComponent=0)  # -> Vector, Length
ф15_cull_pattern = Data(cull_pattern)
surface_curve_13 = SurfaceCurve(Surface=geometry_34, Curve=ф15_surface_curve_curves_2)  # -> Curves, Points, UVPoints, Normals, Parameters, Tangents
point_in_curve = PointInCurve(Point=ф15_end_points_end_2, Curve=geometry_34)  # -> Relationship, Point
geometry_35 = Geometry(ф15_list_item_2)
geometry_36 = Geometry(ф15_list_item_2)
geometry_37 = Geometry(ф5_end_points_end_2)
geometry_38 = Geometry(ф5_explode_tree)
geometry_39 = Geometry(ф5_explode_tree_2)
list_item_12 = ListItem(List=ф15_circle, Index=0, Wrap=True)
reverse_list_5 = ReverseList(List=ф15_series)
division_15 = Division(A=ввод_explode_tree_11, B=ввод_explode_tree_12)
panel_48 = Panel("""Ю
10°
20°
30°
40°
50°
60°
70°
80°
90°
80°
70°
60°
50°
40°
30°
20°
10°
0°
10°
20°
30°
40°
50°
60°
70°
80°
90°
80°
70°
60°
50°
40°
30°
20°
10°""")
panel_49 = Panel(ввод_explode_tree_10)
curve_curve_2 = CurveCurve(CurveA=ф15_cull_pattern, CurveB=line_9)  # -> flatten(Points), ParamsA, ParamsB
cull_pattern_8 = CullPattern(List=panel_48, CullPattern=point_in_curve.Relationship)
scale_nu = ScaleNU(Geometry=geometry_35, Plane=PlaneXY(0, 0, 0), ScaleX=1, ScaleY=range_2, ScaleZ=1)  # -> Geometry, Transform
move_31 = Move(Geometry=list_item_12, Motion=[vector_xyz_19.Vector, vector_xyz_20.Vector])  # -> Geometry, Transform
surface_curve_14 = SurfaceCurve(Surface=geometry_34, Curve=list_item_12)  # -> Curves, Points, UVPoints, Normals, Parameters, Tangents
boundary_surfaces_20 = BoundarySurfaces(Edges=flatten(geometry_36))
cull_pattern_9 = CullPattern(List=ф15_end_points_end_2, CullPattern=point_in_curve.Relationship)
subtraction_10 = Subtraction(A=180, B=panel_49)
cull_index_6 = CullIndex(List=reverse_list_5, Indices=0, Wrap=True)
arctangent_2 = ArcTangent(Value=division_15)
cull_index_7 = CullIndex(List=curve_curve_2.Points, Indices=-1, Wrap=True)
surface_curve_15 = SurfaceCurve(Surface=geometry_34, Curve=scale_nu.Geometry)  # -> Curves, Points, UVPoints, Normals, Parameters, Tangents
cluster_18 = Cluster(relay=cull_pattern_8, relay_2=cull_pattern_9)
replace_text_8 = ReplaceText(Text=".°", Find=".", Replace=cull_index_6, RecursiveReplace=False)  # -> flatten(Result)
vector_xyz_21 = VectorXYZ(XComponent=5, YComponent=4, ZComponent=0)  # -> Vector, Length
radians_5 = Radians(Degrees=subtraction_10)
boundary_surfaces_21 = BoundarySurfaces(Edges=[move_31.Geometry, list_item_12])
degrees_2 = Degrees(Radians=arctangent_2)
move_32 = Move(Geometry=cull_index_7, Motion=vector_xyz_21.Vector)  # -> Geometry, Transform
region_intersection_4 = RegionIntersection(CurvesA=boundary_surfaces_21, CurvesB=geometry_34)
subtraction_11 = Subtraction(A=90, B=degrees_2)
rotate_22 = Rotate(Geometry=geometry_37, Angle=radians_5, Plane=PlaneXY(0, 0, 0))  # -> Geometry, Transform
ф5_construct_point_3 = Data(construct_point_15)
rotate_23 = Rotate(Geometry=geometry_38, Angle=radians_5, Plane=PlaneXY(0, 0, 0))  # -> Geometry, Transform
rotate_24 = Rotate(Geometry=geometry_39, Angle=radians_5, Plane=PlaneXY(0, 0, 0))  # -> Geometry, Transform
cluster_19 = Cluster(relay=replace_text_8, relay_2=move_32.Geometry)
division_16 = Division(A=subtraction_11, B=90)
vector_2pt_14 = Vector2Pt(PointA=construct_point_25, PointB=rotate_23.Geometry, Unitize=False)  # -> Vector, Length
vector_2pt_15 = Vector2Pt(PointA=construct_point_25, PointB=rotate_24.Geometry, Unitize=False)  # -> Vector, Length
define_angular_dimension_12 = DefineAngularDimension(Origin=ф5_construct_point_3, Point1=rotate_23.Geometry, Point2=rotate_22.Geometry, Offset="55", internalize=False)
define_angular_dimension_13 = DefineAngularDimension(Origin=ф5_construct_point_3, Point1=rotate_24.Geometry, Point2=rotate_22.Geometry, Offset="55", internalize=False)
region_intersection_5 = RegionIntersection(CurvesA=region_intersection_4, CurvesB=geometry_35)
line_sdl_8 = LineSDL(Start=construct_point_25, Direction=vector_2pt_14.Vector, Length=90)
line_sdl_9 = LineSDL(Start=construct_point_25, Direction=vector_2pt_15.Vector, Length=90)
scale_nu_2 = ScaleNU(Geometry=geometry_36, Plane=PlaneXY(0, 0, 0), ScaleX=1, ScaleY=division_16, ScaleZ=1)  # -> Geometry, Transform
boundary_surfaces_22 = BoundarySurfaces(Edges=region_intersection_5)
vector_xyz_22 = VectorXYZ(XComponent=0, YComponent=0, ZComponent=1)  # -> Vector, Length
angle_3 = Angle(VectorA=line_sdl_8, VectorB=vector_2pt_13.Vector)  # -> Angle, Reflex
angle_4 = Angle(VectorA=line_sdl_8, VectorB=line_sdl_9)  # -> Angle, Reflex
boundary_surfaces_23 = BoundarySurfaces(Edges=flatten(scale_nu_2.Geometry))
relay_7 = Relay([define_angular_dimension_12, define_angular_dimension_13, cluster_18, surface_curve_13.Curves, surface_curve_15.Curves, line_10, cluster_17, surface_curve_14.Curves, boundary_surfaces_22, cluster_19])
move_33 = Move(Geometry=boundary_surfaces_22, Motion=vector_xyz_22.Vector)  # -> Geometry, Transform
arc = Arc(Plane=PlaneXY(0, 0, 0), Radius=90, Angle=angle_4.Angle)  # -> Arc, Length
region_difference_4 = RegionDifference(CurvesA=boundary_surfaces_20, CurvesB=boundary_surfaces_23)
move_34 = Move(Geometry=relay_7, Motion=vector_xyz_18.Vector)  # -> Geometry, Transform
move_35 = Move(Geometry=move_33.Geometry, Motion=vector_xyz_18.Vector)  # -> Geometry, Transform
boundary_surfaces_24 = BoundarySurfaces(Edges=region_difference_4)

# ---- group: Ф15 [лист 0,-1500] — круговая карта с заливкой (continued)
ф3_surface_curve_curves = Data(surface_curve_15.Curves)
ф3_geometry = Data(geometry_36)
ф3_construct_point = Data(construct_point_25)
ф3_cluster_text = Data(cluster_19)
geometry_40 = Geometry(flatten(ф3_surface_curve_curves))
geometry_41 = Geometry(ф3_geometry)
cluster_20 = Cluster_13(relay=ф3_geometry, edges=ф3_geometry, B=ф14_panel, degrees=ф16_panel, point=ф3_construct_point)
ф3_surface_curve_curves_2 = Data(surface_curve_13.Curves)
ф3_line = Data(line_10)
ф3_surface_curve_curves_3 = Data(surface_curve_14.Curves)
ф3_boundary_surfaces = Data(boundary_surfaces_22)
ф3_cluster_text_2 = Data(cluster_18)
move_36 = Move(Geometry=ф3_cluster_text, Motion=construct_point_5)  # -> Geometry, Transform
cull_pattern_10 = CullPattern(List=geometry_40, CullPattern=[False, True])
boundary_surfaces_25 = BoundarySurfaces(Edges=cluster_20)
cluster_21 = Cluster_13(relay=ф3_geometry, edges=ф3_geometry, B=panel_24, degrees=panel_23, point=ф3_construct_point)
relay_8 = Relay([ф3_surface_curve_curves_2, ф3_line, ф3_surface_curve_curves_3, ф3_boundary_surfaces, ф3_cluster_text_2, cull_pattern_10])
region_difference_5 = RegionDifference(CurvesA=geometry_41, CurvesB=boundary_surfaces_25)
boundary_surfaces_26 = BoundarySurfaces(Edges=cluster_21)
rotate_25 = Rotate(Geometry=[relay_8, move_36.Geometry], Angle=3.141592654, Plane=PlaneXY(0, 0, 0))  # -> Geometry, Transform
boundary_surfaces_27 = BoundarySurfaces(Edges=region_difference_5)
region_difference_6 = RegionDifference(CurvesA=geometry_41, CurvesB=boundary_surfaces_26)
geometry_42 = Geometry([relay_8, rotate_25.Geometry])
move_37 = Move(Geometry=boundary_surfaces_27, Motion=vector_xyz.Vector)  # -> Geometry, Transform
region_difference_7 = RegionDifference(CurvesA=region_difference_6, CurvesB=region_difference_5)
boundary_surfaces_28 = BoundarySurfaces(Edges=region_difference_7)
move_38 = Move(Geometry=geometry_42, Motion=vector_xyz.Vector)  # -> Geometry, Transform
move_39 = Move(Geometry=boundary_surfaces_28, Motion=vector_xyz.Vector)  # -> Geometry, Transform

# ---- group: Ф9 [лист 600,-800] — инсоляционный график (полукруг) №1 (continued)
ф3_surface_curve_curves_4 = Data(surface_curve_13.Curves)
ф3_surface_curve_curves_5 = Data(surface_curve_15.Curves)
ф3_line_2 = Data(line_10)
ф3_surface_curve_curves_6 = Data(surface_curve_14.Curves)
ф3_boundary_surfaces_2 = Data(boundary_surfaces_22)
ф3_cluster_text_3 = Data(cluster_18)
ф3_cluster_text_4 = Data(cluster_19)
ф3_cluster_text_5 = Data(cluster_17)
ф3_geometry_2 = Data(geometry_36)
relay_9 = Relay([ф3_surface_curve_curves_4, ф3_surface_curve_curves_5, ф3_line_2, ф3_surface_curve_curves_6, ф3_boundary_surfaces_2, ф3_cluster_text_3, ф3_cluster_text_4, ф3_cluster_text_5])
geometry_43 = Geometry(ф3_cluster_text_3)
boundary_surfaces_29 = BoundarySurfaces(Edges=flatten(ф3_geometry_2))
geometry_44 = Geometry(relay_9)
rotate_26 = Rotate(Geometry=geometry_43, Angle=3.141592654, Plane=PlaneXY(0, 0, 0))  # -> Geometry, Transform
move_40 = Move(Geometry=rotate_26.Geometry, Motion=vector_xyz_15.Vector)  # -> Geometry, Transform
rotate_27 = Rotate(Geometry=geometry_44, Angle=3.141592654, Plane=PlaneXY(0, 0, 0))  # -> Geometry, Transform
move_41 = Move(Geometry=rotate_27.Geometry, Motion=vector_xyz_15.Vector)  # -> Geometry, Transform
scale_nu_3 = ScaleNU(Geometry=ф3_geometry_2, Plane=PlaneXY(0, 0, 0), ScaleX=1, ScaleY=division_14, ScaleZ=1)  # -> Geometry, Transform
boundary_surfaces_30 = BoundarySurfaces(Edges=scale_nu_3.Geometry)  # -> graft(Surfaces)
region_difference_8 = RegionDifference(CurvesA=boundary_surfaces_19, CurvesB=boundary_surfaces_30)
region_intersection_6 = RegionIntersection(CurvesA=region_difference_8, CurvesB=boundary_surfaces_29)
boundary_surfaces_31 = BoundarySurfaces(Edges=region_intersection_6)
explode_tree_4 = ExplodeTree(Data=boundary_surfaces_31)  # -> _00000, _00100, _00200
move_42 = Move(Geometry=explode_tree_4._00000, Motion=vector_xyz_15.Vector)  # -> Geometry, Transform

# ---- group: Ф6 [лист 600,-350] — круговая солнечная карта с сектором (continued)
ф3_arc_arc = Data(arc.Arc)
ф3_radians = Data(radians_5)
ф3_angle_angle = Data(angle_3.Angle)
ф3_construct_point_2 = Data(construct_point_25)
rotate_28 = Rotate(Geometry=ф3_arc_arc, Angle=ф3_angle_angle, Plane=PlaneXY(0, 0, 0))  # -> Geometry, Transform
subtraction_12 = Subtraction(A=0, B=ф3_radians)
extrude_point_8 = ExtrudePoint(Base=rotate_28.Geometry, Point=ф3_construct_point_2)
ф3_cluster_text_6 = Data(cluster_19)

# ---- group: Ф3 [лист 600,-200] — полукруглый угломер высот солнца (continued)
ф6_extrude_point = Data(extrude_point_8)
region_intersection_7 = RegionIntersection(CurvesA=boundary_surfaces_24, CurvesB=ф6_extrude_point)

# ---- group: Ф6 [лист 600,-350] — круговая солнечная карта с сектором (continued)
ф3_region_intersection = Data(region_intersection_7)
boundary_surfaces_32 = BoundarySurfaces(Edges=ф3_region_intersection)
rotate_29 = Rotate(Geometry=boundary_surfaces_32, Angle=subtraction_12, Plane=PlaneXY(0, 0, 0))  # -> Geometry, Transform
move_43 = Move(Geometry=rotate_29.Geometry, Motion=vector_xyz_17.Vector)  # -> Geometry, Transform

# ---- group: Ф3 [лист 600,-200] — полукруглый угломер высот солнца (continued)
ф6_boundary_surfaces = Data(boundary_surfaces_32)
move_44 = Move(Geometry=ф6_boundary_surfaces, Motion=vector_xyz_18.Vector)  # -> Geometry, Transform

# ---- group: Ф10 [лист 900,-800] — инсоляционный график (полукруг) №2
vector_xyz_23 = VectorXYZ(XComponent=900, YComponent=-800, ZComponent=0)  # -> Vector, Length
construct_point_31 = ConstructPoint(XCoordinate=0, YCoordinate=0, ZCoordinate=0)
ф9_rotate_geometry = Data(rotate_27.Geometry)
ф9_explode_tree = Data(explode_tree_4._00100)
ф9_geometry = Data(geometry_43)
ф9_geometry_2 = Data(geometry_32)
move_45 = Move(Geometry=ф9_rotate_geometry, Motion=vector_xyz_23.Vector)  # -> Geometry, Transform
move_46 = Move(Geometry=ф9_explode_tree, Motion=vector_xyz_23.Vector)  # -> Geometry, Transform
move_47 = Move(Geometry=construct_point_31, Motion=ф9_geometry_2)  # -> Geometry, Transform
rotate_30 = Rotate(Geometry=ф9_geometry, Angle=3.141592654, Plane=PlaneXY(0, 0, 0))  # -> Geometry, Transform
move_48 = Move(Geometry=rotate_30.Geometry, Motion=vector_xyz_23.Vector)  # -> Geometry, Transform

# ---- group: Ф11 [лист 1200,-800] — инсоляционный график (полукруг) №3
ф9_rotate_geometry_2 = Data(rotate_27.Geometry)
vector_xyz_24 = VectorXYZ(XComponent=1200, YComponent=-800, ZComponent=0)  # -> Vector, Length
panel_50 = Panel("-1500")
ф9_explode_tree_2 = Data(explode_tree_4._00200)
ф9_geometry_3 = Data(geometry_43)
ввод_explode_tree_13 = Data(данные.rot)
ф10_move_geometry = Data(move_47.Geometry)
ф7_panel_40_50_30_3 = Data(panel_17)
vector_xyz_25 = VectorXYZ(XComponent=1200, YComponent=panel_50, ZComponent=0)  # -> Vector, Length
move_49 = Move(Geometry=ф9_rotate_geometry_2, Motion=vector_xyz_24.Vector)  # -> Geometry, Transform
move_50 = Move(Geometry=ф9_explode_tree_2, Motion=vector_xyz_24.Vector)  # -> Geometry, Transform
rotate_31 = Rotate(Geometry=ф9_geometry_3, Angle=3.141592654, Plane=PlaneXY(0, 0, 0))  # -> Geometry, Transform
panel_51 = Panel(ф7_panel_40_50_30_3)
panel_52 = Panel(ввод_explode_tree_13)
xy_plane_3 = XYPlane(Origin=ф10_move_geometry)
move_51 = Move(Geometry=ф9_rotate_geometry_2, Motion=vector_xyz_25.Vector)  # -> Geometry, Transform
move_52 = Move(Geometry=rotate_31.Geometry, Motion=vector_xyz_24.Vector)  # -> Geometry, Transform
move_53 = Move(Geometry=rotate_31.Geometry, Motion=vector_xyz_25.Vector)  # -> Geometry, Transform
cull_index_8 = CullIndex(List=panel_51, Indices=-1, Wrap=True)
list_item_13 = ListItem(List=panel_51, Index=-1, Wrap=True)
insert_items_8 = InsertItems(List=cull_index_8, Item=list_item_13, Indices=1, Wrap=True)

# ---- group: Ф9 [лист 600,-800] — инсоляционный график (полукруг) №1 (continued)
ф11_panel_1500 = Data(panel_50)
vector_xyz_26 = VectorXYZ(XComponent=600, YComponent=ф11_panel_1500, ZComponent=0)  # -> Vector, Length
move_54 = Move(Geometry=rotate_26.Geometry, Motion=vector_xyz_26.Vector)  # -> Geometry, Transform
move_55 = Move(Geometry=rotate_27.Geometry, Motion=vector_xyz_26.Vector)  # -> Geometry, Transform

# ---- group: Ф10 [лист 900,-800] — инсоляционный график (полукруг) №2 (continued)
ф11_panel = Data(panel_52)
ф11_panel_1500_2 = Data(panel_50)
ф11_insert_items = Data(insert_items_8)
vector_xyz_27 = VectorXYZ(XComponent=900, YComponent=ф11_panel_1500_2, ZComponent=0)  # -> Vector, Length
radians_6 = Radians(Degrees=ф11_panel)
move_56 = Move(Geometry=ф9_rotate_geometry, Motion=vector_xyz_27.Vector)  # -> Geometry, Transform
move_57 = Move(Geometry=rotate_30.Geometry, Motion=vector_xyz_27.Vector)  # -> Geometry, Transform

# ---- group: Ф11 [лист 1200,-800] — инсоляционный график (полукруг) №3 (continued)
ф10_radians = Data(radians_6)

# ---- group: Ф12 [лист 1500,-800] — круговой инсоляционный график
circle_2 = Circle(Plane=PlaneXY(0, 0, 0), Radius=1)
vector_xyz_28 = VectorXYZ(XComponent=1500, YComponent=-800, ZComponent=0)  # -> Vector, Length
cluster_22 = Cluster_3()  # -> rectangle_4, radians_2, result, start, point
construct_point_32 = ConstructPoint(XCoordinate=0, YCoordinate=0, ZCoordinate=0)
ф2_removeduplicatepts_2 = Data(removeduplicatepts)
ф15_circle_2 = Data(circle)
ф2_sort_list = Data(sort_list.Keys)
ф9_boundary_surfaces = Data(boundary_surfaces_31)
ф9_vector_angle_2 = Data(vector_angle)
ф11_panel_1500_3 = Data(panel_50)
ф9_geometry_4 = Data(geometry_43)
ф9_geometry_5 = Data(geometry_33)
ф15_list_item_3 = Data(list_item_7)
ф9_rotate_geometry_3 = Data(rotate_27.Geometry)
ввод_replace_text = Data(данные.t_rise)
ф8_radians_4 = Data(radians_4)
ф11_insert_items_2 = Data(insert_items_8)
boundary_surfaces_33 = BoundarySurfaces(Edges=cluster_22.result)
interpolate = Interpolate(Vertices=ф2_removeduplicatepts_2, Degree=3, Periodic=False, KnotStyle=1)  # -> Curve, Length, Domain
surface_curve_16 = SurfaceCurve(Surface=ф15_list_item_3, Curve=ф15_circle_2)  # -> Curves, Points, UVPoints, Normals, Parameters, Tangents
delete_consecutive = DeleteConsecutive(Set=ф2_sort_list, Wrap=False)  # -> Set, Count
move_58 = Move(Geometry=construct_point_32, Motion=ф9_geometry_5)  # -> Geometry, Transform
rotate_32 = Rotate(Geometry=simplify(ф9_boundary_surfaces), Angle=simplify(graft(ф9_vector_angle_2)), Plane=PlaneXY(0, 0, 0))  # -> Geometry, Transform
vector_xyz_29 = VectorXYZ(XComponent=1500, YComponent=ф11_panel_1500_3, ZComponent=0)  # -> Vector, Length
rotate_33 = Rotate(Geometry=ф9_geometry_4, Angle=3.141592654, Plane=PlaneXY(0, 0, 0))  # -> Geometry, Transform
ввод_replace_text_2 = Data(данные.t_set)
cluster_23 = Cluster_22(list=ф11_insert_items_2, relay=cluster_22.result, relay_2=cluster_22.point, curves_b=boundary_surfaces_33)  # -> result, geometry_6, angular_dimension, line
replace_items_3 = ReplaceItems(List=delete_consecutive.Set, Item=ввод_replace_text, Indices=0, Wrap=False)
rotate_34 = Rotate(Geometry=rotate_32.Geometry, Angle=ф8_radians_4, Plane=PlaneXY(0, 0, 0))  # -> Geometry, Transform
move_59 = Move(Geometry=ф9_rotate_geometry_3, Motion=vector_xyz_29.Vector)  # -> Geometry, Transform
xy_plane_4 = XYPlane(Origin=move_58.Geometry)
move_60 = Move(Geometry=rotate_33.Geometry, Motion=vector_xyz_29.Vector)  # -> Geometry, Transform
boundary_surfaces_34 = BoundarySurfaces(Edges=cluster_23.geometry_6)
boundary_surfaces_35 = BoundarySurfaces(Edges=cluster_23.result)
replace_items_4 = ReplaceItems(List=replace_items_3, Item=ввод_replace_text_2, Indices=-1, Wrap=True)
move_61 = Move(Geometry=rotate_34.Geometry, Motion=vector_xyz_28.Vector)  # -> Geometry, Transform
area_2 = Area(Geometry=boundary_surfaces_35)  # -> flatten(Area), Centroid
move_62 = Move(Geometry=boundary_surfaces_34, Motion=ф9_geometry_5)  # -> Geometry, Transform

# ---- group: Ф15 [лист 0,-1500] — круговая карта с заливкой (continued)
ф12_replace_items = Data(replace_items_4)
panel_53 = Panel(ф12_replace_items)

# ---- group: Ф6 [лист 600,-350] — круговая солнечная карта с сектором (continued)
ф12_interpolate_curve = Data(interpolate.Curve)
surface_curve_17 = SurfaceCurve(Surface=ф15_list_item, Curve=ф12_interpolate_curve)  # -> Curves, Points, UVPoints, Normals, Parameters, Tangents
ф12_replace_items_2 = Data(replace_items_4)
cluster_24 = Cluster(relay=ф12_replace_items_2, relay_2=move_30.Geometry)
ф12_surface_curve_curves = Data(surface_curve_16.Curves)
ф12_circle = Data(circle_2)
relay_10 = Relay([cluster_16, surface_curve_17.Curves, ф15_circle_cnr, ф12_surface_curve_curves, cluster_24, ф15_surface_curve_curves, ф3_cluster_text_6, ф12_circle])
move_63 = Move(Geometry=relay_10, Motion=vector_xyz_17.Vector)  # -> Geometry, Transform

# ---- group: Ф10 [лист 900,-800] — инсоляционный график (полукруг) №2 (continued)
ф12_cluster_result = Data(cluster_22.result)
ф12_cluster_start = Data(cluster_22.start)
ф12_boundary_surfaces = Data(boundary_surfaces_33)
cluster_25 = Cluster_22(list=ф11_insert_items, relay=ф12_cluster_result, relay_2=ф12_cluster_start, curves_b=ф12_boundary_surfaces)  # -> result, geometry_6, angular_dimension, line
boundary_surfaces_36 = BoundarySurfaces(Edges=cluster_25.geometry_6)
boundary_surfaces_37 = BoundarySurfaces(Edges=cluster_25.result)
explode_tree_5 = ExplodeTree(Data=boundary_surfaces_37)  # -> _000000, Branch1
move_64 = Move(Geometry=boundary_surfaces_36, Motion=ф9_geometry_2)  # -> Geometry, Transform
move_65 = Move(Geometry=explode_tree_5.Branch1, Motion=vector_xyz_27.Vector)  # -> Geometry, Transform

# ---- group: Ф9 [лист 600,-800] — инсоляционный график (полукруг) №1 (continued)
ф10_explode_tree = Data(explode_tree_5._000000)
move_66 = Move(Geometry=ф10_explode_tree, Motion=vector_xyz_26.Vector)  # -> Geometry, Transform

# ---- group: Ф11 [лист 1200,-800] — инсоляционный график (полукруг) №3 (continued)
ф12_area_area = Data(area_2.Area)
ф12_move_geometry = Data(move_62.Geometry)
ф12_xy_plane = Data(xy_plane_4)
ф12_boundary_surfaces_2 = Data(boundary_surfaces_35)
ф10_move_geometry_2 = Data(move_64.Geometry)
larger_than_2 = LargerThan(FirstNumber=ф12_area_area, SecondNumber=300)  # -> LargerThan, OrEqualTo
rotate_35 = Rotate(Geometry=ф12_move_geometry, Angle=ф10_radians, Plane=ф12_xy_plane)  # -> Geometry, Transform
cull_pattern_11 = CullPattern(List=flatten(ф12_boundary_surfaces_2), CullPattern=larger_than_2.LargerThan)  # -> graft(List)
rotate_36 = Rotate(Geometry=ф10_move_geometry_2, Angle=ф10_radians, Plane=xy_plane_3)  # -> Geometry, Transform
explode_tree_6 = ExplodeTree(Data=cull_pattern_11)  # -> Branch0, Branch1
move_67 = Move(Geometry=explode_tree_6.Branch0, Motion=vector_xyz_25.Vector)  # -> Geometry, Transform

# ---- group: Ф16 [лист 0,-1950] — ГИЗ, задача 10 (граница В = Б − норма из «ВЫВОДЫ») (continued)
ф11_rotate_geometry = Data(rotate_36.Geometry)
ф11_rotate_geometry_2 = Data(rotate_35.Geometry)
ф12_delete_consecutive_set = Data(delete_consecutive.Set)
cluster_26 = Cluster(relay=ф12_delete_consecutive_set, relay_2=ф7_center_center)
merge_13 = Merge(Data1=ф11_rotate_geometry, Data2=ф11_rotate_geometry_2)
geometry_45 = Geometry(cluster_26)
geometry_46 = Geometry(geometry_45)
geometry_47 = Geometry([geometry_46, geometry_17])
move_68 = Move(Geometry=geometry_47, Motion=rotate_4)  # -> Geometry, Transform
geometry_48 = Geometry([move_19.Geometry, move_20.Geometry, move_68.Geometry, move_14.Geometry, geometry_47, geometry_20])
move_69 = Move(Geometry=geometry_48, Motion=vector_xyz_9.Vector)  # -> Geometry, Transform

# ---- group: Ф1 [лист 0,-200] — план-сетка: солнечные лучи по часам (continued)
ф16_geometry = Data(geometry_45)
relay_11 = Relay([surface_curve.Curves, surface_curve_2.Curves, circle_cnr, rectangle_3.Rectangle, ф16_geometry, cluster_2, ф16_cluster_text])
move_70 = Move(Geometry=relay_11, Motion=vector_xyz_4.Vector)  # -> Geometry, Transform

# ---- group: Ф2 [лист 300,-200] — план-сетка: тень стержня (continued)
ф16_geometry_2 = Data(geometry_45)
relay_12 = Relay([ф1_surface_curve_curves, ф1_surface_curve_curves_2, ф1_circle_cnr_3, ф1_rectangle_rectangle_2, ф16_geometry_2, ф16_cluster_text_2])
move_71 = Move(Geometry=relay_12, Motion=vector_xyz_12.Vector)  # -> Geometry, Transform

# ---- group: Ф13 [лист 0,-1000] — застройка с лучами (1) (continued)
ф2_relay = Data(relay_12)
cluster_27 = Cluster_6(
    relay_3=ф7_rotate_geometry,
    relay_4=ф7_rotate_geometry_2,
    relay_5=ф7_rotate_geometry_3,
    relay=ф7_rotate_geometry_4,
    relay_6=ф2_cluster_text,
    relay_2=ф2_relay,
    geometry_2=ф8_cluster_start,
    angle=ф8_radians,
    point_a=ф8_cluster_start,
    geometry=ф8_cluster_result,
    angle_2=ф8_radians,
    curves_b=ф7_extrude_point,
    point=ф2_construct_point)  # -> geometry_6, geometry_7, geometry_8
move_72 = Move(Geometry=cluster_27.geometry_8, Motion=vector_xyz_7.Vector)  # -> Geometry, Transform
move_73 = Move(Geometry=[cluster_27.geometry_7, boundary_surfaces_17], Motion=vector_xyz_7.Vector)  # -> Geometry, Transform
move_74 = Move(Geometry=[cluster_27.geometry_6, relay_6], Motion=vector_xyz_7.Vector)  # -> Geometry, Transform

# ---- group: Ф14 [лист 0,-1250] — застройка с лучами (2) (continued)
ф2_relay_2 = Data(relay_12)
cluster_28 = Cluster_6(
    relay_3=ф7_rotate_geometry_5,
    relay_4=ф7_rotate_geometry_6,
    relay_5=ф7_rotate_geometry_7,
    relay=ф7_rotate_geometry_8,
    relay_6=ф2_cluster_text_3,
    relay_2=ф2_relay_2,
    geometry_2=ф8_cluster_end,
    angle=ф8_radians_3,
    point_a=ф8_cluster_end,
    geometry=ф8_cluster_result_3,
    angle_2=ф8_radians_3,
    curves_b=ф7_extrude_point_2,
    point=ф2_construct_point_5)  # -> geometry_6, geometry_7, geometry_8
move_75 = Move(Geometry=[cluster_28.geometry_6, ф13_relay], Motion=vector_xyz_6.Vector)  # -> Geometry, Transform
move_76 = Move(Geometry=cluster_28.geometry_8, Motion=vector_xyz_6.Vector)  # -> Geometry, Transform
move_77 = Move(Geometry=[cluster_28.geometry_7, move_29.Geometry], Motion=vector_xyz_6.Vector)  # -> Geometry, Transform

# ---- group: Ф7 [лист 0,-800] — схема застройки на сетке (continued)
ф2_relay_3 = Data(relay_12)
geometry_49 = Geometry([ф2_relay_3, rotate_18.Geometry, rotate_17.Geometry, ф2_cluster_text_2, rotate_19.Geometry])
geometry_50 = Geometry([geometry_49, rotate_16.Geometry])
move_78 = Move(Geometry=geometry_50, Motion=vector_xyz_5.Vector)  # -> Geometry, Transform

# ---- group: Ф12 [лист 1500,-800] — круговой инсоляционный график (continued)
ф6_relay = Data(relay_10)
ф11_explode_tree = Data(explode_tree_6.Branch1)
move_79 = Move(Geometry=ф6_relay, Motion=vector_xyz_28.Vector)  # -> Geometry, Transform
move_80 = Move(Geometry=ф11_explode_tree, Motion=vector_xyz_29.Vector)  # -> Geometry, Transform

# ---- group: ВЫХОД — сборка листа: слои eleFront, штриховки, запекание, экспорт DWG
ф15_circle_cnr_2 = Data(circle_cnr_2)
ф1_move_geometry = Data(move_70.Geometry)
ф1_colour_swatch = Data(colour_swatch_5)
ф4_move_geometry_5 = Data(move_24.Geometry)
ф2_colour_swatch = Data(colour_swatch_6)
ф15_colour_swatch = Data(colour_swatch)
ф5_move_geometry = Data(move_25.Geometry)
ф3_move_geometry = Data(move_34.Geometry)
ф6_move_geometry = Data(move_63.Geometry)
ф2_move_geometry = Data(move_17.Geometry)
ф2_move_geometry_2 = Data(move_23.Geometry)
ф2_move_geometry_3 = Data(move_71.Geometry)
ф6_cluster_text = Data(cluster_16)
ф6_surface_curve_curves = Data(surface_curve_17.Curves)
ф12_surface_curve_curves_2 = Data(surface_curve_16.Curves)
ф6_cluster_text_2 = Data(cluster_24)
ф15_surface_curve_curves_3 = Data(surface_curve_4.Curves)
ф3_cluster_text_7 = Data(cluster_19)
ф12_circle_2 = Data(circle_2)
ф9_move_geometry = Data(move_42.Geometry)
ф10_move_geometry_3 = Data(move_46.Geometry)
ф11_move_geometry = Data(move_50.Geometry)
ф12_move_geometry_2 = Data(move_61.Geometry)
ф9_move_geometry_2 = Data(move_41.Geometry)
ф10_move_geometry_4 = Data(move_45.Geometry)
ф11_move_geometry_2 = Data(move_49.Geometry)
ф15_move_geometry = Data(move_38.Geometry)
ф15_geometry = Data(geometry)
ф15_vector_xyz_vector_3 = Data(vector_xyz_2.Vector)
ввод_explode_tree_14 = Data(данные.rot)
ф15_boundary_surfaces = Data(boundary_surfaces_27)
ф15_boundary_surfaces_2 = Data(boundary_surfaces_28)
ф15_vector_xyz_vector_4 = Data(vector_xyz_3.Vector)
ф9_move_geometry_3 = Data(move_55.Geometry)
ф10_move_geometry_5 = Data(move_56.Geometry)
ф11_move_geometry_3 = Data(move_51.Geometry)
ф12_move_geometry_3 = Data(move_59.Geometry)
ф9_move_geometry_4 = Data(move_40.Geometry)
ф10_move_geometry_6 = Data(move_48.Geometry)
ф11_move_geometry_4 = Data(move_52.Geometry)
ф9_move_geometry_5 = Data(move_54.Geometry)
ф10_move_geometry_7 = Data(move_57.Geometry)
ф11_move_geometry_5 = Data(move_53.Geometry)
ф12_move_geometry_4 = Data(move_60.Geometry)
ф9_move_geometry_6 = Data(move_66.Geometry)
ф10_move_geometry_8 = Data(move_65.Geometry)
ф11_move_geometry_6 = Data(move_67.Geometry)
ф12_move_geometry_5 = Data(move_80.Geometry)
ф16_move_geometry = Data(move_16.Geometry)
ф16_move_geometry_2 = Data(move_15.Geometry)
ф16_vector_2pt_vector = Data(vector_2pt_9.Vector)
ф16_merge = Data(merge_13)
custom_preview_2 = CustomPreview(Geometry=ф1_move_geometry, Material=ф1_colour_swatch)
custom_preview_3 = CustomPreview(Geometry=ф4_move_geometry_5, Material=ф2_colour_swatch)
custom_preview_4 = CustomPreview(Geometry=ф5_move_geometry, Material=ф2_colour_swatch)
custom_preview_5 = CustomPreview(Geometry=ф3_move_geometry, Material=ф15_colour_swatch)
custom_preview_6 = CustomPreview(Geometry=ф6_move_geometry, Material=ф15_colour_swatch)
curve = Curve(ф2_move_geometry)
relay_13 = Relay([ф2_move_geometry_2, ф2_move_geometry_3])
relay_14 = Relay([ф6_cluster_text, ф6_surface_curve_curves, ф15_circle_cnr_2, ф12_surface_curve_curves_2, ф6_cluster_text_2, ф15_surface_curve_curves_3, ф3_cluster_text_7, ф12_circle_2])
ф15_move_geometry_2 = Data(move.Geometry)
relay_15 = Relay([ф9_move_geometry, ф10_move_geometry_3, ф11_move_geometry, ф12_move_geometry_2])
cluster_29 = Cluster_15(
    relay_4=[ф6_surface_curve_curves, ф15_circle_cnr_2, ф12_surface_curve_curves_2, ф6_cluster_text_2, ф15_surface_curve_curves_3, ф3_cluster_text_7, ф12_circle_2, ф15_geometry],
    relay=ф15_vector_xyz_vector_3,
    relay_2=ввод_explode_tree_14,
    geometry=ф15_boundary_surfaces,
    relay_3=ввод_explode_tree_14,
    geometry_2=ф15_boundary_surfaces_2)  # -> geometry_6, relay_5, relay_6
cluster_30 = Cluster_15(
    relay_4=[ф6_surface_curve_curves, ф15_circle_cnr_2, ф12_surface_curve_curves_2, ф6_cluster_text_2, ф15_surface_curve_curves_3, ф3_cluster_text_7, ф12_circle_2, ф15_geometry],
    relay=ф15_vector_xyz_vector_4,
    relay_2=ввод_explode_tree_14,
    geometry=ф15_boundary_surfaces,
    relay_3=ввод_explode_tree_14,
    geometry_2=ф15_boundary_surfaces_2)  # -> geometry_6, relay_5, relay_6
cluster_31 = Cluster_16(relay=ф9_move_geometry_4)
cluster_32 = Cluster_16(relay=ф10_move_geometry_6)
cluster_33 = Cluster_16(relay=ф11_move_geometry_4)
cluster_34 = Cluster_16(relay=ф9_move_geometry_5)
cluster_35 = Cluster_16(relay=ф10_move_geometry_7)
cluster_36 = Cluster_16(relay=ф11_move_geometry_5)
cluster_37 = Cluster_16(relay=ф12_move_geometry_4)
merge_14 = Merge(Data1=ф9_move_geometry_6, Data2=ф10_move_geometry_8, Data3=ф11_move_geometry_6, Data4=ф12_move_geometry_5)
geometry_51 = Geometry(ф16_move_geometry)
move_81 = Move(Geometry=ф16_move_geometry_2, Motion=ф16_vector_2pt_vector)  # -> Geometry, Transform
по_типу_brep_curve = CSharpScript(G=ф9_move_geometry_2)  # -> out, Breps, Curves; inputs G: tree
# ---------- по_типу_brep_curve: C# ----------
// #! csharp
using System;
using Rhino.Geometry;
using Grasshopper;
using Grasshopper.Kernel;
using Grasshopper.Kernel.Data;
using Grasshopper.Kernel.Types;

public class Script_Instance : GH_ScriptInstance
{
  static IGH_Goo Cast<T>(IGH_Goo g) where T : class, IGH_Goo, new()
  {
    if (g == null) return null;
    if (g is T) return g;
    var t = new T();
    if (t.CastFrom(g)) return t;
    T o;
    if (g.CastTo<T>(out o) && o != null) return o;
    return null;
  }

  private void RunScript(DataTree<object> G, ref object Breps, ref object Curves)
  {
    var raw = Component.Params.Input[0].VolatileData;
    var b = new DataTree<object>();
    var c = new DataTree<object>();
    for (int i = 0; i < raw.PathCount; i++)
    {
      var p = raw.Paths[i];
      b.EnsurePath(p); c.EnsurePath(p);
      foreach (var x in raw.get_Branch(p))
      {
        var g = x as IGH_Goo;
        b.Add(Cast<GH_Brep>(g), p);
        c.Add(Cast<GH_Curve>(g), p);
      }
    }
    Breps = b;
    Curves = c;
  }
}
# ---------- end по_типу_brep_curve ----------
по_типу_brep_curve_2 = CSharpScript(G=ф10_move_geometry_4)  # -> out, Breps, Curves; inputs G: tree; same code as по_типу_brep_curve
по_типу_brep_curve_3 = CSharpScript(G=ф11_move_geometry_2)  # -> out, Breps, Curves; inputs G: tree; same code as по_типу_brep_curve
по_типу_brep_curve_4 = CSharpScript(G=ф15_move_geometry)  # -> out, Breps, Curves; inputs G: tree; same code as по_типу_brep_curve
по_типу_brep_curve_5 = CSharpScript(G=ф9_move_geometry_3)  # -> out, Breps, Curves; inputs G: tree; same code as по_типу_brep_curve
по_типу_brep_curve_6 = CSharpScript(G=ф10_move_geometry_5)  # -> out, Breps, Curves; inputs G: tree; same code as по_типу_brep_curve
по_типу_brep_curve_7 = CSharpScript(G=ф11_move_geometry_3)  # -> out, Breps, Curves; inputs G: tree; same code as по_типу_brep_curve
по_типу_brep_curve_8 = CSharpScript(G=ф12_move_geometry_3)  # -> out, Breps, Curves; inputs G: tree; same code as по_типу_brep_curve
text_3 = DefineTextObject(Text=выводы.T, Plane=выводы.P, DimensionStyle=выводы.text)
custom_preview_7 = CustomPreview(Geometry=relay_13, Material=ф2_colour_swatch)
custom_preview_8 = CustomPreview(Geometry=relay_14, Material=ф15_colour_swatch)
ф12_move_geometry_6 = Data(move_79.Geometry)
ф13_move_geometry = Data(move_74.Geometry)
ф14_move_geometry_2 = Data(move_75.Geometry)
ф15_move_geometry_3 = Data(move_2.Geometry)
ф13_move_geometry_2 = Data(move_72.Geometry)
ф14_move_geometry_3 = Data(move_76.Geometry)
ф15_move_geometry_4 = Data(move_39.Geometry)
ф13_move_geometry_3 = Data(move_73.Geometry)
ф14_move_geometry_4 = Data(move_77.Geometry)
ф15_move_geometry_5 = Data(move_37.Geometry)
relay_16 = Relay([cluster_29.geometry_6, cluster_30.geometry_6])
relay_17 = Relay([cluster_29.relay_5, cluster_30.relay_5])
relay_18 = Relay([cluster_29.relay_6, cluster_30.relay_6])
relay_19 = Relay([по_типу_brep_curve_4.Curves, ф15_move_geometry_2])
relay_20 = Relay([по_типу_brep_curve.Breps, по_типу_brep_curve_2.Breps, по_типу_brep_curve_3.Breps])
geometry_52 = Geometry(по_типу_brep_curve_4.Breps)
relay_21 = Relay([merge_14, ф16_merge])
relay_22 = Relay([по_типу_brep_curve_5.Breps, по_типу_brep_curve_6.Breps, по_типу_brep_curve_7.Breps, по_типу_brep_curve_8.Breps])
geometry_53 = Geometry([cluster_31, cluster_32, cluster_33])
geometry_54 = Geometry([cluster_34, cluster_35, cluster_36, cluster_37])
deconstruct_brep_4 = DeconstructBrep(Brep=geometry_51)  # -> Faces, Edges, Vertices
relay_23 = Relay([ф13_move_geometry, ф14_move_geometry_2, relay_19, relay_16, ф15_move_geometry_3])
relay_24 = Relay([ф13_move_geometry_2, ф14_move_geometry_3, ф15_move_geometry_4, relay_18])
relay_25 = Relay([ф13_move_geometry_3, ф14_move_geometry_4, ф15_move_geometry_5, relay_17])
ф14_move_geometry_5 = Data(move_5.Geometry)
ф16_move_geometry_3 = Data(move_69.Geometry)
ф3_move_geometry_2 = Data(move_35.Geometry)
ф7_move_geometry = Data(move_27.Geometry)
ф7_move_geometry_2 = Data(move_26.Geometry)
relay_26 = Relay([relay_20, relay_22])
relay_27 = Relay([ф12_move_geometry_6, по_типу_brep_curve.Curves, по_типу_brep_curve_2.Curves, по_типу_brep_curve_3.Curves, geometry_53])
region_union_4 = RegionUnion(Curves=deconstruct_brep_4.Faces)
relay_28 = Relay([по_типу_brep_curve_5.Curves, по_типу_brep_curve_6.Curves, по_типу_brep_curve_7.Curves, geometry_54, по_типу_brep_curve_8.Curves])
relay_29 = Relay([ф7_move_geometry, relay_25])
relay_30 = Relay([ф7_move_geometry_2, relay_24])
boundary_surfaces_38 = BoundarySurfaces(Edges=region_union_4)
relay_31 = Relay([relay_27, relay_28])
relay_32 = Relay([ф3_move_geometry_2, relay_26, geometry_52])
relay_33 = Relay([ф6_move_geometry, ф3_move_geometry, ф1_move_geometry, ф5_move_geometry, relay_13, ф4_move_geometry_5, relay_14, ф14_move_geometry_5, ф16_move_geometry_3, region_union_4, move_81.Geometry])
ф3_move_geometry_3 = Data(move_44.Geometry)
ф6_move_geometry_2 = Data(move_43.Geometry)
ф5_move_geometry_2 = Data(move_21.Geometry)
ф4_move_geometry_6 = Data(move_8.Geometry)
ф16_move_geometry_4 = Data(move_13.Geometry)
ф2_move_geometry_4 = Data(move_7.Geometry)
ф15_panel_45 = Data(panel_9)
ф15_panel_10 = Data(panel_8)
geometry_55 = Geometry(relay_29)
relay_34 = Relay([ф2_move_geometry_4, relay_29, boundary_surfaces_38])
define_hatch = DefineHatch(Curve=relay_32, Pattern="Solid", Rotation=0, Scale=1)
relay_35 = Relay([ф3_move_geometry_3, ф6_move_geometry_2, ф5_move_geometry_2, ф4_move_geometry_6, curve, relay_30, relay_15, relay_21, ф16_move_geometry_4])
ф15_list_item_4 = Data(list_item_2)
только_поверхности = CSharpScript(G=geometry_55)  # -> out, B; inputs G: tree
# ---------- только_поверхности: C# ----------
// #! csharp
using System;
using Rhino.Geometry;
using Grasshopper;
using Grasshopper.Kernel;
using Grasshopper.Kernel.Data;
using Grasshopper.Kernel.Types;

public class Script_Instance : GH_ScriptInstance
{
  private void RunScript(DataTree<object> G, ref object B)
  {
    var t = new DataTree<object>();
    for (int i = 0; i < G.BranchCount; i++)
    {
      var p = G.Paths[i];
      t.EnsurePath(p);
      foreach (var x in G.Branch(i))
      {
        object v = x is IGH_Goo g ? g.ScriptVariable() : x;
        if (v is Brep || v is Surface || v is Extrusion) t.Add(v, p);
        else if (v is Curve c && c.IsClosed && c.IsPlanar()) t.Add(c, p);
      }
    }
    B = t;
  }
}
# ---------- end только_поверхности ----------
list_length_5 = ListLength(List=define_hatch)
define_hatch_2 = DefineHatch(Curve=relay_34, Pattern=ф15_list_item_4, Rotation=ф15_panel_45, Scale=ф15_panel_10)
define_hatch_3 = DefineHatch(Curve=relay_35, Pattern=ф15_list_item_4, Rotation=ф15_panel_45, Scale=ф15_panel_10)  # -> flatten(Hatch)
relay_36 = Relay([relay_35, ф2_move_geometry_4, ф3_move_geometry_2])
ф15_elefront_attributes = Data(elefront_attributes.Attributes)
brep_edges_6 = BrepEdges(Brep=только_поверхности.B)  # -> Naked, Interior, NonManifold
list_length_6 = ListLength(List=define_hatch_2)
repeat_data = RepeatData(Data=ф15_elefront_attributes, Length=list_length_5)
list_length_7 = ListLength(List=flatten(define_hatch_3))
curve_2 = Curve(relay_36)
ф7_move_geometry_3 = Data(move_78.Geometry)
ф8_move_geometry = Data(move_28.Geometry)
ф15_elefront_attributes_2 = Data(elefront_attributes_3.Attributes)
ф15_elefront_attributes_3 = Data(elefront_attributes_2.Attributes)
relay_37 = Relay([ф7_move_geometry_3, ф8_move_geometry, relay_31, relay_23, brep_edges_6.Naked])
repeat_data_2 = RepeatData(Data=ф15_elefront_attributes_3, Length=list_length_6)
repeat_data_3 = RepeatData(Data=ф15_elefront_attributes_2, Length=list_length_7)
geometry_56 = Geometry([relay_33, relay_37])
relay_38 = Relay([geometry_56, curve_2, text_3])
ф15_colour_swatch_2 = Data(colour_swatch_2)
geometry_57 = Geometry(flatten(relay_38))
custom_preview_9 = CustomPreview(Geometry=relay_38, Material=ф15_colour_swatch_2)
ф15_construct_point = Data(construct_point_4)
list_length_8 = ListLength(List=geometry_57)
replace_nulls = ReplaceNulls(Items=geometry_57, Replacements=ф15_construct_point)  # -> Items, Count
ф15_elefront_attributes_4 = Data(elefront_attributes_4.Attributes)
repeat_data_4 = RepeatData(Data=ф15_elefront_attributes_4, Length=list_length_8)
merge_15 = Merge(Data1=replace_nulls.Items, Data2=define_hatch, Data3=define_hatch_3, Data4=define_hatch_2)
merge_16 = Merge(Data1=repeat_data_4, Data2=repeat_data, Data3=repeat_data_3, Data4=repeat_data_2)
ф15_boolean_toggle = Data(boolean_toggle)
bake_objects = BakeObjects(Geometry=merge_15, Attributes=merge_16, Bake=ф15_boolean_toggle, createGroups=False, preset="Moderate")  # -> Message, Ghosts

# ==== cluster Cluster
relay = ClusterInput()
relay_2 = ClusterInput()
xy_plane = XYPlane(Origin=relay_2)
define_text_object = DefineTextObject(Text=relay, Plane=xy_plane)
center = Center(Geometric=define_text_object)  # -> Center, Dimension
line = Line(StartPoint=relay_2, EndPoint=center.Center)
scale = Scale(Geometry=line, Center=relay_2, Factor=1.5)  # -> Geometry, Transform
geometry = Geometry(relay_2)
end_points = EndPoints(Curve=scale.Geometry)  # -> Start, End
vector_2pt = Vector2Pt(PointA=end_points.End, PointB=end_points.Start, Unitize=False)  # -> Vector, Length
move = Move(Geometry=geometry, Motion=vector_2pt.Vector)  # -> Geometry, Transform
xy_plane_2 = XYPlane(Origin=move.Geometry)
define_text_object_2 = DefineTextObject(Text=relay, Plane=xy_plane_2)
text = ClusterOutput(define_text_object_2)

# ==== cluster Cluster_2
construct_point = ConstructPoint(XCoordinate=0, YCoordinate=0, ZCoordinate=0)
point_b = ClusterInput()
point_b_2 = ClusterInput()
vector_2pt = Vector2Pt(PointA=construct_point, PointB=point_b, Unitize=True)  # -> Vector, Length
vector_2pt_2 = Vector2Pt(PointA=construct_point, PointB=point_b_2, Unitize=True)  # -> Vector, Length
deconstruct_vector = DeconstructVector(Vector=vector_2pt.Vector)  # -> XComponent, YComponent, ZComponent
deconstruct_vector_2 = DeconstructVector(Vector=vector_2pt_2.Vector)  # -> XComponent, YComponent, ZComponent
similarity = Similarity(FirstNumber=deconstruct_vector.XComponent, SecondNumber=deconstruct_vector_2.XComponent, Threshold=0.1)  # -> Similarity, AbsoluteDifference
similarity_2 = Similarity(FirstNumber=deconstruct_vector.YComponent, SecondNumber=deconstruct_vector_2.YComponent, Threshold=0.1)  # -> Similarity, AbsoluteDifference
similarity_3 = Similarity(FirstNumber=deconstruct_vector.ZComponent, SecondNumber=deconstruct_vector_2.ZComponent, Threshold=0.1)  # -> Similarity, AbsoluteDifference
gate_and = GateAnd(A=similarity.Similarity, B=similarity_2.Similarity, C=similarity_3.Similarity)
gate_not = GateNot(A=gate_and)
result = ClusterOutput(gate_not)

# ==== cluster Cluster_3
number_slider = Slider(25, range=0..100)
number_slider_2 = Slider(27, range=0..100)
division = Division(A=Slider(12, range=0..100), B=2)
division_2 = Division(A=Slider(74, range=0..100), B=2)
division_3 = Division(A=Slider(96, range=0..100), B=2)
division_4 = Division(A=Slider(12, range=0..100), B=2)
negative = Negative(Value=division)
negative_2 = Negative(Value=division_3)
negative_3 = Negative(Value=division_2)
negative_4 = Negative(Value=division_4)
negative_5 = Negative(Value=number_slider)
negative_6 = Negative(Value=number_slider_2)
construct_domain = ConstructDomain(DomainStart=division, DomainEnd=negative)
construct_domain_2 = ConstructDomain(DomainStart=division_3, DomainEnd=negative_2)
construct_domain_3 = ConstructDomain(DomainStart=division_2, DomainEnd=negative_3)
construct_domain_4 = ConstructDomain(DomainStart=division_4, DomainEnd=negative_4)
xy_plane = XYPlane(Origin=Point(0, 0, 0))
construct_domain_5 = ConstructDomain(DomainStart=number_slider, DomainEnd=negative_5)
construct_domain_6 = ConstructDomain(DomainStart=number_slider_2, DomainEnd=negative_6)
xy_plane_2 = XYPlane(Origin=Point(0, 0, 0))
rectangle = Rectangle(Plane=xy_plane, XSize=construct_domain_2, YSize=construct_domain_4, Radius=0)  # -> Rectangle, Length
mass_addition = MassAddition(Input=[division, number_slider, "23"])  # -> Result, PartialResults
rectangle_2 = Rectangle(Plane=xy_plane, XSize=construct_domain, YSize=construct_domain_3, Radius=0)  # -> Rectangle, Length
rectangle_3 = Rectangle(Plane=xy_plane_2, XSize=construct_domain_5, YSize=construct_domain_6, Radius=0)  # -> Rectangle, Length
subtraction = Subtraction(A=division_2, B=number_slider_2)
mass_addition_2 = MassAddition(Input=[number_slider_2, division_4, "30"])  # -> Result, PartialResults
unit_y = UnitY(Factor=mass_addition_2.Result)
unit_x = UnitX(Factor=mass_addition.Result)
unit_x_2 = UnitX(Factor=mass_addition.Result)
rectangle_4 = ClusterOutput(rectangle_3.Rectangle)
subtraction_2 = Subtraction(A="6", B=subtraction)
reverse = Reverse(Vector=unit_x)
reverse_2 = Reverse(Vector=unit_y)
unit_y_2 = UnitY(Factor=subtraction_2)
move = Move(Geometry=rectangle_2.Rectangle, Motion=unit_x_2)  # -> Geometry, Transform
move_2 = Move(Geometry=rectangle_2.Rectangle, Motion=reverse)  # -> Geometry, Transform
move_3 = Move(Motion=Vector(0, 0, 10))  # -> Geometry, Transform
move_4 = Move(Geometry=move_2.Geometry, Motion=unit_y_2)  # -> Geometry, Transform
move_5 = Move(Geometry=move.Geometry, Motion=unit_y_2)  # -> Geometry, Transform
move_6 = Move(Geometry=rectangle.Rectangle, Motion=reverse_2)  # -> Geometry, Transform
curve = Curve(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)
panel = Panel("на запад")
end_points = EndPoints(Curve=curve)  # -> Start, End
deconstruct = Deconstruct(Point=end_points.End)  # -> XComponent, YComponent, ZComponent
merge = Merge(Data1=move_4.Geometry, Data2=move_6.Geometry, Data3=move_5.Geometry)
geometry = Geometry(end_points.Start)
radians = Radians(Degrees="40")
construct_point = ConstructPoint(XCoordinate=-48, YCoordinate=deconstruct.YComponent, ZCoordinate=deconstruct.ZComponent)
result = ClusterOutput(merge)
start = ClusterOutput(end_points.Start)
point = ClusterOutput(construct_point)
radians_2 = ClusterOutput(radians)

# ==== cluster Cluster_4
curve = ClusterInput()
construct_point = ConstructPoint(XCoordinate=0, YCoordinate=0, ZCoordinate=0)
end_points = EndPoints(Curve=simplify(curve))  # -> graft(Start), graft(End)
line = Line(StartPoint=end_points.Start, EndPoint=construct_point)
line_2 = Line(StartPoint=end_points.End, EndPoint=construct_point)
length = Length(Curve=line_2)
length_2 = Length(Curve=line)
integer = Integer(length_2)
integer_2 = Integer(length)
similarity = Similarity(FirstNumber=integer, SecondNumber=0, Threshold=1)  # -> Similarity, AbsoluteDifference
similarity_2 = Similarity(FirstNumber=integer_2, SecondNumber=0, Threshold=4)  # -> Similarity, AbsoluteDifference
gate_not = GateNot(A=similarity.Similarity)
gate_not_2 = GateNot(A=similarity_2.Similarity)
cull_pattern = CullPattern(List=end_points.Start, CullPattern=gate_not)
cull_pattern_2 = CullPattern(List=end_points.End, CullPattern=gate_not_2)
insert_items = InsertItems(List=cull_pattern, Item=cull_pattern_2, Indices=0, Wrap=False)
clean_tree = CleanTree(RemoveNulls=True, RemoveInvalid=True, RemoveEmpty=False, Tree=insert_items)
tree = ClusterOutput(clean_tree)

# ==== cluster Cluster_6
point_a = ClusterInput()
geometry = ClusterInput()
geometry_2 = ClusterInput()
angle = ClusterInput()
rotate = Rotate(Geometry=geometry_2, Angle=angle, Plane=PlaneXY(0, 0, 0))  # -> Geometry, Transform
construct_point = ConstructPoint(XCoordinate=0, YCoordinate=0, ZCoordinate=0)
vector_2pt = Vector2Pt(PointA=point_a, PointB=construct_point, Unitize=False)  # -> Vector, Length
move = Move(Geometry=geometry, Motion=vector_2pt.Vector)  # -> Geometry, Transform
angle_2 = ClusterInput()
rotate_2 = Rotate(Geometry=move.Geometry, Angle=angle_2, Plane=PlaneXY(0, 0, 0))  # -> Geometry, Transform
vector_2pt_2 = Vector2Pt(PointA=rotate.Geometry, PointB=construct_point, Unitize=False)  # -> Vector, Length
curves_b = ClusterInput()
point = ClusterInput()
relay = ClusterInput()
relay_2 = ClusterInput()
relay_3 = ClusterInput()
relay_4 = ClusterInput()
relay_5 = ClusterInput()
relay_6 = ClusterInput()
cluster = Cluster_5(curves_a=rotate_2.Geometry, curves_b=curves_b, point=point)  # -> surfaces, surfaces_2
move_2 = Move(Geometry=[relay_3, relay_4, relay_5], Motion=vector_2pt_2.Vector)  # -> Geometry, Transform
geometry_3 = Geometry(cluster.surfaces)
geometry_4 = Geometry(cluster.surfaces_2)
geometry_5 = Geometry([relay_2, relay, relay_6, move_2.Geometry])
geometry_6 = ClusterOutput(geometry_5)
geometry_7 = ClusterOutput(geometry_3)
geometry_8 = ClusterOutput(geometry_4)

# ==== cluster Cluster_11
relay = ClusterInput()
relay_2 = ClusterInput()
panel = ClusterInput()
panel_2 = Panel(relay_2)
panel_3 = Panel(panel)
panel_4 = Panel(relay)
boolean_toggle = BooleanToggle(False)
boolean_toggle_2 = BooleanToggle(True)
division = Division(A="3.3", B=2)
cluster = Cluster_10(
    relay_2="100",
    passing_switch_2=boolean_toggle,
    value="1.2",
    A=division,
    A_2=panel,
    A_3="0.3",
    passing_switch=boolean_toggle,
    A_4="2",
    A_5="0.3",
    A_6="0.51",
    A_7=panel,
    B="0.8",
    A_8="0.51",
    A_9=relay,
    A_10=relay_2,
    relay="10")  # -> geometry_7, unit_vector, geometry_8, nearest, nearest_2
cluster_2 = Cluster_10(
    relay_2="100",
    passing_switch_2=boolean_toggle_2,
    value="1.2",
    A=division,
    A_2=panel,
    A_3="0.3",
    passing_switch=boolean_toggle_2,
    A_4="2",
    A_5="0.3",
    A_6="0.51",
    A_7=panel,
    B="0.8",
    A_8="0.51",
    A_9=relay,
    A_10=relay_2,
    relay="10")  # -> geometry_7, unit_vector, geometry_8, nearest, nearest_2
nearest = ClusterOutput(cluster.nearest)
nearest_2 = ClusterOutput(cluster.nearest_2)
nearest_3 = ClusterOutput(cluster_2.nearest)
nearest_4 = ClusterOutput(cluster_2.nearest_2)
move = Move(Geometry=cluster.geometry_7, Motion=cluster.unit_vector)  # -> Geometry, Transform
move_2 = Move(Geometry=cluster.geometry_8, Motion=cluster.unit_vector)  # -> Geometry, Transform
move_3 = Move(Geometry=cluster_2.geometry_7, Motion=cluster_2.unit_vector)  # -> Geometry, Transform
move_4 = Move(Geometry=cluster_2.geometry_8, Motion=cluster_2.unit_vector)  # -> Geometry, Transform
geometry = Geometry([move.Geometry, move_2.Geometry, move_3.Geometry, move_4.Geometry])
geometry_2 = ClusterOutput(geometry)

# ==== cluster Cluster_12
B = ClusterInput()
subtraction = Subtraction(A=90, B=B)
radians = Radians(Degrees=subtraction)
geometry = Geometry(Line((0, -4.249464817e-11, 0), (0, 43.27760659, 0)))
negative = Negative(Value=radians)
xz_plane = XZPlane(Origin=Point(0, 0, 0))
rotate = Rotate(Geometry=geometry, Angle=negative, Plane=PlaneXY(0, 0, 0))  # -> Geometry, Transform
end_points = EndPoints(Curve=geometry)  # -> Start, End
end_points_2 = EndPoints(Curve=rotate.Geometry)  # -> Start, End
geometry_2 = ClusterOutput(rotate.Geometry)
offset = ClusterInput()
define_angular_dimension = DefineAngularDimension(Origin=end_points.Start, Point1=end_points.End, Point2=end_points_2.End, Offset=offset, internalize=False)
mirror = Mirror(Geometry=define_angular_dimension, Plane=xz_plane)  # -> Geometry, Transform
mirror_2 = Mirror(Geometry=rotate.Geometry, Plane=xz_plane)  # -> Geometry, Transform
geometry_3 = ClusterOutput(mirror.Geometry)
angular_dimension = ClusterOutput(define_angular_dimension)
geometry_4 = ClusterOutput(mirror_2.Geometry)

# ==== cluster Cluster_13
B = ClusterInput()
relay = ClusterInput()
subtraction = Subtraction(A=90, B=B)
degrees = ClusterInput()
division = Division(A=subtraction, B=90)
scale_nu = ScaleNU(Geometry=relay, Plane=PlaneXY(0, 0, 0), ScaleX=1, ScaleY=division, ScaleZ=1)  # -> Geometry, Transform
radians = Radians(Degrees=degrees)
edges = ClusterInput()
boundary_surfaces = BoundarySurfaces(Edges=flatten(scale_nu.Geometry))
boundary_surfaces_2 = BoundarySurfaces(Edges=flatten(edges))
region_difference = RegionDifference(CurvesA=boundary_surfaces_2, CurvesB=boundary_surfaces)
boundary_surfaces_3 = BoundarySurfaces(Edges=region_difference)
division_2 = Division(A=radians, B=2)
negative = Negative(Value=division_2)
construct_domain = ConstructDomain(DomainStart=division_2, DomainEnd=negative)
arc = Arc(Plane=PlaneXY(0, 0, 0), Radius=90, Angle=construct_domain)  # -> Arc, Length
angle = Angle(-1.570796327)
rotate = Rotate(Geometry=arc.Arc, Angle=angle, Plane=PlaneXY(0, 0, 0))  # -> Geometry, Transform
point = ClusterInput()
extrude_point = ExtrudePoint(Base=rotate.Geometry, Point=point)
region_intersection = RegionIntersection(CurvesA=boundary_surfaces_3, CurvesB=extrude_point)
result = ClusterOutput(region_intersection)

# ==== cluster Cluster_15
relay = ClusterInput()
relay_2 = ClusterInput()
geometry = ClusterInput()
relay_3 = ClusterInput()
geometry_2 = ClusterInput()
cluster = Cluster_14(relay=relay_2, geometry=geometry)
cluster_2 = Cluster_14(relay=relay_3, geometry=geometry_2)
relay_4 = ClusterInput()
geometry_3 = Geometry(relay_4)
geometry_4 = ClusterInput()
move = Move(Geometry=geometry_3, Motion=relay)  # -> Geometry, Transform
move_2 = Move(Geometry=cluster, Motion=relay)  # -> Geometry, Transform
move_3 = Move(Geometry=geometry_4, Motion=relay)  # -> Geometry, Transform
move_4 = Move(Geometry=cluster_2, Motion=relay)  # -> Geometry, Transform
geometry_5 = Geometry([move.Geometry, move_3.Geometry])
relay_5 = ClusterOutput(move_2.Geometry)
relay_6 = ClusterOutput(move_4.Geometry)
geometry_6 = ClusterOutput(geometry_5)

# ==== cluster Cluster_16
relay = ClusterInput()
center = Center(Geometric=relay)  # -> Center, Dimension
rotate_3d = Rotate3D(Geometry=relay, Angle=3.141592654, Center=center.Center, Axis=Vector(0, 0, 1))  # -> Geometry, Transform
vector_xyz = VectorXYZ(XComponent=Slider(-7.079, range=-8..4), YComponent=Slider(3.681, range=-8..5), ZComponent=0)  # -> Vector, Length
move = Move(Geometry=rotate_3d.Geometry, Motion=vector_xyz.Vector)  # -> Geometry, Transform
geometry = ClusterOutput(move.Geometry)

# ==== cluster Cluster_22
relay = ClusterInput()
relay_2 = ClusterInput()
cluster = Cluster_17(relay_2=relay, relay=relay_2)  # -> surfaces, list, result
geometry = Geometry(relay_2)
region_union = RegionUnion(Curves=cluster.surfaces)
curves_b = ClusterInput()
boundary_surfaces = BoundarySurfaces(Edges=cluster.list)
region_difference = RegionDifference(CurvesA=region_union, CurvesB=curves_b)
boundary_surfaces_2 = BoundarySurfaces(Edges=region_difference)
cluster_2 = Cluster_20(geometry_3=boundary_surfaces_2, surface=boundary_surfaces_2, curve=region_union)  # -> result, geometry_4, angular_dimension, geometry_5, line
angular_dimension = ClusterOutput(cluster_2.angular_dimension)
line = ClusterOutput(cluster_2.line)
geometry_2 = Geometry(cluster_2.geometry_4)
list = ClusterInput()
cull_pattern = CullPattern(List=list, CullPattern=cluster.result)
length = Length(Curve=geometry_2)
reverse_list = ReverseList(List=cull_pattern)
division = Division(A=cull_pattern, B=reverse_list)
cluster_3 = Cluster_21(A=reverse_list, B=length)  # -> geometry_2, geometry_3
geometry_3 = Geometry(cluster_2.geometry_5)
scale = Scale(Geometry=geometry_3, Center=Point(0, 0, 0), Factor=10)  # -> Geometry, Transform
geometry_4 = Geometry(cluster_3.geometry_3)
geometry_5 = Geometry(cluster_3.geometry_2)
region_intersection = RegionIntersection(CurvesA=geometry_5, CurvesB=graft(scale.Geometry))
boundary_surfaces_3 = BoundarySurfaces(Edges=geometry_4)
region_difference_2 = RegionDifference(CurvesA=region_intersection, CurvesB=graft(boundary_surfaces_3))
number = Number(cluster_2.result)
negative = Negative(Value=number)
rotate_3d = Rotate3D(Geometry=region_difference_2, Angle=graft(negative), Center=Point(0, 0, 0), Axis=Vector(0, 0, 1))  # -> Geometry, Transform
result = ClusterOutput(region_difference_2)
geometry_6 = ClusterOutput(rotate_3d.Geometry)

# ==== cluster Cluster_5
point = ClusterInput()
curves_a = ClusterInput()
curves_b = ClusterInput()
region_intersection = RegionIntersection(CurvesA=graft(curves_a), CurvesB=graft(curves_b))
extrude_point = ExtrudePoint(Base=region_intersection, Point=point)
brep_edges = BrepEdges(Brep=extrude_point)  # -> Naked, Interior, NonManifold
project = Project(Geometry=[brep_edges.Naked, brep_edges.Interior], Plane=PlaneXY(0, 0, 0))  # -> Geometry, Transform
removeduplicatelines = RemoveDuplicateLines(Lines=project.Geometry, Tolerance=0.01)  # -> flatten(UniqueLines)
project_2 = Project(Geometry=region_intersection, Plane=PlaneXY(0, 0, 0))  # -> flatten(Geometry), Transform
boundary_surfaces = BoundarySurfaces(Edges=removeduplicatelines)
region_union = RegionUnion(Curves=boundary_surfaces)
region_difference = RegionDifference(CurvesA=region_union, CurvesB=project_2.Geometry)
geometry = Geometry(project_2.Geometry)
boundary_surfaces_2 = BoundarySurfaces(Edges=region_difference)
boundary_surfaces_3 = BoundarySurfaces(Edges=geometry)
surfaces = ClusterOutput(boundary_surfaces_2)
surfaces_2 = ClusterOutput(boundary_surfaces_3)

# ==== cluster Cluster_10
panel = Panel("1.2")
value = ClusterInput()
A = ClusterInput()
A_2 = ClusterInput()
A_3 = ClusterInput()
passing_switch = ClusterInput()
A_4 = ClusterInput()
A_5 = ClusterInput()
A_6 = ClusterInput()
A_7 = ClusterInput()
B = ClusterInput()
A_8 = ClusterInput()
A_9 = ClusterInput()
A_10 = ClusterInput()
cluster = Cluster_9(
    value=value,
    A_10=A,
    A_2=A_2,
    A_3=A_3,
    passing_switch=passing_switch,
    A_4=A_4,
    A_5=A_5,
    A=A_6,
    A_6=A_7,
    B=B,
    A_7=A_8,
    A_8=A_9,
    A_9=A_10)  # -> closest_point, closest_point_4, curve_2, closest_point_2, curve_3, closest_point_3, geometry_6, geometry_8, geometry_7, box
deconstruct_box = DeconstructBox(Box=cluster.box)  # -> Plane, X, Y, Z
deconstruct_domain = DeconstructDomain(Domain=deconstruct_box.X)  # -> Start, End
division = Division(A=deconstruct_domain.Start, B=3)
construct_domain = ConstructDomain(DomainStart=division, DomainEnd=0)
domain_box = DomainBox(Base=PlaneXY(0, 0, 0), X=construct_domain, Y=deconstruct_box.Y, Z=deconstruct_box.Z)
panel_2 = Panel("10")
relay = ClusterInput()
scale = Scale(Geometry=cluster.closest_point, Center=Point(0, 0, 0), Factor=relay)  # -> Geometry, Transform
scale_2 = Scale(Geometry=cluster.closest_point_4, Center=Point(0, 0, 0), Factor=relay)  # -> Geometry, Transform
scale_3 = Scale(Geometry=cluster.geometry_6, Center=Point(0, 0, 0), Factor=relay)  # -> Geometry, Transform
scale_4 = Scale(Geometry=cluster.geometry_8, Center=Point(0, 0, 0), Factor=relay)  # -> Geometry, Transform
scale_5 = Scale(Geometry=cluster.geometry_7, Center=Point(0, 0, 0), Factor=relay)  # -> Geometry, Transform
deconstruct = Deconstruct(Point=scale_5.Geometry)  # -> XComponent, YComponent, ZComponent
xz_plane = XZPlane(Origin=Point(0, 0, 0))
xy_plane = XYPlane(Origin=Point(0, 0, 0))
brep_plane = BrepPlane(Brep=domain_box, Plane=xy_plane)  # -> Curves, Points
brep_plane_2 = BrepPlane(Brep=domain_box, Plane=xz_plane)  # -> Curves, Points
panel_3 = Panel("-600")
scale_6 = Scale(Geometry=cluster.closest_point_3, Center=Point(0, 0, 0), Factor=relay)  # -> Geometry, Transform
relay_2 = ClusterInput()
scale_7 = Scale(Geometry=cluster.closest_point_2, Center=Point(0, 0, 0), Factor=relay)  # -> Geometry, Transform
construct_point = ConstructPoint(XCoordinate=0, YCoordinate=0, ZCoordinate=deconstruct.ZComponent)
passing_switch_2 = ClusterInput()
geometry = Geometry(scale_7.Geometry)
geometry_2 = Geometry(scale_6.Geometry)
stream_freeze_gate = StreamFreezeGate(Data=relay_2, PassingSwitch=passing_switch_2, Freeze=False)
scale_8 = Scale(Geometry=[cluster.curve_2, brep_plane.Curves], Center=Point(0, 0, 0), Factor=relay)  # -> Geometry, Transform
scale_9 = Scale(Geometry=[cluster.curve_3, brep_plane_2.Curves], Center=Point(0, 0, 0), Factor=relay)  # -> Geometry, Transform
explode_tree = ExplodeTree(Data=geometry)  # -> Branch0, Branch1
explode_tree_2 = ExplodeTree(Data=geometry_2)  # -> Branch0, Branch1
negative = Negative(Value=relay_2)
yz_plane = YZPlane(Origin=Point(0, 0, 0))
construct_point_2 = ConstructPoint(XCoordinate=0, YCoordinate=0, ZCoordinate=0)
construct_point_3 = ConstructPoint(XCoordinate=0, YCoordinate=0, ZCoordinate=0)
addition = Addition(A=negative, B=stream_freeze_gate)
unit_x = UnitX(Factor=70)
unit_x_2 = UnitX(Factor=200)
construct_point_4 = ConstructPoint(XCoordinate=0, YCoordinate=0, ZCoordinate=0)  # disabled
unit_y = UnitY(Factor=addition)
line_sdl = LineSDL(Start=scale.Geometry, Direction=Vector(0, -40, 0), Length=100)  # disabled
define_angular_dimension = DefineAngularDimension(Origin=construct_point_4, Point1=explode_tree.Branch1, Point2=scale.Geometry, Offset=30, internalize=False)  # disabled
unit_vector = ClusterOutput(unit_y)

line = Line(StartPoint=[scale_3.Geometry, scale_4.Geometry], EndPoint=geometry)
line_2 = Line(StartPoint=scale_5.Geometry, EndPoint=geometry_2)  # -> flatten(Line)
length = Length(Curve=line_2)
length_2 = Length(Curve=line)
sort_list = SortList(Keys=length_2, ValuesValuesA=line)  # -> Keys, ValuesValuesA
sort_list_2 = SortList(Keys=length, ValuesValuesA=line_2)  # -> Keys, ValuesValuesA
list_item = ListItem(List=sort_list.ValuesValuesA, Index=-1, Wrap=True)
list_item_2 = ListItem(List=sort_list_2.ValuesValuesA, Index=-1, Wrap=True)
xy_plane_2 = XYPlane(Origin=Point(0, 0, 0))
geometry_3 = Geometry(list_item)
geometry_4 = Geometry(list_item_2)
explode_tree_3 = ExplodeTree(Data=geometry_3)  # -> Branch0, Branch1
curve_plane = CurvePlane(Curve=geometry_4, Plane=xy_plane_2)  # -> Points, ParamsC, ParamsP
curve_curve = CurveCurve(CurveA=explode_tree_3.Branch0, CurveB=explode_tree_3.Branch1)  # -> Points, ParamsA, ParamsB
deconstruct_2 = Deconstruct(Point=curve_plane.Points)  # -> XComponent, YComponent, ZComponent
subtraction = Subtraction(A=deconstruct_2.XComponent, B=1)
construct_point_5 = ConstructPoint(XCoordinate=subtraction, YCoordinate=0, ZCoordinate=deconstruct.ZComponent)
panel_4 = Panel(relay)
define_angular_dimension_2 = DefineAngularDimension(Origin=curve_curve.Points, Point1=explode_tree.Branch0, Point2=explode_tree.Branch1, Offset=panel_4, internalize=False)
define_angular_dimension_3 = DefineAngularDimension(Origin=construct_point, Point1=explode_tree_2.Branch1, Point2=construct_point_5, Offset=panel_4, internalize=False)

geometry_5 = Geometry(curve_curve.Points)
entwine = Entwine(Branch00=explode_tree.Branch0, Branch01=curve_curve.Points, Branch02=explode_tree.Branch1, FlattenInputs=True)
entwine_2 = Entwine(Branch00=explode_tree_2.Branch1, Branch01=construct_point, Branch02=construct_point_5, FlattenInputs=True)

polyline = PolyLine(Vertices=flatten(entwine), Closed=False)
polyline_2 = PolyLine(Vertices=flatten(entwine_2), Closed=False)

rotate = Rotate(Geometry=[scale_9.Geometry, define_angular_dimension_3, polyline_2, geometry_4], Angle=-1.570796327, Plane=yz_plane)  # -> Geometry, Transform
point = Point(curve_curve.Points)
point_2 = Point(curve_curve.Points)
line_3 = Line(StartPoint=construct_point_3, EndPoint=point_2)
vector_2pt = Vector2Pt(PointA=construct_point_2, PointB=point, Unitize=False)  # -> Vector, Length
move = Move(Geometry=rotate.Geometry, Motion=unit_x)  # -> Geometry, Transform
geometry_6 = Geometry([scale_8.Geometry, define_angular_dimension_2, polyline, curve_curve.Points, geometry_3])
define_angular_dimension_4 = DefineAngularDimension(Point1=explode_tree_2.Branch1, Point2=construct_point_5, Offset=panel_4, internalize=False)  # disabled
geometry_7 = ClusterOutput(geometry_6)
geometry_8 = ClusterOutput(move.Geometry)
polylinecurve_angle = PolyLineCurveAngle(PolyLine=polyline, Distance=1)  # -> Angle, Plane, Points
polylinecurve_angle_2 = PolyLineCurveAngle(PolyLine=polyline_2, Distance=1)  # -> Angle, Plane, Points
round = Round(Number=polylinecurve_angle_2.Angle)  # -> Nearest, Floor, Ceiling
round_2 = Round(Number=polylinecurve_angle.Angle)  # -> Nearest, Floor, Ceiling
nearest = ClusterOutput(round_2.Nearest)
nearest_2 = ClusterOutput(round.Nearest)

# ==== cluster Cluster_14
relay = ClusterInput()
addition = Addition(A=relay, B=90)
radians = Radians(Degrees=addition)
geometry = ClusterInput()
rotate = Rotate(Geometry=geometry, Angle=radians, Plane=PlaneXY(0, 0, 0))  # -> Geometry, Transform
geometry_2 = ClusterOutput(rotate.Geometry)

# ==== cluster Cluster_17
relay = ClusterInput()
relay_2 = ClusterInput()
point_in_curves = PointInCurves(Point=relay, Curves=graft(relay_2))  # -> flatten(Relationship), Index, Point
gate_not = GateNot(A=point_in_curves.Relationship)
cull_pattern = CullPattern(List=relay_2, CullPattern=gate_not)
result = ClusterOutput(gate_not)
extrude_point = ExtrudePoint(Base=cull_pattern, Point=relay)
list = ClusterOutput(cull_pattern)
project = Project(Geometry=extrude_point, Plane=PlaneXY(0, 0, 0))  # -> Geometry, Transform
brep_edges = BrepEdges(Brep=project.Geometry)  # -> Naked, Interior, NonManifold
relay_3 = Relay([brep_edges.Naked, brep_edges.Interior])
boundary_surfaces = BoundarySurfaces(Edges=flatten(relay_3))
surfaces = ClusterOutput(boundary_surfaces)

# ==== cluster Cluster_20
surface = ClusterInput()
curve = ClusterInput()
cluster = Cluster_19(surface=surface, curve=curve)  # -> angular_dimension, point_2, line_4, line_2
angular_dimension = ClusterOutput(cluster.angular_dimension)
line = ClusterOutput(cluster.line_2)
geometry = Geometry(cluster.point_2)
geometry_2 = Geometry(cluster.line_4)
unit_y = UnitY(Factor=1)
vector_angle = VectorAngle(Vector1=unit_y, Vector2=geometry_2, Radians=False)
radians = Radians(Degrees=vector_angle)
geometry_3 = ClusterInput()
addition = Addition(A=radians, B=3.141592654)
rotate_3d = Rotate3D(Geometry=geometry_3, Angle=addition, Center=geometry, Axis=Vector(0, 0, 1))  # -> Geometry, Transform
construct_point = ConstructPoint(XCoordinate=0, YCoordinate=0, ZCoordinate=0)
vector_2pt = Vector2Pt(PointA=geometry, PointB=construct_point, Unitize=False)  # -> Vector, Length
move = Move(Geometry=rotate_3d.Geometry, Motion=vector_2pt.Vector)  # -> Geometry, Transform
result = ClusterOutput(addition)
geometry_4 = ClusterOutput(geometry_2)
geometry_5 = ClusterOutput(move.Geometry)

# ==== cluster Cluster_21
A = ClusterInput()
B = ClusterInput()
division = Division(A=A, B=B)
arctangent = ArcTangent(Value=division)
degrees = Degrees(Radians=arctangent)
subtraction = Subtraction(A=90, B=degrees)
division_2 = Division(A=subtraction, B=90)
geometry = Geometry({Plane=PlaneXY(0, 0, 0), Radius=90})
scale_nu = ScaleNU(Geometry=geometry, Plane=PlaneXY(0, 0, 0), ScaleX=1, ScaleY=division_2, ScaleZ=1)  # -> Geometry, Transform
geometry_2 = ClusterOutput(geometry)
geometry_3 = ClusterOutput(scale_nu.Geometry)

# ==== cluster Cluster_9
panel = Panel("1.2")
value = ClusterInput()
A = ClusterInput()
negative = Negative(Value=value)
A_2 = ClusterInput()
A_3 = ClusterInput()
A_4 = ClusterInput()
A_5 = ClusterInput()
A_6 = ClusterInput()
A_7 = ClusterInput()
A_8 = ClusterInput()
A_9 = ClusterInput()
домейн_в_разные_стороны = ДомейнВРазныеСтороны(A=A)
домейн_в_разные_стороны_2 = ДомейнВРазныеСтороны(A=A_2)
домейн_в_разные_стороны_3 = ДомейнВРазныеСтороны(A=A_3)
домейн_в_разные_стороны_4 = ДомейнВРазныеСтороны(A=A_4)
домейн_в_разные_стороны_5 = ДомейнВРазныеСтороны(A=A_5)
домейн_в_разные_стороны_6 = ДомейнВРазныеСтороны(A=A_6)
домейн_в_разные_стороны_7 = ДомейнВРазныеСтороны(A=A_7)
домейн_в_разные_стороны_8 = ДомейнВРазныеСтороны(A=A_8)
домейн_в_разные_стороны_9 = ДомейнВРазныеСтороны(A=A_9)
deconstruct_domain = DeconstructDomain(Domain=домейн_в_разные_стороны_3)  # -> Start, End
deconstruct_domain_2 = DeconstructDomain(Domain=домейн_в_разные_стороны)  # -> Start, End
deconstruct_domain_3 = DeconstructDomain(Domain=домейн_в_разные_стороны_6)  # -> Start, End
deconstruct_domain_4 = DeconstructDomain(Domain=домейн_в_разные_стороны_8)  # -> Start, End
deconstruct_domain_5 = DeconstructDomain(Domain=домейн_в_разные_стороны_2)  # -> Start, End
deconstruct_domain_6 = DeconstructDomain(Domain=домейн_в_разные_стороны_4)  # -> Start, End
deconstruct_domain_7 = DeconstructDomain(Domain=домейн_в_разные_стороны_5)  # -> Start, End
deconstruct_domain_8 = DeconstructDomain(Domain=домейн_в_разные_стороны_8)  # -> Start, End
B = ClusterInput()
addition = Addition(A=deconstruct_domain_3.End, B=deconstruct_domain_4.Start)
deconstruct_domain_9 = DeconstructDomain(Domain=домейн_в_разные_стороны_6)  # -> Start, End
construct_domain = ConstructDomain(DomainStart=0, DomainEnd=0)
construct_domain_2 = ConstructDomain(DomainStart=0, DomainEnd=0)
construct_domain_3 = ConstructDomain(DomainStart=0, DomainEnd=0)
addition_2 = Addition(A=negative, B=deconstruct_domain_2.End)
construct_domain_4 = ConstructDomain(DomainStart=deconstruct_domain_8.End, DomainEnd=deconstruct_domain_8.End)
addition_3 = Addition(A=addition, B=B)
domain_box = DomainBox(Base=PlaneXY(0, 0, 0), X=домейн_в_разные_стороны_7, Y=домейн_в_разные_стороны_9, Z=домейн_в_разные_стороны_8)
addition_4 = Addition(A=deconstruct_domain_6.Start, B=deconstruct_domain_2.Start)
construct_domain_5 = ConstructDomain(DomainStart=deconstruct_domain_2.Start, DomainEnd=addition_2)
unit_z = UnitZ(Factor=addition_3)
construct_domain_6 = ConstructDomain(DomainStart=addition_4, DomainEnd=deconstruct_domain_2.End)
construct_domain_7 = ConstructDomain(DomainStart=deconstruct_domain_2.Start, DomainEnd=addition_2)
domain_box_2 = DomainBox(Base=PlaneXY(0, 0, 0), X=construct_domain, Y=домейн_в_разные_стороны_9, Z=construct_domain_2)
addition_5 = Addition(A=deconstruct_domain_7.Start, B=deconstruct_domain_9.Start)
domain_box_3 = DomainBox(Base=PlaneXY(0, 0, 0), X=construct_domain_3, Y=construct_domain_2, Z=домейн_в_разные_стороны_8)
addition_6 = Addition(A=deconstruct_domain_7.End, B=deconstruct_domain_9.End)
box = ClusterOutput(domain_box)
construct_domain_8 = ConstructDomain(DomainStart=addition_4, DomainEnd=deconstruct_domain_2.End)
box_corners = BoxCorners(Box=domain_box_2)  # -> CornerA, CornerB, CornerC, CornerD, CornerE, CornerF, CornerG, CornerH
box_corners_2 = BoxCorners(Box=domain_box_3)  # -> CornerA, CornerB, CornerC, CornerD, CornerE, CornerF, CornerG, CornerH
unit_z_2 = UnitZ(Factor=[addition_5, addition_6])
domain_box_4 = DomainBox(Base=PlaneXY(0, 0, 0), X=construct_domain_5, Y=домейн_в_разные_стороны_3, Z=домейн_в_разные_стороны_2)
A_10 = ClusterInput()
domain_box_5 = DomainBox(Base=PlaneXY(0, 0, 0), X=construct_domain_8, Y=домейн_в_разные_стороны_3, Z=домейн_в_разные_стороны_2)
cluster = Cluster_7(A=A_10, B=deconstruct_domain.Start, geometry=domain_box_4)  # -> result, geometry_2
passing_switch = ClusterInput()
cluster_2 = Cluster_7(A="3", B=deconstruct_domain.Start, geometry=domain_box_5)  # -> result, geometry_2
addition_7 = Addition(A=deconstruct_domain.Start, B=cluster_2.result)
multiplication = Multiplication(A=addition_7, B=2)
panel_2 = Panel(multiplication)
panel_3 = Panel(multiplication)
домейн_в_разные_стороны_10 = ДомейнВРазныеСтороны(A=panel_2)
домейн_в_разные_стороны_11 = ДомейнВРазныеСтороны(A=panel_3)
domain_box_6 = DomainBox(Base=PlaneXY(0, 0, 0), X=домейн_в_разные_стороны, Y=домейн_в_разные_стороны_11, Z=домейн_в_разные_стороны_6)
domain_box_7 = DomainBox(Base=PlaneXY(0, 0, 0), X=construct_domain_6, Y=домейн_в_разные_стороны_10, Z=домейн_в_разные_стороны_5)
domain_box_8 = DomainBox(Base=PlaneXY(0, 0, 0), X=construct_domain_7, Y=домейн_в_разные_стороны_10, Z=домейн_в_разные_стороны_5)
move = Move(Geometry=domain_box_7, Motion=unit_z_2)  # -> Geometry, Transform
move_2 = Move(Geometry=domain_box_8, Motion=unit_z_2)  # -> Geometry, Transform
relay = Relay([cluster.geometry_2, move_2.Geometry])
stream_freeze_gate = StreamFreezeGate(Data=relay, PassingSwitch=passing_switch, Freeze=False)
geometry = Geometry(cluster_2.geometry_2)
geometry_2 = Geometry([move.Geometry, domain_box_6, stream_freeze_gate])
reverse = Reverse(Vector=unit_z)
solid_union = SolidUnion(Geometry=[geometry_2, geometry])
move_3 = Move(Geometry=solid_union, Motion=reverse)  # -> Geometry, Transform
solid_difference = SolidDifference(BrepsA=move_3.Geometry, BrepsB=domain_box)
xy_plane = XYPlane(Origin=Point(0, 0, 0))
xz_plane = XZPlane(Origin=Point(0, 0, 0))
brep_plane = BrepPlane(Brep=solid_difference, Plane=xz_plane)  # -> flatten(Curves), Points
curve = Curve(brep_plane.Curves)
construct_point = ConstructPoint(XCoordinate=-10, YCoordinate=0, ZCoordinate=0)
construct_point_2 = ConstructPoint(XCoordinate=-10, YCoordinate=10, ZCoordinate=10)
geometry_3 = Geometry(box_corners.CornerA)
geometry_4 = Geometry(box_corners.CornerH)
geometry_5 = Geometry(box_corners_2.CornerA)
cluster_3 = Cluster_8(brep=domain_box_6, plane=xy_plane, point=construct_point_2)  # -> curve_2, closest_point_2
cluster_4 = Cluster_8(brep=domain_box_6, plane=xz_plane, point=construct_point_2)  # -> curve_2, closest_point_2
cluster_5 = Cluster_8(brep=solid_difference, plane=xy_plane, point=construct_point)  # -> curve_2, closest_point_2
cluster_6 = Cluster_8(brep=solid_difference, plane=xz_plane, point=construct_point)  # -> curve_2, closest_point_2
geometry_6 = ClusterOutput(geometry_3)
geometry_7 = ClusterOutput(geometry_5)
geometry_8 = ClusterOutput(geometry_4)
closest_point = ClusterOutput(cluster_3.closest_point_2)
curve_2 = ClusterOutput(cluster_5.curve_2)
closest_point_2 = ClusterOutput(cluster_5.closest_point_2)
curve_3 = ClusterOutput(cluster_6.curve_2)
closest_point_3 = ClusterOutput(cluster_6.closest_point_2)
closest_point_4 = ClusterOutput(cluster_4.closest_point_2)

# ==== cluster Cluster_19
surface = ClusterInput()
curve = ClusterInput()
cluster = Cluster_18(surface=surface, curve=curve)  # -> flatten(union), start, end
point = Point(cluster.union)
line = Line(StartPoint=cluster.start, EndPoint=cluster.end)
point_2 = ClusterOutput(point)
line_2 = ClusterOutput(line)
curve_closest_point = CurveClosestPoint(Point=point, Curve=line)  # -> Point, Parameter, Distance
geometry = Geometry([cluster.start, cluster.end])
line_3 = Line(StartPoint=point, EndPoint=curve_closest_point.Point)
set_difference = SetDifference(SetA=geometry, SetB=curve_closest_point.Point)
line_4 = ClusterOutput(line_3)
define_angular_dimension = DefineAngularDimension(Origin=point, Point1=set_difference, Point2=curve_closest_point.Point, Offset=45, Flip=False, internalize=False)
angular_dimension = ClusterOutput(define_angular_dimension)

# ==== cluster ДомейнВРазныеСтороны
A = ClusterInput()
division = Division(A=A, B=2)
negative = Negative(Value=division)
construct_domain = ConstructDomain(DomainStart=division, DomainEnd=negative)
domain = ClusterOutput(construct_domain)

# ==== cluster Cluster_7
A = ClusterInput()
B = ClusterInput()
addition = Addition(A=A, B=B)
result = ClusterOutput(addition)
unit_y = UnitY(Factor=addition)
reverse = Reverse(Vector=unit_y)
geometry = ClusterInput()
move = Move(Geometry=geometry, Motion=[unit_y, reverse])  # -> Geometry, Transform
geometry_2 = ClusterOutput(move.Geometry)

# ==== cluster Cluster_8
brep = ClusterInput()
plane = ClusterInput()
construct_point = ConstructPoint(XCoordinate=-10, YCoordinate=0, ZCoordinate=0)
brep_plane = BrepPlane(Brep=brep, Plane=plane)  # -> flatten(Curves), Points
point = ClusterInput()
curve = Curve(brep_plane.Curves)
curve_2 = ClusterOutput(curve)
explode = Explode(Curve=curve, Recursive=True)  # -> Segments, Vertices
closest_point = ClosestPoint(Point=point, Cloud=explode.Vertices)  # -> ClosestPoint, CPIndex, Distance
closest_point_2 = ClusterOutput(closest_point.ClosestPoint)

# ==== cluster Cluster_18
surface = ClusterInput()
curve = ClusterInput()
surface_curve = SurfaceCurve(Surface=surface, Curve=curve)  # -> Curves, Points, UVPoints, Normals, Parameters, Tangents
join_curves = JoinCurves(Curves=surface_curve.Curves, Preserve=False)  # -> flatten(Curves)
explode = Explode(Curve=join_curves, Recursive=True)  # -> Segments, Vertices
list_item = ListItem(List=curve, Index=1, Wrap=True)
end_points = EndPoints(Curve=join_curves)  # -> Start, End
start = ClusterOutput(end_points.Start)
end = ClusterOutput(end_points.End)
set_difference = SetDifference(SetA=explode.Vertices, SetB=[end_points.Start, end_points.End])
union = ClusterOutput(set_difference)
