# Grasshopper definition relief_demo_v4.gh (Grasshopper 1.0.8)
# plug-ins: Heteroptera, Pufferfish, DeCodingSpaces, Human, BubalusGH2.0, Cordyceps, Sasquatch

cordyceps = Cordyceps(HttpPort=26929, DebugLevel=0)  # -> About, Status, LastCommand
swatch = ColourSwatch(SwatchColor=RGB(0, 63, 255))  # disabled
unit_z = UnitZ(Factor=3)  # disabled
c_script = CSharpScript(color=swatch)  # -> out, A; inputs color: Color; disabled
# ---------- c_script: C# usings ----------
using System.Drawing;
# ---------- c_script: C# ----------
    var objects = new List<GeometryBase>();
    foreach(var obj in RhinoDocument.Objects.FindByDrawColor(color, false))
      objects.Add(obj.Geometry);
    A = objects;
# ---------- end c_script ----------
curve = Curve(c_script.A)  # disabled
boundary_surfaces = BoundarySurfaces(Edges=curve)  # disabled
panel = Panel("""20
16
30
10
0
0
0
16
10
0""")  # disabled
extrude = Extrude(Base=boundary_surfaces, Direction=unit_z)  # disabled
crv = Curve(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)
panel_2 = Panel("""7
7
14
0
0
0
0
7
6
0""")  # disabled
division = Division(A=panel, B=2)  # disabled
panel_4 = Panel("""5
5
5
5
5
5
5
5
5
5""")  # disabled
swatch_2 = ColourSwatch(SwatchColor=RGB(255, 0, 0))  # disabled
swatch_3 = ColourSwatch(SwatchColor=RGB(255, 191, 0))  # disabled
swatch_4 = ColourSwatch(SwatchColor=RGB(255, 255, 0))  # disabled
swatch_5 = ColourSwatch(SwatchColor=RGB(0, 255, 0))  # disabled
swatch_6 = ColourSwatch(SwatchColor=RGB(0, 0, 255))  # disabled
swatch_7 = ColourSwatch(SwatchColor=RGB(191, 0, 255))  # disabled
swatch_8 = ColourSwatch(SwatchColor=RGB(0, 255, 255))  # disabled
swatch_9 = ColourSwatch(SwatchColor=RGB(127, 0, 0))  # disabled
swatch_10 = ColourSwatch(SwatchColor=RGB(82, 165, 82))  # disabled
swatch_11 = ColourSwatch(SwatchColor=RGB(191, 255, 0))  # disabled
panel_5 = Panel("""12
8
25
4
0
0
0
15
5
0""")  # disabled
geometry = Geometry(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)
subtraction = Subtraction(A=panel_4, B=1)  # disabled
division_2 = Division(A=subtraction, B=2)  # disabled
panel_7 = Panel("""7
1.1
0
0
0
0
0
0
0
0""")
panel_8 = Panel("""8
7
14
10
0
7
0
7
7
7""")
division_3 = Division(A=panel_8, B=2)

swatch_12 = ColourSwatch(SwatchColor=RGB(255, 0, 0))
panel_9 = Panel(division_3)

panel_10 = Panel(division_2)  # disabled
panel_11 = Panel("""5
5
15
0
0
0
0
10
5
0""")  # disabled
division_4 = Division(A=panel_8, B=2)
python = GhPythonScript(color=swatch_2)  # -> out, a; inputs color: Color; disabled
# ---------- python: Python ----------
from Rhino.RhinoDoc import ActiveDoc
a = []
for obj in ActiveDoc.Objects.FindByDrawColor(color, False):
    a.append(obj.Geometry)
# ---------- end python ----------
python_2 = GhPythonScript(color=swatch_12)  # -> out, a; inputs color: Color; disabled; same code as python
c_script_2 = CSharpScript(color=swatch_2)  # -> out, A; inputs color: Color; disabled; same code as c_script
c_script_3 = CSharpScript(color=swatch_3)  # -> out, A; inputs color: Color; disabled; same code as c_script
c_script_4 = CSharpScript(color=swatch_4)  # -> out, A; inputs color: Color; disabled; same code as c_script
c_script_5 = CSharpScript(color=swatch_5)  # -> out, A; inputs color: Color; disabled; same code as c_script
c_script_6 = CSharpScript(color=swatch_6)  # -> out, A; inputs color: Color; disabled; same code as c_script
c_script_7 = CSharpScript(color=swatch_7)  # -> out, A; inputs color: Color; disabled; same code as c_script
c_script_8 = CSharpScript(color=swatch_8)  # -> out, A; inputs color: Color; disabled; same code as c_script
c_script_9 = CSharpScript(color=swatch_9)  # -> out, A; inputs color: Color; disabled; same code as c_script
c_script_10 = CSharpScript(color=swatch_10)  # -> out, A; inputs color: Color; disabled; same code as c_script
c_script_11 = CSharpScript(color=swatch_11)  # -> out, A; inputs color: Color; disabled; same code as c_script
c_script_12 = CSharpScript(color=swatch_12)  # -> out, A; inputs color: Color; same code as c_script
c_script_13 = CSharpScript(color=ColourSwatch(SwatchColor=RGB(255, 127, 0)))  # -> out, A; inputs color: Color; same code as c_script
c_script_14 = CSharpScript(color=ColourSwatch(SwatchColor=RGB(255, 255, 0)))  # -> out, A; inputs color: Color; same code as c_script
c_script_15 = CSharpScript(color=ColourSwatch(SwatchColor=RGB(0, 255, 0)))  # -> out, A; inputs color: Color; same code as c_script
c_script_16 = CSharpScript(color=ColourSwatch(SwatchColor=RGB(0, 0, 255)))  # -> out, A; inputs color: Color; same code as c_script
c_script_17 = CSharpScript(color=ColourSwatch(SwatchColor=RGB(191, 0, 255)))  # -> out, A; inputs color: Color; same code as c_script
c_script_18 = CSharpScript(color=ColourSwatch(SwatchColor=RGB(0, 255, 255)))  # -> out, A; inputs color: Color; same code as c_script
c_script_19 = CSharpScript(color=ColourSwatch(SwatchColor=RGB(127, 0, 0)))  # -> out, A; inputs color: Color; same code as c_script
c_script_20 = CSharpScript(color=ColourSwatch(SwatchColor=RGB(82, 165, 82)))  # -> out, A; inputs color: Color; same code as c_script
c_script_21 = CSharpScript(color=ColourSwatch(SwatchColor=RGB(191, 255, 0)))  # -> out, A; inputs color: Color; same code as c_script
curve_2 = Curve(c_script_11.A)  # disabled
curve_3 = Curve(c_script_21.A)
curve_4 = Curve(c_script_2.A)  # disabled
curve_5 = Curve(c_script_3.A)  # disabled
curve_6 = Curve(c_script_4.A)  # disabled
curve_7 = Curve(c_script_5.A)  # disabled
curve_8 = Curve(c_script_6.A)  # disabled
curve_9 = Curve(c_script_7.A)  # disabled
curve_10 = Curve(c_script_8.A)  # disabled
curve_11 = Curve(c_script_9.A)  # disabled
curve_12 = Curve(c_script_10.A)  # disabled
curve_13 = Curve(c_script_12.A)
curve_14 = Curve(c_script_13.A)
curve_15 = Curve(c_script_14.A)
curve_16 = Curve(c_script_15.A)
curve_17 = Curve(c_script_16.A)
curve_18 = Curve(c_script_17.A)
curve_19 = Curve(c_script_18.A)
curve_20 = Curve(c_script_19.A)
curve_21 = Curve(c_script_20.A)
number_slider = Slider(1000, range=0..1000)
explode = Explode(Curve=curve_4, Recursive=True)  # -> flatten(Segments), Vertices; disabled
explode_2 = Explode(Curve=curve_5, Recursive=True)  # -> flatten(Segments), Vertices; disabled
explode_3 = Explode(Curve=curve_6, Recursive=True)  # -> flatten(Segments), Vertices; disabled
explode_4 = Explode(Curve=curve_8, Recursive=True)  # -> flatten(Segments), Vertices; disabled
explode_5 = Explode(Curve=curve_9, Recursive=True)  # -> flatten(Segments), Vertices; disabled
explode_6 = Explode(Curve=curve_10, Recursive=True)  # -> flatten(Segments), Vertices; disabled
explode_7 = Explode(Curve=curve_11, Recursive=True)  # -> flatten(Segments), Vertices; disabled
explode_8 = Explode(Curve=curve_12, Recursive=True)  # -> flatten(Segments), Vertices; disabled
explode_9 = Explode(Curve=curve_2, Recursive=True)  # -> flatten(Segments), Vertices; disabled
explode_10 = Explode(Curve=curve_13, Recursive=True)  # -> flatten(Segments), Vertices
explode_11 = Explode(Curve=curve_14, Recursive=True)  # -> flatten(Segments), Vertices
explode_12 = Explode(Curve=curve_15, Recursive=True)  # -> flatten(Segments), Vertices
explode_13 = Explode(Curve=curve_17, Recursive=True)  # -> flatten(Segments), Vertices
explode_14 = Explode(Curve=curve_18, Recursive=True)  # -> flatten(Segments), Vertices
explode_15 = Explode(Curve=curve_19, Recursive=True)  # -> flatten(Segments), Vertices
explode_16 = Explode(Curve=curve_20, Recursive=True)  # -> flatten(Segments), Vertices
explode_17 = Explode(Curve=curve_21, Recursive=True)  # -> flatten(Segments), Vertices
explode_18 = Explode(Curve=curve_3, Recursive=True)  # -> flatten(Segments), Vertices
explode_19 = Explode(Curve=curve_7, Recursive=True)  # -> flatten(Segments), Vertices; disabled
explode_20 = Explode(Curve=curve_16, Recursive=True)  # -> flatten(Segments), Vertices

geometry_2 = Geometry(<curve referenced from the Rhino model>)  # disabled
geometry_3 = Geometry(<curve referenced from the Rhino model>)  # disabled

removeduplicatelines = RemoveDuplicateLines(Lines=explode_2.Segments, Tolerance=0.01)  # disabled
removeduplicatelines_2 = RemoveDuplicateLines(Lines=explode_19.Segments, Tolerance=0.01)  # disabled
removeduplicatelines_3 = RemoveDuplicateLines(Lines=explode_4.Segments, Tolerance=0.01)  # disabled
removeduplicatelines_4 = RemoveDuplicateLines(Lines=explode_6.Segments, Tolerance=0.01)  # disabled
removeduplicatelines_5 = RemoveDuplicateLines(Lines=explode_11.Segments, Tolerance=0.01)
removeduplicatelines_6 = RemoveDuplicateLines(Lines=explode_20.Segments, Tolerance=0.01)
removeduplicatelines_7 = RemoveDuplicateLines(Lines=explode_13.Segments, Tolerance=0.01)
removeduplicatelines_8 = RemoveDuplicateLines(Lines=explode_15.Segments, Tolerance=0.01)
removeduplicatelines_9 = RemoveDuplicateLines(Lines=explode.Segments, Tolerance=0.01)  # disabled
removeduplicatelines_10 = RemoveDuplicateLines(Lines=explode_3.Segments, Tolerance=0.01)  # disabled
removeduplicatelines_11 = RemoveDuplicateLines(Lines=explode_5.Segments, Tolerance=0.01)  # disabled
removeduplicatelines_12 = RemoveDuplicateLines(Lines=explode_7.Segments, Tolerance=0.01)  # disabled
removeduplicatelines_13 = RemoveDuplicateLines(Lines=explode_8.Segments, Tolerance=0.01)  # disabled
removeduplicatelines_14 = RemoveDuplicateLines(Lines=explode_9.Segments, Tolerance=0.01)  # disabled
removeduplicatelines_15 = RemoveDuplicateLines(Lines=explode_10.Segments, Tolerance=0.01)
removeduplicatelines_16 = RemoveDuplicateLines(Lines=explode_12.Segments, Tolerance=0.01)
removeduplicatelines_17 = RemoveDuplicateLines(Lines=explode_14.Segments, Tolerance=0.01)
removeduplicatelines_18 = RemoveDuplicateLines(Lines=explode_16.Segments, Tolerance=0.01)
removeduplicatelines_19 = RemoveDuplicateLines(Lines=explode_17.Segments, Tolerance=0.01)
removeduplicatelines_20 = RemoveDuplicateLines(Lines=explode_18.Segments, Tolerance=0.01)
unit_z_2 = UnitZ(Factor=number_slider)
project = Project(Geometry=removeduplicatelines, Plane=PlaneXY(0, 0, 0))  # -> Geometry, Transform; disabled
project_2 = Project(Geometry=removeduplicatelines_10, Plane=PlaneXY(0, 0, 0))  # -> Geometry, Transform; disabled
project_3 = Project(Geometry=removeduplicatelines_2, Plane=PlaneXY(0, 0, 0))  # -> Geometry, Transform; disabled
project_4 = Project(Geometry=removeduplicatelines_3, Plane=PlaneXY(0, 0, 0))  # -> Geometry, Transform; disabled
project_5 = Project(Geometry=removeduplicatelines_15, Plane=PlaneXY(0, 0, 0))  # -> Geometry, Transform
project_6 = Project(Geometry=removeduplicatelines_5, Plane=PlaneXY(0, 0, 0))  # -> Geometry, Transform
project_7 = Project(Geometry=removeduplicatelines_16, Plane=PlaneXY(0, 0, 0))  # -> Geometry, Transform
project_8 = Project(Geometry=removeduplicatelines_6, Plane=PlaneXY(0, 0, 0))  # -> Geometry, Transform
project_9 = Project(Geometry=removeduplicatelines_7, Plane=PlaneXY(0, 0, 0))  # -> Geometry, Transform
project_10 = Project(Geometry=removeduplicatelines_9, Plane=PlaneXY(0, 0, 0))  # -> Geometry, Transform; disabled
project_11 = Project(Geometry=removeduplicatelines_11, Plane=PlaneXY(0, 0, 0))  # -> Geometry, Transform; disabled
project_12 = Project(Geometry=removeduplicatelines_4, Plane=PlaneXY(0, 0, 0))  # -> Geometry, Transform; disabled
project_13 = Project(Geometry=removeduplicatelines_12, Plane=PlaneXY(0, 0, 0))  # -> Geometry, Transform; disabled
project_14 = Project(Geometry=removeduplicatelines_13, Plane=PlaneXY(0, 0, 0))  # -> Geometry, Transform; disabled
project_15 = Project(Geometry=removeduplicatelines_14, Plane=PlaneXY(0, 0, 0))  # -> Geometry, Transform; disabled
project_16 = Project(Geometry=removeduplicatelines_17, Plane=PlaneXY(0, 0, 0))  # -> Geometry, Transform
project_17 = Project(Geometry=removeduplicatelines_8, Plane=PlaneXY(0, 0, 0))  # -> Geometry, Transform
project_18 = Project(Geometry=removeduplicatelines_18, Plane=PlaneXY(0, 0, 0))  # -> Geometry, Transform
project_19 = Project(Geometry=removeduplicatelines_19, Plane=PlaneXY(0, 0, 0))  # -> Geometry, Transform
project_20 = Project(Geometry=removeduplicatelines_20, Plane=PlaneXY(0, 0, 0))  # -> Geometry, Transform
reverse = Reverse(Vector=unit_z_2)  # disabled
geometry_4 = Geometry(<brep referenced from the Rhino model>)  # disabled
construct_mesh = ConstructMesh(Vertices=[Point(0, 0, 0), Point(10, 0, 0), Point(10, 10, 0), Point(0, 10, 0)], Faces={A=0, B=1, C=2, D=3})  # disabled
getguid_by_selection = GetGuidBySelection(SaveGuids0_TypeName="InstanceReference", SaveGuids0_Trees_Branch0_Path="{0}")  # -> Guid, Geometry, ObjectAttributes, LayerName, ObjectTypes; disabled
point = Point()  # disabled
deconstruct_brep = DeconstructBrep(Brep=geometry_4)  # -> Faces, Edges, Vertices; disabled
jitter = Jitter(List=point, Jitter=1, Seed=2)  # -> Values, Indices; disabled
area = Area(Geometry=deconstruct_brep.Faces)  # -> Area, Centroid; disabled
cluster = Cluster_6(
    list_6=panel_10,
    list=panel_10,
    list_7=panel_10,
    list_2=panel_10,
    list_8=panel_10,
    list_3=panel_10,
    list_9=panel_10,
    list_4=panel_10,
    list_10=panel_10,
    list_5=panel_10)  # -> i_6, i, i_7, i_2, i_8, i_3, i_9, i_4, i_10, i_5; disabled
cluster_2 = Cluster_6(
    list_6=panel_9,
    list=panel_9,
    list_7=panel_9,
    list_2=panel_9,
    list_8=panel_9,
    list_3=panel_9,
    list_9=panel_9,
    list_4=panel_9,
    list_10=panel_9,
    list_5=panel_9)  # -> i_6, i, i_7, i_2, i_8, i_3, i_9, i_4, i_10, i_5
number_slider_2 = Slider(0.5, range=0..1)  # disabled
min_max = MinMax(Number=area.Area)  # -> Minimum, Maximum; disabled
list_length = ListLength(List=jitter.Values)  # disabled
button = Button()  # disabled
member_index = MemberIndex(Set=area.Area, Member=min_max.Maximum)  # -> Index, Count; disabled
multiplication = Multiplication(A=list_length, B=0.3)  # disabled
list_item = ListItem(List=deconstruct_brep.Faces, Index=member_index.Index, Wrap=True)  # disabled
subtraction_2 = Subtraction(A=list_length, B=multiplication)  # disabled
list_item_2 = ListItem(List=list_item, Index=0, Wrap=True)  # disabled
subtraction_3 = Subtraction(A=subtraction_2, B=multiplication)  # disabled
brep_edges = BrepEdges(Brep=list_item_2)  # -> Naked, Interior, NonManifold; disabled
join_curves = JoinCurves(Curves=brep_edges.Naked, Preserve=False)  # disabled
closed = Closed(Curve=join_curves)  # -> Closed, Periodic; disabled
entwine = Entwine(Branch00=multiplication, Branch01=multiplication, Branch02=subtraction_3, FlattenInputs=True)  # disabled
geometry_5 = Geometry(<brep referenced from the Rhino model>)  # disabled
geometry_6 = Geometry(geometry_5)  # disabled
geometry_7 = Geometry(flatten([project_10.Geometry, project.Geometry, project_2.Geometry, project_3.Geometry, project_4.Geometry, project_11.Geometry, project_12.Geometry, project_13.Geometry, project_14.Geometry, project_15.Geometry]))  # disabled
geometry_8 = Geometry(flatten([project_5.Geometry, project_6.Geometry, project_7.Geometry, project_8.Geometry, project_9.Geometry, project_16.Geometry, project_17.Geometry, project_18.Geometry, project_19.Geometry, project_20.Geometry]))
addgeometrys = AddGeometrys(
    Run=button,
    GeometryGuid=flatten(getguid_by_selection.Guid),
    GeometryLocation=flatten(point),
    ScaleDomain=Domain(0.7, 1.2),
    RotateDomain=Domain(0, 360),
    AllocationRatio=flatten(entwine),
    GeometryPlane=flatten(PlaneXY(0, 0, 0)),
    Seed=2,
    Accurate=True)  # disabled
curve_22 = Curve(geometry_7)  # disabled
curve_23 = Curve(geometry_8)
explode_21 = Explode(Curve=curve_22, Recursive=True)  # -> flatten(Segments), Vertices; disabled
explode_22 = Explode(Curve=curve_23, Recursive=True)  # -> flatten(Segments), Vertices
line = Line(explode_21.Segments)  # disabled
line_2 = Line(explode_22.Segments)
line_3 = Line(Line((639.4601839, 1371.417843, -407.8461226), (1647.773799, 467.1433582, -425.5021014)))  # disabled
network_from_lines = NetworkFromLines(Lines=line)  # -> PointPointTopology, ConnectionPointTopology, Points, Lines; disabled
network_from_lines_2 = NetworkFromLines(Lines=line_2)  # -> PointPointTopology, ConnectionPointTopology, Points, Lines
polygons_from_lines = PolygonsFromLines(Lines=network_from_lines_2.Lines, MinBlockSize=0)  # -> Polygons, SynchronizedValues
polygons_from_lines_2 = PolygonsFromLines(Lines=network_from_lines.Lines, MinBlockSize=0)  # -> Polygons, SynchronizedValues; disabled
explode_23 = Explode(Curve=polygons_from_lines_2.Polygons, Recursive=False)  # -> Segments, Vertices; disabled
explode_24 = Explode(Curve=polygons_from_lines.Polygons, Recursive=False)  # -> Segments, Vertices
simplify_tree = SimplifyTree(Tree=explode_23.Segments, Front=False)  # disabled
simplify_tree_2 = SimplifyTree(Tree=explode_24.Segments, Front=False)
geometry_9 = Geometry(flatten(simplify_tree))  # disabled

geometry_10 = Geometry(flatten(simplify_tree_2))
crv_2 = Curve(graft(project_5.Geometry))
curve_middle = CurveMiddle(Curve=geometry_10)
isoncurve = CSharpScript(x=crv_2, y=curve_middle)  # -> out, A; inputs x: Curve, y: Point3d
# ---------- isoncurve: C# ----------
    //We only use this method if there is a curve
    if(x != null)
    {
      //T is the paramenter on the curve
      double t;

      //A is assigned with true if closest point to y is within model tolerance,
      //otherwise it will be assigned false, and t will not be calculated
      A = x.ClosestPoint(y, out t, RhinoDoc.ActiveDoc.ModelAbsoluteTolerance);
    }
# ---------- end isoncurve ----------
simplify_tree_3 = SimplifyTree(Tree=isoncurve.A, Front=False)
flip_matrix = FlipMatrix(Data=simplify_tree_3)
replace_nulls = ReplaceNulls(Items=flip_matrix, Replacements=0)  # -> Items, Count
mass_addition = MassAddition(Input=replace_nulls.Items)  # -> flatten(Result), PartialResults
multiplication_2 = Multiplication(A=mass_addition.Result, B=cluster_2.i_6)  # -> graft(Result)

crv_3 = Curve(graft(project_10.Geometry))  # disabled
geometry_11 = Geometry(flatten(simplify_tree))  # disabled
geometry_12 = Geometry(flatten(simplify_tree))  # disabled

geometry_13 = Geometry(flatten(simplify_tree_2))
crv_4 = Curve(graft(project_19.Geometry))
curve_middle_2 = CurveMiddle(Curve=geometry_13)
isoncurve_2 = CSharpScript(x=crv_4, y=curve_middle_2)  # -> out, A; inputs x: Curve, y: Point3d; same code as isoncurve
simplify_tree_4 = SimplifyTree(Tree=isoncurve_2.A, Front=False)
flip_matrix_2 = FlipMatrix(Data=simplify_tree_4)
replace_nulls_2 = ReplaceNulls(Items=flip_matrix_2, Replacements=0)  # -> Items, Count
mass_addition_2 = MassAddition(Input=replace_nulls_2.Items)  # -> flatten(Result), PartialResults
multiplication_3 = Multiplication(A=mass_addition_2.Result, B=cluster_2.i_10)  # -> graft(Result)

geometry_14 = Geometry(flatten(simplify_tree_2))
crv_5 = Curve(graft(project_20.Geometry))
curve_middle_3 = CurveMiddle(Curve=geometry_14)
isoncurve_3 = CSharpScript(x=crv_5, y=curve_middle_3)  # -> out, A; inputs x: Curve, y: Point3d; same code as isoncurve
simplify_tree_5 = SimplifyTree(Tree=isoncurve_3.A, Front=False)
flip_matrix_3 = FlipMatrix(Data=simplify_tree_5)
replace_nulls_3 = ReplaceNulls(Items=flip_matrix_3, Replacements=0)  # -> Items, Count
mass_addition_3 = MassAddition(Input=replace_nulls_3.Items)  # -> flatten(Result), PartialResults
multiplication_4 = Multiplication(A=mass_addition_3.Result, B=cluster_2.i_5)  # -> graft(Result)

geometry_15 = Geometry(flatten(simplify_tree))  # disabled
crv_6 = Curve(graft(project_12.Geometry))  # disabled

geometry_16 = Geometry(flatten(simplify_tree_2))
crv_7 = Curve(graft(project_9.Geometry))
curve_middle_4 = CurveMiddle(Curve=geometry_16)
isoncurve_4 = CSharpScript(x=crv_7, y=curve_middle_4)  # -> out, A; inputs x: Curve, y: Point3d; same code as isoncurve
simplify_tree_6 = SimplifyTree(Tree=isoncurve_4.A, Front=False)
flip_matrix_4 = FlipMatrix(Data=simplify_tree_6)
replace_nulls_4 = ReplaceNulls(Items=flip_matrix_4, Replacements=0)  # -> Items, Count
mass_addition_4 = MassAddition(Input=replace_nulls_4.Items)  # -> flatten(Result), PartialResults
multiplication_5 = Multiplication(A=mass_addition_4.Result, B=cluster_2.i_8)  # -> graft(Result)

crv_8 = Curve(graft(project_17.Geometry))
geometry_17 = Geometry(flatten(simplify_tree_2))
curve_middle_5 = CurveMiddle(Curve=geometry_17)
isoncurve_5 = CSharpScript(x=crv_8, y=curve_middle_5)  # -> out, A; inputs x: Curve, y: Point3d; same code as isoncurve
simplify_tree_7 = SimplifyTree(Tree=isoncurve_5.A, Front=False)
flip_matrix_5 = FlipMatrix(Data=simplify_tree_7)
replace_nulls_5 = ReplaceNulls(Items=flip_matrix_5, Replacements=0)  # -> Items, Count
mass_addition_5 = MassAddition(Input=replace_nulls_5.Items)  # -> flatten(Result), PartialResults
multiplication_6 = Multiplication(A=mass_addition_5.Result, B=cluster_2.i_9)  # -> graft(Result)

geometry_18 = Geometry(flatten(simplify_tree))  # disabled
geometry_19 = Geometry(flatten(simplify_tree))  # disabled
geometry_20 = Geometry(flatten(simplify_tree))  # disabled
geometry_21 = Geometry(flatten(simplify_tree))  # disabled
geometry_22 = Geometry(flatten(simplify_tree))  # disabled
geometry_23 = Geometry(flatten(simplify_tree))  # disabled

geometry_24 = Geometry(flatten(simplify_tree_2))
crv_9 = Curve(graft(project_6.Geometry))
curve_middle_6 = CurveMiddle(Curve=geometry_24)
isoncurve_6 = CSharpScript(x=crv_9, y=curve_middle_6)  # -> out, A; inputs x: Curve, y: Point3d; same code as isoncurve
simplify_tree_8 = SimplifyTree(Tree=isoncurve_6.A, Front=False)
flip_matrix_6 = FlipMatrix(Data=simplify_tree_8)
replace_nulls_6 = ReplaceNulls(Items=flip_matrix_6, Replacements=0)  # -> Items, Count
mass_addition_6 = MassAddition(Input=replace_nulls_6.Items)  # -> flatten(Result), PartialResults
multiplication_7 = Multiplication(A=mass_addition_6.Result, B=cluster_2.i)  # -> graft(Result)

geometry_25 = Geometry(flatten(simplify_tree_2))
crv_10 = Curve(graft(project_7.Geometry))
curve_middle_7 = CurveMiddle(Curve=geometry_25)
isoncurve_7 = CSharpScript(x=crv_10, y=curve_middle_7)  # -> out, A; inputs x: Curve, y: Point3d; same code as isoncurve
simplify_tree_9 = SimplifyTree(Tree=isoncurve_7.A, Front=False)
flip_matrix_7 = FlipMatrix(Data=simplify_tree_9)
replace_nulls_7 = ReplaceNulls(Items=flip_matrix_7, Replacements=0)  # -> Items, Count
mass_addition_7 = MassAddition(Input=replace_nulls_7.Items)  # -> flatten(Result), PartialResults
multiplication_8 = Multiplication(A=mass_addition_7.Result, B=cluster_2.i_7)  # -> graft(Result)

geometry_26 = Geometry(flatten(simplify_tree_2))
crv_11 = Curve(graft(project_8.Geometry))
curve_middle_8 = CurveMiddle(Curve=geometry_26)
isoncurve_8 = CSharpScript(x=crv_11, y=curve_middle_8)  # -> out, A; inputs x: Curve, y: Point3d; same code as isoncurve
simplify_tree_10 = SimplifyTree(Tree=isoncurve_8.A, Front=False)
flip_matrix_8 = FlipMatrix(Data=simplify_tree_10)
replace_nulls_8 = ReplaceNulls(Items=flip_matrix_8, Replacements=0)  # -> Items, Count
mass_addition_8 = MassAddition(Input=replace_nulls_8.Items)  # -> flatten(Result), PartialResults
multiplication_9 = Multiplication(A=mass_addition_8.Result, B=cluster_2.i_2)  # -> graft(Result)

geometry_27 = Geometry(flatten(simplify_tree_2))
crv_12 = Curve(graft(project_16.Geometry))
curve_middle_9 = CurveMiddle(Curve=geometry_27)
isoncurve_9 = CSharpScript(x=crv_12, y=curve_middle_9)  # -> out, A; inputs x: Curve, y: Point3d; same code as isoncurve
simplify_tree_11 = SimplifyTree(Tree=isoncurve_9.A, Front=False)
flip_matrix_9 = FlipMatrix(Data=simplify_tree_11)
replace_nulls_9 = ReplaceNulls(Items=flip_matrix_9, Replacements=0)  # -> Items, Count
mass_addition_9 = MassAddition(Input=replace_nulls_9.Items)  # -> flatten(Result), PartialResults
multiplication_10 = Multiplication(A=mass_addition_9.Result, B=cluster_2.i_3)  # -> graft(Result)

geometry_28 = Geometry(flatten(simplify_tree_2))
crv_13 = Curve(graft(project_18.Geometry))
curve_middle_10 = CurveMiddle(Curve=geometry_28)
isoncurve_10 = CSharpScript(x=crv_13, y=curve_middle_10)  # -> out, A; inputs x: Curve, y: Point3d; same code as isoncurve
simplify_tree_12 = SimplifyTree(Tree=isoncurve_10.A, Front=False)
flip_matrix_10 = FlipMatrix(Data=simplify_tree_12)
replace_nulls_10 = ReplaceNulls(Items=flip_matrix_10, Replacements=0)  # -> Items, Count
mass_addition_10 = MassAddition(Input=replace_nulls_10.Items)  # -> flatten(Result), PartialResults
multiplication_11 = Multiplication(A=mass_addition_10.Result, B=cluster_2.i_4)  # -> graft(Result)

crv_14 = Curve(graft(project_4.Geometry))  # disabled
crv_15 = Curve(graft(project_11.Geometry))  # disabled
crv_16 = Curve(graft(project_14.Geometry))  # disabled
crv_17 = Curve(graft(project_15.Geometry))  # disabled
crv_18 = Curve(graft(project.Geometry))  # disabled
crv_19 = Curve(graft(project_2.Geometry))  # disabled
crv_20 = Curve(graft(project_3.Geometry))  # disabled
crv_21 = Curve(graft(project_13.Geometry))  # disabled
curve_middle_11 = CurveMiddle(Curve=geometry_9)  # disabled
curve_middle_12 = CurveMiddle(Curve=geometry_19)  # disabled
curve_middle_13 = CurveMiddle(Curve=geometry_15)  # disabled
curve_middle_14 = CurveMiddle(Curve=geometry_11)  # disabled
curve_middle_15 = CurveMiddle(Curve=geometry_12)  # disabled
curve_middle_16 = CurveMiddle(Curve=geometry_18)  # disabled
curve_middle_17 = CurveMiddle(Curve=geometry_20)  # disabled
curve_middle_18 = CurveMiddle(Curve=geometry_22)  # disabled
curve_middle_19 = CurveMiddle(Curve=geometry_23)  # disabled
curve_middle_20 = CurveMiddle(Curve=geometry_21)  # disabled
isoncurve_11 = CSharpScript(x=crv_3, y=curve_middle_11)  # -> out, A; inputs x: Curve, y: Point3d; disabled; same code as isoncurve
isoncurve_12 = CSharpScript(x=crv_16, y=curve_middle_14)  # -> out, A; inputs x: Curve, y: Point3d; disabled; same code as isoncurve
isoncurve_13 = CSharpScript(x=crv_17, y=curve_middle_15)  # -> out, A; inputs x: Curve, y: Point3d; disabled; same code as isoncurve
isoncurve_14 = CSharpScript(x=crv_18, y=curve_middle_16)  # -> out, A; inputs x: Curve, y: Point3d; disabled; same code as isoncurve
isoncurve_15 = CSharpScript(x=crv_19, y=curve_middle_12)  # -> out, A; inputs x: Curve, y: Point3d; disabled; same code as isoncurve
isoncurve_16 = CSharpScript(x=crv_20, y=curve_middle_17)  # -> out, A; inputs x: Curve, y: Point3d; disabled; same code as isoncurve
isoncurve_17 = CSharpScript(x=crv_14, y=curve_middle_13)  # -> out, A; inputs x: Curve, y: Point3d; disabled; same code as isoncurve
isoncurve_18 = CSharpScript(x=crv_15, y=curve_middle_20)  # -> out, A; inputs x: Curve, y: Point3d; disabled; same code as isoncurve
isoncurve_19 = CSharpScript(x=crv_6, y=curve_middle_18)  # -> out, A; inputs x: Curve, y: Point3d; disabled; same code as isoncurve
isoncurve_20 = CSharpScript(x=crv_21, y=curve_middle_19)  # -> out, A; inputs x: Curve, y: Point3d; disabled; same code as isoncurve
simplify_tree_13 = SimplifyTree(Tree=isoncurve_12.A, Front=False)  # disabled
simplify_tree_14 = SimplifyTree(Tree=isoncurve_11.A, Front=False)  # disabled
simplify_tree_15 = SimplifyTree(Tree=isoncurve_13.A, Front=False)  # disabled
simplify_tree_16 = SimplifyTree(Tree=isoncurve_14.A, Front=False)  # disabled
simplify_tree_17 = SimplifyTree(Tree=isoncurve_15.A, Front=False)  # disabled
simplify_tree_18 = SimplifyTree(Tree=isoncurve_16.A, Front=False)  # disabled
simplify_tree_19 = SimplifyTree(Tree=isoncurve_18.A, Front=False)  # disabled
simplify_tree_20 = SimplifyTree(Tree=isoncurve_19.A, Front=False)  # disabled
simplify_tree_21 = SimplifyTree(Tree=isoncurve_20.A, Front=False)  # disabled
simplify_tree_22 = SimplifyTree(Tree=isoncurve_17.A, Front=False)  # disabled
flip_matrix_11 = FlipMatrix(Data=simplify_tree_13)  # disabled
flip_matrix_12 = FlipMatrix(Data=simplify_tree_15)  # disabled
flip_matrix_13 = FlipMatrix(Data=simplify_tree_14)  # disabled
flip_matrix_14 = FlipMatrix(Data=simplify_tree_16)  # disabled
flip_matrix_15 = FlipMatrix(Data=simplify_tree_17)  # disabled
flip_matrix_16 = FlipMatrix(Data=simplify_tree_18)  # disabled
flip_matrix_17 = FlipMatrix(Data=simplify_tree_19)  # disabled
flip_matrix_18 = FlipMatrix(Data=simplify_tree_20)  # disabled
flip_matrix_19 = FlipMatrix(Data=simplify_tree_21)  # disabled
flip_matrix_20 = FlipMatrix(Data=simplify_tree_22)  # disabled
replace_nulls_11 = ReplaceNulls(Items=flip_matrix_11, Replacements=0)  # -> Items, Count; disabled
replace_nulls_12 = ReplaceNulls(Items=flip_matrix_12, Replacements=0)  # -> Items, Count; disabled
replace_nulls_13 = ReplaceNulls(Items=flip_matrix_13, Replacements=0)  # -> Items, Count; disabled
replace_nulls_14 = ReplaceNulls(Items=flip_matrix_14, Replacements=0)  # -> Items, Count; disabled
replace_nulls_15 = ReplaceNulls(Items=flip_matrix_15, Replacements=0)  # -> Items, Count; disabled
replace_nulls_16 = ReplaceNulls(Items=flip_matrix_16, Replacements=0)  # -> Items, Count; disabled
replace_nulls_17 = ReplaceNulls(Items=flip_matrix_17, Replacements=0)  # -> Items, Count; disabled
replace_nulls_18 = ReplaceNulls(Items=flip_matrix_18, Replacements=0)  # -> Items, Count; disabled
replace_nulls_19 = ReplaceNulls(Items=flip_matrix_19, Replacements=0)  # -> Items, Count; disabled
replace_nulls_20 = ReplaceNulls(Items=flip_matrix_20, Replacements=0)  # -> Items, Count; disabled
mass_addition_11 = MassAddition(Input=replace_nulls_11.Items)  # -> flatten(Result), PartialResults; disabled
mass_addition_12 = MassAddition(Input=replace_nulls_13.Items)  # -> flatten(Result), PartialResults; disabled
mass_addition_13 = MassAddition(Input=replace_nulls_14.Items)  # -> flatten(Result), PartialResults; disabled
mass_addition_14 = MassAddition(Input=replace_nulls_15.Items)  # -> flatten(Result), PartialResults; disabled
mass_addition_15 = MassAddition(Input=replace_nulls_18.Items)  # -> flatten(Result), PartialResults; disabled
mass_addition_16 = MassAddition(Input=replace_nulls_17.Items)  # -> flatten(Result), PartialResults; disabled
mass_addition_17 = MassAddition(Input=replace_nulls_19.Items)  # -> flatten(Result), PartialResults; disabled
mass_addition_18 = MassAddition(Input=replace_nulls_12.Items)  # -> flatten(Result), PartialResults; disabled
mass_addition_19 = MassAddition(Input=replace_nulls_16.Items)  # -> flatten(Result), PartialResults; disabled
mass_addition_20 = MassAddition(Input=replace_nulls_20.Items)  # -> flatten(Result), PartialResults; disabled
multiplication_12 = Multiplication(A=mass_addition_11.Result, B=cluster.i_10)  # -> graft(Result); disabled
multiplication_13 = Multiplication(A=mass_addition_18.Result, B=cluster.i_5)  # -> graft(Result); disabled
multiplication_14 = Multiplication(A=mass_addition_12.Result, B=cluster.i_6)  # -> graft(Result); disabled
multiplication_15 = Multiplication(A=mass_addition_13.Result, B=cluster.i)  # -> graft(Result); disabled
multiplication_16 = Multiplication(A=mass_addition_14.Result, B=cluster.i_7)  # -> graft(Result); disabled
multiplication_17 = Multiplication(A=mass_addition_19.Result, B=cluster.i_2)  # -> graft(Result); disabled
multiplication_18 = Multiplication(A=mass_addition_20.Result, B=cluster.i_8)  # -> graft(Result); disabled
multiplication_19 = Multiplication(A=mass_addition_16.Result, B=cluster.i_3)  # -> graft(Result); disabled
multiplication_20 = Multiplication(A=mass_addition_15.Result, B=cluster.i_9)  # -> graft(Result); disabled
multiplication_21 = Multiplication(A=mass_addition_17.Result, B=cluster.i_4)  # -> graft(Result); disabled
mass_addition_21 = MassAddition(Input=[multiplication_14, multiplication_15, multiplication_16, multiplication_17, multiplication_18, multiplication_19, multiplication_20, multiplication_21, multiplication_12, multiplication_13])  # -> flatten(Result), PartialResults; disabled
mass_addition_22 = MassAddition(Input=[multiplication_2, multiplication_7, multiplication_8, multiplication_9, multiplication_5, multiplication_10, multiplication_6, multiplication_11, multiplication_3, multiplication_4])  # -> flatten(Result), PartialResults
subtraction_4 = Subtraction(A=0, B=mass_addition_21.Result)  # disabled
subtraction_5 = Subtraction(A=0, B=mass_addition_22.Result)
unflatten_tree = UnflattenTree(Tree=subtraction_4, Guide=simplify_tree)  # disabled
custom_offset = CustomOffset(Polygons=polygons_from_lines_2.Polygons, OffsetValues=unflatten_tree)  # -> OffsetedPolygons, Test; disabled
выкидыватель = Выкидыватель(curve=custom_offset.OffsetedPolygons, geometry=polygons_from_lines_2.Polygons)  # disabled
unflatten_tree_2 = UnflattenTree(Tree=subtraction_5, Guide=simplify_tree_2)
region_union = RegionUnion(Curves=выкидыватель)  # disabled
custom_offset_2 = CustomOffset(Polygons=polygons_from_lines.Polygons, OffsetValues=unflatten_tree_2)  # -> OffsetedPolygons, Test
выкидыватель_2 = Выкидыватель(curve=custom_offset_2.OffsetedPolygons, geometry=polygons_from_lines.Polygons)  # disabled
geometry_29 = Geometry(выкидыватель_2)  # disabled

area_2 = Area(Geometry=выкидыватель_2)  # -> Area, Centroid; disabled
integer = Integer(20)  # disabled
deconstruct = Deconstruct(Point=area_2.Centroid)  # -> XComponent, YComponent, ZComponent; disabled
division_5 = Division(A=area_2.Area, B=1000)  # disabled
construct_point = ConstructPoint(XCoordinate=deconstruct.XComponent, YCoordinate=deconstruct.YComponent, ZCoordinate=integer)  # disabled
integer_2 = Integer(division_5)  # disabled
division_6 = Division(A=integer_2, B=10)  # disabled
text_tag = TextTag(Location=construct_point, Text=division_6)  # disabled

cluster_3 = Cluster_7(list=region_union, curves=region_union, curve=region_union)  # disabled
simplify_curve = SimplifyCurve(Curve=cluster_3, AngleTolerance=1)  # -> Curve, Simplified; disabled
curve_24 = Curve(simplify_curve.Curve)  # disabled
fillet_distance = FilletDistance(Curve=curve_24, Distance=5)  # disabled
boundary_surfaces_2 = BoundarySurfaces(Edges=fillet_distance)  # disabled

cluster_4 = Cluster_7(list=geometry_29, curves=geometry_29, curve=geometry_29)  # disabled
simplify_curve_2 = SimplifyCurve(Curve=cluster_4, AngleTolerance=1)  # -> Curve, Simplified; disabled
curve_25 = Curve(simplify_curve_2.Curve)  # disabled
fillet_distance_2 = FilletDistance(Curve=curve_25, Distance=5)  # disabled
boundary_surfaces_3 = BoundarySurfaces(Edges=fillet_distance_2)  # disabled

boolean_toggle = BooleanToggle(False)  # disabled
geometry_30 = Geometry(<brep referenced from the Rhino model>)  # disabled
vector_xyz = VectorXYZ(XComponent=0, YComponent=0, ZComponent=1)  # -> Vector, Length; disabled
vector_xyz_2 = VectorXYZ(XComponent=0, YComponent=0, ZComponent=150)  # -> Vector, Length; disabled
vector_xyz_3 = VectorXYZ(XComponent=0, YComponent=0, ZComponent=-50)  # -> Vector, Length; disabled
geometry_31 = Geometry([<brep referenced from the Rhino model> x14])  # disabled
vector_xyz_4 = VectorXYZ(XComponent=0, YComponent=0, ZComponent=3)  # -> Vector, Length; disabled
colour_swatch = ColourSwatch(SwatchColor=RGB(196, 183, 183))  # disabled

geometry_32 = Geometry([<brep referenced from the Rhino model> x366])  # disabled
geometry_33 = Geometry(<brep referenced from the Rhino model>)  # disabled
geometry_34 = Geometry(<brep referenced from the Rhino model>)  # disabled
geometry_35 = Geometry(<brep referenced from the Rhino model>)  # disabled
geometry_36 = Geometry(<brep referenced from the Rhino model>)  # disabled
geometry_37 = Geometry(<brep referenced from the Rhino model>)  # disabled
geometry_38 = Geometry(<brep referenced from the Rhino model>)  # disabled
cluster_5 = Cluster_13(
    relay=geometry_32,
    geometry_4=geometry_33,
    geometry_5=geometry_34,
    geometry_6=geometry_35,
    geometry_7=geometry_36,
    geometry_8=geometry_37,
    geometry_9=geometry_38)  # -> list, list_2, list_3, list_4, i, list_5, list_6; disabled
geometry_39 = Geometry([cluster_5.list, cluster_5.list_2, cluster_5.list_3, cluster_5.list_4, cluster_5.list_5, cluster_5.list_6])  # disabled

geometry_40 = Geometry([<brep referenced from the Rhino model> x1301])  # disabled

# ---- group: Pedestrian allowance: zero-width boundary stays zero
c_script_22 = CSharpScript(HalfWidths=flatten(unflatten_tree_2))  # -> out, Allowance; inputs HalfWidths: list of Double
# ---------- c_script_22: C# ----------
// #! csharp
using System;
using System.Collections.Generic;
using Grasshopper.Kernel;
public class Script_Instance : GH_ScriptInstance {
 private void RunScript(List<double> HalfWidths, ref object Allowance) {
 var result = new List<double>();
 if(HalfWidths!=null) foreach(double w in HalfWidths) result.Add(Math.Abs(w)>0.000001 ? 10.0 : 0.0);
 Allowance=result;
 }
}
# ---------- end c_script_22 ----------

# ----
create_material = CreateMaterial(Diffuse=colour_swatch, Specular=RGB(255, 255, 255), Emission=RGB(0, 0, 0), Transparency=0, Shine=0)  # disabled
geometry_41 = Geometry([<brep referenced from the Rhino model> x42])  # disabled
colour_swatch_2 = ColourSwatch(SwatchColor=RGB(255, 255, 255))  # disabled
vector_xyz_5 = VectorXYZ(XComponent=0, YComponent=0, ZComponent=-0.3)  # -> Vector, Length; disabled
mesh = Mesh([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])
c_script_23 = CSharpScript(Blocks=flatten(custom_offset_2.OffsetedPolygons))  # -> out, Volumes; inputs Blocks: list of Curve
# ---------- c_script_23: C# ----------
// #! csharp
using System;
using System.Collections.Generic;
using Rhino.Geometry;
using Grasshopper.Kernel;
public class Script_Instance : GH_ScriptInstance
{
  private void RunScript(List<Curve> Blocks, ref object Volumes)
  {
    var result=new List<Brep>();
    if(Blocks==null){Volumes=result;return;}
    int i=0;
    foreach(var crv in Blocks)
    {
      var ap=AreaMassProperties.Compute(crv);
      if(ap==null)continue;
      Point3d p=ap.Centroid;p.Z=0;
      var bb=crv.GetBoundingBox(true);
      double w=Math.Min(34,(bb.Max.X-bb.Min.X)*.55);
      double d=Math.Min(30,(bb.Max.Y-bb.Min.Y)*.5);
      for(int attempt=0;attempt<30;attempt++)
      {
        bool fits=true;
        foreach(double sx in new double[]{-1,1})foreach(double sy in new double[]{-1,1})
        {
          var q=new Point3d(p.X+sx*w/2,p.Y+sy*d/2,0);double t;
          if(crv.Contains(q,Plane.WorldXY,.001)!=PointContainment.Inside ||
             !crv.ClosestPoint(q,out t) || q.DistanceTo(crv.PointAt(t))<12)fits=false;
        }
        if(fits)break;
        w*=.9;d*=.9;
      }
      result.Add(new BoundingBox(p.X-w/2,p.Y-d/2,0,p.X+w/2,p.Y+d/2,12+(i%4)*4).ToBrep());
      i++;
    }
    Volumes=result;
  }
}
# ---------- end c_script_23 ----------
brep = Brep([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])

# ---- group: DEMO / Layered display, 2 m (cached presentation mesh)
mesh_2 = Mesh(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)

# ---- group: DEMO / Terrain
# ДЕМОНСТРАЦИЯ V3
# 
# Исходная логика: рельеф, дорожная сеть, полосы озеленения, точки посадки, размещение объёмов по высоте.
# 
# Новые демонстрационные входы: участок 300×300 м, 4 цветные оси, 3 болванки деревьев, объёмы в кварталах.
# 
# Добавлены адаптеры предпросмотра и связь отступа озеленения с шириной дороги. Старые ссылки на модели деревьев не нужны.
# 
# Подробности: ЗАПУСК_V3.md рядом с файлом.
preview = CustomPreview(
    Geometry=mesh_2,
    Material={diffuse=RGB(213, 224, 208), emission=RGB(0, 0, 0), shine=0, specular=RGB(255, 255, 255), transparency=0})

# ----
unit_z_3 = UnitZ(Factor=1)  # disabled
geometry_42 = Geometry(<brep referenced from the Rhino model>)  # disabled

panel_13 = Panel("""23
16
30
7
0
0
0
13
11
5""")  # disabled
panel_15 = Panel("""7
7
14
0
0
7
0
7
7
7""")  # disabled
division_7 = Division(A=panel_13, B=2)  # disabled
swatch_13 = ColourSwatch(SwatchColor=RGB(255, 0, 0))
swatch_14 = ColourSwatch(SwatchColor=RGB(255, 127, 0))  # disabled
division_8 = Division(A=panel_13, B=2)  # disabled
python_3 = GhPythonScript(color=swatch_13)  # -> out, a; inputs color: Color; disabled; same code as python
panel_18 = Panel(division_4)
cluster_6 = Cluster_6(
    list_6=panel_18,
    list=panel_18,
    list_7=panel_18,
    list_2=panel_18,
    list_8=panel_18,
    list_3=panel_18,
    list_9=panel_18,
    list_4=panel_18,
    list_10=panel_18,
    list_5=panel_18)  # -> i_6, i, i_7, i_2, i_8, i_3, i_9, i_4, i_10, i_5
polygons_from_lines_3 = PolygonsFromLines(Lines=network_from_lines_2.Lines, MinBlockSize=0)  # -> Polygons, SynchronizedValues
explode_25 = Explode(Curve=polygons_from_lines_3.Polygons, Recursive=False)  # -> Segments, Vertices
simplify_tree_23 = SimplifyTree(Tree=explode_25.Segments, Front=False)
geometry_43 = Geometry(flatten(simplify_tree_23))
geometry_44 = Geometry(flatten(simplify_tree_23))
geometry_45 = Geometry(flatten(simplify_tree_23))
geometry_46 = Geometry(flatten(simplify_tree_23))
geometry_47 = Geometry(flatten(simplify_tree_23))
geometry_48 = Geometry(flatten(simplify_tree_23))
geometry_49 = Geometry(flatten(simplify_tree_23))
geometry_50 = Geometry(flatten(simplify_tree_23))
geometry_51 = Geometry(flatten(simplify_tree_23))
geometry_52 = Geometry(flatten(simplify_tree_23))
curve_middle_21 = CurveMiddle(Curve=geometry_43)
curve_middle_22 = CurveMiddle(Curve=geometry_48)
curve_middle_23 = CurveMiddle(Curve=geometry_46)
curve_middle_24 = CurveMiddle(Curve=geometry_44)
curve_middle_25 = CurveMiddle(Curve=geometry_45)
curve_middle_26 = CurveMiddle(Curve=geometry_47)
curve_middle_27 = CurveMiddle(Curve=geometry_49)
curve_middle_28 = CurveMiddle(Curve=geometry_51)
curve_middle_29 = CurveMiddle(Curve=geometry_52)
curve_middle_30 = CurveMiddle(Curve=geometry_50)
subtraction_6 = Subtraction(A=flatten(unflatten_tree_2), B=c_script_22.Allowance)
unflatten_tree_3 = UnflattenTree(Tree=subtraction_6, Guide=simplify_tree_23)
custom_offset_3 = CustomOffset(Polygons=polygons_from_lines_3.Polygons, OffsetValues=unflatten_tree_3)  # -> OffsetedPolygons, Test
выкидыватель_3 = Выкидыватель(curve=custom_offset_3.OffsetedPolygons, geometry=polygons_from_lines_3.Polygons)
colour_swatch_3 = ColourSwatch(SwatchColor=RGB(89, 89, 89))  # disabled
brep_edges_2 = BrepEdges(Brep=geometry_29)  # -> Naked, Interior, NonManifold; disabled
geometry_53 = Geometry(geometry_29)  # disabled
create_material_2 = CreateMaterial(Diffuse=colour_swatch_3, Specular=RGB(255, 255, 255), Emission=RGB(0, 0, 0), Transparency=0, Shine=0)  # disabled
region_union_2 = RegionUnion(Curves=geometry_53)  # disabled
join_curves_2 = JoinCurves(Curves=brep_edges_2.Naked, Preserve=False)  # -> flatten(Curves); disabled
fillet_distance_3 = FilletDistance(Curve=region_union_2, Distance=5)  # disabled
boundary_surfaces_4 = BoundarySurfaces(Edges=fillet_distance_3)  # disabled
getguid_by_selection_2 = GetGuidBySelection(SaveGuids0_TypeName="InstanceReference", SaveGuids0_Trees_Branch0_Path="{0}")  # -> Guid, Geometry, ObjectAttributes, LayerName, ObjectTypes; disabled
vector_xyz_6 = VectorXYZ(XComponent=0, YComponent=0, ZComponent=0.2)  # -> Vector, Length; disabled
button_2 = Button()  # disabled
button_3 = Button()  # disabled
geometry_54 = Geometry([<brep referenced from the Rhino model> x1301])  # disabled
антиперемещ = Антиперемещ()  # disabled

division_9 = Division(A=panel_13, B=2)  # disabled

c_script_24 = CSharpScript(color=swatch_13)  # -> out, A; inputs color: Color; same code as c_script
c_script_25 = CSharpScript(color=ColourSwatch(SwatchColor=RGB(255, 127, 0)))  # -> out, A; inputs color: Color; same code as c_script
c_script_26 = CSharpScript(color=ColourSwatch(SwatchColor=RGB(255, 255, 0)))  # -> out, A; inputs color: Color; same code as c_script
c_script_27 = CSharpScript(color=ColourSwatch(SwatchColor=RGB(0, 255, 0)))  # -> out, A; inputs color: Color; same code as c_script
c_script_28 = CSharpScript(color=ColourSwatch(SwatchColor=RGB(0, 0, 255)))  # -> out, A; inputs color: Color; same code as c_script
c_script_29 = CSharpScript(color=ColourSwatch(SwatchColor=RGB(191, 0, 255)))  # -> out, A; inputs color: Color; same code as c_script
c_script_30 = CSharpScript(color=ColourSwatch(SwatchColor=RGB(0, 255, 255)))  # -> out, A; inputs color: Color; same code as c_script
c_script_31 = CSharpScript(color=ColourSwatch(SwatchColor=RGB(255, 255, 0)))  # -> out, A; inputs color: Color; same code as c_script
c_script_32 = CSharpScript(color=ColourSwatch(SwatchColor=RGB(82, 165, 82)))  # -> out, A; inputs color: Color; same code as c_script
c_script_33 = CSharpScript(color=ColourSwatch(SwatchColor=RGB(191, 255, 0)))  # -> out, A; inputs color: Color; same code as c_script

geometry_55 = Geometry(custom_offset_3.OffsetedPolygons)  # disabled
explode_26 = Explode(Curve=geometry_55, Recursive=True)  # -> Segments, Vertices; disabled
join_curves_3 = JoinCurves(Curves=explode_26.Segments, Preserve=False)  # -> flatten(Curves); disabled

mesh_join = MeshJoin(Meshes=geometry)
точки_из_бокса = ТочкиИзБокса(B="200", A="12000", B_2="200", box=mesh_join)
cluster_7 = Cluster_5(box=mesh_join)  # -> x_component, y_component, x_component_2, y_component_2
cluster_8 = Cluster(A=cluster_7.x_component, B=cluster_7.x_component_2, A_2=cluster_7.y_component, A_3="12000", B_2=cluster_7.y_component_2)  # -> result_2, result
cluster_9 = Cluster_2(A=cluster_8.result_2, B="200")
addition = Addition(A=cluster_9, B=1)
mesh_ray = MeshRay(Mesh=graft(mesh_join), Point=graft(точки_из_бокса), Direction=reverse)  # -> flatten(Point), flatten(Hit); disabled
cull_pattern = CullPattern(List=точки_из_бокса, CullPattern=mesh_ray.Hit)  # disabled
gate_not = GateNot(A=mesh_ray.Hit)  # disabled
cull_pattern_2 = CullPattern(List=точки_из_бокса, CullPattern=gate_not)  # disabled

scale = Scale(Geometry=точки_из_бокса, Center=Point(191, 183, 0), Factor=0.9999)  # -> Geometry, Transform
nakedvertices = NakedVertices(Mesh=mesh_join)  # -> ClothedIndex, NakedIndex, ClothedPts, NakedPts; disabled
geometry_56 = Geometry(nakedvertices.ClothedPts)  # disabled
line_sdl = LineSDL(Start=точки_из_бокса, Direction=reverse, Length=number_slider)  # disabled
surface_line = SurfaceLine(Surface=geometry_6, Line=line_sdl, LimitToFirst=False)  # -> Curves, flatten(Points), UVPoints, Normal; disabled

number_slider_3 = Slider(8, range=0..20)  # disabled
panel_19 = Panel("холм")  # disabled
number_slider_4 = Slider(35, range=0..200)  # disabled
geometry_57 = Geometry(<curve referenced from the Rhino model>)  # disabled
cluster_10 = Cluster_9(
    distance=number_slider_4,
    curve=geometry_2,
    geometry_3=geometry_57,
    curve_2=geometry_3,
    A=number_slider_3,
    B=number_slider_4,
    geometry=surface_line.Points)  # disabled
panel_20 = Panel("река")  # disabled
number_slider_5 = Slider(14, range=0..14)  # disabled
number_slider_6 = Slider(15, range=0..24)  # disabled
subtraction_7 = Subtraction(A=0, B=number_slider_6)  # disabled
geometry_58 = Geometry(<curve referenced from the Rhino model>)  # disabled
number_slider_7 = Slider(-4, range=-17..10)  # disabled
offset_curve = OffsetCurve(Curve=join_curves, Distance=subtraction_7, Corners=1)  # -> flatten(Curve); disabled
number_slider_8 = Slider(7, range=0..24)  # disabled
cluster_11 = Cluster_9(
    distance=number_slider_6,
    curve=geometry_2,
    geometry_3=offset_curve,
    curve_2=geometry_3,
    A=number_slider_7,
    B=number_slider_6,
    geometry=cluster_10)  # disabled
number_slider_9 = Slider(0, range=-7..10)  # disabled
geometry_59 = Geometry(<curve referenced from the Rhino model>)  # disabled
cluster_12 = Cluster_9(
    distance=number_slider_8,
    curve=geometry_2,
    geometry_3=geometry_59,
    curve_2=geometry_3,
    A=number_slider_9,
    B=number_slider_8,
    geometry=cluster_11)  # disabled

cull_pattern_3 = CullPattern(List=mesh_ray.Point, CullPattern=mesh_ray.Hit)  # disabled

mesh_ray_2 = MeshRay(Mesh=graft(mesh_join), Point=graft(scale.Geometry), Direction=unit_z_2)  # -> flatten(Point), flatten(Hit)
weave = Weave(Pattern=mesh_ray.Hit, Stream0=cull_pattern_2, Stream1=cull_pattern_3, NullGaps=False)  # disabled
delaunay_mesh = DelaunayMesh(Points=mesh_ray_2.Point, Plane=PlaneXY(0, 0, 0))
move = Move(Geometry=delaunay_mesh, Motion=Vector(0, 0, 10))  # -> Geometry, Transform
толщинатор_меша = ТолщинаторМеша(mesh=move.Geometry)
surface_from_points = SurfaceFromPoints(Points=flatten(mesh_ray_2.Point), UCount=addition, Interpolate=False)
extrude_2 = Extrude(Base=surface_from_points, Direction=Vector(0, 0, 1))  # disabled

surface_from_points_2 = SurfaceFromPoints(Points=flatten(weave), UCount=addition, Interpolate=False)  # disabled
center = Center(Geometric=surface_from_points)  # -> Center, Dimension; disabled
reverse_2 = Reverse(Vector=center.Center)  # disabled
move_2 = Move(Geometry=surface_from_points, Motion=reverse_2)  # -> Geometry, Transform; disabled
custom_preview = CustomPreview(
    Geometry=surface_from_points,
    Material={diffuse=RGB(221, 160, 221), emission=RGB(66, 48, 66), shine=0.5, specular=RGB(255, 255, 255), transparency=0})  # disabled
flip = Flip(Surface=boundary_surfaces_2, Guide=surface_from_points)  # -> Surface, Result; disabled
geometry_60 = Geometry(surface_from_points)  # disabled
geometry_61 = Geometry(surface_from_points)  # disabled
cluster_13 = Cluster_14(brep=geometry_30, relay=geometry_60)  # disabled
geometry_62 = Geometry(flip.Surface)  # disabled
extrude_3 = Extrude(Base=geometry_61, Direction=vector_xyz.Vector)  # disabled
extrude_4 = Extrude(Base=geometry_62, Direction=vector_xyz_2.Vector)  # disabled

colour_swatch_4 = ColourSwatch(SwatchColor=RGB(196, 183, 183))  # disabled
cluster_14 = Cluster_10(geometry=выкидыватель_3, relay=surface_from_points)
create_material_3 = CreateMaterial(Diffuse=colour_swatch_4, Specular=RGB(255, 255, 255), Emission=RGB(0, 0, 0), Transparency=0, Shine=0)  # disabled
custom_preview_2 = CustomPreview(Geometry=cluster_14, Material=create_material_3)  # disabled

surface = Surface(surface_from_points)  # disabled
_1 = _1(geometric=c_script_23.Volumes, geometry=c_script_23.Volumes, surface=surface_from_points)

_2 = _2(box=geometry_31, geometry=geometry_31, surface=surface)  # disabled
move_3 = Move(Geometry=extrude_4, Motion=vector_xyz_3.Vector)  # -> Geometry, Transform; disabled
project_21 = Project(Curve=[custom_offset_2.OffsetedPolygons, crv], Brep=surface_from_points, Direction=Vector(0, 0, 1))  # -> flatten(Curve)
fast_solid_difference = FastSolidDifference(
    SubtractFrom=extrude_3,
    SubtractWith=move_3.Geometry,
    Tolerance=0.01,
    computeBBFastSolidDiff=True,
    retainFastSolidDiff=True,
    strictFastSolidDiff=True,
    trueIntFastSolidDiff=False)  # disabled
box = Box(geometry_62)  # disabled
surface_split = SurfaceSplit(Surface=surface_from_points, Curves=project_21)
project_22 = Project(Geometry=surface_split, Plane=PlaneXY(0, 0, 0))  # -> Geometry, Transform; disabled
box_properties = BoxProperties(Box=box)  # -> Center, Diagonal, Area, Volume, Degeneracy; disabled
box_2 = Box(project_22.Geometry)  # disabled
box_properties_2 = BoxProperties(Box=box_2)  # -> Center, Diagonal, Area, Volume, Degeneracy; disabled
closest_point = ClosestPoint(Point=box_properties.Center, Cloud=box_properties_2.Center)  # -> ClosestPoint, CPIndex, Distance; disabled
cull_index = CullIndex(List=surface_split, Indices=closest_point.CPIndex, Wrap=False)  # disabled
extrude_5 = Extrude(Base=cluster_13, Direction=vector_xyz_4.Vector)  # disabled
_2_2 = _2(box=geometry_32, geometry=geometry_32, surface=surface)  # disabled
geometry_63 = Geometry(flatten([extrude_5, _2]))  # disabled
merge = Merge(Data1=geometry_40, Data2=_2_2, Data3=_2, Data4=geometry_41)  # disabled
move_4 = Move(Geometry=_1, Motion=vector_xyz_5.Vector)  # -> Geometry, Transform; disabled
custom_preview_3 = CustomPreview(Geometry=cull_index, Material=create_material)  # disabled
c_script_34 = CSharpScript(Fragments=flatten(surface_split), Blocks=flatten(custom_offset_2.OffsetedPolygons))  # -> out, Roads; inputs Fragments: list of Brep, Blocks: list of Curve
# ---------- c_script_34: C# ----------
// #! csharp
using System;
using System.Collections.Generic;
using Rhino.Geometry;
using Grasshopper.Kernel;
public class Script_Instance : GH_ScriptInstance
{
 private void RunScript(
		List<Brep> Fragments,
		List<Curve> Blocks,
		ref object Roads)
 {
   var result=new List<Brep>();
   if(Fragments==null||Blocks==null){Roads=result;return;}
   foreach(var b in Fragments)
   {
     var mm=Mesh.CreateFromBrep(b,MeshingParameters.FastRenderMesh);
     if(mm==null||mm.Length==0||mm[0].Faces.Count==0)continue;
     var m=mm[0];var f=m.Faces[0];
     var a=m.Vertices.Point3dAt(f.A);var c=m.Vertices.Point3dAt(f.B);var d=m.Vertices.Point3dAt(f.C);
     var p=new Point3d((a.X+c.X+d.X)/3,(a.Y+c.Y+d.Y)/3,0);
     if(p.X<=20.001||p.X>=279.999||p.Y<=20.001||p.Y>=279.999)continue;
     bool inside=false;
     foreach(var block in Blocks)if(block.Contains(p,Plane.WorldXY,.0001)==PointContainment.Inside){inside=true;break;}
     if(!inside)result.Add(b);
   }
   Roads=result;
 }
}
# ---------- end c_script_34 ----------
c_script_35 = CSharpScript(Surfaces=flatten(cluster_14))  # -> out, Pavement; inputs Surfaces: list of Brep
# ---------- c_script_35: C# ----------
// #! csharp
using System;
using System.Collections.Generic;
using Rhino.Geometry;
using Grasshopper.Kernel;
public class Script_Instance : GH_ScriptInstance {
 private void RunScript(List<Brep> Surfaces, ref object Pavement) {
  var result=new List<Brep>();
  if(Surfaces==null){Pavement=result;return;}
  var planes=new Plane[]{new Plane(new Point3d(20,0,0),-Vector3d.XAxis),new Plane(new Point3d(280,0,0),Vector3d.XAxis),new Plane(new Point3d(0,20,0),-Vector3d.YAxis),new Plane(new Point3d(0,280,0),Vector3d.YAxis)};
  foreach(var s in Surfaces) {
   var pieces=new List<Brep>{s};
   foreach(var plane in planes) {
    var next=new List<Brep>();
    foreach(var b in pieces) {
     var cut=b.Trim(plane,.001);
     if(cut!=null&&cut.Length>0)next.AddRange(cut);
     else if(plane.DistanceTo(b.GetBoundingBox(true).Center)<=0)next.Add(b);
    }
    pieces=next;
   }
   result.AddRange(pieces);
  }
  Pavement=result;
 }
}
# ---------- end c_script_35 ----------
move_5 = Move(Geometry=c_script_34.Roads, Motion=Vector(0, 0, 0.12))  # -> Geometry, Transform
move_6 = Move(Geometry=c_script_35.Pavement, Motion=Vector(0, 0, 0.04))  # -> Geometry, Transform

# ---- group: DEMO / Roads
preview_2 = CustomPreview(
    Geometry=move_5.Geometry,
    Material={diffuse=RGB(60, 82, 89), emission=RGB(0, 0, 0), shine=0, specular=RGB(255, 255, 255), transparency=0})

# ---- group: DEMO / Buildings
preview_3 = CustomPreview(
    Geometry=_1,
    Material={diffuse=RGB(224, 215, 191), emission=RGB(0, 0, 0), shine=0, specular=RGB(255, 255, 255), transparency=0})

# ---- group: DEMO / Pedestrian base
preview_4 = CustomPreview(
    Geometry=move_6.Geometry,
    Material={diffuse=RGB(194, 197, 194), emission=RGB(0, 0, 0), shine=0, specular=RGB(255, 255, 255), transparency=0})

# ----
move_7 = Move(Geometry=cluster_14, Motion=reverse_2)  # -> Geometry, Transform; disabled
extrude_6 = Extrude(Base=move_7.Geometry)  # disabled
move_8 = Move(Geometry=geometry_42, Motion=reverse_2)  # -> Geometry, Transform; disabled

curve_26 = Curve(c_script_33.A)
curve_27 = Curve(c_script_24.A)
curve_28 = Curve(c_script_25.A)
curve_29 = Curve(c_script_26.A)
curve_30 = Curve(c_script_27.A)
curve_31 = Curve(c_script_28.A)
curve_32 = Curve(c_script_29.A)
curve_33 = Curve(c_script_30.A)
curve_34 = Curve(c_script_31.A)
curve_35 = Curve(c_script_32.A)
explode_27 = Explode(Curve=curve_27, Recursive=True)  # -> flatten(Segments), Vertices
explode_28 = Explode(Curve=curve_28, Recursive=True)  # -> flatten(Segments), Vertices
explode_29 = Explode(Curve=curve_29, Recursive=True)  # -> flatten(Segments), Vertices
explode_30 = Explode(Curve=curve_31, Recursive=True)  # -> flatten(Segments), Vertices
explode_31 = Explode(Curve=curve_32, Recursive=True)  # -> flatten(Segments), Vertices
explode_32 = Explode(Curve=curve_33, Recursive=True)  # -> flatten(Segments), Vertices
explode_33 = Explode(Curve=curve_34, Recursive=True)  # -> flatten(Segments), Vertices
explode_34 = Explode(Curve=curve_35, Recursive=True)  # -> flatten(Segments), Vertices
explode_35 = Explode(Curve=curve_26, Recursive=True)  # -> flatten(Segments), Vertices
explode_36 = Explode(Curve=curve_30, Recursive=True)  # -> flatten(Segments), Vertices
removeduplicatelines_21 = RemoveDuplicateLines(Lines=explode_28.Segments, Tolerance=0.01)
removeduplicatelines_22 = RemoveDuplicateLines(Lines=explode_36.Segments, Tolerance=0.01)
removeduplicatelines_23 = RemoveDuplicateLines(Lines=explode_30.Segments, Tolerance=0.01)
removeduplicatelines_24 = RemoveDuplicateLines(Lines=explode_32.Segments, Tolerance=0.01)
removeduplicatelines_25 = RemoveDuplicateLines(Lines=explode_27.Segments, Tolerance=0.01)
removeduplicatelines_26 = RemoveDuplicateLines(Lines=explode_29.Segments, Tolerance=0.01)
removeduplicatelines_27 = RemoveDuplicateLines(Lines=explode_31.Segments, Tolerance=0.01)
removeduplicatelines_28 = RemoveDuplicateLines(Lines=explode_33.Segments, Tolerance=0.01)
removeduplicatelines_29 = RemoveDuplicateLines(Lines=explode_34.Segments, Tolerance=0.01)
removeduplicatelines_30 = RemoveDuplicateLines(Lines=explode_35.Segments, Tolerance=0.01)
project_23 = Project(Geometry=removeduplicatelines_25, Plane=PlaneXY(0, 0, 0))  # -> Geometry, Transform
project_24 = Project(Geometry=removeduplicatelines_21, Plane=PlaneXY(0, 0, 0))  # -> Geometry, Transform
project_25 = Project(Geometry=removeduplicatelines_26, Plane=PlaneXY(0, 0, 0))  # -> Geometry, Transform
project_26 = Project(Geometry=removeduplicatelines_22, Plane=PlaneXY(0, 0, 0))  # -> Geometry, Transform
project_27 = Project(Geometry=removeduplicatelines_23, Plane=PlaneXY(0, 0, 0))  # -> Geometry, Transform
project_28 = Project(Geometry=removeduplicatelines_27, Plane=PlaneXY(0, 0, 0))  # -> Geometry, Transform
project_29 = Project(Geometry=removeduplicatelines_24, Plane=PlaneXY(0, 0, 0))  # -> Geometry, Transform
project_30 = Project(Geometry=removeduplicatelines_28, Plane=PlaneXY(0, 0, 0))  # -> Geometry, Transform
project_31 = Project(Geometry=removeduplicatelines_29, Plane=PlaneXY(0, 0, 0))  # -> Geometry, Transform
project_32 = Project(Geometry=removeduplicatelines_30, Plane=PlaneXY(0, 0, 0))  # -> Geometry, Transform
geometry_64 = Geometry(flatten([project_23.Geometry, project_24.Geometry, project_25.Geometry, project_26.Geometry, project_27.Geometry, project_28.Geometry, project_29.Geometry, project_30.Geometry, project_31.Geometry, project_32.Geometry]))
curve_36 = Curve(geometry_64)
explode_37 = Explode(Curve=curve_36, Recursive=True)  # -> flatten(Segments), Vertices
line_4 = Line(explode_37.Segments)
network_from_lines_3 = NetworkFromLines(Lines=line_4)  # -> PointPointTopology, ConnectionPointTopology, Points, Lines
crv_22 = Curve(graft(project_23.Geometry))
crv_23 = Curve(graft(project_29.Geometry))
crv_24 = Curve(graft(project_27.Geometry))
crv_25 = Curve(graft(project_28.Geometry))
crv_26 = Curve(graft(project_31.Geometry))
crv_27 = Curve(graft(project_32.Geometry))
crv_28 = Curve(graft(project_24.Geometry))
crv_29 = Curve(graft(project_25.Geometry))
crv_30 = Curve(graft(project_26.Geometry))
crv_31 = Curve(graft(project_30.Geometry))
isoncurve_21 = CSharpScript(x=crv_22, y=curve_middle_21)  # -> out, A; inputs x: Curve, y: Point3d; same code as isoncurve
isoncurve_22 = CSharpScript(x=crv_26, y=curve_middle_24)  # -> out, A; inputs x: Curve, y: Point3d; same code as isoncurve
isoncurve_23 = CSharpScript(x=crv_27, y=curve_middle_25)  # -> out, A; inputs x: Curve, y: Point3d; same code as isoncurve
isoncurve_24 = CSharpScript(x=crv_28, y=curve_middle_26)  # -> out, A; inputs x: Curve, y: Point3d; same code as isoncurve
isoncurve_25 = CSharpScript(x=crv_29, y=curve_middle_22)  # -> out, A; inputs x: Curve, y: Point3d; same code as isoncurve
isoncurve_26 = CSharpScript(x=crv_30, y=curve_middle_27)  # -> out, A; inputs x: Curve, y: Point3d; same code as isoncurve
isoncurve_27 = CSharpScript(x=crv_24, y=curve_middle_23)  # -> out, A; inputs x: Curve, y: Point3d; same code as isoncurve
isoncurve_28 = CSharpScript(x=crv_25, y=curve_middle_30)  # -> out, A; inputs x: Curve, y: Point3d; same code as isoncurve
isoncurve_29 = CSharpScript(x=crv_23, y=curve_middle_28)  # -> out, A; inputs x: Curve, y: Point3d; same code as isoncurve
isoncurve_30 = CSharpScript(x=crv_31, y=curve_middle_29)  # -> out, A; inputs x: Curve, y: Point3d; same code as isoncurve
simplify_tree_24 = SimplifyTree(Tree=isoncurve_22.A, Front=False)
simplify_tree_25 = SimplifyTree(Tree=isoncurve_21.A, Front=False)
simplify_tree_26 = SimplifyTree(Tree=isoncurve_23.A, Front=False)
simplify_tree_27 = SimplifyTree(Tree=isoncurve_24.A, Front=False)
simplify_tree_28 = SimplifyTree(Tree=isoncurve_25.A, Front=False)
simplify_tree_29 = SimplifyTree(Tree=isoncurve_26.A, Front=False)
simplify_tree_30 = SimplifyTree(Tree=isoncurve_28.A, Front=False)
simplify_tree_31 = SimplifyTree(Tree=isoncurve_29.A, Front=False)
simplify_tree_32 = SimplifyTree(Tree=isoncurve_30.A, Front=False)
simplify_tree_33 = SimplifyTree(Tree=isoncurve_27.A, Front=False)
flip_matrix_21 = FlipMatrix(Data=simplify_tree_24)
flip_matrix_22 = FlipMatrix(Data=simplify_tree_26)
flip_matrix_23 = FlipMatrix(Data=simplify_tree_25)
flip_matrix_24 = FlipMatrix(Data=simplify_tree_27)
flip_matrix_25 = FlipMatrix(Data=simplify_tree_28)
flip_matrix_26 = FlipMatrix(Data=simplify_tree_29)
flip_matrix_27 = FlipMatrix(Data=simplify_tree_30)
flip_matrix_28 = FlipMatrix(Data=simplify_tree_31)
flip_matrix_29 = FlipMatrix(Data=simplify_tree_32)
flip_matrix_30 = FlipMatrix(Data=simplify_tree_33)
replace_nulls_21 = ReplaceNulls(Items=flip_matrix_21, Replacements=0)  # -> Items, Count
replace_nulls_22 = ReplaceNulls(Items=flip_matrix_22, Replacements=0)  # -> Items, Count
replace_nulls_23 = ReplaceNulls(Items=flip_matrix_23, Replacements=0)  # -> Items, Count
replace_nulls_24 = ReplaceNulls(Items=flip_matrix_24, Replacements=0)  # -> Items, Count
replace_nulls_25 = ReplaceNulls(Items=flip_matrix_25, Replacements=0)  # -> Items, Count
replace_nulls_26 = ReplaceNulls(Items=flip_matrix_26, Replacements=0)  # -> Items, Count
replace_nulls_27 = ReplaceNulls(Items=flip_matrix_27, Replacements=0)  # -> Items, Count
replace_nulls_28 = ReplaceNulls(Items=flip_matrix_28, Replacements=0)  # -> Items, Count
replace_nulls_29 = ReplaceNulls(Items=flip_matrix_29, Replacements=0)  # -> Items, Count
replace_nulls_30 = ReplaceNulls(Items=flip_matrix_30, Replacements=0)  # -> Items, Count
mass_addition_23 = MassAddition(Input=replace_nulls_21.Items)  # -> flatten(Result), PartialResults
mass_addition_24 = MassAddition(Input=replace_nulls_23.Items)  # -> flatten(Result), PartialResults
mass_addition_25 = MassAddition(Input=replace_nulls_24.Items)  # -> flatten(Result), PartialResults
mass_addition_26 = MassAddition(Input=replace_nulls_25.Items)  # -> flatten(Result), PartialResults
mass_addition_27 = MassAddition(Input=replace_nulls_28.Items)  # -> flatten(Result), PartialResults
mass_addition_28 = MassAddition(Input=replace_nulls_27.Items)  # -> flatten(Result), PartialResults
mass_addition_29 = MassAddition(Input=replace_nulls_29.Items)  # -> flatten(Result), PartialResults
mass_addition_30 = MassAddition(Input=replace_nulls_22.Items)  # -> flatten(Result), PartialResults
mass_addition_31 = MassAddition(Input=replace_nulls_26.Items)  # -> flatten(Result), PartialResults
mass_addition_32 = MassAddition(Input=replace_nulls_30.Items)  # -> flatten(Result), PartialResults
multiplication_22 = Multiplication(A=mass_addition_23.Result, B=cluster_6.i_10)  # -> graft(Result)
multiplication_23 = Multiplication(A=mass_addition_30.Result, B=cluster_6.i_5)  # -> graft(Result)
multiplication_24 = Multiplication(A=mass_addition_24.Result, B=cluster_6.i_6)  # -> graft(Result)
multiplication_25 = Multiplication(A=mass_addition_25.Result, B=cluster_6.i)  # -> graft(Result)
multiplication_26 = Multiplication(A=mass_addition_26.Result, B=cluster_6.i_7)  # -> graft(Result)
multiplication_27 = Multiplication(A=mass_addition_31.Result, B=cluster_6.i_2)  # -> graft(Result)
multiplication_28 = Multiplication(A=mass_addition_32.Result, B=cluster_6.i_8)  # -> graft(Result)
multiplication_29 = Multiplication(A=mass_addition_28.Result, B=cluster_6.i_3)  # -> graft(Result)
multiplication_30 = Multiplication(A=mass_addition_27.Result, B=cluster_6.i_9)  # -> graft(Result)
multiplication_31 = Multiplication(A=mass_addition_29.Result, B=cluster_6.i_4)  # -> graft(Result)
mass_addition_33 = MassAddition(Input=[multiplication_24, multiplication_25, multiplication_26, multiplication_27, multiplication_28, multiplication_29, multiplication_30, multiplication_31, multiplication_22, multiplication_23])  # -> flatten(Result), PartialResults; disabled
mass_addition_34 = MassAddition(Input=[multiplication_24, multiplication_25, multiplication_26, multiplication_27, multiplication_28, multiplication_29, multiplication_30, multiplication_31, multiplication_22, multiplication_23])  # -> flatten(Result), PartialResults
list_length_2 = ListLength(List=mass_addition_34.Result)
cluster_15 = Cluster_10(geometry=выкидыватель_3, relay=surface_from_points)  # disabled
custom_preview_4 = CustomPreview(Geometry=cluster_15, Material=create_material_2)  # disabled
cluster_16 = Cluster_10(geometry=boundary_surfaces_3, relay=surface_from_points)  # disabled
createattributes = CreateAttributes(Color=colour_swatch_4, enableFullPath=False)  # disabled
премещатор = Премещатор(geometry=cluster_14, center=Point(0, 0, 0), motion=Vector(0, 0, 10))  # disabled
bake_geometry = BakeGeometry(Bake=boolean_toggle, Geometry=cluster_14, Attributes=createattributes, DeleteOldBakes=False, PreserveTrees=False)  # disabled
geometry_65 = Geometry([<brep referenced from the Rhino model> x1322])  # disabled
антиперемещ_2 = Антиперемещ(geometry=geometry_65)  # disabled
geometry_66 = Geometry(merge)  # disabled
box_3 = Box(geometry_66)  # disabled
box_properties_3 = BoxProperties(Box=box_3)  # -> Center, Diagonal, Area, Volume, Degeneracy; disabled
deconstruct_2 = Deconstruct(Point=box_properties_3.Diagonal)  # -> XComponent, YComponent, ZComponent; disabled
project_33 = Project(Geometry=geometry_66, Plane=PlaneXY(0, 0, 0))  # -> Geometry, Transform; disabled
division_10 = Division(A=deconstruct_2.ZComponent, B=3)  # disabled
min_max_2 = MinMax(Number=division_10)  # -> Minimum, Maximum; disabled
gradient = Gradient(
    LowerLimit=min_max_2.Minimum,
    UpperLimit=min_max_2.Maximum,
    Parameter=division_10,
    stops=[0: RGB(18, 178, 90), 0: RGB(210, 0, 118), 0: RGB(128, 0, 128), 0: RGB(103, 0, 120), 0: RGB(236, 27, 60), 0.132: RGB(39, 72, 161), 0.23: RGB(1, 192, 229), 0.327: RGB(79, 186, 8), 0.535: RGB(220, 237, 32), 0.748: RGB(247, 159, 20), 1: RGB(255, 0, 0)])  # disabled
area_3 = Area(Geometry=project_33.Geometry)  # -> Area, Centroid; disabled
multiplication_32 = Multiplication(A=area_3.Area, B=division_10)  # disabled
geometry_67 = Geometry(graft(join_curves_3))  # disabled
point_in_curves = PointInCurves(Point=area_3.Centroid, Curves=simplify(geometry_67))  # -> Relationship, Index, Point; disabled
division_11 = Division(A=point_in_curves.Relationship, B=2)  # disabled
geometry_68 = Geometry(выкидыватель_3)  # disabled
geometry_69 = Geometry(graft(geometry_68))  # disabled
multiplication_33 = Multiplication(A=division_11, B=multiplication_32)  # disabled
area_4 = Area(Geometry=geometry_69)  # -> simplify(Area), Centroid; disabled
mass_addition_35 = MassAddition(Input=multiplication_33)  # -> simplify(Result), PartialResults; disabled
division_12 = Division(A=mass_addition_35.Result, B=area_4.Area)  # -> flatten(Result); disabled
cluster_17 = Cluster_7(list=geometry_68, curves=geometry_68, curve=geometry_68)  # disabled
min_max_3 = MinMax(Number=division_12)  # -> Minimum, Maximum; disabled
simplify_curve_3 = SimplifyCurve(Curve=cluster_17, AngleTolerance=1)  # -> Curve, Simplified; disabled
gradient_2 = Gradient(
    LowerLimit=min_max_3.Minimum,
    UpperLimit=min_max_3.Maximum,
    Parameter=division_12,
    stops=[0: RGB(75, 107, 169), 0.0909: RGB(173, 203, 249), 0.314: RGB(254, 244, 84), 0.572: RGB(234, 126, 0), 1: RGB(234, 38, 0)])  # disabled
boundary_surfaces_5 = BoundarySurfaces(Edges=simplify_curve_3.Curve)  # disabled
number_slider_10 = Slider(6, range=0..10)  # disabled
construct_point_2 = ConstructPoint(XCoordinate=0, YCoordinate=0, ZCoordinate=100)  # disabled
subtraction_8 = Subtraction(A=0, B=number_slider_10)  # disabled
panel_21 = Panel("лучше вычертить границы")  # disabled
vector_xyz_7 = VectorXYZ(XComponent=0, YComponent=0, ZComponent=-50)  # -> Vector, Length; disabled
move_9 = Move(Geometry=geometry_68, Motion=vector_xyz_7.Vector)  # -> Geometry, Transform; disabled
extrude_7 = Extrude(Base=move_9.Geometry, Direction=construct_point_2)  # disabled
custom_preview_5 = CustomPreview(Geometry=graft(extrude_7), Material=graft(gradient_2))  # disabled
brep_is_solid = BrepIsSolid(Brep=extrude_7)  # disabled
cull_pattern_4 = CullPattern(List=extrude_7, CullPattern=brep_is_solid)  # disabled
brep_2 = Brep(cull_pattern_4)  # disabled

box_4 = Box(geometry_66)  # disabled
deconstruct_box = DeconstructBox(Box=box_4)  # -> Plane, X, Y, Z; disabled
deconstruct_domain = DeconstructDomain(Domain=deconstruct_box.Z)  # -> Start, End; disabled
deconstruct_3 = Deconstruct(Point=construct_point_2)  # -> XComponent, YComponent, ZComponent; disabled
subtraction_9 = Subtraction(A=deconstruct_3.ZComponent, B=deconstruct_domain.Start)  # disabled
deconstruct_4 = Deconstruct(Point=vector_xyz_7.Vector)  # -> XComponent, YComponent, ZComponent; disabled
addition_2 = Addition(A=deconstruct_4.ZComponent, B=subtraction_9)  # disabled
vector_xyz_8 = VectorXYZ(XComponent=0, YComponent=0, ZComponent=addition_2)  # -> Vector, Length; disabled
move_10 = Move(Geometry=geometry_66, Motion=vector_xyz_8.Vector)  # -> Geometry, Transform; disabled

custom_preview_6 = CustomPreview(Geometry=graft(move_10.Geometry), Material=graft(gradient))  # disabled

премещатор_2 = Премещатор(geometry=extrude_7, center=Point(0, 0, 0), motion=Vector(0, 0, 10))  # disabled
премещатор_3 = Премещатор(geometry=extrude_7, center=Point(0, 0, 0), motion=Vector(0, 0, 10))  # disabled

box_5 = Box(surface_from_points)  # disabled
box_properties_4 = BoxProperties(Box=box_5)  # -> Center, Diagonal, Area, Volume, Degeneracy; disabled
deconstruct_5 = Deconstruct(Point=box_properties_4.Center)  # -> XComponent, YComponent, ZComponent; disabled
deconstruct_6 = Deconstruct(Point=box_properties_4.Diagonal)  # -> XComponent, YComponent, ZComponent; disabled
division_13 = Division(A=deconstruct_6.ZComponent, B=2)  # disabled
construct_point_3 = ConstructPoint(XCoordinate=0, YCoordinate=0, ZCoordinate=0)  # disabled
panel_22 = Panel("-70")  # disabled
panel_23 = Panel("50")  # disabled
division_14 = Division(A=deconstruct_6.ZComponent, B=number_slider_2)  # disabled
geometry_70 = Geometry(line_3)  # disabled
multiplication_34 = Multiplication(A=division_14, B=2)  # disabled
addition_3 = Addition(A=division_14, B=5)  # disabled
subtraction_10 = Subtraction(A=deconstruct_5.ZComponent, B=division_13)  # disabled
deconstruct_7 = Deconstruct(Point=construct_point_3)  # -> XComponent, YComponent, ZComponent; disabled
subtraction_11 = Subtraction(A=subtraction_10, B=5)  # disabled
end_points = EndPoints(Curve=geometry_70)  # -> Start, End; disabled
integer_3 = Integer(addition_3)  # disabled
deconstruct_8 = Deconstruct(Point=end_points.Start)  # -> XComponent, YComponent, ZComponent; disabled
deconstruct_9 = Deconstruct(Point=end_points.End)  # -> XComponent, YComponent, ZComponent; disabled
vector_xyz_9 = VectorXYZ(XComponent=0, YComponent=0, ZComponent=-60)  # -> Vector, Length; disabled
series = Series(Start=6, Step=2, Count=21)
construct_point_4 = ConstructPoint(XCoordinate=deconstruct_8.XComponent, YCoordinate=deconstruct_8.YComponent, ZCoordinate=panel_23)  # disabled
construct_point_5 = ConstructPoint(XCoordinate=deconstruct_9.XComponent, YCoordinate=deconstruct_9.YComponent, ZCoordinate=panel_22)  # disabled
subtraction_12 = Subtraction(A=deconstruct_8.XComponent, B=deconstruct_9.XComponent)  # disabled
subtraction_13 = Subtraction(A=deconstruct_9.YComponent, B=deconstruct_8.YComponent)  # disabled
extrude_8 = Extrude(Base=surface_from_points, Direction=vector_xyz_9.Vector)  # disabled
construct_point_6 = ConstructPoint(XCoordinate=0, YCoordinate=0, ZCoordinate=series)
box_2pt = Box2Pt(PointA=construct_point_4, PointB=construct_point_5, Plane=PlaneXY(0, 0, 0))  # disabled
xy_plane = XYPlane(Origin=construct_point_6)  # -> flatten(Plane)
plane_surface = PlaneSurface(Plane=xy_plane, XSize=subtraction_12, YSize=subtraction_13)  # disabled
box_properties_5 = BoxProperties(Box=plane_surface)  # -> Center, Diagonal, Area, Volume, Degeneracy; disabled
box_properties_6 = BoxProperties(Box=box_2pt)  # -> Center, Diagonal, Area, Volume, Degeneracy; disabled
fast_solid_intersect = FastSolidIntersect(FirstBrepSet=extrude_8, SecondBrepSet=box_2pt, Tolerance=0.01, strictFastSolidInt=True, trueIntFastSolidInt=False)  # disabled
deconstruct_10 = Deconstruct(Point=box_properties_5.Center)  # -> XComponent, YComponent, ZComponent; disabled
deconstruct_11 = Deconstruct(Point=box_properties_6.Center)  # -> XComponent, YComponent, ZComponent; disabled
subtraction_14 = Subtraction(A=deconstruct_10.XComponent, B=deconstruct_11.XComponent)  # disabled
subtraction_15 = Subtraction(A=deconstruct_10.YComponent, B=deconstruct_11.YComponent)  # disabled
brep_plane = BrepPlane(Brep=surface_from_points, Plane=flatten(xy_plane))  # -> simplify(Curves), Points
vector_xyz_10 = VectorXYZ(XComponent=subtraction_14, YComponent=subtraction_15, ZComponent=0)  # -> Vector, Length; disabled
reverse_3 = Reverse(Vector=vector_xyz_10.Vector)  # disabled
move_11 = Move(Geometry=plane_surface, Motion=reverse_3)  # -> Geometry, Transform; disabled
brep_brep = BrepBrep(BrepA=fast_solid_intersect, BrepB=move_11.Geometry)  # -> Curves, Points; disabled
join_curves_4 = JoinCurves(Curves=brep_brep.Curves, Preserve=False)  # disabled
prune_tree = PruneTree(Tree=join_curves_4, Minimum=1, Maximum=0)  # disabled
geometry_71 = Geometry(prune_tree)  # disabled
closed_2 = Closed(Curve=geometry_71)  # -> Closed, Periodic; disabled
gate_not_2 = GateNot(A=closed_2.Closed)  # disabled
closed_3 = Closed(Curve=geometry_71)  # -> Closed, Periodic; disabled
cull_pattern_5 = CullPattern(List=geometry_71, CullPattern=gate_not_2)  # -> simplify(List); disabled
cull_pattern_6 = CullPattern(List=geometry_71, CullPattern=closed_3.Closed)  # -> flatten(List); disabled
prune_tree_2 = PruneTree(Tree=cull_pattern_5, Minimum=2, Maximum=2)  # disabled
prune_tree_3 = PruneTree(Tree=cull_pattern_5, Minimum=1, Maximum=1)  # disabled
prune_tree_4 = PruneTree(Tree=cull_pattern_5, Minimum=3, Maximum=0)  # disabled
end_points_2 = EndPoints(Curve=prune_tree_2)  # -> Start, End; disabled
close_curve = CloseCurve(Curve=prune_tree_3, CloseType=0, Bulge=0.5, Tolerance=0)  # -> flatten(Closed), ResultBoolean; disabled
shift_list = ShiftList(List=end_points_2.End, Shift=1, Wrap=True)  # disabled
line_5 = Line(StartPoint=end_points_2.Start, EndPoint=shift_list)  # -> simplify(Line); disabled
merge_2 = Merge(Data1=prune_tree_2, Data2=line_5)  # disabled
join_curves_5 = JoinCurves(Curves=merge_2, Preserve=False)  # -> flatten(Curves); disabled
relay = Relay([cull_pattern_6, close_curve.Closed, join_curves_5])  # disabled
length = Length(Curve=relay)  # disabled
larger_than = LargerThan(FirstNumber=length, SecondNumber=200)  # -> LargerThan, OrEqualTo; disabled
cull_pattern_7 = CullPattern(List=relay, CullPattern=larger_than.LargerThan)  # disabled
subtraction_16 = Subtraction(A=0, B=number_slider_2)  # disabled
unit_z_4 = UnitZ(Factor=subtraction_16)  # disabled
panel_24 = Panel("Рельеф")  # disabled

solid_intersection = SolidIntersection(BrepsA=surface_from_points, BrepsB=box_2pt)  # disabled
deconstruct_brep_2 = DeconstructBrep(Brep=solid_intersection)  # -> Faces, Edges, Vertices; disabled
list_item_3 = ListItem(List=deconstruct_brep_2.Faces, Index=5, Wrap=True)  # disabled
explode_38 = Explode(Curve=cull_pattern_7, Recursive=True)  # -> flatten(Segments), Vertices; disabled
join_curves_6 = JoinCurves(Curves=explode_38.Segments, Preserve=False)  # disabled

boundary_surfaces_6 = BoundarySurfaces(Edges=join_curves_6)  # -> flatten(Surfaces); disabled
extrude_9 = Extrude(Base=flatten(boundary_surfaces_6), Direction=unit_z_4)  # disabled
box_6 = Box(extrude_9)  # disabled
box_properties_7 = BoxProperties(Box=box_6)  # -> Center, Diagonal, Area, Volume, Degeneracy; disabled
deconstruct_12 = Deconstruct(Point=box_properties_7.Center)  # -> XComponent, YComponent, ZComponent; disabled
премещатор_4 = Премещатор(geometry=extrude_9, center=Point(0, 0, 0), motion=Vector(0, 0, 10))  # disabled
min_max_4 = MinMax(Number=deconstruct_12.ZComponent)  # -> Minimum, Maximum; disabled
gradient_3 = Gradient(
    LowerLimit=min_max_4.Minimum,
    UpperLimit=min_max_4.Maximum,
    Parameter=deconstruct_12.ZComponent,
    stops=[0: RGB(0, 0, 0), 1: RGB(169, 169, 169)])  # disabled
custom_preview_7 = CustomPreview(Geometry=graft(extrude_9), Material=graft(gradient_3))  # disabled

createattributes_2 = CreateAttributes(Color=gradient_3, GroupIndices=1, enableFullPath=False)  # disabled
премещатор_5 = Премещатор(geometry=extrude_9, center=Point(0, 0, 0), motion=Vector(0, 0, 10))  # disabled
bake_geometry_2 = BakeGeometry(Bake=False, Geometry=премещатор_5, Attributes=createattributes_2, DeleteOldBakes=False, PreserveTrees=True)  # disabled
move_12 = Move(Geometry=brep_plane.Curves, Motion=Vector(0, 0, 0.2))  # -> Geometry, Transform

# ---- group: DEMO / Sections
preview_5 = CustomPreview(
    Geometry=move_12.Geometry,
    Material={diffuse=RGB(160, 179, 159), emission=RGB(0, 0, 0), shine=0, specular=RGB(255, 255, 255), transparency=0})

# ----
geometry_72 = Geometry([<brep referenced from the Rhino model> x1310])  # disabled
null_item = NullItem(Item=geometry_72)  # -> NullFlags, InvalidFlags, Description; disabled
gate_not_3 = GateNot(A=null_item.NullFlags)  # disabled
cull_pattern_8 = CullPattern(List=geometry_72, CullPattern=gate_not_3)  # disabled
антиперемещ_3 = Антиперемещ(geometry=cull_pattern_8)  # disabled
_2_3 = _2(box=антиперемещ_3, geometry=антиперемещ_3, surface=surface)  # disabled
create_material_4 = CreateMaterial(Diffuse=colour_swatch_2, Specular=RGB(255, 255, 255), Emission=RGB(0, 0, 0), Transparency=0, Shine=0)  # disabled
move_13 = Move(Geometry=_2_3, Motion=vector_xyz_5.Vector)  # -> Geometry, Transform; disabled
button_4 = Button()  # disabled

custom_preview_8 = CustomPreview(Geometry=move_4.Geometry, Material=create_material_4)  # disabled

отступ_длины = Slider(6, range=0..10)
отступ_ширины = Slider(5, range=0..20)
ширина_пополам = Slider(1.6, range=0..3)
geometry_73 = Geometry(surface_from_points)
vector_xyz_11 = VectorXYZ(XComponent=0, YComponent=0, ZComponent=0.2)  # -> Vector, Length; disabled
colour_swatch_5 = ColourSwatch(SwatchColor=RGB(25, 165, 41))  # disabled
create_material_5 = CreateMaterial(Diffuse=colour_swatch_5, Specular=RGB(255, 255, 255), Emission=RGB(0, 0, 0), Transparency=0, Shine=0)  # disabled

отступ_длины_2 = Slider(6, range=0..10)
отступ_ширины_2 = Slider(5, range=0..20)
ширина_пополам_2 = Slider(1.6, range=0..3)
geometry_74 = Geometry(surface_from_points)
vector_xyz_12 = VectorXYZ(XComponent=0, YComponent=0, ZComponent=0.2)  # -> Vector, Length; disabled
colour_swatch_6 = ColourSwatch(SwatchColor=RGB(25, 165, 41))  # disabled
create_material_6 = CreateMaterial(Diffuse=colour_swatch_6, Specular=RGB(255, 255, 255), Emission=RGB(0, 0, 0), Transparency=0, Shine=0)  # disabled

addition_4 = Addition(A=cluster_2.i_6, B=отступ_длины_2)
addition_5 = Addition(A=cluster_2.i, B=отступ_длины_2)
addition_6 = Addition(A=cluster_2.i_7, B=отступ_длины_2)

repeat_data = RepeatData(Data=отступ_длины_2, Length=list_length_2)
subtraction_17 = Subtraction(A=flatten(unflatten_tree_2), B=repeat_data)
unflatten_tree_4 = UnflattenTree(Tree=subtraction_17, Guide=simplify_tree_23)
createattributes_3 = CreateAttributes(Color=colour_swatch_5, enableFullPath=False)  # disabled

custom_offset_4 = CustomOffset(Polygons=polygons_from_lines_3.Polygons, OffsetValues=unflatten_tree_4)  # -> OffsetedPolygons, Test
выкидыватель_4 = Выкидыватель(curve=custom_offset_4.OffsetedPolygons, geometry=polygons_from_lines_3.Polygons)
cluster_18 = Cluster_11(
    geometry=выкидыватель_4,
    list=geometry_43,
    distance_2=ширина_пополам_2,
    distance=addition_4,
    surface=geometry_74,
    B=отступ_ширины_2,
    input=flip_matrix_23,
    brep=geometry_74)  # -> list_2, curve
geometry_75 = Geometry(cluster_18.list_2)
move_14 = Move(Geometry=geometry_75, Motion=vector_xyz_12.Vector)  # -> Geometry, Transform; disabled
custom_preview_9 = CustomPreview(Geometry=move_14.Geometry, Material=create_material_6)  # disabled

custom_offset_5 = CustomOffset(Polygons=polygons_from_lines_3.Polygons, OffsetValues=unflatten_tree_4)  # -> OffsetedPolygons, Test
отступ_длины_3 = Slider(6, range=0..10)
отступ_ширины_3 = Slider(5, range=0..20)
ширина_пополам_3 = Slider(1.6, range=0..3)
выкидыватель_5 = Выкидыватель(curve=custom_offset_5.OffsetedPolygons, geometry=polygons_from_lines_3.Polygons)
geometry_76 = Geometry(surface_from_points)
cluster_19 = Cluster_11(
    geometry=выкидыватель_5,
    list=geometry_47,
    distance_2=ширина_пополам_3,
    distance=addition_5,
    surface=geometry_76,
    B=отступ_ширины_3,
    input=flip_matrix_24,
    brep=geometry_76)  # -> list_2, curve
vector_xyz_13 = VectorXYZ(XComponent=0, YComponent=0, ZComponent=0.2)  # -> Vector, Length; disabled
geometry_77 = Geometry(cluster_19.list_2)  # disabled
colour_swatch_7 = ColourSwatch(SwatchColor=RGB(25, 165, 41))  # disabled
move_15 = Move(Geometry=geometry_77, Motion=vector_xyz_13.Vector)  # -> Geometry, Transform; disabled
create_material_7 = CreateMaterial(Diffuse=colour_swatch_7, Specular=RGB(255, 255, 255), Emission=RGB(0, 0, 0), Transparency=0, Shine=0)  # disabled
custom_preview_10 = CustomPreview(Geometry=move_15.Geometry, Material=create_material_7)  # disabled

custom_offset_6 = CustomOffset(Polygons=polygons_from_lines_3.Polygons, OffsetValues=unflatten_tree_4)  # -> OffsetedPolygons, Test
выкидыватель_6 = Выкидыватель(curve=custom_offset_6.OffsetedPolygons, geometry=polygons_from_lines_3.Polygons)
cluster_20 = Cluster_11(
    geometry=выкидыватель_6,
    list=geometry_52,
    distance_2=ширина_пополам,
    distance=addition_6,
    surface=geometry_73,
    B=отступ_ширины,
    input=flip_matrix_29,
    brep=geometry_73)  # -> list_2, curve
geometry_78 = Geometry(cluster_20.list_2)  # disabled
move_16 = Move(Geometry=geometry_78, Motion=vector_xyz_11.Vector)  # -> Geometry, Transform; disabled
custom_preview_11 = CustomPreview(Geometry=move_16.Geometry, Material=create_material_5)  # disabled

move_17 = Move(Geometry=[cluster_18.list_2, cluster_19.list_2, cluster_20.list_2], Motion=Vector(0, 0, 0.18))  # -> Geometry, Transform

# ---- group: DEMO / Green strips
preview_6 = CustomPreview(
    Geometry=move_17.Geometry,
    Material={diffuse=RGB(128, 170, 114), emission=RGB(0, 0, 0), shine=0, specular=RGB(255, 255, 255), transparency=0})

# ----
vector_xyz_14 = VectorXYZ(XComponent=0, YComponent=0, ZComponent=0.1)  # -> Vector, Length; disabled
cluster_21 = Cluster_10(geometry=boundary_surfaces_4, relay=surface_from_points)  # disabled
colour_swatch_8 = ColourSwatch(SwatchColor=RGB(89, 89, 89))  # disabled
create_material_8 = CreateMaterial(Diffuse=colour_swatch_8, Specular=RGB(255, 255, 255), Emission=RGB(0, 0, 0), Transparency=0, Shine=0)  # disabled

move_18 = Move(Geometry=cluster_21, Motion=vector_xyz_6.Vector)  # -> Geometry, Transform; disabled
extrude_10 = Extrude(Base=cluster_21, Direction=vector_xyz_6.Vector)  # disabled
cluster_22 = Cluster_15(
    geometry=[cluster_18.curve, cluster_19.curve, cluster_20.curve],
    curve=[cluster_18.curve, cluster_19.curve, cluster_20.curve])  # -> point_2, result
createattributes_4 = CreateAttributes(Color=colour_swatch_8, GroupIndices=0, enableFullPath=False)  # disabled
премещатор_6 = Премещатор(geometry=[extrude_10, cluster_14], center=Point(0, 0, 0), motion=Vector(0, 0, 10))  # disabled
addgeometrys_2 = AddGeometrys(
    Run=button_2,
    GeometryGuid=flatten(getguid_by_selection_2.Guid),
    GeometryLocation=flatten(cluster_22.point_2),
    ScaleDomain=Domain(0.7, 1.2),
    RotateDomain=Domain(0, 360),
    AllocationRatio=flatten(cluster_22.result),
    GeometryPlane=flatten(PlaneXY(0, 0, 0)),
    Seed=2,
    Accurate=True)  # disabled
bake_geometry_3 = BakeGeometry(Bake=boolean_toggle, Geometry=премещатор_6, Attributes=createattributes_4, DeleteOldBakes=False, PreserveTrees=False)  # disabled
bake_geometry_4 = BakeGeometry(Bake=boolean_toggle, Geometry=move_14.Geometry, Attributes=createattributes_3, DeleteOldBakes=False, PreserveTrees=False)  # disabled
bake_geometry_5 = BakeGeometry(Bake=boolean_toggle, Geometry=move_15.Geometry, Attributes=createattributes_3, DeleteOldBakes=False, PreserveTrees=False)  # disabled
bake_geometry_6 = BakeGeometry(Bake=boolean_toggle, Geometry=move_16.Geometry, Attributes=createattributes_3, DeleteOldBakes=False, PreserveTrees=False)  # disabled

createattributes_5 = CreateAttributes(Color=colour_swatch_8, GroupIndices=5, enableFullPath=False)  # disabled
bake_geometry_7 = BakeGeometry(Bake=button_4, Geometry=move_13.Geometry, Attributes=createattributes_5, DeleteOldBakes=False, PreserveTrees=False)  # disabled

custom_preview_12 = CustomPreview(Geometry=move_18.Geometry, Material=create_material_8)  # disabled

c_script_36 = CSharpScript(P=flatten(cluster_22.point_2), Models=mesh, Seed=2)  # -> out, Trees, Records; inputs P: list of Point3d, Models: list of Mesh, Seed: Int32
# ---------- c_script_36: C# ----------
// #! csharp
using System;
using System.Collections.Generic;
using System.Globalization;
using Rhino.Geometry;
using Grasshopper.Kernel;
public class Script_Instance : GH_ScriptInstance
{
  private void RunScript(
		List<Point3d> P,
		List<Mesh> Models,
		int Seed,
		ref object Trees,
		ref object Records)
  {
    var trees = new List<Mesh>();
    var records = new List<string>();
    var rng = new Random(Seed);
    if (P == null || Models == null || Models.Count == 0) { Trees = trees; Records = records; return; }
    for (int i=0;i<P.Count;i++)
    {
      var choice = rng.NextDouble();
      int species = Math.Min(Models.Count-1, choice < .3 ? 0 : choice < .6 ? 1 : 2);
      double scale = .7 + .5*rng.NextDouble();
      double angle = 2*Math.PI*rng.NextDouble();
      var mesh = Models[species].DuplicateMesh();
      mesh.Transform(Transform.Scale(Point3d.Origin,scale));
      mesh.Transform(Transform.Rotation(angle,Vector3d.ZAxis,Point3d.Origin));
      mesh.Transform(Transform.Translation(new Vector3d(P[i])));
      trees.Add(mesh);
      records.Add(String.Format(CultureInfo.InvariantCulture,"{0}|{1:R}|{2:R}|{3:R}|{4:R}|{5:R}",species,scale,angle,P[i].X,P[i].Y,P[i].Z));
    }
    Trees=trees; Records=records;
  }
}
# ---------- end c_script_36 ----------

# ---- group: DEMO / Trees
preview_7 = CustomPreview(
    Geometry=c_script_36.Trees,
    Material={diffuse=RGB(66, 121, 83), emission=RGB(0, 0, 0), shine=0, specular=RGB(255, 255, 255), transparency=0})

# ==== cluster ТочкиИзБокса
A = ClusterInput()
box = ClusterInput()
cluster = Cluster_5(box=box)  # -> x_component, y_component, x_component_2, y_component_2
cluster_2 = Cluster(A=cluster.x_component, B=cluster.x_component_2, A_2=cluster.y_component, A_3=A, B_2=cluster.y_component_2)  # -> result_2, result
panel = Panel(cluster_2.result)
panel_2 = Panel(cluster_2.result_2)
B = ClusterInput()
B_2 = ClusterInput()
cluster_3 = Cluster_2(A=panel_2, B=B)
cluster_4 = Cluster_3(domain_start=cluster.x_component, steps=cluster_3, domain_end=cluster.x_component_2)
cluster_5 = Cluster_2(A=panel, B=B_2)
cluster_6 = Cluster_3(domain_start=cluster.y_component, steps=cluster_5, domain_end=cluster.y_component_2)
construct_point = ConstructPoint(XCoordinate=graft(cluster_4), YCoordinate=cluster_6, ZCoordinate=0)  # -> flatten(Point)
point = ClusterOutput(construct_point)

# ==== cluster ТолщинаторМеша
mesh = ClusterInput()
mesh_2 = Mesh(mesh)
medges = MeshEdges(Mesh=mesh_2)  # -> graft(NakedEdges), InteriorEdges, NonManifoldEdges
project = Project(Geometry=medges.NakedEdges, Plane=PlaneXY(0, 0, 0))  # -> Geometry, Transform
end = EndPoints(Curve=medges.NakedEdges)  # -> Start, End
end_2 = EndPoints(Curve=project.Geometry)  # -> Start, End
project_2 = Project(Geometry=mesh_2, Plane=PlaneXY(0, 0, 0))  # -> Geometry, Transform
conmesh = ConstructMesh(Vertices=[end.End, end.Start, end_2.Start, end_2.End], Faces={A=0, B=1, C=2, D=3})  # -> flatten(Mesh)
mjoin = MeshJoin(Meshes=[conmesh, project_2.Geometry, mesh_2])
unim = UnifyMesh(Mesh=mjoin)  # -> flatten(Result), Count
mjoin_2 = MeshJoin(Meshes=unim.Result)
M = ClusterOutput(mjoin_2)

# ==== cluster Премещатор
geometry = ClusterInput()
center = ClusterInput()
scale = Scale(Geometry=geometry, Center=center, Factor=0.01)  # -> Geometry, Transform
motion = ClusterInput()
move = Move(Geometry=scale.Geometry, Motion=motion)  # -> Geometry, Transform
geometry_2 = ClusterOutput(move.Geometry)

# ==== cluster Cluster_6
list = ClusterInput()
list_2 = ClusterInput()
list_3 = ClusterInput()
list_4 = ClusterInput()
list_5 = ClusterInput()
list_6 = ClusterInput()
list_7 = ClusterInput()
list_8 = ClusterInput()
list_9 = ClusterInput()
list_10 = ClusterInput()
list_item = ListItem(List=list, Index=1, Wrap=True)
list_item_2 = ListItem(List=list_2, Index=3, Wrap=True)
list_item_3 = ListItem(List=list_3, Index=5, Wrap=True)
list_item_4 = ListItem(List=list_4, Index=7, Wrap=True)
list_item_5 = ListItem(List=list_5, Index=9, Wrap=True)
list_item_6 = ListItem(List=list_6, Index=0, Wrap=True)
list_item_7 = ListItem(List=list_7, Index=2, Wrap=True)
list_item_8 = ListItem(List=list_8, Index=4, Wrap=True)
list_item_9 = ListItem(List=list_9, Index=6, Wrap=True)
list_item_10 = ListItem(List=list_10, Index=8, Wrap=True)
i = ClusterOutput(list_item)
i_2 = ClusterOutput(list_item_2)
i_3 = ClusterOutput(list_item_3)
i_4 = ClusterOutput(list_item_4)
i_5 = ClusterOutput(list_item_5)
i_6 = ClusterOutput(list_item_6)
i_7 = ClusterOutput(list_item_7)
i_8 = ClusterOutput(list_item_8)
i_9 = ClusterOutput(list_item_9)
i_10 = ClusterOutput(list_item_10)

# ==== cluster Антиперемещ
geometry = ClusterInput()
scale = Scale(Geometry=geometry, Center=Point(0, 0, 0), Factor=100)  # -> Geometry, Transform
move = Move(Geometry=scale.Geometry, Motion=Vector(0, 0, -10))  # -> Geometry, Transform
geometry_2 = ClusterOutput(move.Geometry)

# ==== cluster Выкидыватель
curve = ClusterInput()
explode = Explode(Curve=curve, Recursive=True)  # -> Segments, Vertices
network_from_lines = NetworkFromLines(Lines=explode.Segments)  # -> PointPointTopology, ConnectionPointTopology, Points, Lines
boundary_surfaces = BoundarySurfaces(Edges=network_from_lines.Lines)
geometry = ClusterInput()
area = Area(Geometry=boundary_surfaces)  # -> Area, Centroid
area_2 = Area(Geometry=geometry)  # -> Area, graft(Centroid)
prune_tree = PruneTree(Tree=boundary_surfaces, Minimum=0, Maximum=1)
prune_tree_2 = PruneTree(Tree=boundary_surfaces, Minimum=3, Maximum=0)
vector_2pt = Vector2Pt(PointA=area.Centroid, PointB=area_2.Centroid, Unitize=False)  # -> Vector, Length
highest_lowest_numbers = HighestLowestNumbers(Numbers=vector_2pt.Length)  # -> Highest, simplify(Lowest)
member_index = MemberIndex(Set=vector_2pt.Length, Member=highest_lowest_numbers.Lowest)  # -> Index, Count
list_item = ListItem(List=boundary_surfaces, Index=member_index.Index, Wrap=True)  # -> flatten(Item)
list_item_2 = ListItem(List=boundary_surfaces, Index=member_index.Index, Wrap=True)  # -> flatten(Item)
i = ClusterOutput(list_item_2)

# ==== cluster Cluster_7
curve = ClusterInput()
explode = Explode(Curve=curve, Recursive=True)  # -> Segments, Vertices
curves = ClusterInput()
list_length = ListLength(List=explode.Vertices)
region_union = RegionUnion(Curves=curves)
point_in_curves = PointInCurves(Point=explode.Vertices, Curves=region_union)  # -> Relationship, Index, Point
boundary_surfaces = BoundarySurfaces(Edges=region_union)
list = ClusterInput()
vector_xyz = VectorXYZ(XComponent=0, YComponent=0, ZComponent=1)  # -> Vector, Length
mass_addition = MassAddition(Input=point_in_curves.Relationship)  # -> Result, PartialResults
division = Division(A=mass_addition.Result, B=list_length)  # -> flatten(Result)
min_max = MinMax(Number=division)  # -> Minimum, Maximum
member_index = MemberIndex(Set=division, Member=min_max.Minimum)  # -> Index, Count
list_item = ListItem(List=list, Index=member_index.Index, Wrap=True)
extrude = Extrude(Base=list_item, Direction=vector_xyz.Vector)
fast_solid_union = FastSolidUnion(Breps=extrude, Tolerance=0.01, strictFastSolidUnion=True, trueIntFastSolidUnion=False)
brep_plane = BrepPlane(Brep=fast_solid_union, Plane=PlaneXY(0, 0, 0))  # -> Curves, Points
curve_2 = Curve(boundary_surfaces)
join_curves = JoinCurves(Curves=brep_plane.Curves, Preserve=False)
merge = Merge(Data1=boundary_surfaces, Data2=brep_plane.Curves)
length = Length(Curve=join_curves)
min_max_2 = MinMax(Number=length)  # -> Minimum, Maximum
member_index_2 = MemberIndex(Set=length, Member=min_max_2.Maximum)  # -> Index, Count
list_item_2 = ListItem(List=join_curves, Index=member_index_2.Index, Wrap=True)
boundary_surfaces_2 = BoundarySurfaces(Edges=list_item_2)
merge_2 = Merge(Data1=boundary_surfaces_2, Data2=curve_2)  # -> flatten(Result)
result = ClusterOutput(merge_2)

# ==== cluster Cluster_9
geometry = ClusterInput()
geometry_2 = Geometry(geometry)
geometry_3 = ClusterInput()
project = Project(Geometry=geometry_3, Plane=PlaneXY(0, 0, 0))  # -> Geometry, Transform
project_2 = Project(Geometry=geometry_2, Plane=PlaneXY(0, 0, 0))  # -> Geometry, Transform
distance = ClusterInput()
offset_curve = OffsetCurve(Curve=project.Geometry, Distance=distance, Corners=3)
point_in_curves = PointInCurves(Point=project_2.Geometry, Curves=project.Geometry)  # -> Relationship, Index, Point
point_in_curves_2 = PointInCurves(Point=project_2.Geometry, Curves=offset_curve)  # -> Relationship, Index, Point
larger_than = LargerThan(FirstNumber=point_in_curves_2.Relationship, SecondNumber=0)  # -> LargerThan, OrEqualTo
larger_than_2 = LargerThan(FirstNumber=point_in_curves.Relationship, SecondNumber=0)  # -> LargerThan, OrEqualTo
cull_pattern = CullPattern(List=geometry_2, CullPattern=larger_than_2.LargerThan)
gate_not = GateNot(A=larger_than_2.LargerThan)
gate_not_2 = GateNot(A=larger_than.LargerThan)
gate_and = GateAnd(A=gate_not, B=larger_than.LargerThan)
deconstruct = Deconstruct(Point=cull_pattern)  # -> XComponent, YComponent, ZComponent
cull_pattern_2 = CullPattern(List=geometry_2, CullPattern=gate_and)
list_length = ListLength(List=cull_pattern)
cull_pattern_3 = CullPattern(List=geometry_2, CullPattern=gate_not)
cull_pattern_4 = CullPattern(List=project_2.Geometry, CullPattern=gate_and)
mass_addition = MassAddition(Input=deconstruct.ZComponent)  # -> Result, PartialResults
deconstruct_2 = Deconstruct(Point=cull_pattern_2)  # -> XComponent, YComponent, ZComponent
min_max = MinMax(Number=deconstruct.ZComponent)  # -> Minimum, Maximum
curve_closest_point = CurveClosestPoint(Point=cull_pattern_4, Curve=project.Geometry)  # -> Point, Parameter, Distance
deconstruct_3 = Deconstruct(Point=cull_pattern_4)  # -> XComponent, YComponent, ZComponent
gate_not_3 = GateNot(A=gate_and)
division = Division(A=mass_addition.Result, B=list_length)
A = ClusterInput()
B = ClusterInput()
addition = Addition(A=A, B=division)
division_2 = Division(A=curve_closest_point.Distance, B=B)
bounds = Bounds(Numbers=division_2)
construct_point = ConstructPoint(XCoordinate=deconstruct.XComponent, YCoordinate=deconstruct.YComponent, ZCoordinate=addition)
subtraction = Subtraction(A=1, B=division_2)
subtraction_2 = Subtraction(A=deconstruct_2.ZComponent, B=addition)
weave = Weave(Pattern=larger_than_2.LargerThan, Stream0=cull_pattern_3, Stream1=construct_point, NullGaps=False)
remap_numbers = RemapNumbers(Value=division_2, Source=bounds, Target=Domain(0, 1))  # -> Mapped, Clipped
cull_pattern_5 = CullPattern(List=weave, CullPattern=gate_not_3)
curve = ClusterInput()
curve_2 = ClusterInput()
cluster = Cluster_8(curve_2=curve, curve=curve_2, relay=remap_numbers.Mapped)
multiplication = Multiplication(A=subtraction_2, B=cluster)
subtraction_3 = Subtraction(A=deconstruct_2.ZComponent, B=multiplication)
construct_point_2 = ConstructPoint(XCoordinate=deconstruct_3.XComponent, YCoordinate=deconstruct_3.YComponent, ZCoordinate=subtraction_3)
weave_2 = Weave(Pattern=gate_and, Stream0=cull_pattern_5, Stream1=construct_point_2, NullGaps=False)
weave_3 = ClusterOutput(weave_2)

# ==== cluster Cluster_10
relay = ClusterInput()
geometry = ClusterInput()
geometry_2 = Geometry(geometry)
project = Project(Curve=geometry_2, Brep=relay, Direction=Vector(0, 0, 1))  # -> flatten(Curve)
box = Box(geometry_2)
surface_split = SurfaceSplit(Surface=relay, Curves=project)
project_2 = Project(Geometry=surface_split, Plane=PlaneXY(0, 0, 0))  # -> Geometry, Transform
box_properties = BoxProperties(Box=box)  # -> Center, Diagonal, Area, Volume, Degeneracy
box_2 = Box(project_2.Geometry)
box_properties_2 = BoxProperties(Box=box_2)  # -> Center, Diagonal, Area, Volume, Degeneracy
closest_point = ClosestPoint(Point=box_properties.Center, Cloud=box_properties_2.Center)  # -> ClosestPoint, CPIndex, Distance
cull_index = CullIndex(List=surface_split, Indices=closest_point.CPIndex, Wrap=False)
list = ClusterOutput(cull_index)

# ==== cluster Cluster_11
input = ClusterInput()
mass_addition = MassAddition(Input=input)  # -> Result, PartialResults
flip_matrix = FlipMatrix(Data=mass_addition.Result)
list = ClusterInput()
cull_pattern = CullPattern(List=list, CullPattern=flip_matrix)
list_item = ListItem(List=cull_pattern, Index=0, Wrap=True)
distance = ClusterInput()
join_curves = JoinCurves(Curves=cull_pattern, Preserve=False)
subtraction = Subtraction(A=0, B=distance)
offset_curve = OffsetCurve(Curve=cull_pattern, Distance=distance, Corners=2)
geometry = ClusterInput()
geometry_2 = Geometry(geometry)
curve_curve = CurveCurve(CurveA=geometry_2, CurveB=offset_curve)  # -> Points, ParamsA, ParamsB
prune_tree = PruneTree(Tree=curve_curve.Points, Minimum=1, Maximum=0)
polyline = PolyLine(Vertices=prune_tree, Closed=False)  # -> simplify(flatten(Polyline))
null_item = NullItem(Item=polyline)  # -> NullFlags, InvalidFlags, Description
gate_not = GateNot(A=null_item.NullFlags)
cull_pattern_2 = CullPattern(List=polyline, CullPattern=gate_not)
explode = Explode(Curve=cull_pattern_2, Recursive=True)  # -> flatten(Segments), Vertices
removeduplicatelines = RemoveDuplicateLines(Lines=explode.Segments, Tolerance=0.01)
larger_than = LargerThan(FirstNumber=removeduplicatelines, SecondNumber=15)  # -> LargerThan, OrEqualTo
cull_pattern_3 = CullPattern(List=removeduplicatelines, CullPattern=larger_than.LargerThan)
length = Length(Curve=cull_pattern_3)
list_item_2 = ListItem(List=cull_pattern_3, Index=0, Wrap=True)
B = ClusterInput()
end_points = EndPoints(Curve=cull_pattern_3)  # -> Start, End
division = Division(A=length, B=100)
round = Round(Number=division)  # -> Nearest, Floor, Ceiling
divide_curve = DivideCurve(Curve=cull_pattern_3, Count=round.Ceiling, Kinks=False)  # -> Points, Tangents, Parameters
list_length = ListLength(List=divide_curve.Points)
subtraction_2 = Subtraction(A=list_length, B=1)
cull_index = CullIndex(List=divide_curve.Points, Indices=subtraction_2, Wrap=True)
line = Line(StartPoint=graft(end_points.Start), EndPoint=cull_index)
length_2 = Length(Curve=line)
division_2 = Division(A=length_2, B=graft(length))  # -> simplify(Result)
shatter = Shatter(Curve=graft(cull_pattern_3), Parameters=division_2)  # -> simplify(flatten(Segments))
length_3 = Length(Curve=graft(shatter))
subtraction_3 = Subtraction(A=length_3, B=B)
insert_items = InsertItems(List=subtraction_3, Item=B, Indices=1, Wrap=True)  # -> simplify(List)
tree_statistics = TreeStatistics(Tree=division_2)  # -> Paths, Length, Count
evaluate_length = EvaluateLength(Curve=simplify(graft(shatter)), Length=simplify(insert_items), Normalized=False)  # -> Point, Tangent, Parameter
larger_than_2 = LargerThan(FirstNumber=tree_statistics.Length, SecondNumber=0)  # -> LargerThan, OrEqualTo
polyline_2 = PolyLine(Vertices=evaluate_length.Point, Closed=False)
insert_items_2 = InsertItems(List=evaluate_length.Point, Indices=1, Wrap=True)  # -> simplify(List)
distance_2 = ClusterInput()
subtraction_4 = Subtraction(A=0, B=distance_2)
offset_curve_2 = OffsetCurve(Curve=polyline_2, Plane=PlaneXY(0, 0, 0), Distance=distance_2, BothSides=subtraction_4, Kinks=0, CapType=1)  # -> flatten(Offset)
brep = ClusterInput()
project = Project(Curve=offset_curve_2, Brep=brep, Direction=Vector(0, 0, 1))  # -> flatten(Curve)
project_2 = Project(Curve=polyline_2, Brep=brep, Direction=Vector(0, 0, 1))  # -> flatten(Curve)
surface = ClusterInput()
surface_split = SurfaceSplit(Surface=surface, Curves=project)
box = Box(surface_split)
volume = Volume(Geometry=box)  # -> Volume, Centroid
min_max = MinMax(Number=volume.Volume)  # -> Minimum, Maximum
member_index = MemberIndex(Set=volume.Volume, Member=min_max.Maximum)  # -> Index, Count
cull_index_2 = CullIndex(List=surface_split, Indices=member_index.Index, Wrap=True)
list_2 = ClusterOutput(cull_index_2)
curve = ClusterOutput(project_2)

# ==== cluster Cluster_13
relay = ClusterInput()
volume = Volume(Geometry=relay)  # -> Volume, Centroid
smaller_than = SmallerThan(FirstNumber=volume.Volume, SecondNumber=1200)  # -> SmallerThan, OrEqualTo
cull_pattern = CullPattern(List=relay, CullPattern=smaller_than.SmallerThan)
geometry = Geometry(cull_pattern)
project = Project(Geometry=geometry, Plane=PlaneXY(0, 0, 0))  # -> Geometry, Transform
brep_edges = BrepEdges(Brep=project.Geometry)  # -> Naked, Interior, NonManifold
length = Length(Curve=brep_edges.Interior)
smaller_than_2 = SmallerThan(FirstNumber=length, SecondNumber=0)  # -> SmallerThan, OrEqualTo
panel = Panel(smaller_than_2.OrEqualTo)
gate_not = GateNot(A=smaller_than_2.OrEqualTo)
cull_pattern_2 = CullPattern(List=brep_edges.Interior, CullPattern=gate_not)
removeduplicatelines = RemoveDuplicateLines(Lines=cull_pattern_2, Tolerance=0.01)
join_curves = JoinCurves(Curves=removeduplicatelines, Preserve=False)
area = Area(Geometry=join_curves)  # -> Area, flatten(Centroid)
geometry_2 = Geometry(area.Centroid)
line = Line(StartPoint=graft(geometry_2), EndPoint=geometry_2)
length_2 = Length(Curve=line)
smaller_than_3 = SmallerThan(FirstNumber=length_2, SecondNumber=0)  # -> SmallerThan, OrEqualTo
gate_not_2 = GateNot(A=smaller_than_3.OrEqualTo)
panel_2 = Panel(smaller_than_3.OrEqualTo)
cull_pattern_3 = CullPattern(List=line, CullPattern=gate_not_2)
cull_pattern_4 = CullPattern(List=length_2, CullPattern=gate_not_2)
smaller_than_4 = SmallerThan(FirstNumber=cull_pattern_4, SecondNumber="15")  # -> SmallerThan, OrEqualTo

cull_pattern_5 = CullPattern(List=cull_pattern_3, CullPattern=smaller_than_4.SmallerThan)  # -> flatten(List)
join_curves_2 = JoinCurves(Curves=cull_pattern_5, Preserve=False)
end_points = EndPoints(Curve=cull_pattern_5)  # -> Start, End
boundary_surfaces = BoundarySurfaces(Edges=join_curves_2)
deconstruct_brep = DeconstructBrep(Brep=boundary_surfaces)  # -> Faces, flatten(Edges), simplify(flatten(Vertices))
member_index = MemberIndex(Set=end_points.End, Member=deconstruct_brep.Vertices)  # -> flatten(Index), Count
member_index_2 = MemberIndex(Set=end_points.Start, Member=deconstruct_brep.Vertices)  # -> flatten(Index), Count
cull_index = CullIndex(List=end_points.End, Indices=member_index.Index, Wrap=False)
cull_index_2 = CullIndex(List=end_points.Start, Indices=member_index_2.Index, Wrap=False)
line_2 = Line(StartPoint=cull_index_2, EndPoint=cull_index)
geometry_3 = Geometry(flatten([deconstruct_brep.Edges, line_2]))

panel_3 = Panel(cull_pattern_4)
removeduplicatelines_2 = RemoveDuplicateLines(Lines=geometry_3, Tolerance=0.01)
join_curves_3 = JoinCurves(Curves=removeduplicatelines_2, Preserve=False)
explode = Explode(Curve=join_curves_3, Recursive=True)  # -> Segments, Vertices
end_points_2 = EndPoints(Curve=explode.Segments)  # -> Start, End
deconstruct = Deconstruct(Point=geometry_2)  # -> XComponent, YComponent, ZComponent
removeduplicatepts = RemoveDuplicatePts(Points=[end_points_2.Start, end_points_2.End], Tolerance=0.01)  # -> simplify(UniquePoints)
construct_point = ConstructPoint(XCoordinate=deconstruct.XComponent, YCoordinate=deconstruct.YComponent, ZCoordinate=deconstruct.ZComponent)
member_index_3 = MemberIndex(Set=construct_point, Member=removeduplicatepts)  # -> Index, Count
trim_tree = TrimTree(Tree=member_index_3.Index, Depth=1)
list_item = ListItem(List=cull_pattern, Index=trim_tree, Wrap=True)
i = ClusterOutput(list_item)

tree_statistics = TreeStatistics(Tree=list_item)  # -> Paths, Length, Count
multiplication = Multiplication(A=tree_statistics.Count, B=0.6)
x_minus_one = XMinusOne(NumberX=tree_statistics.Count)
construct_domain = ConstructDomain(DomainStart=0, DomainEnd=x_minus_one)
round = Round(Number=multiplication)  # -> Nearest, Floor, Ceiling
multiplication_2 = Multiplication(A=multiplication, B=0.5)
series = Series(Start=0, Step=1, Count=tree_statistics.Count)
jitter = Jitter(List=series, Jitter=1, Seed=Slider(63, range=0..100))  # -> Values, Indices
round_2 = Round(Number=multiplication_2)  # -> Nearest, Floor, Ceiling
multiplication_3 = Multiplication(A=multiplication_2, B=0.8)
split_list = SplitList(List=jitter.Values, Index=round.Floor)  # -> ListA, ListB
random = Random(Range=construct_domain, Number=Slider(17, range=0..20), Seed=2, Integers=True)
round_3 = Round(Number=multiplication_3)  # -> Nearest, Floor, Ceiling
split_list_2 = SplitList(List=split_list.ListA, Index=round_2.Floor)  # -> ListA, ListB
split_list_3 = SplitList(List=split_list.ListB, Index=round_2.Floor)  # -> ListA, ListB
split_list_4 = SplitList(List=split_list_2.ListA, Index=round_3.Floor)  # -> ListA, ListB
split_list_5 = SplitList(List=split_list_2.ListB, Index=round_3.Floor)  # -> ListA, ListB

geometry_4 = ClusterInput()
geometry_5 = ClusterInput()
geometry_6 = ClusterInput()
geometry_7 = ClusterInput()
geometry_8 = ClusterInput()
geometry_9 = ClusterInput()
data = Data(split_list_3.ListA)
data_2 = Data(split_list_3.ListB)
data_3 = Data(split_list_4.ListA)
data_4 = Data(split_list_4.ListB)
data_5 = Data(split_list_5.ListA)
data_6 = Data(split_list_5.ListB)
cluster = Cluster_12(tree=list_item, data_path=data, geometry=geometry_4)  # -> data_path_3, list
cluster_2 = Cluster_12(tree=list_item, data_path=data_2, geometry=geometry_5)  # -> data_path_3, list
cluster_3 = Cluster_12(tree=list_item, data_path=data_3, geometry=geometry_6)  # -> data_path_3, list
cluster_4 = Cluster_12(tree=list_item, data_path=data_4, geometry=geometry_7)  # -> data_path_3, list
cluster_5 = Cluster_12(tree=list_item, data_path=data_5, geometry=geometry_8)  # -> data_path_3, list
cluster_6 = Cluster_12(tree=list_item, data_path=data_6, geometry=geometry_9)  # -> data_path_3, list
list = ClusterOutput(cluster.list)
list_2 = ClusterOutput(cluster_2.list)
list_3 = ClusterOutput(cluster_3.list)
list_4 = ClusterOutput(cluster_4.list)
list_5 = ClusterOutput(cluster_5.list)
list_6 = ClusterOutput(cluster_6.list)

# ==== cluster _1
geometric = ClusterInput()
box = Box(geometric)
deconstruct_box = DeconstructBox(Box=box)  # -> Plane, X, Y, Z
unit_z = UnitZ(Factor=1)
center = Center(Geometric=geometric)  # -> Center, Dimension
reverse = Reverse(Vector=unit_z)
deconstruct_domain = DeconstructDomain(Domain=deconstruct_box.Z)  # -> Start, End
surface = ClusterInput()
line_sdl = LineSDL(Start=center.Center, Direction=reverse, Length=2000)
surface_line = SurfaceLine(Surface=surface, Line=line_sdl, LimitToFirst=False)  # -> Curves, flatten(Points), UVPoints, Normal
deconstruct = Deconstruct(Point=center.Center)  # -> XComponent, YComponent, ZComponent
deconstruct_2 = Deconstruct(Point=surface_line.Points)  # -> XComponent, YComponent, ZComponent
subtraction = Subtraction(A=deconstruct_2.ZComponent, B=deconstruct_domain.Start)
unit_z_2 = UnitZ(Factor=subtraction)
geometry = ClusterInput()
move = Move(Geometry=geometry, Motion=unit_z_2)  # -> Geometry, Transform
geometry_2 = ClusterOutput(move.Geometry)

# ==== cluster _2
box = ClusterInput()
box_2 = Box(box)
volume = Volume(Geometry=box_2)  # -> Volume, Centroid
replace_nulls = ReplaceNulls(Items=volume.Volume, Replacements=0)  # -> Items, Count
larger_than = LargerThan(FirstNumber=replace_nulls.Items, SecondNumber=0)  # -> LargerThan, OrEqualTo
cull_pattern = CullPattern(List=box, CullPattern=larger_than.LargerThan)
center = Center(Geometric=cull_pattern)  # -> Center, Dimension
cull_pattern_2 = CullPattern(List=box, CullPattern=larger_than.LargerThan)
deconstruct_box = DeconstructBox(Box=cull_pattern_2)  # -> Plane, X, Y, Z
unit_z = UnitZ(Factor=1)
reverse = Reverse(Vector=unit_z)
deconstruct_domain = DeconstructDomain(Domain=deconstruct_box.Z)  # -> Start, End
surface = ClusterInput()
deconstruct = Deconstruct(Point=center.Center)  # -> XComponent, YComponent, ZComponent
construct_point = ConstructPoint(XCoordinate=deconstruct.XComponent, YCoordinate=deconstruct.YComponent, ZCoordinate=deconstruct_domain.Start)
line_sdl = LineSDL(Start=construct_point, Direction=reverse, Length=2000)
surface_line = SurfaceLine(Surface=surface, Line=line_sdl, LimitToFirst=False)  # -> Curves, flatten(Points), UVPoints, Normal
deconstruct_2 = Deconstruct(Point=surface_line.Points)  # -> XComponent, YComponent, ZComponent
subtraction = Subtraction(A=deconstruct_2.ZComponent, B=deconstruct_domain.Start)
unit_z_2 = UnitZ(Factor=subtraction)
geometry = ClusterInput()
move = Move(Geometry=geometry, Motion=unit_z_2)  # -> Geometry, Transform
geometry_2 = ClusterOutput(move.Geometry)

# ==== cluster Cluster_14
brep = ClusterInput()
deconstruct_brep = DeconstructBrep(Brep=brep)  # -> Faces, Edges, Vertices
list_item = ListItem(List=deconstruct_brep.Faces, Index=Slider(8, range=0..10), Wrap=True)
deconstruct_brep_2 = DeconstructBrep(Brep=list_item)  # -> Faces, Edges, Vertices
join_curves = JoinCurves(Curves=deconstruct_brep_2.Edges, Preserve=False)
relay = ClusterInput()
offset_curve = OffsetCurve(Curve=join_curves, Distance=-1, Corners=1)
project = Project(Curve=flatten([offset_curve, join_curves]), Brep=relay, Direction=Vector(0, 0, 1))  # -> flatten(Curve)
surface_split = SurfaceSplit(Surface=relay, Curves=flatten(project))
join_curves_2 = JoinCurves(Curves=project, Preserve=False)
area = Area(Geometry=surface_split)  # -> Area, Centroid
min_max = MinMax(Number=area.Area)  # -> Minimum, Maximum
member_index = MemberIndex(Set=area.Area, Member=min_max.Minimum)  # -> Index, Count
list_item_2 = ListItem(List=surface_split, Index=member_index.Index, Wrap=True)
i = ClusterOutput(list_item_2)

# ==== cluster Cluster_15
curve = ClusterInput()
geometry = ClusterInput()
length = Length(Curve=curve)
geometry_2 = Geometry(geometry)
division = Division(A=length, B=10)
round = Round(Number=division)  # -> Nearest, Floor, Ceiling
addition = Addition(A=round.Ceiling, B=1)
divide_curve = DivideCurve(Curve=geometry_2, Count=addition, Kinks=False)  # -> Points, Tangents, Parameters
list_length = ListLength(List=divide_curve.Points)
subtraction = Subtraction(A=list_length, B=1)
cull_index = CullIndex(List=divide_curve.Points, Indices=subtraction, Wrap=False)
cull_index_2 = CullIndex(List=cull_index, Indices=0, Wrap=True)
point = Point(flatten(cull_index_2))
jitter = Jitter(List=point, Jitter=1, Seed=2)  # -> Values, Indices
point_2 = ClusterOutput(point)
list_length_2 = ListLength(List=jitter.Values)
multiplication = Multiplication(A=list_length_2, B=0.3)
round_2 = Round(Number=multiplication)  # -> Nearest, Floor, Ceiling
subtraction_2 = Subtraction(A=list_length_2, B=round_2.Floor)
subtraction_3 = Subtraction(A=subtraction_2, B=round_2.Floor)
entwine = Entwine(Branch00=round_2.Floor, Branch01=round_2.Floor, Branch02=subtraction_3, FlattenInputs=True)  # -> flatten(Result)
result = ClusterOutput(entwine)

# ==== cluster Cluster
A = ClusterInput()
B = ClusterInput()
A_2 = ClusterInput()
B_2 = ClusterInput()
subtraction = Subtraction(A=A, B=B)
subtraction_2 = Subtraction(A=A_2, B=B_2)
division = Division(A=subtraction, B=subtraction_2)
addition = Addition(A=division, B=1)
A_3 = ClusterInput()
division_2 = Division(A=A_3, B=addition)
multiplication = Multiplication(A=division_2, B=division)
result = ClusterOutput(division_2)
result_2 = ClusterOutput(multiplication)

# ==== cluster Cluster_2
A = ClusterInput()
B = ClusterInput()
division = Division(A=A, B=B)
integer = Integer(division)
integer_2 = ClusterOutput(integer)

# ==== cluster Cluster_3
domain_start = ClusterInput()
domain_end = ClusterInput()
construct_domain = ConstructDomain(DomainStart=domain_start, DomainEnd=domain_end)
steps = ClusterInput()
range = Range(Domain=construct_domain, Steps=steps)
range_2 = ClusterOutput(range)

# ==== cluster Cluster_5
box = ClusterInput()
box_2 = Box(box)
cluster = Cluster_4(box=box_2)  # -> x_component, y_component, x_component_2, y_component_2
x_component = ClusterOutput(cluster.x_component)
y_component = ClusterOutput(cluster.y_component)
x_component_2 = ClusterOutput(cluster.x_component_2)
y_component_2 = ClusterOutput(cluster.y_component_2)

# ==== cluster Cluster_8
curve = ClusterInput()
curve_2 = ClusterInput()

explode = Explode(Curve=curve, Recursive=True)  # -> Segments, Vertices
explode_2 = Explode(Curve=curve_2, Recursive=True)  # -> Segments, Vertices
length = Length(Curve=explode.Segments)
min_max = MinMax(Number=length)  # -> Minimum, Maximum
nurbs_curve = NurbsCurve(Vertices=explode_2.Vertices, Degree=3, Periodic=False)  # -> Curve, Length, Domain
member_index = MemberIndex(Set=length, Member=min_max.Minimum)  # -> Index, Count
member_index_2 = MemberIndex(Set=length, Member=min_max.Maximum)  # -> Index, Count
list_item = ListItem(List=explode.Segments, Index=member_index.Index, Wrap=True)
list_item_2 = ListItem(List=explode.Segments, Index=member_index_2.Index, Wrap=True)
list_item_3 = ListItem(List=list_item_2, Index=1, Wrap=True)
list_item_4 = ListItem(List=list_item, Index=1, Wrap=True)

relay = ClusterInput()
evaluate_length = EvaluateLength(Curve=reparameterize(list_item_3), Length=relay, Normalized=True)  # -> Point, Tangent, Parameter
unit_x = UnitX(Factor=1)
line_sdl = LineSDL(Start=evaluate_length.Point, Direction=unit_x, Length=min_max.Minimum)
end_points = EndPoints(Curve=list_item_4)  # -> Start, End
unit_y = UnitY(Factor=1)
curve_curve = CurveCurve(CurveA=nurbs_curve.Curve, CurveB=line_sdl)  # -> Points, ParamsA, ParamsB
deconstruct = Deconstruct(Point=end_points.Start)  # -> XComponent, YComponent, ZComponent
deconstruct_2 = Deconstruct(Point=end_points.End)  # -> XComponent, YComponent, ZComponent
line_sdl_2 = LineSDL(Start=curve_curve.Points, Direction=unit_y, Length=min_max.Maximum)
construct_domain = ConstructDomain(DomainStart=deconstruct.XComponent, DomainEnd=deconstruct_2.XComponent)
curve_curve_2 = CurveCurve(CurveA=list_item_4, CurveB=line_sdl_2)  # -> flatten(Points), flatten(ParamsA), flatten(ParamsB)
deconstruct_3 = Deconstruct(Point=curve_curve_2.Points)  # -> XComponent, YComponent, ZComponent
remap_numbers = RemapNumbers(Value=deconstruct_3.XComponent, Source=construct_domain, Target=Domain(0, 1))  # -> Mapped, Clipped
mapped = ClusterOutput(remap_numbers.Mapped)

# ==== cluster Cluster_12
data_path = ClusterInput()
data_path_2 = DataPath(data_path)
tree = ClusterInput()
data_path_3 = ClusterOutput(data_path_2)
tree_branch = TreeBranch(Tree=tree, Path=data_path_2, MaintainPaths=True)  # -> flatten(Branch)
geometry = ClusterInput()
geometry_2 = Geometry(geometry)
brep_edges = BrepEdges(Brep=tree_branch)  # -> Naked, Interior, NonManifold
length = Length(Curve=brep_edges.Interior)
min_max = MinMax(Number=length)  # -> Minimum, Maximum
member_index = MemberIndex(Set=simplify(length), Member=simplify(min_max.Maximum))  # -> Index, Count
center = Center(Geometric=tree_branch)  # -> Center, Dimension
list_item = ListItem(List=member_index.Index, Index=0, Wrap=True)
center_2 = Center(Geometric=geometry_2)  # -> Center, Dimension
list_item_2 = ListItem(List=brep_edges.Interior, Index=list_item, Wrap=True)
deconstruct = Deconstruct(Point=center.Center)  # -> XComponent, YComponent, ZComponent
construct_point = ConstructPoint(XCoordinate=deconstruct.XComponent, YCoordinate=deconstruct.YComponent, ZCoordinate=0)
construct_point_2 = ConstructPoint(XCoordinate=deconstruct.XComponent, YCoordinate=deconstruct.YComponent, ZCoordinate=2)
deconstruct_2 = Deconstruct(Point=center_2.Center)  # -> XComponent, YComponent, ZComponent
line = Line(StartPoint=construct_point, EndPoint=construct_point_2)
unit_y = UnitY(Factor=1)
subtraction = Subtraction(A=deconstruct_2.XComponent, B=deconstruct.XComponent)
subtraction_2 = Subtraction(A=deconstruct_2.YComponent, B=deconstruct.YComponent)
subtraction_3 = Subtraction(A=deconstruct_2.ZComponent, B=deconstruct.ZComponent)
reverse = Reverse(Vector=unit_y)
vector_xyz = VectorXYZ(XComponent=subtraction, YComponent=subtraction_2, ZComponent=subtraction_3)  # -> Vector, Length
reverse_2 = Reverse(Vector=vector_xyz.Vector)
move = Move(Geometry=geometry_2, Motion=reverse_2)  # -> Geometry, Transform
line_2 = Line(StartPoint=center_2.Center, EndPoint=center.Center)
cross_product = CrossProduct(VectorA=unit_y, VectorB=list_item_2, Unitize=False)  # -> Vector, Length
cross_product_2 = CrossProduct(VectorA=reverse, VectorB=list_item_2, Unitize=False)  # -> Vector, Length
line_sdl = LineSDL(Start=center.Center, Direction=unit_y, Length=20)  # -> graft(Line)
line_sdl_2 = LineSDL(Start=center.Center, Direction=reverse, Length=20)  # -> graft(Line)
angle = Angle(VectorA=unit_y, VectorB=list_item_2)  # -> flatten(Angle), Reflex
angle_2 = Angle(VectorA=reverse, VectorB=list_item_2)  # -> flatten(Angle), Reflex
subtraction_4 = Subtraction(A=3.141592654, B=angle_2.Angle)
minimum = Minimum(A=subtraction_4, B=angle_2.Angle)
vector_length = VectorLength(Vector=cross_product.Vector)  # -> flatten(Length)
vector_length_2 = VectorLength(Vector=cross_product_2.Vector)  # -> flatten(Length)
end_points = EndPoints(Curve=line_sdl)  # -> Start, End
end_points_2 = EndPoints(Curve=line_sdl_2)  # -> Start, End
line_sdl_3 = LineSDL(Start=end_points.End, Direction=list_item_2, Length=20)
line_sdl_4 = LineSDL(Start=end_points_2.End, Direction=list_item_2, Length=20)
subtraction_5 = Subtraction(A=0, B=angle.Angle)
subtraction_6 = Subtraction(A=0, B=angle_2.Angle)
line_sdl_5 = LineSDL(Start=center.Center, Direction=unit_y, Length=20)
end_points_3 = EndPoints(Curve=line_sdl_3)  # -> Start, End
end_points_4 = EndPoints(Curve=line_sdl_4)  # -> Start, End
rotate_axis = RotateAxis(Geometry=move.Geometry, Angle=subtraction_6, Axis=line)  # -> Geometry, Transform
rotate_axis_2 = RotateAxis(Geometry=move.Geometry, Angle=subtraction_5, Axis=line)  # -> Geometry, Transform
rotate_axis_3 = RotateAxis(Geometry=line_sdl_5, Angle=subtraction_5, Axis=line)  # -> Geometry, Transform
deconstruct_3 = Deconstruct(Point=end_points_3.Start)  # -> XComponent, YComponent, ZComponent
deconstruct_4 = Deconstruct(Point=end_points_3.End)  # -> XComponent, YComponent, ZComponent
deconstruct_5 = Deconstruct(Point=end_points_4.Start)  # -> XComponent, YComponent, ZComponent
deconstruct_6 = Deconstruct(Point=end_points_4.End)  # -> XComponent, YComponent, ZComponent
subtraction_7 = Subtraction(A=deconstruct_3.XComponent, B=deconstruct_4.XComponent)
subtraction_8 = Subtraction(A=deconstruct_6.XComponent, B=deconstruct_5.XComponent)
larger_than = LargerThan(FirstNumber=subtraction_7, SecondNumber=0)  # -> flatten(LargerThan), OrEqualTo
larger_than_2 = LargerThan(FirstNumber=subtraction_8, SecondNumber=0)  # -> flatten(LargerThan), OrEqualTo
cull_pattern = CullPattern(List=rotate_axis.Geometry, CullPattern=larger_than.LargerThan)
cull_pattern_2 = CullPattern(List=rotate_axis_2.Geometry, CullPattern=larger_than_2.LargerThan)
list = ClusterOutput([cull_pattern, cull_pattern_2])

# ==== cluster Cluster_4
box = ClusterInput()
box_corners = BoxCorners(Box=box)  # -> CornerA, CornerB, CornerC, CornerD, CornerE, CornerF, CornerG, CornerH
deconstruct = Deconstruct(Point=box_corners.CornerA)  # -> XComponent, YComponent, ZComponent
deconstruct_2 = Deconstruct(Point=box_corners.CornerG)  # -> XComponent, YComponent, ZComponent
x_component = ClusterOutput(deconstruct.XComponent)
y_component = ClusterOutput(deconstruct.YComponent)
x_component_2 = ClusterOutput(deconstruct_2.XComponent)
y_component_2 = ClusterOutput(deconstruct_2.YComponent)
