# Grasshopper definition perforation_random_blocks.gh (Grasshopper 1.0.7)
# plug-ins: Heteroptera, Pufferfish

# ---- group: 0 · ВХОД: поверхность панели (Reparameterize → u,v 0…1)
geo = Geometry(<brep referenced from the Rhino model>)
reparamsrf = ReparameterizeSurface(Surface=geo)  # -> Reparameterized, Original
panel = Panel(reparamsrf.Original)
geo_2 = Geometry(<brep referenced from the Rhino model>)

# ---- group: ПРЕВЬЮ: сетка u,v на поверхности (на результат не влияет)
range = Range(Domain=Domain(0, 1), Steps=3)
range_2 = Range(Domain=Domain(0, 1), Steps=3)
pt = ConstructPoint(XCoordinate=range_2, YCoordinate=graft(range), ZCoordinate=0)
crvsrf = CurveOnSurface(Surface=reparamsrf.Reparameterized, UVCoordinates=pt, Closed=False)  # -> Curve, Length, Domain
geo_3 = Geometry(crvsrf.Curve)
pipe = Pipe(Curve=geo_3, Radius=0.04, Caps=0)
preview = CustomPreview(Geometry=pipe, Material=ColourSwatch(SwatchColor=RGB(107, 107, 107)))

# ---- group: 1 · КРУПНЫЕ ОТВЕРСТИЯ — световые фонари (кандидаты, отступ от краёв, радиус)
фонари_отступ_по_u = Slider(0.044, range=0..1)
фонари_отступ_по_v_низ = Slider(0.074, range=0..1)
фонари_отступ_по_v_верх = Slider(0.542, range=0..1)
фонари_кандидатов = Slider(14, range=0..30)
popgeo = PopulateGeometry(Geometry=reparamsrf.Reparameterized, Count=фонари_кандидатов, Seed=1)
cluster = Cluster_2(
    P=popgeo,
    A_2=фонари_отступ_по_u,
    S=reparamsrf.Reparameterized,
    B=фонари_отступ_по_u,
    A=фонари_отступ_по_v_низ,
    B_2=фонари_отступ_по_v_верх)
srf_cp = SurfaceClosestPoint(Point=popgeo, Surface=reparamsrf.Reparameterized)  # -> Point, UVPoint, Distance
cull = CullPattern(List=srf_cp.UVPoint, CullPattern=cluster)
cull_2 = CullPattern(List=popgeo, CullPattern=cluster)
cull_3 = CullPattern(List=srf_cp.Point, CullPattern=cluster)
фонари_радиус = Slider(0.159, range=0..1)
evalsrf = EvaluateSurface(Surface=reparamsrf.Reparameterized, Point=cull)  # -> Point, Normal, UDirection, VDirection, Frame
circle = CircleCNR(Center=evalsrf.Point, Normal=evalsrf.Normal, Radius=фонари_радиус)
cluster_2 = Cluster(R=фонари_радиус, relay=evalsrf.Point, relay_2=evalsrf.Normal)
geo_4 = Geometry(cluster_2)

# ---- group: НЕ ИСПОЛЬЗУЕТСЯ (случайные точки, Jitter, MD Slider)
md_slider = MDSlider(
    SliderMode=0,
    slider_value=Point(0.9369441707, 0.2439919448, 0.5),
    x_domain=Domain(0, 1),
    y_domain=Domain(0, 1),
    z_domain=Domain(0, 1))
rnd = Random(Number=10)
rnd_2 = Random(Number=10)
pt_2 = ConstructPoint(XCoordinate=rnd, YCoordinate=rnd_2, ZCoordinate=0)
evalsrf_2 = EvaluateSurface(Surface=reparameterize(reparamsrf.Reparameterized), Point=pt_2)  # -> Point, Normal, UDirection, VDirection, Frame
evalsrf_3 = EvaluateSurface(Point=md_slider)  # -> Point, Normal, UDirection, VDirection, Frame
popgeo_2 = PopulateGeometry(Geometry=reparamsrf.Reparameterized, Count=100, Seed=1)
srf_cp_2 = SurfaceClosestPoint(Point=popgeo_2, Surface=reparamsrf.Reparameterized)  # -> Point, UVPoint, Distance
jitter = Jitter(List=srf_cp_2.UVPoint, Jitter=1, Seed=2)  # -> Values, Indices
series = Series(Start=0, Step=5, Count=5)
item = ListItem(List=jitter.Values, Index=series, Wrap=True)
cull_i = CullIndex(List=jitter.Values, Indices=series, Wrap=True)

# ---- group: 2 · МЕЛКИЕ ОТВЕРСТИЯ: точки + отступ от краёв панели
отверстия_отступ_по_u = Slider(0.022, range=0..1)
отверстия_отступ_по_v = Slider(0.104, range=0..1)
subtraction = Subtraction(A=1, B=отверстия_отступ_по_u)
subtraction_2 = Subtraction(A=1, B=отверстия_отступ_по_v)
dom = ConstructDomain(DomainStart=отверстия_отступ_по_v, DomainEnd=subtraction_2)
dom_2 = ConstructDomain(DomainStart=отверстия_отступ_по_u, DomainEnd=subtraction)
planesrf = PlaneSurface(Plane=PlaneXY(0, 0, 0), XSize=dom_2, YSize=dom)
отверстия_кандидатов = Slider(257, range=0..260)
popgeo_3 = PopulateGeometry(Geometry=reparamsrf.Reparameterized, Count=отверстия_кандидатов, Seed=1, Points=cull_3)
srf_cp_3 = SurfaceClosestPoint(Point=popgeo_3, Surface=reparamsrf.Reparameterized)  # -> Point, UVPoint, Distance
pt_3 = Point(srf_cp_3.UVPoint)
incurve = PointInCurve(Point=pt_3, Curve=planesrf)  # -> Relationship, Point
srf_cp_4 = SurfaceClosestPoint(Point=popgeo_3, Surface=reparamsrf.Reparameterized)  # -> Point, UVPoint, Distance
cull_4 = CullPattern(List=srf_cp_4.UVPoint, CullPattern=incurve.Relationship)
geo_5 = Geometry(cull_4)

# ---- group: 3 · РАДИУС МЕЛКИХ = f(расстояние до фонаря) · Graph Mapper · отсев малых
evalsrf_4 = EvaluateSurface(Surface=reparameterize(reparamsrf.Reparameterized), Point=geo_5)  # -> Point, Normal, UDirection, VDirection, Frame
отверстия_макс_радиус = Slider(0.204, range=0..1)
cps = ClosestPoints(Point=evalsrf_4.Point, Cloud=cull_2, Count=1)  # -> ClosestPoint, CPIndex, Distance
ln = Line(StartPoint=flatten(evalsrf_4.Point), EndPoint=flatten(cps.ClosestPoint))
отверстия_мин_радиус_отсев = Slider(0.014, range=0..0.1)
len = Length(Curve=flatten(ln))
extremums = MinMax(Number=len)  # -> Minimum, Maximum
dom_3 = ConstructDomain(DomainStart=extremums.Minimum, DomainEnd=extremums.Maximum)
remap = RemapNumbers(Value=len, Source=dom_3, Target=Domain(0, 1))  # -> Mapped, Clipped
graph = GraphMapper(
    remap.Mapped,
    x0=0,
    x1=1,
    y0=0,
    y1=1,
    container_name="Bezier",
    cpx=[0, 0.4542483985, 0.7590862513, 1],
    cpy=[0, 0.7453199625, 1, 1])
subtraction_3 = Subtraction(A=1, B=graph)
multiplication = Multiplication(A=отверстия_макс_радиус, B=subtraction_3)
cluster_3 = Cluster(R=multiplication, relay=evalsrf_4.Point, relay_2=evalsrf_4.Normal)
larger = LargerThan(FirstNumber=multiplication, SecondNumber=отверстия_мин_радиус_отсев)  # -> LargerThan, OrEqualTo
cull_5 = CullPattern(List=flatten(cluster_3), CullPattern=larger.LargerThan)

# ---- group: 4 · ВЫРЕЗКА: Brep|Brep → Surface Split → панель с отверстиями
brep = Brep(reparamsrf.Reparameterized)
relay = Relay([cull_5, geo_4])
bbx = BrepBrep(BrepA=brep, BrepB=flatten(relay))  # -> flatten(Curves), Points
srfsplit = SurfaceSplit(Surface=reparamsrf.Reparameterized, Curves=bbx.Curves)
area = Area(Geometry=srfsplit)  # -> Area, Centroid
sort = SortList(Keys=area.Area, ValuesA=srfsplit)  # -> Keys, ValuesA
item_2 = ListItem(List=sort.ValuesA, Index=-1, Wrap=True)
preview_2 = CustomPreview(
    Geometry=item_2,
    Material={diffuse=RGB(221, 160, 221), emission=RGB(66, 48, 66), shine=0.5, specular=RGB(255, 255, 255), transparency=0})

# ==== cluster Cluster
relay = ClusterInput()
relay_2 = ClusterInput()
line = LineSDL(Start=relay, Direction=relay_2, Length=1)
end = EndPoints(Curve=line)  # -> Start, End
R = ClusterInput()
circle = CircleCNR(Center=relay, Normal=relay_2, Radius=R)
vec2pt = Vector2Pt(PointA=end.Start, PointB=end.End, Unitize=False)  # -> Vector, Length
unit = UnitVector(Vector=relay_2)
geo = Geometry(graft(circle))
move = Move(Geometry=circle, Motion=vec2pt.Vector)  # -> Geometry, Transform
ins = InsertItems(List=geo, Item=graft(move.Geometry), Indices=0, Wrap=True)
boundary = BoundarySurfaces(Edges=ins)
amp = Amplitude(Vector=vec2pt.Vector, Amplitude=-0.5)
loft = Loft(Curves=boundary, Options={Adjust=False, Closed=False, LoftEnds=0, LoftSimp=0, LoftType=0, Rebuild=10, Refit=0.01})
move_2 = Move(Geometry=loft, Motion=graft(amp))  # -> Geometry, Transform
G = ClusterOutput(move_2.Geometry)

# ==== cluster Cluster_2
B = ClusterInput()
B_2 = ClusterInput()
A = ClusterInput()
subtraction = Subtraction(A=1, B=B)
subtraction_2 = Subtraction(A=1, B=B_2)
A_2 = ClusterInput()
dom = ConstructDomain(DomainStart=A, DomainEnd=subtraction_2)
dom_2 = ConstructDomain(DomainStart=A_2, DomainEnd=subtraction)
planesrf = PlaneSurface(Plane=PlaneXY(0, 0, 0), XSize=dom_2, YSize=dom)
P = ClusterInput()
S = ClusterInput()
srf_cp = SurfaceClosestPoint(Point=P, Surface=S)  # -> Point, UVPoint, Distance
pt = Point(srf_cp.UVPoint)
incurve = PointInCurve(Point=pt, Curve=planesrf)  # -> Relationship, Point
R = ClusterOutput(incurve.Relationship)
