# Grasshopper definition theatre_hall_blocks.gh (Grasshopper 1.0.7)
# plug-ins: Pufferfish, Sasquatch, BubalusGH2.0, Heteroptera

# ---- group: 1 · РЁБРА ПОТОЛКА: 2 опорные дуги > Tween ×5 (+1) > проекция на SubD потолка · 6 ползунков
подъём_копии_рёбер_м = Slider(10.001, range=-20..10.001)
ребро_1_фактор = Slider(0, range=0..1)
ребро_2_фактор = Slider(0.183, range=-0.001..1)
ребро_3_фактор = Slider(0.404, range=-0.001..1)
ребро_4_фактор = Slider(0.684, range=-0.001..1)
ребро_5_фактор = Slider(1, range=0..1)
ребро_6_за_дугой_фактор = Slider(1.344, range=-0.001..2)
geometry = Geometry(<brep referenced from the Rhino model>)
geometry_2 = Geometry(<brep referenced from the Rhino model>)
unit_z = UnitZ(Factor=подъём_копии_рёбер_м)
geometry_3 = Geometry([<curve referenced from the Rhino model> x2])
merge = Merge(Data1=ребро_1_фактор, Data2=ребро_2_фактор, Data3=ребро_3_фактор, Data4=ребро_4_фактор, Data5=ребро_5_фактор)
tween_through_curves = TweenThroughCurves(
    Curves=geometry_3,
    Factor=merge,
    Normalized=True,
    Equalized=False,
    Loopback=False,
    InterpolationType=0,
    Refit=0,
    PointSample=0)
tween_consecutive_curves = TweenConsecutiveCurves(Curves=geometry_3, Factor=ребро_6_за_дугой_фактор, Loopback=False, InterpolationType=0, Refit=0, PointSample=0)
relay = Relay([tween_through_curves, tween_consecutive_curves])
project = Project(Curve=relay, Brep=geometry, Direction=Vector(0, 0, 1))
project_2 = Project(Geometry=[tween_consecutive_curves, tween_through_curves], Plane=geometry_2)  # -> Geometry, Transform
move = Move(Geometry=project, Motion=unit_z)  # -> Geometry, Transform

# ---- group: 6 · ОБЪЁМЫ В ЗАЛЕ: балкон, галереи, порталы (Sweep / Extrude по кривым Rhino)
geometry_4 = Geometry(<curve referenced from the Rhino model>)
geometry_5 = Geometry(<curve referenced from the Rhino model>)
geometry_6 = Geometry(<curve referenced from the Rhino model>)
geometry_7 = Geometry(<curve referenced from the Rhino model>)
geometry_8 = Geometry(<curve referenced from the Rhino model>)
geometry_9 = Geometry(<curve referenced from the Rhino model>)
geometry_10 = Geometry(<curve referenced from the Rhino model>)
geometry_11 = Geometry(<brep referenced from the Rhino model>)
geometry_12 = Geometry(<curve referenced from the Rhino model>)
geometry_13 = Geometry(<brep referenced from the Rhino model>)
geometry_14 = Geometry(<curve referenced from the Rhino model>)
geometry_15 = Geometry(<brep referenced from the Rhino model>)
geometry_16 = Geometry(<curve referenced from the Rhino model>)
geometry_17 = Geometry(<curve referenced from the Rhino model>)
geometry_18 = Geometry(<brep referenced from the Rhino model>)
geometry_19 = Geometry(<curve referenced from the Rhino model>)
geometry_20 = Geometry(<brep referenced from the Rhino model>)
geometry_21 = Geometry(<brep referenced from the Rhino model>)
geometry_22 = Geometry([<brep referenced from the Rhino model> x2])
geometry_23 = Geometry([<brep referenced from the Rhino model> x2])
geometry_24 = Geometry([<brep referenced from the Rhino model> x2])
geometry_25 = Geometry(<brep referenced from the Rhino model>)
geometry_26 = Geometry(<brep referenced from the Rhino model>)
cap_holes = CapHoles(Brep=geometry_13)
cap_holes_2 = CapHoles(Brep=geometry_21)
flip_curve = FlipCurve(Curve=geometry_8)  # -> Curve, Flag
flip_curve_2 = FlipCurve(Curve=geometry_12)  # -> Curve, Flag
flip_curve_3 = FlipCurve(Curve=geometry_6)  # -> Curve, Flag
geometry_27 = Geometry(<brep referenced from the Rhino model>)
flip_curve_4 = FlipCurve(Curve=geometry_9)  # -> Curve, Flag
flip_curve_5 = FlipCurve(Curve=geometry_7)  # -> Curve, Flag
geometry_28 = Geometry(<brep referenced from the Rhino model>)
sweep1 = Sweep1(Rail=geometry_17, Sections=geometry_18, Miter=1)
brep_edges = BrepEdges(Brep=geometry_20)  # -> Naked, Interior, NonManifold
flip_curve_6 = FlipCurve(Curve=geometry_4)  # -> Curve, Flag
flip_curve_7 = FlipCurve(Curve=geometry_5)  # -> Curve, Flag
sweep1_2 = Sweep1(Rail=geometry_10, Sections=geometry_11, Miter=1)
sweep1_3 = Sweep1(Rail=geometry_16, Sections=geometry_24, Miter=1)
sweep1_4 = Sweep1(Rail=geometry_14, Sections=geometry_15, Miter=1)
sweep1_5 = Sweep1(Rail=geometry_12, Sections=geometry_25, Miter=1)
solid_intersection = SolidIntersection(BrepsA=cap_holes, BrepsB=geometry_28)
sweep2 = Sweep2(Rail1=geometry_8, Rail2=flip_curve_4.Curve, Sections=geometry_23, SameHeight=True)
sweep2_2 = Sweep2(Rail1=geometry_6, Rail2=geometry_7, Sections=geometry_22, SameHeight=True)
cap_holes_3 = CapHoles(Brep=sweep1_2)
sweep2_3 = Sweep2(Rail1=geometry_4, Rail2=geometry_5, Sections=geometry_27, SameHeight=True)
sweep2_4 = Sweep2(Rail1=geometry_4, Rail2=geometry_5, Sections=geometry_26, SameHeight=True)
offset_curve = OffsetCurve(Curve=geometry_19, Plane=PlaneXY(0, 0, 0), Distance=-1, BothSides=0, Kinks=0, CapType=1)
geometry_29 = Geometry([<curve referenced from the Rhino model> x2])
join_curves = JoinCurves(Curves=geometry_29, Preserve=False)
cap_holes_4 = CapHoles(Brep=sweep2_4)
geometry_30 = Geometry([<curve referenced from the Rhino model> x3])
offset_curve_2 = OffsetCurve(Curve=join_curves, Plane=PlaneXY(0, 0, 0), Distance=-1, BothSides=0, Kinks=0, CapType=1)  # -> flatten(Offset)
boundary_surfaces = BoundarySurfaces(Edges=flatten(offset_curve_2))
boundary_surfaces_2 = BoundarySurfaces(Edges=geometry_30)
geometry_31 = Geometry(<brep referenced from the Rhino model>)
geometry_32 = Geometry([<curve referenced from the Rhino model> x5])
unit_z_2 = UnitZ(Factor=7.9)
unit_z_3 = UnitZ(Factor=5.9)
extrude = Extrude(Base=boundary_surfaces, Direction=unit_z_3)
extrude_2 = Extrude(Base=boundary_surfaces, Direction=unit_z_2)
boundary_surfaces_3 = BoundarySurfaces(Edges=geometry_30)
extrude_3 = Extrude(Base=boundary_surfaces_3, Direction=unit_z_2)
project_3 = Project(Geometry=flatten([geometry_32, boundary_surfaces, geometry_31]), Plane=PlaneXY(0, 0, 0))  # -> Geometry, Transform

# ---- group: 8 · ВНЕ ЗАЛА: навес / фойе (Loft с ошибкой)
geometry_33 = Geometry([<curve referenced from the Rhino model> x2])
geometry_34 = Geometry([<curve referenced from the Rhino model> x3])
project_4 = Project(Geometry=geometry_33, Plane=PlaneXY(0, 0, 0))  # -> Geometry, Transform
project_5 = Project(Geometry=geometry_34, Plane=PlaneXY(0, 0, 0))  # -> Geometry, Transform
geometry_35 = Geometry([<curve referenced from the Rhino model> x3])
offset_curve_3 = OffsetCurve(Curve=project_5.Geometry, Plane=PlaneXY(0, 0, 0), Distance=0.5, BothSides=-0.5, Kinks=0, CapType=1)
project_6 = Project(Geometry=geometry_35, Plane=PlaneXY(0, 0, 0))  # -> Geometry, Transform
panel = Panel("""0.01
3.5
7.5""")
offset_curve_4 = OffsetCurve(Curve=project_4.Geometry, Plane=PlaneXY(0, 0, 0), Distance=1, BothSides=0, Kinks=0, CapType=1)
join_curves_2 = JoinCurves(Curves=project_6.Geometry, Preserve=False)
boundary_surfaces_4 = BoundarySurfaces(Edges=offset_curve_3)
unit_z_4 = UnitZ(Factor=panel)
boundary_surfaces_5 = BoundarySurfaces(Edges=offset_curve_4)
list_item = ListItem(List=join_curves_2, Index=0, Wrap=True)
offset_curve_5 = OffsetCurve(Curve=join_curves_2, Plane=PlaneXY(0, 0, 0), Distance=-1, BothSides=0, Kinks=0, CapType=1)
surface_curve = SurfaceCurve(Surface=boundary_surfaces_4, Curve=project_4.Geometry)  # -> Curves, Points, UVPoints, Normals, Parameters, Tangents
extrude_4 = Extrude(Base=boundary_surfaces_5, Direction=graft(unit_z_4))
curve_curve = CurveCurve(CurveA=simplify(graft(project_5.Geometry)), CurveB=project_4.Geometry)  # -> Points, ParamsA, ParamsB
null = Null(Count=1)
null_2 = Null(Count=1)
insert_items = InsertItems(List=curve_curve.Points, Item=null, Indices=1, Wrap=False)
insert_items_2 = InsertItems(List=surface_curve.Curves, Item=null_2, Indices=1, Wrap=False)
list_item_2 = ListItem(List=insert_items, Index=0, Wrap=True)
trim_tree = TrimTree(Tree=list_item_2, Depth=1)
trim_tree_2 = TrimTree(Tree=trim_tree, Depth=1)
list_item_3 = ListItem(List=insert_items_2, Index=0, Wrap=True)
trim_tree_3 = TrimTree(Tree=list_item_3, Depth=1)
trim_tree_4 = TrimTree(Tree=trim_tree_3, Depth=1)
trim_tree_5 = TrimTree(Tree=trim_tree_3, Depth=1)
unflatten_tree = UnflattenTree(Guide=trim_tree_4)
explode_tree = ExplodeTree(Data=trim_tree_2)  # -> Branch0, Branch1, Branch2
simplify_tree = SimplifyTree(Tree=trim_tree_5, Front=True)
extrude_5 = Extrude(Base=simplify_tree, Direction=unit_z_4)
line_sdl = LineSDL(Start=trim_tree_2, Direction=unit_z_4, Length=panel)
curve = Curve(extrude_5)
clean_tree = CleanTree(RemoveNulls=True, RemoveInvalid=True, RemoveEmpty=False, Tree=extrude_5)
explode_tree_2 = ExplodeTree(Data=unflatten_tree)  # -> Branch0, Branch1, Branch2
geometry_36 = Geometry(explode_tree_2.Branch1)
loft = Loft(Curves=clean_tree, Options={Adjust=True, Closed=False, LoftEnds=0, LoftSimp=0, LoftType=3, Rebuild=10, Refit=0.01})
custom_preview = CustomPreview(Geometry=[extrude_4, loft, offset_curve_5], Material=ColourSwatch(SwatchColor=RGB(133, 133, 133)))

# ---- group: 2 · СТЕНЫ, ПОЛ, ПРОХОДЫ · кривые Rhino (Join > Offset > Boundary > Extrude)
geometry_37 = Geometry([<curve referenced from the Rhino model> x3])
geometry_38 = Geometry([<curve referenced from the Rhino model> x8])
join_curves_3 = JoinCurves(Curves=geometry_38, Preserve=False)
offset_curve_6 = OffsetCurve(Curve=geometry_37, Plane=PlaneXY(0, 0, 0), Distance=0.5, BothSides=-0.5, Kinks=0, CapType=1)
offset_curve_7 = OffsetCurve(Curve=join_curves_3, Plane=PlaneXY(0, 0, 0), Distance=0.5, BothSides=0, Kinks=0, CapType=1)
offset_curve_8 = OffsetCurve(Curve=join_curves_3, Plane=PlaneXY(0, 0, 0), Distance=-1, BothSides=0, Kinks=0, CapType=1)
boundary_surfaces_6 = BoundarySurfaces(Edges=offset_curve_6)
unit_z_5 = UnitZ(Factor=8)
boundary_surfaces_7 = BoundarySurfaces(Edges=flatten(offset_curve_7))
boundary_surfaces_8 = BoundarySurfaces(Edges=flatten([offset_curve_8, join_curves_3]))
boundary_surfaces_9 = BoundarySurfaces(Edges=flatten([offset_curve_7, join_curves_3]))
unit_z_6 = UnitZ(Factor=12)
extrude_6 = Extrude(Base=boundary_surfaces_6, Direction=unit_z_5)
geometry_39 = Geometry(boundary_surfaces_7)
guid = Guid(geometry_39)
extrude_7 = Extrude(Base=boundary_surfaces_8, Direction=unit_z_5)
extrude_8 = Extrude(Base=boundary_surfaces_9, Direction=unit_z_6)
select_guid = SelectGuid(Guids=guid)

# ---- group: 7 · НАД ПОТОЛКОМ И КРОВЛЯ
geometry_40 = Geometry(<curve referenced from the Rhino model>)
geometry_41 = Geometry(<curve referenced from the Rhino model>)
unit_x = UnitX(Factor=1)
geometry_42 = Geometry([<curve referenced from the Rhino model> x8])
geometry_43 = Geometry([<curve referenced from the Rhino model> x2, <point referenced from the Rhino model> x4, <curve referenced from the Rhino model>, <point referenced from the Rhino model>, <curve referenced from the Rhino model>])
geometry_44 = Geometry(<curve referenced from the Rhino model>)
geometry_45 = Geometry([<curve referenced from the Rhino model> x4])
geometry_46 = Geometry([<curve referenced from the Rhino model> x6])
geometry_47 = Geometry([<curve referenced from the Rhino model> x8])
geometry_48 = Geometry([<curve referenced from the Rhino model> x7])
join_curves_4 = JoinCurves(Curves=geometry_41, Preserve=False)
explode = Explode(Curve=geometry_43, Recursive=True)  # -> Segments, Vertices
geometry_49 = Geometry(<brep referenced from the Rhino model>)
boundary_surfaces_10 = BoundarySurfaces(Geometry=geometry_47)
flip_curve_8 = FlipCurve(Curve=geometry_40)  # -> Curve, Flag
flip_curve_9 = FlipCurve(Curve=geometry_44)  # -> Curve, Flag
boundary_surfaces_11 = BoundarySurfaces(Edges=geometry_45)
boundary_surfaces_12 = BoundarySurfaces(Edges=geometry_46)
guid_2 = Guid(geometry_42)
project_7 = Project(Geometry=geometry_42, Plane=PlaneXY(0, 0, 0))  # -> Geometry, Transform
project_8 = Project(Curve=geometry_48, Brep=geometry_49, Direction=unit_x)  # -> flatten(Curve)
select_guid_2 = SelectGuid(Guids=guid_2)
sweep2_5 = Sweep2(
    Rail1=flip_curve_8.Curve,
    Rail2=flip_curve_9.Curve,
    Sections=[boundary_surfaces_11, boundary_surfaces_12, boundary_surfaces_10],
    SameHeight=False)
offset_curve_9 = OffsetCurve(Curve=join_curves_4, Plane=PlaneXY(0, 0, 0), Distance=-0.5, BothSides=0.5, Kinks=0, CapType=1)
join_curves_5 = JoinCurves(Curves=project_8, Preserve=False)
boundary_surfaces_13 = BoundarySurfaces(Edges=project_8)
boundary_surfaces_14 = BoundarySurfaces(Edges=offset_curve_9)
unit_z_7 = UnitZ(Factor=8)
extrude_9 = Extrude(Base=boundary_surfaces_14, Direction=unit_z_7)

# ---- group: 3 · РАССАДКА: ПАРТЕР (кластер: ряд − 0,5 м с концов, место 0,56 м)
geometry_50 = Geometry([<curve referenced from the Rhino model> x9])
geometry_51 = Geometry([<curve referenced from the Rhino model> x4])
geometry_52 = Geometry([<curve referenced from the Rhino model> x39])
geometry_53 = Geometry([<curve referenced from the Rhino model> x13])
geometry_54 = Geometry([<curve referenced from the Rhino model> x13])
geometry_55 = Geometry([<curve referenced from the Rhino model> x6])
geometry_56 = Geometry([<curve referenced from the Rhino model> x7])
cluster = Cluster(d1=geometry_52, d2=geometry_53, d3=geometry_54, d4=geometry_50, d5=geometry_55, d6=geometry_56, d7=geometry_51)
custom_preview_2 = CustomPreview(Geometry=cluster, Material=ColourSwatch(SwatchColor=RGB(135, 99, 99)))

# ---- group: ТЕСТЫ: Tween по шагу, линии между кривыми (ссылки частично потеряны)
geometry_57 = Geometry(<curve referenced from the Rhino model>)
geometry_58 = Geometry(<curve referenced from the Rhino model>)
division = Division(A=4, B=0.15)
division_2 = Division(A=2, B=0.15)
geometry_59 = Geometry([<curve referenced from the Rhino model> x2])
geometry_60 = Geometry([<curve referenced from the Rhino model> x2])
round = Round(Number=division)  # -> Nearest, Floor, Ceiling
round_2 = Round(Number=division_2)  # -> Nearest, Floor, Ceiling
range = Range(Domain=Domain(0, 1), Steps=round.Floor)
range_2 = Range(Domain=Domain(0, 1), Steps=round_2.Floor)
length = Length(Curve=geometry_57)
length_2 = Length(Curve=geometry_58)
length_3 = Length(Curve=geometry_57)
length_4 = Length(Curve=geometry_58)
division_3 = Division(A=length, B=0.9)
division_4 = Division(A=length_2, B=0.9)
tween_through_curves_2 = TweenThroughCurves(
    Curves=geometry_60,
    Factor=range_2,
    Normalized=True,
    Equalized=False,
    Loopback=False,
    InterpolationType=0,
    Refit=0,
    PointSample=0)
tween_through_curves_3 = TweenThroughCurves(
    Curves=geometry_59,
    Factor=range,
    Normalized=True,
    Equalized=False,
    Loopback=False,
    InterpolationType=0,
    Refit=0,
    PointSample=0)
round_3 = Round(Number=division_3)  # -> Nearest, Floor, Ceiling
division_5 = Division(A=length_3, B=round_3.Floor)
round_4 = Round(Number=division_4)  # -> Nearest, Floor, Ceiling
division_6 = Division(A=length_4, B=round_4.Floor)
divide_distance = DivideDistance(Curve=geometry_57, Distance=division_5)  # -> Points, Tangents, Parameters
divide_distance_2 = DivideDistance(Curve=geometry_58, Distance=division_6)  # -> Points, Tangents, Parameters
line_sdl_2 = LineSDL(Start=[divide_distance.Points, divide_distance_2.Points], Direction=Vector(0, 0, 1), Length=10)

# ---- group: 4 · РАССАДКА: БАЛКОН (тот же кластер)
geometry_61 = Geometry([<curve referenced from the Rhino model> x4])
geometry_62 = Geometry([<curve referenced from the Rhino model> x6])
geometry_63 = Geometry([<curve referenced from the Rhino model> x14])
cluster_2 = Cluster(d8=geometry_63, d9=geometry_62, d10=geometry_61)
bang = ExplodeTree(Data=cluster_2)  # -> Branch0, Branch1, Branch2, Branch3, Branch4, Branch5, Branch6
custom_preview_3 = CustomPreview(Geometry=cluster_2, Material=ColourSwatch(SwatchColor=RGB(94, 81, 81)))  # disabled

# ---- group: НЕ ПОДКЛЮЧЕНО / ПУСТЫЕ ССЫЛКИ
geometry_64 = Geometry([<curve referenced from the Rhino model> x3])
loft_2 = Loft(Options={Adjust=False, Closed=False, LoftEnds=0, LoftSimp=0, LoftType=0, Rebuild=10, Refit=0.01})
geometry_65 = Geometry([<brep referenced from the Rhino model> x7])
geometry_66 = Geometry(<brep referenced from the Rhino model>)
range_3 = Range(Domain=Domain(0, 1), Steps=4)  # disabled
geometry_67 = Geometry([<curve referenced from the Rhino model> x13])
geometry_68 = Geometry([<brep referenced from the Rhino model> x3])
geometry_69 = Geometry([<curve referenced from the Rhino model> x11])

# ---- group: 5 · КРЕСЛО-ЭТАЛОН (сетка, зеркало)
geometry_70 = Geometry(<mesh referenced from the Rhino model>)
geometry_71 = Geometry([<mesh referenced from the Rhino model>, <brep referenced from the Rhino model>])
geometry_72 = Geometry([<brep referenced from the Rhino model> x2])
deconstruct_brep = DeconstructBrep(Brep=geometry_72)  # -> Faces, Edges, Vertices
brep_join = BrepJoin(Breps=deconstruct_brep.Faces)  # -> flatten(Breps), Closed
center = Center(Geometric=geometry_70)  # -> Center, Dimension
mesh_brep = MeshBrep(
    Brep=brep_join.Breps,
    Settings={GridMaxCount=0, GridMinCount=16, JaggedSeams=False, MaxEdgeLength=0, MinEdgeLength=0.0001, MinTolerance=0, Refine=True, RefineAngle=0, RelativeTolerance=0.65, SimplePlanes=True, Tolerance=0})
yz_plane = YZPlane(Origin=center.Center)
mirror = Mirror(Geometry=geometry_71, Plane=yz_plane)  # -> Geometry, Transform
fast_solid_union = FastSolidUnion(Breps=brep_join.Breps, Tolerance=0.01, strictFastSolidUnion=True, trueIntFastSolidUnion=False)
mesh_union = MeshUnion(Meshes=mesh_brep)
deconstruct_brep_2 = DeconstructBrep(Brep=fast_solid_union)  # -> Faces, Edges, Vertices
brep_join_2 = BrepJoin(Breps=deconstruct_brep_2.Faces)  # -> flatten(Breps), Closed

# ==== cluster Cluster
geometry = Geometry([<curve referenced from the Rhino model> x3])
d1 = ClusterInput()
d2 = ClusterInput()
d3 = ClusterInput()
d4 = ClusterInput()
d5 = ClusterInput()
d6 = ClusterInput()
d7 = ClusterInput()
d8 = ClusterInput()
d9 = ClusterInput()
d10 = ClusterInput()
offset_curve = OffsetCurve(Curve=geometry, Plane=PlaneXY(0, 0, 0), Distance=0.3, BothSides=0, Kinks=0, CapType=1)
merge = Merge(Data1=d1, Data2=d2, Data3=d3, Data4=d4, Data5=d5, Data6=d6, Data7=d7, Data8=d8, Data9=d9, Data10=d10)
guid = Guid(merge)
select_guid = SelectGuid(Guids=guid)
geometry_2 = Geometry([<brep referenced from the Rhino model> x2])
geometry_3 = Geometry([<curve referenced from the Rhino model> x2])
brep_edges = BrepEdges(Brep=geometry_2)  # -> flatten(Naked), Interior, NonManifold
project = Project(Geometry=geometry_3, Plane=PlaneXY(0, 0, 0))  # -> Geometry, Transform
boundary_surfaces = BoundarySurfaces(Edges=flatten(geometry_2))
geometry_4 = Geometry([<mesh referenced from the Rhino model> x4, <brep referenced from the Rhino model>, <mesh referenced from the Rhino model>, <brep referenced from the Rhino model>])
center = Center(Geometric=geometry_4, forall=True)  # -> Center, Dimension
geometry_5 = Geometry([<mesh referenced from the Rhino model> x5, <brep referenced from the Rhino model> x2])
explode = Explode(Curve=merge, Recursive=True)  # -> flatten(Segments), Vertices
yz_plane = YZPlane(Origin=center.Center)
join_curves = JoinCurves(Curves=brep_edges.Naked, Preserve=False)
join_curves_2 = JoinCurves(Curves=project.Geometry, Preserve=False)
join_curves_3 = JoinCurves(Curves=explode.Segments, Preserve=False)  # -> flatten(Curves)
center_2 = Center(Geometric=join_curves_3)  # -> Center, Dimension
rotate = Rotate(Geometry=geometry_4, Angle=-1.570796327, Plane=yz_plane)  # -> Geometry, Transform
xy_plane = XYPlane(Origin=center_2.Center)
join_curves_4 = JoinCurves(Curves=explode.Segments, Preserve=False)  # -> flatten(Curves)
unit_z = UnitZ(Factor="-7.5")
mesh_join = MeshJoin(Meshes=rotate.Geometry)
offset_curve_2 = OffsetCurve(Curve=geometry_2, Distance="-0.3", Corners=1)  # -> flatten(Curve)
boundary_surfaces_2 = BoundarySurfaces(Edges=flatten([join_curves, offset_curve_2]))
boundary_surfaces_3 = BoundarySurfaces(Edges=flatten([join_curves, offset_curve_2]))
project_2 = Project(Geometry=join_curves_3, Plane=xy_plane)  # -> Geometry, Transform
extrude = Extrude(Base=boundary_surfaces_3, Direction=unit_z)
graft = GraftTree(Tree=rotate.Geometry, IncludeEmptyLists=True, IncludeNullItems=True)
offset_curve_3 = OffsetCurve(Curve=project_2.Geometry, Distance="-0.3", Corners=1)  # -> flatten(Curve)
center_3 = Center(Geometric=rotate.Geometry, forall=True)  # -> Center, Dimension
offset_curve_4 = OffsetCurve(Curve=offset_curve_3, Plane=PlaneXY(0, 0, 0), Distance=0.5, BothSides=0, Kinks=0, CapType=0)
flip = FlipMatrix(Data=graft)
construct_point = ConstructPoint(XCoordinate=0, YCoordinate=0, ZCoordinate=0)
length = Length(Curve=offset_curve_3)
point = Point()
point_2 = Point(construct_point)
yz_plane_2 = YZPlane(Origin=center_3.Center)
ghpython_script = GhPythonScript(point=point)  # -> out, a
# ---------- ghpython_script: Python ----------
import rhinoscriptsyntax as rs
import Rhino.Geometry as rg
import math  # Импортируем библиотеку для работы с математическими функциями

# Входные параметры, если применимо, могут быть статичны или принят от пользователя
distance = 10  # Пример расстояние от центральной точки до прямоугольников
pt = rg.Point3d(0,0,0)

# Функция для создания прямоугольника вокруг точки
def create_rect_around_point(pt, dist, width, height):
    # Создаем базовые точки с учетом расстояния и размера прямоугольника
    pts = [
        rg.Point3d(pt.X - width/2, pt.Y + dist + height/2, 0),
        rg.Point3d(pt.X + width/2, pt.Y + dist + height/2, 0),
        rg.Point3d(pt.X + width/2, pt.Y + dist - height/2, 0),
        rg.Point3d(pt.X - width/2, pt.Y + dist - height/2, 0)
    ]
    rect = rg.Polyline(pts + [pts[0]])  # Замыкаем прямоугольник
    return rect

# Генерация прямоугольников
rects = []
for i in range(4):
    angle = math.radians(90 * i)  # Поворот на 90 градусов для каждого прямоугольника, преобразование в радианы
    vector = rg.Vector3d(distance, 0, 0)
    vector.Rotate(angle, rg.Vector3d.ZAxis)  # Поворачиваем вектор для расположения каждого прямоугольника
    rect_pt = rg.Point3d(pt.X + vector.X, pt.Y + vector.Y, pt.Z)  # Создаем новую точку на смещенном расстоянии
    # Создаем прямоугольник с шириной и высотой в 2 раза меньше, чем distance для визуального разделения
    rect = create_rect_around_point(rect_pt, 0, distance/2, distance/2)
    rects.append(rect)  # Добавляем прямоугольник в список

# Установить выходные данные для Grasshopper (предполагается имя выходной переменной 'a')
a = rects
# ---------- end ghpython_script ----------
division = Division(A="0.5", B=length)  # -> graft(Result)
ghpython_script_2 = GhPythonScript(pt=point_2, distance=Slider(45, range=0..100), size=Slider(45, range=0..100))  # -> out, a
# ---------- ghpython_script_2: Python ----------
import Rhino.Geometry as rg
import math

# Эти переменные теперь принимаются как входные данные из Grasshopper
# pt - входная точка, задается в интерфейсе Grasshopper
# distance - расстояние от центра до прямоугольников
# size - размеры сторон прямоугольников

# Функция для создания прямоугольника вокруг точки
def create_rect_around_point(pt, dist, width, height):
    # Создаем прямоугольники с учетом расстояния и размеров
    pts = [
        rg.Point3d(pt.X - width/2, pt.Y + dist + height/2, 0),
        rg.Point3d(pt.X + width/2, pt.Y + dist + height/2, 0),
        rg.Point3d(pt.X + width/2, pt.Y + dist - height/2, 0),
        rg.Point3d(pt.X - width/2, pt.Y + dist - height/2, 0)
    ]
    rect = rg.Polyline(pts + [pts[0]])  # Замыкаем прямоугольник
    return rect

# Генерация прямоугольников
rects = []
for i in range(4):
    angle = math.radians(90 * i)  # Поворот на 90 градусов для каждого прямоугольника
    vector = rg.Vector3d(distance * math.cos(angle), distance * math.sin(angle), 0)
    rect_pt = rg.Point3d(pt.X + vector.X, pt.Y + vector.Y, pt.Z)  # Создаем новую точку смещения
    # Создаем прямоугольник с заданными размерами
    rect = create_rect_around_point(rect_pt, 0, size, size)
    rects.append(rect)  # Добавляем прямоугольник в список

# Выходные данные для Grasshopper
a = rects
# ---------- end ghpython_script_2 ----------
subtraction = Subtraction(A=1, B=division)
ghpython_script_3 = GhPythonScript()  # -> Out, A
geometry_6 = Geometry(ghpython_script.a)
panel = Panel("0.5")
select_guid_2 = SelectGuid(Guids=ghpython_script.out)
merge_2 = Merge(Data1=division, Data2=subtraction)
reparameterize_curve = ReparameterizeCurve(Curve=offset_curve_3)  # -> Reparameterized, Original
shatter = Shatter(Curve=graft(reparameterize_curve.Reparameterized), Parameters=merge_2)
list_item = ListItem(List=shatter, Index=1, Wrap=True)  # -> flatten(Item)
length_2 = Length(Curve=list_item)
division_2 = Division(A=length_2, B=0.56)
unit_z_2 = UnitZ(Factor=1)
round = Round(Number=division_2)  # -> Nearest, Floor, Ceiling
divide_curve = DivideCurve(Curve=list_item, Count=round.Floor, Kinks=False)  # -> Points, Tangents, Parameters
perp_frames = PerpFrames(Curve=list_item, Count=round.Floor, Align=False)  # -> Frames, Parameters
vector_2pt = Vector2Pt(PointA=center_3.Center, PointB=divide_curve.Points, Unitize=False)  # -> Vector, Length
cull_index = CullIndex(List=perp_frames.Frames, Indices=[0, -1], Wrap=True)
cull_index_2 = CullIndex(List=divide_curve.Points, Indices=[0, -1], Wrap=True)
move = Move(Geometry=rotate.Geometry, Motion=vector_2pt.Vector)  # -> Geometry, Transform
geometry_7 = Geometry(<curve referenced from the Rhino model>)
align_plane = AlignPlane(Plane=perp_frames.Frames, Direction=unit_z_2)  # -> Plane, Angle
orient = Orient(Geometry=graft(rotate.Geometry), Source=yz_plane_2, Target=flatten(align_plane.Plane))  # -> Geometry, Transform
unit_z_3 = UnitZ(Factor=0.2)
unit_y = UnitY(Factor=-20)
vector_xyz = VectorXYZ(XComponent=0, YComponent=-20, ZComponent=0.19)  # -> Vector, Length
move_2 = Move(Geometry=orient.Geometry, Motion=vector_xyz.Vector)  # -> Geometry, Transform
geometry_8 = ClusterOutput(move_2.Geometry)
