# Grasshopper definition theatre_perforation_spots.gh (Grasshopper 1.0.8)
# plug-ins: Heteroptera, Pufferfish, Cordyceps

# ---- group: 0 · ВХОД: рёбра потолка (из ТЕАТР) > полосы Loft > полоса № > Reparameterize (u,v 0…1) · старая тест-заготовка отключена
рёбра_из_театр_блок_1 = Curve([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])
полоса = Slider(4, range=0..4)
полосы_из_рёбер = Script(R=рёбра_из_театр_блок_1, i=полоса)  # -> out, S, all; inputs R: list of Curve, i: Int32
# ---------- полосы_из_рёбер: Python ----------
#! python 3
# Полосы потолка: рёбра сортируются от сцены к залу (по Y середины),
# соседние пары соединяются Loft. S — полоса номер i, all — все полосы.
import Rhino.Geometry as rg
ribs = [c for c in R if c is not None and c.GetLength() > 30]
ribs.sort(key=lambda r: -r.PointAtNormalizedLength(0.5).Y)
all = []
for a, b in zip(ribs[:-1], ribs[1:]):
    if (a.PointAtStart - b.PointAtStart).Length > (a.PointAtStart - b.PointAtEnd).Length:
        b = b.DuplicateCurve(); b.Reverse()
    lf = rg.Brep.CreateFromLoft([a, b], rg.Point3d.Unset, rg.Point3d.Unset, rg.LoftType.Normal, False)
    if lf: all.append(lf[0])
S = all[max(0, min(int(i), len(all) - 1))] if all else None
# ---------- end полосы_из_рёбер ----------
geo = Geometry(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)
reparamsrf = ReparameterizeSurface(Surface=полосы_из_рёбер.S)  # -> Reparameterized, Original
panel = Panel(reparamsrf.Original)
geo_2 = Geometry(<brep referenced from the Rhino model>)

# ---- group: ПРЕВЬЮ: сетка u,v на поверхности (на результат не влияет)
range = Range(Domain=Domain(0, 1), Steps=3)
range_2 = Range(Domain=Domain(0, 1), Steps=3)
pt = ConstructPoint(XCoordinate=range_2, YCoordinate=graft(range), ZCoordinate=0)
crvsrf = CurveOnSurface(Surface=reparamsrf.Reparameterized, UVCoordinates=pt, Closed=False)  # -> Curve, Length, Domain
geo_3 = Geometry(crvsrf.Curve)
pipe = Pipe(Curve=geo_3, Radius=0.04, Caps=0)
preview = CustomPreview(Geometry=pipe, Material=ColourSwatch(SwatchColor=RGB(107, 107, 107)))

# ----
cordyceps = Cordyceps(HttpPort=26929, DebugLevel=0)  # -> About, Status, LastCommand

# ---- group: НЕ ИСПОЛЬЗУЕТСЯ (случайные точки, Jitter, MD Slider)
md_slider = MDSlider(
    SliderMode=0,
    slider_value=Point(0.9369441707, 0.2439919448, 0.5),
    x_domain=Domain(0, 1),
    y_domain=Domain(0, 1),
    z_domain=Domain(0, 1))
rnd = Random(Number=10)
rnd_2 = Random(Number=10)
pt_2 = ConstructPoint(XCoordinate=rnd, YCoordinate=rnd_2, ZCoordinate=0)
evalsrf = EvaluateSurface(Surface=reparameterize(reparamsrf.Reparameterized), Point=pt_2)  # -> Point, Normal, UDirection, VDirection, Frame
evalsrf_2 = EvaluateSurface(Point=md_slider)  # -> Point, Normal, UDirection, VDirection, Frame
popgeo = PopulateGeometry(Geometry=reparamsrf.Reparameterized, Count=100, Seed=1)
srf_cp = SurfaceClosestPoint(Point=popgeo, Surface=reparamsrf.Reparameterized)  # -> Point, UVPoint, Distance
jitter = Jitter(List=srf_cp.UVPoint, Jitter=1, Seed=2)  # -> Values, Indices
series = Series(Start=0, Step=5, Count=5)
item = ListItem(List=jitter.Values, Index=series, Wrap=True)
cull_i = CullIndex(List=jitter.Values, Indices=series, Wrap=True)

# ---- group: 2 · ТОЧКИ ОТВЕРСТИЙ: регулярная сетка (шаг, м) + центры пятен у кромок · Populate отключён
сетка_шаг_м = Slider(0.25, range=0.1..1)
пятна_число = Slider(6, range=1..20)
пятна_у_кромки_v = Slider(0.15, range=0..0.5)
сетка_центры_пятен = Script(S=reparamsrf.Reparameterized, step=сетка_шаг_м, n=пятна_число, dv=пятна_у_кромки_v)  # -> out, P, C; inputs S: Surface, step: Double, n: Int32, dv: Double
# ---------- сетка_центры_пятен: Python ----------
#! python 3
# Регулярная сетка точек на поверхности (шаг в метрах, ряды идут по изолиниям)
# и центры пятен перфорации: n штук вдоль длинного направления полосы,
# попеременно у двух кромок (рёбер): на доле dv и 1 - dv ширины.
import Rhino.Geometry as rg
srf = S.Faces[0].UnderlyingSurface() if isinstance(S, rg.Brep) else S
du, dvv = srf.Domain(0), srf.Domain(1)
Lu = srf.IsoCurve(0, dvv.ParameterAt(0.5)).GetLength()
Lv = srf.IsoCurve(1, du.ParameterAt(0.5)).GetLength()
nu = max(2, int(round(Lu / float(step))))
nv = max(2, int(round(Lv / float(step))))
P = [srf.PointAt(du.ParameterAt(i / float(nu)), dvv.ParameterAt(j / float(nv))) for i in range(nu + 1) for j in range(nv + 1)]
C = []
for k in range(int(n)):
    a = (k + 0.5) / int(n)
    b = float(dv) if k % 2 == 0 else 1 - float(dv)
    u, v = (a, b) if Lu >= Lv else (b, a)
    C.append(srf.PointAt(du.ParameterAt(u), dvv.ParameterAt(v)))
print('grid %d x %d = %d, Lu=%.1f Lv=%.1f' % (nu + 1, nv + 1, len(P), Lu, Lv))
# ---------- end сетка_центры_пятен ----------
отверстия_отступ_по_u = Slider(0.01, range=0..1)
отверстия_отступ_по_v = Slider(0.03, range=0..1)
subtraction = Subtraction(A=1, B=отверстия_отступ_по_u)
subtraction_2 = Subtraction(A=1, B=отверстия_отступ_по_v)
dom = ConstructDomain(DomainStart=отверстия_отступ_по_v, DomainEnd=subtraction_2)
dom_2 = ConstructDomain(DomainStart=отверстия_отступ_по_u, DomainEnd=subtraction)
planesrf = PlaneSurface(Plane=PlaneXY(0, 0, 0), XSize=dom_2, YSize=dom)
отверстия_кандидатов = Slider(257, range=0..260)
srf_cp_2 = SurfaceClosestPoint(Point=сетка_центры_пятен.P, Surface=reparamsrf.Reparameterized)  # -> Point, UVPoint, Distance
pt_3 = Point(srf_cp_2.UVPoint)
incurve = PointInCurve(Point=pt_3, Curve=planesrf)  # -> Relationship, Point
srf_cp_3 = SurfaceClosestPoint(Point=сетка_центры_пятен.P, Surface=reparamsrf.Reparameterized)  # -> Point, UVPoint, Distance
cull = CullPattern(List=srf_cp_3.UVPoint, CullPattern=incurve.Relationship)
geo_4 = Geometry(cull)

# ---- group: 1 · ЦЕНТРЫ ПЯТЕН (фонари не вырезаются: выход Geo отсоединён от вырезки)
фонари_отступ_по_u = Slider(0.01, range=0..1)
фонари_отступ_по_v_низ = Slider(0.01, range=0..1)
фонари_отступ_по_v_верх = Slider(0.01, range=0..1)
фонари_кандидатов = Slider(14, range=0..30)
popgeo_2 = PopulateGeometry(Geometry=reparamsrf.Reparameterized, Count=фонари_кандидатов, Seed=1)
cluster = Cluster_2(
    P=popgeo_2,
    A_2=фонари_отступ_по_u,
    S=reparamsrf.Reparameterized,
    B=фонари_отступ_по_u,
    A=фонари_отступ_по_v_низ,
    B_2=фонари_отступ_по_v_верх)
srf_cp_4 = SurfaceClosestPoint(Point=сетка_центры_пятен.C, Surface=reparamsrf.Reparameterized)  # -> Point, UVPoint, Distance
cull_2 = CullPattern(List=srf_cp_4.UVPoint, CullPattern=cluster)
cull_3 = CullPattern(List=сетка_центры_пятен.C, CullPattern=cluster)
cull_4 = CullPattern(List=srf_cp_4.Point, CullPattern=cluster)
фонари_радиус = Slider(0.159, range=0..1)
evalsrf_3 = EvaluateSurface(Surface=reparamsrf.Reparameterized, Point=cull_2)  # -> Point, Normal, UDirection, VDirection, Frame
circle = CircleCNR(Center=evalsrf_3.Point, Normal=evalsrf_3.Normal, Radius=фонари_радиус)
cluster_2 = Cluster(R=фонари_радиус, relay=evalsrf_3.Point, relay_2=evalsrf_3.Normal)
geo_5 = Geometry(cluster_2)

# ---- group: 3 · ДИАМЕТР = f(расстояние до центра пятна / радиус пятна) · Graph Mapper · отсев малых
пятно_радиус_м = Slider(3, range=0.3..6)
dom_пятна = ConstructDomain(DomainStart=0, DomainEnd=пятно_радиус_м)
пятно_вытянутость_вдоль_полосы = Slider(1.8, range=1..4)
evalsrf_4 = EvaluateSurface(Surface=reparameterize(reparamsrf.Reparameterized), Point=geo_4)  # -> Point, Normal, UDirection, VDirection, Frame
расстояние_до_центра_пятна_вытянутость = Script(S=reparamsrf.Reparameterized, P=evalsrf_4.Point, C=cull_3, k=пятно_вытянутость_вдоль_полосы)  # -> out, d; inputs S: Surface, P: list of Point3d, C: list of Point3d, k: Double
# ---------- расстояние_до_центра_пятна_вытянутость: Python ----------
#! python 3
# Расстояние от точки отверстия до ближайшего центра пятна, в метрах по поверхности,
# вдоль длинной стороны полосы делится на k (k > 1 — пятно вытянуто вдоль полосы/ребра).
import Rhino.Geometry as rg, math
srf = S.Faces[0].UnderlyingSurface() if isinstance(S, rg.Brep) else S
du, dv = srf.Domain(0), srf.Domain(1)
Lu = srf.IsoCurve(0, dv.ParameterAt(0.5)).GetLength()
Lv = srf.IsoCurve(1, du.ParameterAt(0.5)).GetLength()
ku, kv = (float(k), 1.0) if Lu >= Lv else (1.0, float(k))
def uv(p):
    ok, u, v = srf.ClosestPoint(p)
    return du.NormalizedParameterAt(u) * Lu, dv.NormalizedParameterAt(v) * Lv
cu = [uv(c) for c in C]
d = []
for p in P:
    a, b = uv(p)
    d.append(min(math.hypot((a - x) / ku, (b - y) / kv) for x, y in cu) if cu else 0.0)
# ---------- end расстояние_до_центра_пятна_вытянутость ----------
отверстия_макс_радиус = Slider(0.12, range=0..1)
cps = ClosestPoints(Point=evalsrf_4.Point, Cloud=cull_3, Count=1)  # -> ClosestPoint, CPIndex, Distance
ln = Line(StartPoint=flatten(evalsrf_4.Point), EndPoint=flatten(cps.ClosestPoint))
отверстия_мин_радиус_отсев = Slider(0.02, range=0..0.1)
len = Length(Curve=flatten(ln))
extremums = MinMax(Number=len)  # -> Minimum, Maximum
dom_3 = ConstructDomain(DomainStart=extremums.Minimum, DomainEnd=extremums.Maximum)
remap = RemapNumbers(Value=расстояние_до_центра_пятна_вытянутость.d, Source=dom_пятна, Target=Domain(0, 1))  # -> Mapped, Clipped
graph = GraphMapper(
    remap.Clipped,
    x0=0,
    x1=1,
    y0=0,
    y1=1,
    container_name="Bezier",
    cpx=[0, 0.4542483985, 0.7590862513, 1],
    cpy=[0, 0.7453199625, 1, 1])
subtraction_3 = Subtraction(A=1, B=graph)
multiplication = Multiplication(A=отверстия_макс_радиус, B=subtraction_3)
cluster_3 = Cluster(R=multiplication, relay=evalsrf_4.Point, relay_2=evalsrf_4.Normal)
larger = LargerThan(FirstNumber=multiplication, SecondNumber=отверстия_мин_радиус_отсев)  # -> LargerThan, OrEqualTo
cull_5 = CullPattern(List=flatten(cluster_3), CullPattern=larger.LargerThan)

# ---- group: 2 · ТОЧКИ ОТВЕРСТИЙ: регулярная сетка (шаг, м) + центры пятен у кромок · Populate отключён (continued)
popgeo_3 = PopulateGeometry(Geometry=reparamsrf.Reparameterized, Count=отверстия_кандидатов, Seed=1, Points=cull_4)

# ---- group: 4 · ВЫРЕЗКА: Brep|Brep → Surface Split → панель с отверстиями
brep = Brep(reparamsrf.Reparameterized)
bbx = BrepBrep(BrepA=brep, BrepB=flatten(cull_5))  # -> flatten(Curves), Points
srfsplit = SurfaceSplit(Surface=reparamsrf.Reparameterized, Curves=bbx.Curves)
area = Area(Geometry=srfsplit)  # -> Area, Centroid
sort = SortList(Keys=area.Area, ValuesA=srfsplit)  # -> Keys, ValuesA
item_2 = ListItem(List=sort.ValuesA, Index=-1, Wrap=True)
preview_2 = CustomPreview(
    Geometry=item_2,
    Material={diffuse=RGB(221, 160, 221), emission=RGB(66, 48, 66), shine=0.5, specular=RGB(255, 255, 255), transparency=0})

# ==== cluster Cluster
relay = ClusterInput()
relay_2 = ClusterInput()
line = LineSDL(Start=relay, Direction=relay_2, Length=1)
end = EndPoints(Curve=line)  # -> Start, End
R = ClusterInput()
circle = CircleCNR(Center=relay, Normal=relay_2, Radius=R)
vec2pt = Vector2Pt(PointA=end.Start, PointB=end.End, Unitize=False)  # -> Vector, Length
unit = UnitVector(Vector=relay_2)
geo = Geometry(graft(circle))
move = Move(Geometry=circle, Motion=vec2pt.Vector)  # -> Geometry, Transform
ins = InsertItems(List=geo, Item=graft(move.Geometry), Indices=0, Wrap=True)
boundary = BoundarySurfaces(Edges=ins)
amp = Amplitude(Vector=vec2pt.Vector, Amplitude=-0.5)
loft = Loft(Curves=boundary, Options={Adjust=False, Closed=False, LoftEnds=0, LoftSimp=0, LoftType=0, Rebuild=10, Refit=0.01})
move_2 = Move(Geometry=loft, Motion=graft(amp))  # -> Geometry, Transform
G = ClusterOutput(move_2.Geometry)

# ==== cluster Cluster_2
B = ClusterInput()
B_2 = ClusterInput()
A = ClusterInput()
subtraction = Subtraction(A=1, B=B)
subtraction_2 = Subtraction(A=1, B=B_2)
A_2 = ClusterInput()
dom = ConstructDomain(DomainStart=A, DomainEnd=subtraction_2)
dom_2 = ConstructDomain(DomainStart=A_2, DomainEnd=subtraction)
planesrf = PlaneSurface(Plane=PlaneXY(0, 0, 0), XSize=dom_2, YSize=dom)
P = ClusterInput()
S = ClusterInput()
srf_cp = SurfaceClosestPoint(Point=P, Surface=S)  # -> Point, UVPoint, Distance
pt = Point(srf_cp.UVPoint)
incurve = PointInCurve(Point=pt, Curve=planesrf)  # -> Relationship, Point
R = ClusterOutput(incurve.Relationship)
